# Grasshopper definition M01_Millipede graphics generator.gh (Grasshopper 1.0.7)

# generated diagrams: . load and support conditions with base mesh
# 
# . colored mesh with principal stress direction
# 
# . spheres of stress value on wireframe mesh
# Activate component, then right click on the icon, "Source", and locate the .ghdata file saved from M00_Millipede FEM field.gh
# 
# If necessary, plug the outputs to the corresponding components
input = DataInput(
    Destination="F:\Users\alessio\Documents\Co-de-iT\Design By Data Master Paris\2019\workshop\@ utilities\Millipede_data.ghdata",
    RelativePath="F:\Users\alessio\Documents\Co-de-iT\Design By Data Master Paris\2019\workshop\@ utilities\Millipede_data.ghdata|Millipede_data.ghdata",
    UpdateDelay=5)  # -> Initial_Mesh, Load_BReps, Support_Breps, B_W_Mesh, Vector_Field, Scalar_Field

# ----
# if necessary, adjust scale factor to compensate for small or large geometries from Millipede
load_vectors_length = Slider(2, range=0..2)
vector_field_length = Slider(2, range=0..2)
scalar_min_size = Slider(0.2, range=0..1)
scalar_max_size = Slider(2, range=0..2)
diagrams_spacing = Slider(2, range=1..2)
scale_factor = Panel("1")

# ---- group: supports
brep = Brep(input.Support_Breps)

# ---- group: vector field
vec = Vector(input.Vector_Field)

# ---- group: scalar field
num = Number(input.Scalar_Field)

# ---- group: initial mesh
mesh = Mesh(input.Initial_Mesh)

# ---- group: loads
brep_2 = Brep(input.Load_BReps)

# ---- group: b/w mesh
mesh_2 = Mesh(input.B_W_Mesh)

# ----
# Millipede graph generator
# 
# generate Millipede diagrams
# 
# code by Alessio Erioli
# 
# v 0.1
scale = Scale(Geometry=mesh, Center=Point(0, 0, 0), Factor=scale_factor)  # -> Geometry, Transform
scale_2 = Scale(Geometry=brep_2, Center=Point(0, 0, 0), Factor=scale_factor)  # -> Geometry, Transform
scale_3 = Scale(Geometry=brep, Center=Point(0, 0, 0), Factor=scale_factor)  # -> Geometry, Transform
scale_4 = Scale(Geometry=mesh_2, Center=Point(0, 0, 0), Factor=scale_factor)  # -> Geometry, Transform
demesh = DeconstructMesh(Mesh=scale_4.Geometry)  # -> Vertices, Faces, Colours, Normals
facen = FaceNormals(Mesh=scale_4.Geometry)  # -> Centers, Normals
mesh_3 = Mesh(scale_3.Geometry)
mesh_4 = Mesh(scale_2.Geometry)

# ---- group: bounding box for diagram spacing
bbox = BoundingBox(Content=[scale.Geometry, mesh_4, mesh_3], Plane=PlaneXY(0, 0, 0), UnionBox=True)  # -> Box, Box_2
boxprop = BoxProperties(Box=bbox.Box)  # -> Center, Diagonal, Area, Volume, Degeneracy
devec = DeconstructVector(Vector=boxprop.Diagonal)  # -> XComponent, YComponent, ZComponent
multiplication = Multiplication(A=devec.XComponent, B=diagrams_spacing)
X = UnitX(Factor=multiplication)

# ---- group: re-colored mesh
argb = SplitARGB(Colour=demesh.Colours)  # -> Alpha, Red, Green, Blue
merge = Merge(Data1=ColourSwatch(SwatchColor=RGB(255, 255, 255)), Data2=ColourSwatch(SwatchColor=RGB(255, 0, 0)))
interp = InterpolateData(Data=merge, Parameter=argb.Red, Interpolation=2)
# diagram 2
conmesh = ConstructMesh(Vertices=demesh.Vertices, Faces=demesh.Faces, Colours=interp)

# ---- group: stress scalar field
num_2 = Number(num)
bnd = Bounds(Numbers=flatten(num_2))
dom = ConstructDomain(DomainStart=scalar_min_size, DomainEnd=scalar_max_size)
remap = RemapNumbers(Value=num_2, Source=bnd, Target=dom)  # -> Mapped, Clipped
msphere = MeshSphere(Base=facen.Centers, Radius=remap.Mapped, UCount="10", VCount="10")

# ----
multiplication_2 = Multiplication(A=X, B="2")
move = Move(Geometry=scale.Geometry, Motion=multiplication_2)  # -> Geometry, Transform
medges = MeshEdges(Mesh=move.Geometry)  # -> NakedEdges, InteriorEdges, NonManifoldEdges
# diagram 3
crv = Curve([medges.NakedEdges, medges.InteriorEdges])
move_2 = Move(Geometry=msphere, Motion=multiplication_2)  # -> Geometry, Transform

# ---- group: supports
minc = MeshInclusion(Mesh=mesh_3, Point=graft(demesh.Vertices), Strict=False)
edges = BrepEdges(Brep=scale_3.Geometry)  # -> Naked, Interior, NonManifold
mmx = MeshMesh(MeshA=scale_4.Geometry, MeshB=mesh_3, UseMeshMeshFast=True)
f_massbool = MassBoolean(V=minc, type=1)  # -> flatten(B); inputs V: list of Boolean, type: Int32
# ---------- f_massbool: C# ----------
  /*
    froGH - a sparse collection of (in)utilities for Grasshopper

    mass boolean
    code by Alessio Erioli

    froGH by Co-de-iT is licensed under a Creative Commons Attribution 4.0 International License.
    http://creativecommons.org/licenses/by/4.0/

    */
    initComp();

    bool r;
    if (type == 0) {
      Component.Message = "AND";
      r = true;
    }else{
      Component.Message = "OR";
      r = false;
    }


    for (int i = 0; i < V.Count; i++){
      if (type == 0) {
        r = r && V[i];
      }
      else{
        r = r || V[i];
      }
    }
    B = r;
# ---------- f_massbool: C# additional code ----------
  void initComp(){
    Component.Name = "Mass Boolean";
    Component.NickName = "f_MassBool";
    Component.Description = "Mass boolean operator on a list of values";
    Component.Params.Input[0].Name = "Values";
    Component.Params.Input[0].Description = "boolean values as list";
    Component.Params.Input[1].Name = "Boolean operator";
    Component.Params.Input[1].Description = "type of operator: 0 AND, 1 OR";
    Component.Params.Output[0].Name = "Boolean result";
    Component.Params.Output[0].Description = "the result";

  }
# ---------- end f_massbool ----------
cull = CullPattern(List=demesh.Vertices, CullPattern=f_massbool)

# ----
medges_2 = MeshEdges(Mesh=scale.Geometry)  # -> NakedEdges, InteriorEdges, NonManifoldEdges
# diagram 1
crv_2 = Curve([medges_2.NakedEdges, medges_2.InteriorEdges])

# ---- group: loads
edges_2 = BrepEdges(Brep=scale_2.Geometry)  # -> Naked, Interior, NonManifold
mmx_2 = MeshMesh(MeshA=scale_4.Geometry, MeshB=mesh_4, UseMeshMeshFast=True)
minc_2 = MeshInclusion(Mesh=mesh_4, Point=demesh.Vertices, Strict=False)
cull_2 = CullPattern(List=demesh.Vertices, CullPattern=minc_2)
line = LineSDL(Start=cull_2, Direction=Vector(0, 0, 1), Length=load_vectors_length)

# ---- group: vector field directions
line_2 = LineSDL(Start=demesh.Vertices, Direction=vec, Length=vector_field_length)

# ----
move_3 = Move(Geometry=line_2, Motion=X)  # -> Geometry, Transform
move_4 = Move(Geometry=conmesh, Motion=X)  # -> Geometry, Transform

panel = Panel("""base mesh
base wires
loads
supports
col mesh
vector field lines
wire mesh
scalar field spheres""")
spheres_material = ColourSwatch(SwatchColor=RGB(0, 0, 0))
ghost_wires = ColourSwatch(SwatchColor=RGB(140, 140, 140))
unmod_wires = ColourSwatch(SwatchColor=RGB(105, 105, 105))
material = CreateMaterial(Diffuse=spheres_material, Specular=RGB(255, 255, 255), Emission=RGB(0, 0, 0), Transparency=0, Shine=0)
concat = Concatenate(FragmentA="MP_Graph", FragmentB=panel)  # -> graft(Result)
entwine = Entwine(
    Branch00=scale.Geometry,
    Branch01=crv_2,
    Branch02=[line, edges_2.Interior, mmx_2],
    Branch03=[edges.Interior, cull, mmx],
    Branch04=move_4.Geometry,
    Branch05=move_3.Geometry,
    Branch06=crv,
    Branch07=move_2.Geometry,
    FlattenInputs=True)
entwine_2 = Entwine(
    Branch01=unmod_wires,
    Branch02=ColourSwatch(SwatchColor=RGB(200, 0, 0)),
    Branch03=ColourSwatch(SwatchColor=RGB(0, 0, 255)),
    Branch05=ColourSwatch(SwatchColor=RGB(0, 0, 0)),
    Branch06=ghost_wires,
    FlattenInputs=True)
entwine_3 = Entwine(Branch07=material, FlattenInputs=True)

# ---- group: enable for spheres preview
preview = CustomPreview(Geometry=move_2.Geometry, Material=material)  # disabled

# ----
group = BooleanToggle(False)
bake = Button()
# bake diagram geometries to Rhino
# Diagrams are best experienced in Rendered Display Mode
f_bakeatt = BakeAttributesEnhanced(obj=entwine, layer=concat, color=entwine_2, material=entwine_3, group=group, bake_iT=bake)  # -> info; inputs obj: GeometryBase, name: String, layer: String, color: Color, pWidth: Double, wires: Int32, group_n: Int32, group: Boolean, bake_iT: Boolean
#   port layer: Layer name for the object if the layer doesn't exist, it will be created
#   port bake_iT: Performs bake operation attach a button here and click to bake
# ---------- f_bakeatt: C# usings ----------
using System.IO;
using System.Linq;
using System.Data;
using System.Drawing;
using System.Reflection;
using System.Windows.Forms;
using System.Xml;
using System.Xml.Linq;
using System.Runtime.InteropServices;

using Rhino.DocObjects;
using Rhino.Collections;
using GH_IO;
using GH_IO.Serialization;
# ---------- f_bakeatt: C# ----------
                                                                    /*
    froGH - a sparse collection of (in)utilities for Grasshopper

    Bake Attributes ++
    Original Version Written by Giulio Piacentino - 2010 11 21 - for Grasshopper 0.8.002
    Enhanced by Co-de-iT (Alessio) - now bakes on chosen layer(s) and in groups

    froGH by Co-de-iT is licensed under a Creative Commons Attribution 4.0 International License.
    http://creativecommons.org/licenses/by/4.0/

    */

    initComp();

    if (bake_iT)
    {
      if(obj == null)
      {
        Print("No object to bake");
        return;
      }

      //Make new attribute to set name
      Rhino.DocObjects.ObjectAttributes att = new Rhino.DocObjects.ObjectAttributes();

      //Set object name
      if(!string.IsNullOrEmpty(name))
      {
        att.Name = name;
      }

      //Set color
      if(!color.IsEmpty)
      {
        att.ColorSource = Rhino.DocObjects.ObjectColorSource.ColorFromObject; //Make the color type "by object"
        att.ObjectColor = color;

        att.PlotColorSource = Rhino.DocObjects.ObjectPlotColorSource.PlotColorFromObject; //Make the plot color type "by object"
        att.PlotColor = color;
      }

      // Set group

      if(group)
      {
        doc.Groups.Add(Convert.ToString(group_n));
        att.AddToGroup(group_n);

      }

      //Set layer
      if(!string.IsNullOrEmpty(layer) && Rhino.DocObjects.Layer.IsValidName(layer))
      {
        //Get the current layer index
        Rhino.DocObjects.Tables.LayerTable layerTable = doc.Layers;
        int layerIndex = layerTable.FindByFullPath(layer, -1);
        //        int layerIndex = layerTable.Find(layer, true); // deprecated function

        if(layerIndex < 0) //This layer does not exist, we add it
        {
          Rhino.DocObjects.Layer onlayer = new Rhino.DocObjects.Layer(); //Make a new layer
          onlayer.Name = layer;

          layerIndex = layerTable.Add(onlayer); //Add the layer to the layer table
          if (layerIndex > -1) //We manged to add layer!
          {
            att.LayerIndex = layerIndex;
            Print("Added new layer to the document at position " + layerIndex + " named " + layer + ". ");
          } else
            Print("Layer did not add. Try cleaning up your layers."); //This never happened to me.
        }
        else
          att.LayerIndex = layerIndex; //We simply add to the existing layer
      }


      //Set plotweight
      if(pWidth > 0)
      {
        att.PlotWeightSource = Rhino.DocObjects.ObjectPlotWeightSource.PlotWeightFromObject;
        att.PlotWeight = pWidth;
      }


      //Set material
      bool materialByName = !string.IsNullOrEmpty(material as string);
      Rhino.Display.DisplayMaterial inMaterial = material as Rhino.Display.DisplayMaterial;
      if(material is Color)
      {
        inMaterial = new Rhino.Display.DisplayMaterial((Color) material);
      }
      if(material != null && inMaterial == null && !materialByName)
      {
        if(!(material is string))
        {
          try //We also resort to try with IConvertible
          {
            inMaterial = (Rhino.Display.DisplayMaterial) Convert.ChangeType(material, typeof(Rhino.Display.DisplayMaterial));
          }
          catch(InvalidCastException)
          {
          }
        }
      }
      if(inMaterial != null || materialByName)
      {
        string matName;

        if(!materialByName)
        {
          matName = string.Format("D:{0}-E:{1}-S:{2},{3}-T:{4}",
            //            Format(inMaterial.Ambient),
            Format(inMaterial.Diffuse),
            Format(inMaterial.Emission),
            Format(inMaterial.Specular),
            inMaterial.Shine.ToString(),
            inMaterial.Transparency.ToString()
            );
        }
        else
        {
          matName = (string) material;
        }

        int materialIndex = doc.Materials.Find(matName, true);
        if(materialIndex < 0 && !materialByName) //Material does not exist and we have its specs
        {
          materialIndex = doc.Materials.Add(); //Let's add it
          if(materialIndex > -1)
          {
            Print("Added new material at position " + materialIndex + " named \"" + matName + "\". ");
            Rhino.DocObjects.Material m = doc.Materials[materialIndex];
            m.Name = matName;
            //            m.AmbientColor = inMaterial.Ambient;
            m.DiffuseColor = inMaterial.Diffuse;
            m.EmissionColor = inMaterial.Emission;
            //m.ReflectionColor = no equivalent
            m.SpecularColor = inMaterial.Specular;
            m.Shine = inMaterial.Shine;
            m.Transparency = inMaterial.Transparency;
            //m.TransparentColor = no equivalent
            m.CommitChanges();

            att.MaterialSource = Rhino.DocObjects.ObjectMaterialSource.MaterialFromObject;
            att.MaterialIndex = materialIndex;
          }
          else
            Print("Material did not add. Try cleaning up your materials."); //This never happened to me.
        }
        else if(materialIndex < 0 && materialByName) //Material does not exist and we do not have its specs. We do nothing
        {
          Print("Warning: material name not found. I cannot set the source to this material name. Add a material with name: " + matName);
        }
        else
        {
          //If this material exists, we do not replace it!
          att.MaterialSource = Rhino.DocObjects.ObjectMaterialSource.MaterialFromObject;
          att.MaterialIndex = materialIndex;
        }
      }


      //Set wire density
      if(wires == -1 || wires > 0)
      {
        att.WireDensity = wires;
      }


      //Bake to the right type of object
      switch(obj.ObjectType)
      {
        case Rhino.DocObjects.ObjectType.Brep:
          doc.Objects.AddBrep(obj as Brep, att);
          break;
        case Rhino.DocObjects.ObjectType.Curve:
          doc.Objects.AddCurve(obj as Curve, att);
          break;
        case Rhino.DocObjects.ObjectType.Point:
          doc.Objects.AddPoint((obj as Rhino.Geometry.Point).Location, att);
          break;
        case Rhino.DocObjects.ObjectType.Surface:
          doc.Objects.AddSurface(obj as Surface, att);
          break;
        case Rhino.DocObjects.ObjectType.Mesh:
          doc.Objects.AddMesh(obj as Mesh, att);
          break;
        case Rhino.DocObjects.ObjectType.Extrusion:
          typeof(Rhino.DocObjects.Tables.ObjectTable).InvokeMember("AddExtrusion", BindingFlags.Instance | BindingFlags.InvokeMethod, null, doc.Objects, new object[]{obj, att});
          break;
        case Rhino.DocObjects.ObjectType.PointSet:
          doc.Objects.AddPointCloud(obj as Rhino.Geometry.PointCloud, att); //This is a speculative entry
          break;
        default:
          Print("The script does not know how to handle this type of geometry: " + obj.GetType().FullName);
          break;
      }
      Print("Added " + obj.GetType().Name);

    }
    else
    {
      Print("Inactive");
    }
    //obj_out = obj;
# ---------- f_bakeatt: C# additional code ----------
  void initComp(){

    Component.Name = "Bake Attributes Enhanced";
    Component.NickName = "f_BakeAtt++";
    Component.Description = "Bakes objects with attributes such as color, material, layer, object name, wire density. Option to bake in groups";
    Component.Params.Input[0].Name = "Object";
    Component.Params.Input[0].Description = "Object to bake";
    Component.Params.Input[1].Name = "Object name";
    Component.Params.Input[1].Description = "A custom name for the object";
    Component.Params.Input[2].Name = "Object Layer";
    Component.Params.Input[2].Description = "Layer name for the object\nif the layer doesn't exist, it will be created";
    Component.Params.Input[3].Name = "Object Color";
    Component.Params.Input[3].Description = "Color of baked object";
    Component.Params.Input[4].Name = "Print Width";
    Component.Params.Input[4].Description = "Print width";
    Component.Params.Input[5].Name = "Wire density";
    Component.Params.Input[5].Description = "Density of wires for display";
    Component.Params.Input[6].Name = "Material";
    Component.Params.Input[6].Description = "Object custom material";
    Component.Params.Input[7].Name = "Group Number";
    Component.Params.Input[7].Description = "Number of the group for the object\n(in case group option is active)";
    Component.Params.Input[8].Name = "Group Objects";
    Component.Params.Input[8].Description = "Bake objects in groups according to the group number for each object";
    Component.Params.Input[9].Name = "Bake it!";
    Component.Params.Input[9].Description = "Performs bake operation\nattach a button here and click to bake";
    Component.Params.Output[0].Name = "Info";
    Component.Params.Output[0].Description = "Info on the bake process/result";

  }

  static string Format(Color c)
  {
    return (new System.Text.StringBuilder("A")).Append(c.A.ToString()).Append("R").Append(c.R.ToString()).Append("G")
      .Append(c.G.ToString()).Append("B").Append(c.B.ToString()).ToString();
  }
# ---------- end f_bakeatt ----------
