# Grasshopper definition interpolate mesh data.gh (Grasshopper 1.0.7)
# Copyright: Co-de-iT
# plug-ins: Weaverbird

# ---- group: scalar field (by face)
num = Number([-3509756.066, -4332037.332, -4808793.655, -4516277.866, -530423.5044, -3016545.127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])

# ---- group: vector field (by face)
vec = Vector([Vector(0.2679376117, -0.5101089539, -0.8173116244), Vector(0.1332489635, -0.5414592644, -0.8301003426), Vector(0.1568592832, -0.5640606489, -0.8106976931), Vector(0.1402390488, -0.5086190709, -0.8494937609), Vector(-0.2392581309, -0.4419918577, -0.8645222638), Vector(-0.2849885379, -0.4486907677, -0.8470290008)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])

# ---- group: original mesh
mesh = Mesh(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)

# ---- group: display original vectors
facen = FaceNormals(Mesh=mesh)  # -> Centers, Normals
amp = Amplitude(Vector=vec, Amplitude=Slider(0.084, range=0..1))
vdisex = VectorDisplayEx(Point=facen.Centers, Vector=amp, Colour=RGB(0, 0, 0), Width=2)

# ----
devec = DeconstructVector(Vector=vec)  # -> XComponent, YComponent, ZComponent

# ----
# you can skip this step if your values are already per vertex
f_mf2vval = MeshFacesToVerticesValues(M=mesh, Vf=num)  # -> Vv; inputs M: Mesh, Vf: list of Double, m: Boolean
#   port m: calculation method: simple or weighted average
# ---------- f_mf2vval: C# ----------
                                                                                                                                                                                                                                                                /*
    froGH - a sparse collection of (in)utilities for Grasshopper

    Convert per-Face values into per-Vertex values

    parallelization occurs after 1000 elements

    code by Alessio Erioli

    froGH by Co-de-iT is licensed under a Creative Commons Attribution 4.0 International License.
    http://creativecommons.org/licenses/by/4.0/

    */
    initComp(m);

    int pThres = 1000; // parallelization threshold

    if (M != null && Vf.Count > 0){

      if (Vf.Count == M.Faces.Count){

        List <double> vVerts = new List<double>(); // per-Vertices values

        if (Vf.Count < pThres){

          int[] vFaces;
          double vVal, vD, dists;
          Point3d v;

          for (int i = 0; i < M.Vertices.Count; i++){

            vVal = 0;
            vD = 0;
            dists = 0;

            // get faces shared by vertex
            vFaces = M.Vertices.GetVertexFaces(i);

            // get the values

            if (m){

              // get vertex
              v = (Point3d) M.Vertices[i];

              // _____________________  weighted average method

              for (int j = 0; j < vFaces.Length; j++){

                // get distances from face center
                vD = v.DistanceTo(getFaceCenter(M, j));

                // add weighted value
                vVal += Vf[vFaces[j]] * vD;
                // update sum of distances
                dists += vD;
              }

              // weight average
              vVal /= dists;

              vVerts.Add(vVal);

            }else{

              // _____________________  standard average method

              for (int j = 0; j < vFaces.Length; j++){
                vVal += Vf[vFaces[j]];
              }
              // average
              vVal /= vFaces.Length;

              vVerts.Add(vVal);

            }
          }

          Vv = vVerts;

        }else{

          var mFv = new System.Collections.Concurrent.ConcurrentDictionary<int, double>(Environment.ProcessorCount, Vf.Count);
          List<int> vInd = new List<int>();

          for(int i = 0; i < M.Vertices.Count; i++){
            vInd.Add(i);
          }

          foreach(int i in vInd) mFv[i] = 0; // initialise dictionary

          if(m){

            System.Threading.Tasks.Parallel.ForEach(vInd, i =>
              {
              // weighted average calculation

              Point3d v = (Point3d) M.Vertices[i];
              int[] vFaces = M.Vertices.GetVertexFaces(i);
              double vVal = 0, dists = 0, vD = 0;

              for (int j = 0; j < vFaces.Length; j++){
                // get distances from face center
                vD = v.DistanceTo(getFaceCenter(M, j));

                // add weighted value
                vVal += Vf[vFaces[j]] * vD;
                // update sum of distances
                dists += vD;
              }
              // average
              vVal /= dists;
              mFv[i] = vVal;
              }
              );

            Vv = mFv.Values;

          }else{

            System.Threading.Tasks.Parallel.ForEach(vInd, i =>
              {
              // standard average calculation
              int[] vFaces = M.Vertices.GetVertexFaces(i);
              double vVal = 0;
              for (int j = 0; j < vFaces.Length; j++){
                vVal += Vf[vFaces[j]];
              }
              // average
              vVal /= vFaces.Length;
              mFv[i] = vVal;
              }
              );

            Vv = mFv.Values;
          }
        }
      }
    }
# ---------- f_mf2vval: C# additional code ----------
  void initComp(bool m){
    Component.Name = "Mesh Faces to Vertices values";
    Component.NickName = "f_MF2VVal";
    Component.Description = "Converts per-face into per-vertex values";
    Component.Message = m ? "weighted" : "simple";
    Component.Params.Input[0].Name = "Mesh";
    Component.Params.Input[0].Description = "Input Mesh";
    Component.Params.Input[1].Name = "Values per faces";
    Component.Params.Input[1].Description = "List of values (one for each face)";
    Component.Params.Input[2].Name = "Method";
    Component.Params.Input[2].Description = "calculation method:\nsimple or weighted average";
    Component.Params.Output[0].Name = "Values per vertices";
    Component.Params.Output[0].Description = "Values distributed per vertices";
  }


  public Point3d getFaceCenter(Mesh M, int fInd){
    MeshFace f = M.Faces[fInd];
    Point3d c = new Point3d();
    if (f.IsValid(M.Vertices.Count)){
      c = Point3d.Add(c, (Point3d) M.Vertices[f.A]);
      c = Point3d.Add(c, (Point3d) M.Vertices[f.B]);
      c = Point3d.Add(c, (Point3d) M.Vertices[f.C]);
      if (f.IsQuad){
        c = Point3d.Add(c, (Point3d) M.Vertices[f.D]);
      }
    }
    c /= f.IsQuad ? 4 : 3;
    return c;
  }
# ---------- end f_mf2vval ----------
f_mf2vval_2 = MeshFacesToVerticesValues(M=mesh, Vf=devec.XComponent)  # -> Vv; inputs M: Mesh, Vf: list of Double, m: Boolean; same code as f_mf2vval
f_mf2vval_3 = MeshFacesToVerticesValues(M=mesh, Vf=devec.YComponent)  # -> Vv; inputs M: Mesh, Vf: list of Double, m: Boolean; same code as f_mf2vval
f_mf2vval_4 = MeshFacesToVerticesValues(M=mesh, Vf=devec.ZComponent)  # -> Vv; inputs M: Mesh, Vf: list of Double, m: Boolean; same code as f_mf2vval

num_2 = Number(f_mf2vval)
num_3 = Number(f_mf2vval_2)
num_4 = Number(f_mf2vval_3)
num_5 = Number(f_mf2vval_4)
bnd = Bounds(Numbers=flatten(num_2))
bnd_2 = Bounds(Numbers=flatten(num_4))
bnd_3 = Bounds(Numbers=flatten(num_3))
bnd_4 = Bounds(Numbers=flatten(num_5))
remap = RemapNumbers(Value=num_2, Source=bnd, Target=Domain(0, 1))  # -> Mapped, Clipped
remap_2 = RemapNumbers(Value=num_3, Source=bnd_3, Target=Domain(0, 1))  # -> Mapped, Clipped
remap_3 = RemapNumbers(Value=num_4, Source=bnd_2, Target=Domain(0, 1))  # -> Mapped, Clipped
remap_4 = RemapNumbers(Value=num_5, Source=bnd_4, Target=Domain(0, 1))  # -> Mapped, Clipped
# Interpolate mesh data
# 
# interpolate mesh data after Catmull-Clark subdivision
# 
# code by Alessio Erioli
# 
# v 0.1
demesh = DeconstructMesh(Mesh=mesh)  # -> Vertices, Faces, Colours, Normals
frgb = ColourRGBF(Alpha=remap.Mapped, Red=remap_2.Mapped, Green=remap_3.Mapped, Blue=remap_4.Mapped)
conmesh = ConstructMesh(Vertices=demesh.Vertices, Faces=demesh.Faces, Colours=frgb)
wbcatmullclark = WeaverbirdsCatmullClarkSubdivision(MeshCurves=conmesh, Level="1", SmoothNakedEdges=1)
demesh_2 = DeconstructMesh(Mesh=wbcatmullclark)  # -> Vertices, Faces, Colours, Normals
argb = SplitARGB(Colour=demesh_2.Colours)  # -> Alpha, Red, Green, Blue
conmesh_2 = ConstructMesh(Vertices=demesh_2.Vertices, Faces=demesh_2.Faces)
remap_5 = RemapNumbers(Value=argb.Alpha, Source=Domain(0, 1), Target=bnd)  # -> Mapped, Clipped
remap_6 = RemapNumbers(Value=argb.Blue, Source=Domain(0, 1), Target=bnd_4)  # -> Mapped, Clipped
remap_7 = RemapNumbers(Value=argb.Red, Source=Domain(0, 1), Target=bnd_3)  # -> Mapped, Clipped
remap_8 = RemapNumbers(Value=argb.Green, Source=Domain(0, 1), Target=bnd_2)  # -> Mapped, Clipped
vec_2 = VectorXYZ(XComponent=remap_7.Mapped, YComponent=remap_8.Mapped, ZComponent=remap_6.Mapped)  # -> Vector, Length

# ---- group: display interpolated vectors
amp_2 = Amplitude(Vector=vec_2.Vector, Amplitude=Slider(0.084, range=0..1))
vdisex_2 = VectorDisplayEx(Point=demesh_2.Vertices, Vector=amp_2, Colour=RGB(0, 0, 0), Width=2)

# ---- group: interpolated mesh
mesh_2 = Mesh(conmesh_2)

# ---- group: interpolated scalar field
num_6 = Number(remap_5.Mapped)

# ---- group: interpolated vector field
vec_3 = Vector(vec_2.Vector)
