# Grasshopper definition XX_iterative_Laplacian Smoothing Polyline.gh (Grasshopper 1.0.7)
# plug-ins: Anemone

start = Button()
crv = Curve(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)
factor = Slider(0.082, range=0..1)
cycles = Slider(4, range=1..10)
loop_start = LoopStart(Repeat=Slider(50, range=0..200), Trigger=start, Data=crv)  # -> port, Counter, Data
panel = Panel(loop_start.Counter)
c_script = CSharpScript(pl=loop_start.Data, factor=factor, cycles=cycles)  # -> out, A; inputs pl: Polyline, factor: Double, cycles: Int32
# ---------- c_script: C# ----------
    // Laplacian smooth on a polyline
    // original code by Giulio Piacentino
    // updates & editing by Alessio Erioli © Co-de-iT 2019
    //
    
    if (pl == null) return;  //if pl is null return

    List<Point3d> pts = new List<Point3d>(pl); // get the polyline vertices

    if (pl.IsClosed) pts.RemoveAt(pts.Count - 1); // remove last point if polyline is closed

    int pC = pts.Count;

    if (pC > 0)
    {

      double oneLessFactor = 1 - factor;
      List<Point3d> newPts = pts;

      if (pl.IsClosed) // closed polyline - cycles through all points
      {
        while (cycles-- > 0)            // decreases at each cycle
        {
          newPts = new List<Point3d>(); // newPts becomes a new list


          for (int i = 0; i < pC; i++)
          {
            Point3d pt = pts[i];

            Point3d newPt = (pts[(i + pC - 1) % pC] + pts[(i + 1) % pC]) * 0.5;
            newPt = newPt * factor + pt * oneLessFactor;
            newPts.Add(newPt);
          }

          pts = newPts;                 // exchange pts with newPts
        }
        newPts.Add(newPts[0]);
      }
        
      else // open polyline, extremities are fixed
        
      {
        int lastPtIndex = pts.Count - 1;

        while (cycles-- > 0)            // decreases at each cycle
        {
          newPts = new List<Point3d>(); // newPts becomes a new list

          for (int i = 0; i < pC; i++)
          {
            Point3d pt = pts[i];
            if (i == 0 || i == lastPtIndex)
            {
              newPts.Add(pt);
              continue;
            }

            Point3d newPt = (pts[i - 1] + pts[i + 1]) * 0.5;
            newPt = newPt * factor + pt * oneLessFactor;
            newPts.Add(newPt);
          }

          pts = newPts;                 // exchange pts with newPts
        }
      }


      A = new Polyline(newPts);
    }
# ---------- end c_script ----------
pt = Point([Point(-10.3917713, -11.23987661, 0), Point(-23.81430102, -12.02743073, 0), Point(-17.03670365, -21.65023412, 0), Point(-13.24599673, -28.90522197, 0), Point(-18.02255717, -29.47583627, 0), Point(-21.44113398, -30.65696497, 0)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])
factor_2 = Slider(0.082, range=0..1)
cycles_2 = Slider(10, range=1..10)
loop_end = LoopEnd(port=loop_start.port, Exit=False, Data=c_script.A, TimeOutVal=0, pausedState=False, state="Constant & Record")  # -> flatten(Data)
pline = PolyLine(Vertices=pt, Closed=Toggle(True))
lng = ListLength(List=loop_end)
# XX_Iterative Laplacian Smoothing
# 
# Laplacian smoothing on a polyline and an iterative application
# 
# code by Alessio Erioli
# 
# v 0.1
# Laplacian smoothing on polylines
# Iterative smoothing - 2.5 D
c_script_2 = CSharpScript(pl=pline, factor=factor_2, cycles=cycles_2)  # -> out, A; inputs pl: Polyline, factor: Double, cycles: Int32; same code as c_script
range = Range(Domain=Domain(0, 1), Steps=expr("x-1", lng))
graph = GraphMapper(
    range,
    x0=0,
    x1=1,
    y0=0,
    y1=1,
    container_name="Bezier",
    cpx=[0, 0.144964695, 0.2287327796, 1],
    cpy=[0, 0.3804343343, 0.6212675571, 1])
multiplication = Multiplication(A=Slider(50.63, range=0..100), B=graph)
Z = UnitZ(Factor=multiplication)  # -> reverse(UnitVector)
move = Move(Geometry=loop_end, Motion=Z)  # -> Geometry, Transform
f_pmloft = PolylineMeshLoft(P=move.Geometry)  # -> M; inputs P: list of Polyline, C: Boolean
# ---------- f_pmloft: C# usings ----------
using System.IO;
using System.Linq;
using System.Data;
using System.Drawing;
using System.Reflection;
using System.Windows.Forms;
using System.Xml;
using System.Xml.Linq;
using System.Runtime.InteropServices;

using Rhino.DocObjects;
using Rhino.Collections;
using GH_IO;
using GH_IO.Serialization;
# ---------- f_pmloft: C# ----------
                           /*
    froGH - a sparse collection of (in)utilities for Grasshopper

    Mesh loft from Polylines with same number of points

    code by Alessio Erioli

    froGH by Co-de-iT is licensed under a Creative Commons Attribution 4.0 International License.
    http://creativecommons.org/licenses/by/4.0/

    */

    initComp();

    if (C && !P[0].IsClosed){
      if (P.Count > 2){
        Mesh m1, m0 = new Mesh();
        int pCount,vCount;
        Point3d[] pts0, pts1;
        pCount = P.Count;
        for (int i = 0; i < P.Count; i++){
          pts0 = P[i % pCount].ToArray();
          pts1 = P[(i + 1) % pCount].ToArray();
          vCount = pts0.Length - 1;
          for (int j = 0; j < vCount; j++){
            m1 = new Mesh();
            m1.Vertices.Add(pts0[j]);
            m1.Vertices.Add(pts0[j + 1]);
            m1.Vertices.Add(pts1[j + 1]);
            m1.Vertices.Add(pts1[j]);
            m1.Faces.AddFace(0, 1, 2, 3);
            m0.Append(m1);
          }
        }
        m0.Weld(Math.PI * 0.5);
        m0.Normals.ComputeNormals();
        M = m0;

      }else{
        Print("you need at least 3 polylines");
        M = null;
      }

    }else{
      if (P.Count > 1){
        Mesh m1, m0 = new Mesh();
        int vCount;
        Point3d[] pts0, pts1;
        for (int i = 0; i < P.Count - 1; i++){
          pts0 = P[i].ToArray();
          pts1 = P[i + 1].ToArray();
          vCount = pts0.Length - 1;
          for (int j = 0; j < vCount; j++){
            m1 = new Mesh();
            m1.Vertices.Add(pts0[j]);
            m1.Vertices.Add(pts0[j + 1]);
            m1.Vertices.Add(pts1[j + 1]);
            m1.Vertices.Add(pts1[j]);
            m1.Faces.AddFace(0, 1, 2, 3);
            m0.Append(m1);
          }
        }
        m0.Weld(Math.PI * 0.5);
        m0.Normals.ComputeNormals();
        M = m0;
      }else{
        Print("you need at least 2 polylines");
        M = null;
      }
    }
    //M = p1.ToArray(); // get points of polyline
# ---------- f_pmloft: C# additional code ----------
  void initComp(){
    Component.Name = "Polyline Mesh Loft";
    Component.NickName = "f_PMLoft";
    Component.Description = "Lofts  polylines with the same number of vertices into a mesh";
    Component.Params.Input[0].Name = "Polylines";
    Component.Params.Input[0].Description = "Lists of polylines to interpolate as mesh loft";
    Component.Params.Input[1].Name = "Closed";
    Component.Params.Input[1].Description = "True for closed loft, False for open loft";
    Component.Params.Output[0].Name = "Mesh";
    Component.Params.Output[0].Description = "Mesh Loft";
  }
# ---------- end f_pmloft ----------
preview = CustomPreview(
    Geometry=f_pmloft,
    Material={diffuse=RGB(221, 160, 221), emission=RGB(66, 48, 66), shine=0.5, specular=RGB(255, 255, 255), transparency=0})
