# Grasshopper definition day 01-01.gh (Grasshopper 1.0.7)
# Copyright: Co-de-iT
# plug-ins: Anemone, Noise 4D

pt = Point(Point(-0.4763752919, 3.006995949, 0))
X = UnitX(Factor=Slider(0.904, range=0..10))
pt_2 = Point(Point(-0.4763752919, -0.01539025062, 0))
X_2 = UnitX(Factor=1)
pt_3 = Point(Point(49.40361527, 35.71536818, 0))
loop_start = LoopStart(N=Slider(1000, range=0..1000), D0=pt, D1=X)  # -> port, Counter, Data, Data_2; disabled
X_3 = UnitX(Factor=Slider(1.15, range=0..10))
panel = Panel(loop_start.Counter)
vdisex = VectorDisplayEx(Point=pt_3, Vector=X_2, Colour=RGB(0, 0, 0), Width=2)
rectangle = Rectangle(Plane=PlaneXY(0, 0, 0), XSize=Slider(200, range=0..200), YSize=Slider(100, range=0..200), Radius=0)  # -> Rectangle, Length
loop_start_2 = LoopStart(N=Slider(0, range=0..100), D0=simplify(pt_3), D1=simplify(pt_3), D2=simplify(X_2))  # -> port, Counter, Data, Data_2, Data_3
multiplication = Multiplication(A=loop_start.Counter, B=Slider(0.319, range=0..3.142))
Z = UnitZ(Factor=1)
move = Move(Geometry=pt_2, Motion=X_3)  # -> Geometry, Transform

X_4 = UnitX(Factor=Slider(1.15, range=0..10))
move_2 = Move(Geometry=move.Geometry, Motion=X_4)  # -> Geometry, Transform

vrot = Rotate(Vector=loop_start.Data_2, Axis=Z, Angle=multiplication)
mplane = MeshPlane(Boundary=rectangle.Rectangle, WidthCount=Slider(200, range=0..1000), HeightCount=Slider(100, range=0..1000))  # -> Mesh, Area
panel_2 = Panel(loop_start_2.Counter)
number_slider = Slider(0, range=0..1)
number_slider_2 = Slider(0.015, range=0..1)
move_3 = Move(Geometry=loop_start.Data, Motion=vrot)  # -> Geometry, Transform
demesh = DeconstructMesh(Mesh=mplane.Mesh)  # -> Vertices, Faces, Colours, Normals
loop_end = LoopEnd(
    port=loop_start.port,
    Exit=False,
    Data=move_3.Geometry,
    Data_2=vrot,
    TimeOutVal=0,
    pausedState=False,
    state="Constant & Record")  # -> D0, D1
maxangle = Slider(17.55, range=0..100)

perlin = PerlinNoise(Values=demesh.Vertices, Time=number_slider, Scale=number_slider_2)
bnd = Bounds(Numbers=perlin)
remap = RemapNumbers(Value=perlin, Source=bnd, Target=Domain(0, 1))  # -> Mapped, Clipped
multiplication_2 = Multiplication(A=remap.Clipped, B=maxangle)
X_5 = UnitX(Factor=1)
Z_2 = UnitZ(Factor=1)
vrot_2 = Rotate(Vector=X_5, Axis=Z_2, Angle=multiplication_2)

# ---- group: CALCULATE FIELD VECTOR
perlin_2 = PerlinNoise(Values=loop_start_2.Data, Time=number_slider, Scale=number_slider_2)
remap_2 = RemapNumbers(Value=perlin_2, Source=bnd, Target=Domain(0, 1))  # -> Mapped, Clipped
multiplication_3 = Multiplication(A=remap_2.Clipped, B=maxangle)
X_6 = UnitX(Factor=1)
Z_3 = UnitZ(Factor=1)
vrot_3 = Rotate(Vector=X_6, Axis=Z_3, Angle=multiplication_3)

# ----
intcrv = Interpolate(Vertices=flatten(loop_end.D0), Degree=3, Periodic=False, KnotStyle=1)  # -> Curve, Length, Domain
gradient = Gradient(LowerLimit="-1", UpperLimit=1, Parameter=perlin, stops=[0: RGB(0, 0, 0), 1: RGB(255, 255, 255)])
field_intensity = Slider(0.163, range=0..1)
# <title>
# 
# <description>
# 
# code by Alessio Erioli
# 
# v 0.1
pt_4 = ConstructPoint(XCoordinate=0, YCoordinate=0, ZCoordinate=0)
panel_3 = Panel(loop_end.D0)
multiplication_4 = Multiplication(A=field_intensity, B=vrot_3)
c_script = CSharpScript(x=Slider(0.341, range=0..1), y=Slider(0.171, range=0..1), z=Slider(0.25, range=0..1))  # -> out, P; inputs x: Double, y: Double, z: Double; disabled
# ---------- c_script: C# ----------
    Print("Hello World");
    Print("{0}", 2 + 2);

    int i;
    double d;
    bool b;

    i = 1;
    d = 3.14;
    b = false;
    
    
    
    P = new Point3d(x, y, z);
# ---------- end c_script ----------
conmesh = ConstructMesh(Vertices=demesh.Vertices, Faces=demesh.Faces, Colours=gradient)
addition = Addition(A=loop_start_2.Data_3, B=multiplication_4)
expression = Expression(Expression="Format(\"{0}, {1}\", x, y)")
amp = Amplitude(Vector=addition, Amplitude=1)
vdisex_2 = VectorDisplayEx(Point=demesh.Vertices, Vector=vrot_2, Colour=vrot_2, Width=2)
panel_4 = Panel(c_script.out)

# ---- group: UPDATE POINT
move_4 = Move(Geometry=loop_start_2.Data, Motion=amp)  # -> flatten(Geometry), Transform

# ---- group: UPDATE TRAIL
mod = Modulus(A=loop_start_2.Counter, B="5")
panel_5 = Panel(mod)
equals = Equality(FirstNumber=mod, SecondNumber="0")  # -> Equality, Inequality
dispatch = Dispatch(List=move_4.Geometry, DispatchPattern=equals.Equality)  # -> ListA, ListB
merge = Merge(Data1=simplify(loop_start_2.Data_2), Data2=dispatch.ListA)

# ----
pt_5 = Point(Point(0, 0, 0))
pt_6 = Point(Point(0.3986231232, 0.5326858133, 0))

# ---- group: DISPLAY CURRENT POINT
vdisex_3 = VectorDisplayEx(Point=move_4.Geometry, Vector=vrot_3, Colour=RGB(0, 0, 0), Width=2)
preview = CustomPreview(
    Geometry=move_4.Geometry,
    Material={diffuse=RGB(221, 160, 221), emission=RGB(66, 48, 66), shine=0.5, specular=RGB(255, 255, 255), transparency=0})

# ----
c_script_2 = CSharpScript(Pa=pt_5, Pb=pt_6)  # -> out, Pm; inputs Pa: Point3d, Pb: Point3d
# ---------- c_script_2: C# ----------
    Vector3d A;
    int i;
    double d;
    bool b;

    Pm = AveragePoint(Pa, Pb);
# ---------- c_script_2: C# additional code ----------
  public Point3d AveragePoint(Point3d A, Point3d B)
  {
    Point3d average;
    average = (A + B) * 0.5;
    return average;
  }
# ---------- end c_script_2 ----------
loop_end_2 = LoopEnd(
    port=loop_start_2.port,
    Exit=False,
    Data=simplify(move_4.Geometry),
    Data_2=merge,
    Data_3=amp,
    TimeOutVal=0,
    pausedState=False,
    state="Constant output")  # -> D0, D1, D2
timer = Timer(TimerInterval=50, Target=c_script_3)
c_script_3 = CSharpScript(startValue="0", reset=Toggle(True))  # -> out, A; inputs startValue: Int32, reset: Boolean
# ---------- c_script_3: C# ----------
    if(reset) 
    {
      i = startValue;
    }
    else
    {
      i++;
    }

    A = i;
 /*
  A= x++;

  A = x;
  x = x + 1;

  A = ++;
  x = x + 1;
  A = x;

  */
# ---------- c_script_3: C# additional code ----------
  int i;
# ---------- end c_script_3 ----------
intcrv_2 = Interpolate(Vertices=flatten(loop_end_2.D1), Degree=3, Periodic=False, KnotStyle=1)  # -> Curve, Length, Domain; disabled
panel_6 = Panel(c_script_3.A)
