# Grasshopper definition in class 2 day 2.gh (Grasshopper 1.0.7)
# Copyright: Co-de-iT
# plug-ins: FileToScript

X = XSize(Domain(-1, 1))
dir_type = ValueList({"desktop": 0, "documents": 1, "GH file path": 2, "C:": 3}, selected="GH file path")
number_slider = Slider(500, range=2..5000)
rectangle = Rectangle(Plane=PlaneXY(0, 0, 0), XSize=X, YSize=X, Radius=0)  # -> Rectangle, Length
file_name = Panel("DBD day 02.cs")
f_pathg = PathGenerator(type=dir_type, subDir="DBD-day02\DBD-day02")  # -> dir; inputs type: Int32, subDir: String
# ---------- f_pathg: C# ----------
                           /*
    froGH - a sparse collection of (in)utilities for Grasshopper

    Path Generator
    code by Alessio Erioli - value list generation based on code by James Ramsden

    froGH by Co-de-iT is licensed under a Creative Commons Attribution 4.0 International License.
    http://creativecommons.org/licenses/by/4.0/

    */
    initComp();


    String S = "";
    String root = "";
    String end = "\\";
    String eol = Environment.NewLine;

    // __________________ autoList part __________________

    // variable for the list
    Grasshopper.Kernel.Special.GH_ValueList vList;
    // tries to cast input as list
    try{

      // if the list is not the first parameter then change Input[0] to the corresponding value
      vList = (Grasshopper.Kernel.Special.GH_ValueList) Component.Params.Input[0].Sources[0];
      // Print("value list connected");
      // check if the list must be created
      //if (vList.NickName != "dir type"){
      if (!vList.NickName.Equals("dir type")){
        vList.ClearData();
        vList.ListItems.Clear();
        vList.NickName = "dir type";
        var item1 = new Grasshopper.Kernel.Special.GH_ValueListItem("desktop", "0");
        var item2 = new Grasshopper.Kernel.Special.GH_ValueListItem("documents", "1");
        var item3 = new Grasshopper.Kernel.Special.GH_ValueListItem("GH file path", "2");
        var item4 = new Grasshopper.Kernel.Special.GH_ValueListItem("C:", "3");
        vList.ListItems.Add(item1);
        vList.ListItems.Add(item2);
        vList.ListItems.Add(item3);
        vList.ListItems.Add(item4);

        vList.ListItems[0].Value.CastTo(out type);
      }
    }
    catch{
      // handles anything that is not a value list
    }


    switch(type){
      case 0:
        root = Environment.GetFolderPath(Environment.SpecialFolder.Desktop) + end;
        S = "Desktop";
        break;
      case 1:
        root = Environment.GetFolderPath(Environment.SpecialFolder.MyDocuments) + end;
        S = "Documents";
        break;
      case 2:
        GH_Document ghDoc = owner.OnPingDocument();

        if (ghDoc.IsFilePathDefined)
        {
          int nameLen = ghDoc.DisplayName.TrimEnd('*').Length + 3; // +3 accounts for the '.gh' extension
          int fileLen = ghDoc.FilePath.TrimEnd('*').Length;

          //F = ghDoc.DisplayName.TrimEnd('*');
          root = ghDoc.FilePath.Substring(0, fileLen - nameLen);
          //root = gh_d.FilePath;
          S = "GH File path";
        }
        else
        {
          Print("No path defined. Saving to Desktop until then");
          root = Environment.GetFolderPath(Environment.SpecialFolder.Desktop);
          S = "Desktop";
        }
        break;
      case 3:
        root = "C:" + end;
        S = root + end;
        break;
    }
    dir = root + (subDir != null ? (subDir + end) : "");
    Component.Message = S;
# ---------- f_pathg: C# additional code ----------
  void initComp(){
    Component.Name = "Path Generator";
    Component.NickName = "f_PathG";
    Component.Description = "generates a path based on local direcories such as Desktop, Documents, GH file path";
    Component.Params.Input[0].Name = "dir type";
    Component.Params.Input[0].Description = "directory type: 0 desktop, 1 documents, 2 GH file path, 3 C:\nconnect a value list for automatic list generation";
    Component.Params.Input[1].Name = "custom subdir";
    Component.Params.Input[1].Description = "(optional) custom subdirectory";
  }
# ---------- end f_pathg ----------

# ---- group: vectors
pop2d = Populate2D(Region=rectangle.Rectangle, Count=number_slider, Seed=1)

# ---- group: positions
pop2d_2 = Populate2D(Region={Plane=PlaneXY(0, 0, 0), Size=Domain2(u=0..20, v=0..10)}, Count=number_slider, Seed=1)

# ----
concat = Concatenate(FragmentA=f_pathg, FragmentB=file_name)
unit = UnitVector(Vector=pop2d)
panel = Panel(concat)
path = FilePath(concat)
# <title>
# 
# <description>
# 
# code by Alessio Erioli
# 
# v 0.1
button = Button()
pt = Point(Point(0, 0, 0))

# ---- group: JITTERBUGS
c_script = CSharpScript(reset=button, go=Toggle(False), maxVel=Slider(0.523, range=0..1), P=pop2d_2, V=unit)  # -> out, Ap, Av, T; inputs reset: Boolean, go: Boolean, maxVel: Double, P: list of Point3d, V: list of Vector3d
# ---------- c_script: C# ----------
        if (agents == null || reset)
        {
            agents = new List<Agent>();

            for (int i = 0; i < P.Count; i++)
                agents.Add(new Agent(P[i], V[i], i));
        }

        if (go)
        {
            foreach (Agent myAgent in agents)
            {
                myAgent.maxVel = maxVel;
                myAgent.Update();
            }
            Component.ExpireSolution(true);
        }

        // output data
        List<Point3d> positions = new List<Point3d>();
        List<Vector3d> velocities = new List<Vector3d>();
        List<Polyline> trails = new List<Polyline>();

        foreach (Agent myAgent in agents)
        {
            positions.Add(myAgent.pos);
            velocities.Add(myAgent.vel);
            trails.Add(myAgent.trail);
        }

        Ap = positions;
        Av = velocities;
        T = trails;
# ---------- c_script: C# additional code ----------
 

    // global variables
    public List<Agent> agents;
    public Agent ag;

    public class Agent
    {
        // fields
        public Point3d pos;
        public Vector3d vel;
        Random rnd;
        public int id;
        public Polyline trail;
        public double maxVel;

        // constructor
        public Agent(Point3d _pos, Vector3d _vel, int _id)
        {
            pos = _pos;
            vel = _vel;
            id = _id;
            rnd = new Random(id);
            //      new List<Point3d> { pos};
            // trail = new Polyline();
            trail = new Polyline { pos };
            maxVel = 1;
        }


        // methods
        public void Update()
        {
            CalcVel();
            Move();
            trail.Add(pos);
        }

        public void CalcVel()
        {
            vel.Rotate((rnd.NextDouble() - 0.5) * Math.PI * 0.6, Vector3d.ZAxis);
            vel.Unitize();
            vel *= maxVel;


        }

        public void Move()
        {
            pos += vel;
        }

    }
# ---------- end c_script ----------
ftsv2 = FileToScriptV2(File=path)

# ----
vdisex = VectorDisplayEx(Point=pt, Vector=unit, Colour=RGB(0, 0, 0), Width=2)
range = Range(Domain=Domain(0, 1), Steps=expr("x-1", number_slider))
# << this error when you hit reset is due to the Polylines initialized with one point only
panel_2 = Panel(c_script.out)
gradient = Gradient(LowerLimit=0, UpperLimit=1, Parameter=range, stops=[0: RGB(0, 0, 0), 0.487: RGB(150, 120, 120), 1: RGB(255, 255, 255)])
crv = Curve(c_script.T)
preview = CustomPreview(Geometry=crv, Material=gradient)
vdisex_2 = VectorDisplayEx(Point=c_script.Ap, Vector=c_script.Av, Colour=gradient, Width=2)
