# Grasshopper definition in class day 2.gh (Grasshopper 1.0.7)
# Copyright: Co-de-iT

pt = Point(Point(6.180604989, 6.311362694, 0))
c_script = CSharpScript()  # -> out, A, B, C, D, E
# ---------- c_script: C# ----------
    // declare a Data Tree
    DataTree <Point3d> dT = new DataTree<Point3d>();

    for (int i = 0; i < 10; i++)
    {
      Point3d pt = new Point3d(i, 0, 0);

      // specify Branch path
      GH_Path Path = new GH_Path(0, 0, i);

      // assign data to the tree
      dT.Add(pt, Path);

    }

    A = dT;

    // .....................................................

    DataTree <Point3d> dT1 = new DataTree<Point3d> ();
    
    GH_Path myPath = new GH_Path(1, 2, 3);
    
    dT1.Add(new Point3d(1.0, 1.0, 0), myPath);
    
    int[] pNums = {1,2,4};

    myPath = new GH_Path(pNums);
    
    dT1.Add(new Point3d(2.0, 1.0, 0), myPath);
    
    B = dT1;
    
    // ......................................................
    
    DataTree <Point3d> dT2 = new DataTree<Point3d> ();
    
    for (int i = 0; i < 10; i++)
      for (int j = 0; j < 10; j++)
        for (int k = 0; k < 10; k++)
        {
          Point3d pt = new Point3d(i, j + 2.0, k);
          
          GH_Path Path = new GH_Path(i, j);
        
          
          dT2.Add(pt, Path);
        }
    
    C = dT2;
    
    // retrieve a branch
    //dT2.Branches.Count;
    // retrieve a sequential branch at index i
    // D = dT2.Branches[i];
    // path for the i-th branch
    //dT2.Paths[i];
    
    D = dT2.Branch(2, 3);

    E = dT2.Branch(2, 3)[5];
# ---------- end c_script ----------
sph = Sphere(Base=c_script.E, Radius=0.2)
c_script_2 = CSharpScript(x=Slider(0.501, range=0..1))  # -> out, A, B; inputs x: Double
# ---------- c_script_2: C# ----------
    double b;
    
    b = x;
    x += 2;
    
    A = x;
    B = b;
# ---------- end c_script_2 ----------
c_script_3 = CSharpScript(x=Slider(0, range=0..1))  # -> out, A, B; inputs x: Double
# ---------- c_script_3: C# ----------
    MySphere s1, s2;

    s1 = new MySphere(new Point3d(x, 0, 0), 1.0);
    s2 = s1;

    s1.center += new Point3d(0.5, 0, 0);
    // s1.center = s1.center + ....
    // -=
    // *=
    // /=

    A = s1.geom();
    B = s2.geom();
# ---------- c_script_3: C# additional code ----------
  public class MySphere
  {
    // fields
    public Point3d center;
    public double radius;

    // constructor
    public MySphere(Point3d _center, double _radius)
    {
      center = _center;
      radius = _radius;

    }

    // methods

    public Sphere geom()
    {
      return new Sphere(center, radius);
    }
  }
# ---------- end c_script_3 ----------
c_script_4 = CSharpScript()  # -> out, A, B, C
# ---------- c_script_4: C# ----------
    List <Point3d> points = new List<Point3d>();
    
    Point3d p0 = new Point3d();
    points.Add(p0);
    
    Point3d p1 = new Point3d(1.0, 2.0, 3.0);
    points.Add(p1);
    
    Point3d p2 = new Point3d(2, 5, 4);
    points.Add(p2);
    
    // number of items in the list
    A = points.Count;
    
    B = points;
    
    Point3d ptOut = points[0];
    C = ptOut;
# ---------- end c_script_4 ----------

# ---- group: arrays
c_script_5 = CSharpScript()  # -> out, A
# ---------- c_script_5: C# ----------
    int a;
    // array
    int[] array;
    //
    array = new int[5];

    array[0] = 5;
    array[1] = 65;
    //
    int value0 = array[0];
    int value1 = array[1];

    int l = array.Length;

    for(int i = 0; i < array.Length;i++)
    {
      array[i] = i * 2;
    }

    string[] Week = {"Monday", "Tuesday", "Wednesday", "Thursday",
      "Friday", "Saturday", "Sunday"};

    // multidimensional array
    int[,] array2 = {{1,2,3},{4,5,6}};

    array2[0, 2] = 10;
    array2 = new int[,]{{8,4,7},{9,0,3}};

    // jagged arrays
    int[][] jagArray1 = new int[4][];
    jagArray1[0] = new int[]{2,3,4};
# ---------- end c_script_5 ----------

# ----
# attractor
c_script_6 = CSharpScript(
    nX=Slider(21, range=2..100),
    nY=Slider(27, range=2..100),
    step=Slider(0.599, range=0..1),
    att=pt,
    rA=Slider(0.233, range=0..1),
    rB=Slider(0.042, range=0..1),
    thres=Slider(2.821, range=0..10))  # -> out, C; inputs nX: Int32, nY: Int32, step: Double, att: Point3d, rA: Double, rB: Double, thres: Double
# ---------- c_script_6: C# ----------
    List <Circle> circles = new List<Circle>();

    double d,r;
    Point3d p;

    for (int i = 0; i < nX; i++)
      for (int j = 0; j < nY; j++)
      {
        p = new Point3d(i * step, j * step, 0);
        d = p.DistanceTo(att);

        if (d < thres)
          r = rB + (rB - rA) * (d - thres) * (1 / thres);
        else
          r = rB;

        circles.Add(new Circle(p, r));
      }


    C = circles;
# ---------- end c_script_6 ----------
# data tree
panel = Panel(c_script.A)
preview = CustomPreview(Geometry=c_script.C, Material=ColourSwatch(SwatchColor=RGB(120, 120, 120)))
panel_2 = Panel(c_script.B)
preview_2 = CustomPreview(Geometry=sph, Material=ColourSwatch(SwatchColor=RGB(255, 255, 255)))
preview_3 = CustomPreview(
    Geometry=c_script.D,
    Material={diffuse=RGB(221, 160, 221), emission=RGB(66, 48, 66), shine=0.5, specular=RGB(255, 255, 255), transparency=0})
panel_3 = Panel(c_script_4.A)
pt_2 = Point(c_script_4.C)
srf = Surface(c_script_3.A)
srf_2 = Surface(c_script_3.B)
# <title>
# 
# <description>
# 
# code by Alessio Erioli
# 
# v 0.1
panel_4 = Panel(c_script_2.A)
panel_5 = Panel(c_script_2.B)
circle = Circle(c_script_6.C)
panel_6 = Panel(c_script_6.out)
