# Grasshopper definition AgentSystem.gh (Grasshopper 1.0.7)
# Copyright: Co-de-iT
# plug-ins: FileToScript

X = XSize(Domain(-1, 1))
number_slider = Slider(500, range=2..5000)
dir_type = ValueList({"desktop": 0, "documents": 1, "GH file path": 2, "C:": 3}, selected="GH file path")
rectangle = Rectangle(Plane=PlaneXY(0, 0, 0), XSize=X, YSize=X, Radius=0)  # -> Rectangle, Length
file_name = Panel("AgentSystem.cs")
f_pathg = PathGenerator(type=dir_type, subDir="AgentSystem\AgentSystem")  # -> dir; inputs type: Int32, subDir: String
# ---------- f_pathg: C# ----------
                           /*
    froGH - a sparse collection of (in)utilities for Grasshopper

    Path Generator
    code by Alessio Erioli - value list generation based on code by James Ramsden

    froGH by Co-de-iT is licensed under a Creative Commons Attribution 4.0 International License.
    http://creativecommons.org/licenses/by/4.0/

    */
    initComp();


    String S = "";
    String root = "";
    String end = "\\";
    String eol = Environment.NewLine;

    // __________________ autoList part __________________

    // variable for the list
    Grasshopper.Kernel.Special.GH_ValueList vList;
    // tries to cast input as list
    try{

      // if the list is not the first parameter then change Input[0] to the corresponding value
      vList = (Grasshopper.Kernel.Special.GH_ValueList) Component.Params.Input[0].Sources[0];
      // Print("value list connected");
      // check if the list must be created
      //if (vList.NickName != "dir type"){
      if (!vList.NickName.Equals("dir type")){
        vList.ClearData();
        vList.ListItems.Clear();
        vList.NickName = "dir type";
        var item1 = new Grasshopper.Kernel.Special.GH_ValueListItem("desktop", "0");
        var item2 = new Grasshopper.Kernel.Special.GH_ValueListItem("documents", "1");
        var item3 = new Grasshopper.Kernel.Special.GH_ValueListItem("GH file path", "2");
        var item4 = new Grasshopper.Kernel.Special.GH_ValueListItem("C:", "3");
        vList.ListItems.Add(item1);
        vList.ListItems.Add(item2);
        vList.ListItems.Add(item3);
        vList.ListItems.Add(item4);

        vList.ListItems[0].Value.CastTo(out type);
      }
    }
    catch{
      // handles anything that is not a value list
    }


    switch(type){
      case 0:
        root = Environment.GetFolderPath(Environment.SpecialFolder.Desktop) + end;
        S = "Desktop";
        break;
      case 1:
        root = Environment.GetFolderPath(Environment.SpecialFolder.MyDocuments) + end;
        S = "Documents";
        break;
      case 2:
        GH_Document ghDoc = owner.OnPingDocument();

        if (ghDoc.IsFilePathDefined)
        {
          int nameLen = ghDoc.DisplayName.TrimEnd('*').Length + 3; // +3 accounts for the '.gh' extension
          int fileLen = ghDoc.FilePath.TrimEnd('*').Length;

          //F = ghDoc.DisplayName.TrimEnd('*');
          root = ghDoc.FilePath.Substring(0, fileLen - nameLen);
          //root = gh_d.FilePath;
          S = "GH File path";
        }
        else
        {
          Print("No path defined. Saving to Desktop until then");
          root = Environment.GetFolderPath(Environment.SpecialFolder.Desktop);
          S = "Desktop";
        }
        break;
      case 3:
        root = "C:" + end;
        S = root + end;
        break;
    }
    dir = root + (subDir != null ? (subDir + end) : "");
    Component.Message = S;
# ---------- f_pathg: C# additional code ----------
  void initComp(){
    Component.Name = "Path Generator";
    Component.NickName = "f_PathG";
    Component.Description = "generates a path based on local direcories such as Desktop, Documents, GH file path";
    Component.Params.Input[0].Name = "dir type";
    Component.Params.Input[0].Description = "directory type: 0 desktop, 1 documents, 2 GH file path, 3 C:\nconnect a value list for automatic list generation";
    Component.Params.Input[1].Name = "custom subdir";
    Component.Params.Input[1].Description = "(optional) custom subdirectory";
  }
# ---------- end f_pathg ----------

# ---- group: vectors
pop2d = Populate2D(Region=rectangle.Rectangle, Count=number_slider, Seed=1)

# ---- group: positions
pop2d_2 = Populate2D(Region={Plane=PlaneXY(0, 0, 0), Size=Domain2(u=0..20, v=0..10)}, Count=number_slider, Seed=1)

# ----
concat = Concatenate(FragmentA=f_pathg, FragmentB=file_name)
unit = UnitVector(Vector=pop2d)
panel = Panel(concat)
path = FilePath(concat)
# <title>
# 
# <description>
# 
# code by Alessio Erioli
# 
# v 0.1
c_script = CSharpScript(reset=Button(), go=Toggle(False), P=pop2d_2, V=unit, nR=Slider(4.744, range=0..5), cS=Slider(38.181, range=0..50))  # -> out, Ap, Av; inputs reset: Boolean, go: Boolean, P: list of Point3d, V: list of Vector3d, nR: Double, cS: Double
# ---------- c_script: C# ----------
        GH_Point[] ptsOut;
        GH_Vector[] vecOut;

        if (reset || Flock == null)
        {
            Flock = new FlockSystem(P, V);
            //ptsOut = new GH_Point[Flock.Agents.Count];
            //vecOut = new GH_Vector[Flock.Agents.Count];
        }

        if (go)
        {
            // update parameters
            Flock.NeighborhoodRadius = nR;
            Flock.CohesionStrength = cS;

            // update system
            Flock.Update();
            Component.ExpireSolution(true);
        }

        Flock.GetPtsVecs(out ptsOut, out vecOut);

        Ap = ptsOut;
        Av = vecOut;
# ---------- c_script: C# additional code ----------
 

    // global variables
    public FlockSystem Flock;


    // classes

    public class FlockSystem
    {
        public List<Agent> Agents;
        public double NeighborhoodRadius;
        public double CohesionStrength;

        public FlockSystem(List <Point3d> P, List<Vector3d> V)
        {
            Agents = new List<Agent>();

            for (int i=0; i< P.Count; i++)
            {
                Agent ag = new Agent(P[i], V[i]);
                ag.Flock = this;

                Agents.Add(ag);
            }
        }

        public void Update()
        {
            // . . . . . . . . . . . . . . . . . . . . . . step 1 - calculate desired

            foreach (Agent ag in Agents)
            {
                // find neighbours & compute desired velocity for each agent
                ComputeAgentDesiredVelocity(ag);
            }

            // . . . . . . . . . . . . . . . . . . . . . . step 2 - update agents velocity and position
            foreach (Agent ag in Agents) ag.UpdateVelocityAndPosition();
        }

        public List<Agent> FindNeighbours(Agent ag)
        {
            List<Agent> neighbours = new List<Agent>();

            foreach(Agent neighbour in Agents)
            {
                if (neighbour != ag && neighbour.position.DistanceTo(ag.position) < NeighborhoodRadius)
                    neighbours.Add(neighbour);
            }

            return neighbours;
        }

        public void ComputeAgentDesiredVelocity(Agent ag)
        {
            List<Agent> neighbours = FindNeighbours(ag);
            ag.ComputeDesiredVelocity(neighbours);
        }

        // extract points and vectors for output
        public void GetPtsVecs(out GH_Point[] pts, out GH_Vector[] vecs)
        {
            pts = new GH_Point[Agents.Count];
            vecs = new GH_Vector[Agents.Count];

            for (int i = 0; i < Agents.Count; i++)
            {
                pts[i] = new GH_Point(Agents[i].position);
                vecs[i] = new GH_Vector(Agents[i].velocity);
            }
        }

    }

    public class Agent
    {
        // field
        public Point3d position;
        public Vector3d velocity;
        public Vector3d desiredVelocity;
        public FlockSystem Flock;

        // constructor
        public Agent(Point3d position, Vector3d velocity)
        {
            this.position = position;
            this.velocity = velocity;
            desiredVelocity = this.velocity;
        }

        // methods
        public void ComputeDesiredVelocity(List<Agent> neighbours)
        {


            if (neighbours.Count == 0)
                desiredVelocity = velocity;
            else
            {
                // find neighbours average
                Point3d average = new Point3d();

                foreach (Agent neighbour in neighbours)
                    average += neighbour.position;

                average /= neighbours.Count;

                // go there
                Vector3d cohesion = average - position;

                desiredVelocity += Flock.CohesionStrength * cohesion;

            }
        }

        public void UpdateVelocityAndPosition()
        {
            // steering method
            velocity = 0.97 * velocity + 0.03 * desiredVelocity;

            // limit the velocity to maximum speed (4.0)
            if (velocity.Length > 4.0)
            {
                velocity.Unitize();
                velocity *= 4.0;
            }

            position += velocity;
        }

    }

    // utilities functions
# ---------- end c_script ----------
ftsv2 = FileToScriptV2(File=path)
vdisex = VectorDisplayEx(Point=c_script.Ap, Vector=c_script.Av, Colour=RGB(0, 0, 0), Width=2)
