# Grasshopper definition AgentSystemMesh.gh (Grasshopper 1.0.7)
# Copyright: Co-de-iT
# plug-ins: FileToScript, Weaverbird, Noise 4D

number_slider = Slider(1, range=0..2)

# ---- group: QUAD-MESH
mesh = Mesh(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)

# ----
wbcatmullclark = WeaverbirdsCatmullClarkSubdivision(MeshCurves=mesh, Level=Slider(3, range=1..3), SmoothNakedEdges=number_slider)
# <title>
# 
# <description>
# 
# code by Alessio Erioli
# 
# v 0.1
wbcatmullclark_2 = WeaverbirdsCatmullClarkSubdivision(MeshCurves=wbcatmullclark, Level=Slider(2, range=1..3), SmoothNakedEdges=number_slider)
mesh_2 = Mesh(wbcatmullclark_2)
demesh = DeconstructMesh(Mesh=mesh_2)  # -> Vertices, Faces, Colours, Normals
perlin = PerlinNoise(Values=demesh.Vertices, Time=Slider(0, range=0..10), Scale=Slider(0.03, range=0..1))
pi = Pi(Factor=Slider(7, range=0..30))
Z = UnitZ(Factor=1)
lng = ListLength(List=demesh.Vertices)
xprod = CrossProduct(VectorA=demesh.Normals, VectorB=Z, Unitize=False)  # -> Vector, Length
random = Random(Range=lng, Number=Slider(500, range=2..5000), Seed=2, Integers=True)
multiplication = Multiplication(A=perlin, B=pi)
cset = CreateSet(List=random)  # -> Set, Map
vrot = Rotate(Vector=xprod.Vector, Axis=demesh.Normals, Angle=multiplication)
lng_2 = ListLength(List=cset.Set)
item = ListItem(List=demesh.Normals, Index=cset.Set, Wrap=True)
gradient = Gradient(LowerLimit="-1", UpperLimit=1, Parameter=perlin, stops=[0: RGB(0, 0, 0), 1: RGB(255, 255, 255)])
Z_2 = UnitZ(Factor=1)
random_2 = Random(Range="-Pi to Pi", Number=lng_2, Seed="3")
xprod_2 = CrossProduct(VectorA=item, VectorB=Z_2, Unitize=False)  # -> Vector, Length
dir_type = ValueList({"desktop": 0, "documents": 1, "GH file path": 2, "C:": 3}, selected="GH file path")
vrot_2 = Rotate(Vector=xprod_2.Vector, Axis=item, Angle=random_2)
item_2 = ListItem(List=demesh.Vertices, Index=cset.Set, Wrap=True)
file_name = Panel("AgentSystemMesh.cs")
conmesh = ConstructMesh(Vertices=demesh.Vertices, Faces=demesh.Faces, Colours=gradient)
f_pathg = PathGenerator(type=dir_type, subDir="AgentSystem\AgentSystem")  # -> dir; inputs type: Int32, subDir: String
# ---------- f_pathg: C# ----------
                           /*
    froGH - a sparse collection of (in)utilities for Grasshopper

    Path Generator
    code by Alessio Erioli - value list generation based on code by James Ramsden

    froGH by Co-de-iT is licensed under a Creative Commons Attribution 4.0 International License.
    http://creativecommons.org/licenses/by/4.0/

    */
    initComp();


    String S = "";
    String root = "";
    String end = "\\";
    String eol = Environment.NewLine;

    // __________________ autoList part __________________

    // variable for the list
    Grasshopper.Kernel.Special.GH_ValueList vList;
    // tries to cast input as list
    try{

      // if the list is not the first parameter then change Input[0] to the corresponding value
      vList = (Grasshopper.Kernel.Special.GH_ValueList) Component.Params.Input[0].Sources[0];
      // Print("value list connected");
      // check if the list must be created
      //if (vList.NickName != "dir type"){
      if (!vList.NickName.Equals("dir type")){
        vList.ClearData();
        vList.ListItems.Clear();
        vList.NickName = "dir type";
        var item1 = new Grasshopper.Kernel.Special.GH_ValueListItem("desktop", "0");
        var item2 = new Grasshopper.Kernel.Special.GH_ValueListItem("documents", "1");
        var item3 = new Grasshopper.Kernel.Special.GH_ValueListItem("GH file path", "2");
        var item4 = new Grasshopper.Kernel.Special.GH_ValueListItem("C:", "3");
        vList.ListItems.Add(item1);
        vList.ListItems.Add(item2);
        vList.ListItems.Add(item3);
        vList.ListItems.Add(item4);

        vList.ListItems[0].Value.CastTo(out type);
      }
    }
    catch{
      // handles anything that is not a value list
    }


    switch(type){
      case 0:
        root = Environment.GetFolderPath(Environment.SpecialFolder.Desktop) + end;
        S = "Desktop";
        break;
      case 1:
        root = Environment.GetFolderPath(Environment.SpecialFolder.MyDocuments) + end;
        S = "Documents";
        break;
      case 2:
        GH_Document ghDoc = owner.OnPingDocument();

        if (ghDoc.IsFilePathDefined)
        {
          int nameLen = ghDoc.DisplayName.TrimEnd('*').Length + 3; // +3 accounts for the '.gh' extension
          int fileLen = ghDoc.FilePath.TrimEnd('*').Length;

          //F = ghDoc.DisplayName.TrimEnd('*');
          root = ghDoc.FilePath.Substring(0, fileLen - nameLen);
          //root = gh_d.FilePath;
          S = "GH File path";
        }
        else
        {
          Print("No path defined. Saving to Desktop until then");
          root = Environment.GetFolderPath(Environment.SpecialFolder.Desktop);
          S = "Desktop";
        }
        break;
      case 3:
        root = "C:" + end;
        S = root + end;
        break;
    }
    dir = root + (subDir != null ? (subDir + end) : "");
    Component.Message = S;
# ---------- f_pathg: C# additional code ----------
  void initComp(){
    Component.Name = "Path Generator";
    Component.NickName = "f_PathG";
    Component.Description = "generates a path based on local direcories such as Desktop, Documents, GH file path";
    Component.Params.Input[0].Name = "dir type";
    Component.Params.Input[0].Description = "directory type: 0 desktop, 1 documents, 2 GH file path, 3 C:\nconnect a value list for automatic list generation";
    Component.Params.Input[1].Name = "custom subdir";
    Component.Params.Input[1].Description = "(optional) custom subdirectory";
  }
# ---------- end f_pathg ----------
vdisex = VectorDisplayEx(Point=demesh.Vertices, Vector=vrot, Colour=RGB(0, 0, 0), Width=2)
unit = UnitVector(Vector=vrot_2)
number_slider_2 = Slider(4.433, range=0..10)
nr = Slider(5, range=0..5)
concat = Concatenate(FragmentA=f_pathg, FragmentB=file_name)
panel = Panel(concat)
reset = Button()
go = BooleanToggle(False)
multiplication_2 = Multiplication(A=nr, B=Slider(0.824, range=0..1))
panel_2 = Panel(multiplication_2)
path = FilePath(concat)
cir = Circle(Plane=PlaneXY(0, 0, 0), Radius=expr("x*0.5", number_slider_2))
c_script = CSharpScript(
    reset=reset,
    go=go,
    M=conmesh,
    MVf=vrot,
    meI=Slider(18.491, range=0..50),
    P=item_2,
    V=unit,
    nR=nr,
    coS=Slider(0.327, range=0..50),
    alS=Slider(9.029, range=0..50),
    seS=Slider(1.949, range=0..50),
    seR=multiplication_2,
    tSpac=number_slider_2)  # -> out, Ap, Av, Tr; inputs reset: Boolean, go: Boolean, M: Mesh, MVf: list of Vector3d, meI: Double, P: list of Point3d, V: list of Vector3d, nR: Double, coS: Double, alS: Double, seS: Double, seR: Double, tSpac: Double
# ---------- c_script: C# usings ----------
using System.Threading;
using System.Threading.Tasks;
# ---------- c_script: C# ----------
        GH_Point[] ptsOut;
        GH_Vector[] vecOut;
        Polyline[] trails;

        if (reset || AgSys == null || MPoints == null)
        {
            AgSys = new AgentSystem(P, V);
            MPoints = PointCloudFromMesh(M);
            Menv = M;
            MeshRTree = RTreeFromMesh(M);
            //ptsOut = new GH_Point[Flock.Agents.Count];
            //vecOut = new GH_Vector[Flock.Agents.Count];
        }

        if (go)
        {
            // update parameters
            AgSys.NeighborhoodRadius = nR;
            AgSys.CohesionStrength = coS;
            AgSys.AlignmentStrength = alS;
            AgSys.SeparationStrength = seS;
            AgSys.SeparationRadius = seR;
            AgSys.MeshIntensity = meI;
            AgSys.TrailSpacing = tSpac;

            // update system
            AgSys.Update();
            Component.ExpireSolution(true);
        }

        AgSys.GetPtsVecs(out ptsOut, out vecOut);
        trails = AgSys.GetTrails();

        Ap = ptsOut;
        Av = vecOut;
        Tr = trails;
# ---------- c_script: C# additional code ----------
 

    // global variables
    public AgentSystem AgSys;
    public static PointCloud MPoints;
    public static Mesh Menv;
    public static RTree MeshRTree;

    // classes

    public class AgentSystem
    {
        public List<Agent> Agents;
        public double NeighborhoodRadius;
        public double CohesionStrength;
        public double AlignmentStrength;
        public double SeparationStrength;
        public double SeparationRadius;
        public double MaxSpeed;
        public double BoundingBoxSize;
        public double ContainmentStrength;
        public double MeshIntensity;
        public double TrailSpacing;

        public AgentSystem(List<Point3d> P, List<Vector3d> V)
        {
            Agents = new List<Agent>();

            for (int i = 0; i < P.Count; i++)
            {
                Agent ag = new Agent(P[i], V[i]);
                ag.Flock = this;

                Agents.Add(ag);
            }

            MaxSpeed = 0.3;
            BoundingBoxSize = 30.0;
            ContainmentStrength = 1.0;
        }

        public void Update()
        {
            // . . . . . . . . . . . . . . . . . . . . . . step 1 - calculate desired
            /*
             function(param a, param b, ....) {...}

            (param a, param b, ....) => {...}
             
             */
            Parallel.ForEach(Agents, ag =>
            {
                // find neighbours & compute desired velocity for each agent
                ComputeAgentDesiredVelocity(ag);
            });

            //foreach (Agent ag in Agents)
            //{
            //    // find neighbours & compute desired velocity for each agent
            //    ComputeAgentDesiredVelocity(ag);
            //}

            // . . . . . . . . . . . . . . . . . . . . . . step 2 - update agents velocity and position
            foreach (Agent ag in Agents) ag.UpdateVelocityAndPosition();
        }


        public void UpdateRTree()
        {

            foreach (Agent ag in Agents)
            {
                // create neighbours list
                List<Point3d> MeshNeighbours = new List<Point3d>();
                //p.neighFieldPts.Clear();

                // Eventhandler function for RTree search
                EventHandler<RTreeEventArgs> rTreeCallback = (object sender, RTreeEventArgs args) =>
                {
                    MeshNeighbours.Add(Menv.Vertices[args.Id]);
                    // p.neighFieldPts.Add(new FieldPt(args.Id, scalarField[args.Id]));
                };

                MeshRTree.Search(new Sphere(Menv.ClosestPoint(ag.position + ag.velocity * 3.5), 2.5), rTreeCallback);

                //p.SeekNeighbours(MeshNeighbours, seekIntensity);

            }


            if (Agents.Count > 500)
            {
                Parallel.ForEach(Agents, ag =>
                {
                    ag.UpdateVelocityAndPosition();
                });
            }
            else
                foreach (Agent ag in Agents)
                    ag.UpdateVelocityAndPosition();

        }

        public List<Agent> FindNeighbours(Agent ag)
        {
            List<Agent> neighbours = new List<Agent>();

            foreach (Agent neighbour in Agents)
            {
                if (neighbour != ag && neighbour.position.DistanceTo(ag.position) < NeighborhoodRadius)
                    neighbours.Add(neighbour);
            }

            return neighbours;
        }

        public void ComputeAgentDesiredVelocity(Agent ag)
        {
            List<Agent> neighbours = FindNeighbours(ag);
            ag.ComputeDesiredVelocity(neighbours);
        }

        // extract points and vectors for output
        public void GetPtsVecs(out GH_Point[] pts, out GH_Vector[] vecs)
        {
            pts = new GH_Point[Agents.Count];
            vecs = new GH_Vector[Agents.Count];

            for (int i = 0; i < Agents.Count; i++)
            {
                pts[i] = new GH_Point(Agents[i].position);
                vecs[i] = new GH_Vector(Agents[i].velocity);
            }
        }

        public Polyline[] GetTrails()
        {
            Polyline[] trails = new Polyline[Agents.Count];

            Parallel.For(0, Agents.Count, i =>
              {
                  trails[i] = Agents[i].trail;
              });
            return trails;
        }

    }

    public class Agent
    {
        // field
        public Point3d position;
        public Vector3d velocity;
        public Vector3d desiredVelocity;
        public Polyline trail;
        public AgentSystem Flock;

        // constructor
        public Agent(Point3d position, Vector3d velocity)
        {
            this.position = position;
            this.velocity = velocity;
            desiredVelocity = this.velocity;
            trail = new Polyline { this.position };
        }

        // methods
        public void ComputeDesiredVelocity(List<Agent> neighbours)
        {

            desiredVelocity = Vector3d.Zero;
            // ------------------------------- CONTAINMENT -------------------------------
            //Containment();
            // ------------------------------- FLOCKING -------------------------------
            if (neighbours.Count > 0)
            {
                // ................................... COHESION BEHAVIOUR .....................
                //
                // find neighbours average
                Point3d average = new Point3d();

                foreach (Agent neighbour in neighbours)
                    average += neighbour.position;

                average /= neighbours.Count;

                // go there
                Vector3d cohesion = average - position;

                desiredVelocity += Flock.CohesionStrength * cohesion;

                // ................................... ALIGNMENT BEHAVIOUR .....................
                //
                Vector3d alignment = Vector3d.Zero;

                foreach (Agent neighbour in neighbours)
                    alignment += neighbour.velocity;

                alignment /= neighbours.Count;

                desiredVelocity += alignment * Flock.AlignmentStrength;

                // ................................... SEPARATION BEHAVIOUR .....................
                //
                Vector3d separation = Vector3d.Zero;

                foreach (Agent neighbour in neighbours)
                {
                    double distanceToNeighbour = position.DistanceTo(neighbour.position);
                    if (distanceToNeighbour < Flock.SeparationRadius)
                    {
                        Vector3d getAway = position - neighbour.position;
                        separation += getAway /= (getAway.Length * distanceToNeighbour);
                    }

                }

                desiredVelocity += separation * Flock.SeparationStrength;
            }

            // ------------------------------- POINT CLOUD or MESH BEHAVIOUR -------------------------------
            //SeekPointCloud(MPoints);
            SeekMeshClosestPt(Menv);
            // ------------------------------- FIELD BEHAVIOUR -------------------------------

            // ------------------------------- CUSTOM MOVEMENT BEHAVIOUR ---------------------
        }

        public void Containment()
        {


            if (position.X < 0.0)
                desiredVelocity += new Vector3d(-position.X, 0.0, 0.0);
            else if (position.X > Flock.BoundingBoxSize)
                desiredVelocity += new Vector3d(Flock.BoundingBoxSize - position.X, 0, 0);

            if (position.Y < 0.0)
                desiredVelocity += new Vector3d(0.0, -position.Y, 0.0);
            else if (position.Y > Flock.BoundingBoxSize)
                desiredVelocity += new Vector3d(0.0, Flock.BoundingBoxSize - position.Y, 0.0);

            if (position.Z < 0.0)
                desiredVelocity += new Vector3d(0.0, 0.0, -position.Z);
            else if (position.Z > Flock.BoundingBoxSize)
                desiredVelocity += new Vector3d(0.0, 0.0, Flock.BoundingBoxSize - position.Z);

            desiredVelocity *= Flock.ContainmentStrength;
        }

        public void SeekPoint(Point3d target, double intensity)
        {
            Vector3d seek = target - position;
            seek.Unitize();
            seek *= Flock.MaxSpeed;

            desiredVelocity += seek * intensity;
        }

        public void SeekPointCloud(PointCloud pc)
        {
            Point3d futurePos = (Point3d)(position + velocity * 3.5);
            int pcIndex = pc.ClosestPoint(futurePos);
            Point3d p = pc[pcIndex].Location;

            SeekPoint(p, Flock.MeshIntensity);

        }

        public void SeekMeshClosestPt(Mesh M)
        {
            Point3d mP = M.ClosestPoint(position + velocity * 1.5);
            SeekPoint(mP, Flock.MeshIntensity);

        }

        public void SeekMeshNeighbours(List<Point3d> neighbours, double seekIntensity)
        {

            if (neighbours.Count > 0)
            {

                Point3d average = new Point3d();

                foreach (Point3d n in neighbours)
                {
                    average += n - position;
                }

                average /= neighbours.Count;
                SeekPoint(average, seekIntensity);
            }
        }

        public void UpdateVelocityAndPosition()
        {
            // steering method
            velocity = 0.97 * velocity + 0.03 * desiredVelocity;

            // limit the velocity to maximum speed (0.5)
            if (velocity.Length > Flock.MaxSpeed)
            {
                velocity.Unitize();
                velocity *= Flock.MaxSpeed;
            }

            position += velocity;

            if (position.DistanceTo(trail[trail.Count - 1]) > Flock.TrailSpacing)
                trail.Add(position);
        }

    }

    // utilities functions
    public PointCloud PointCloudFromMesh(Mesh M)
    {
        PointCloud pc = new PointCloud();

        for (int i = 0; i < M.Vertices.Count; i++)
        {
            pc.Add(M.Vertices[i], M.Normals[i]);
        }

        return pc;
    }

    public RTree RTreeFromMesh(Mesh M)
    {

        return RTree.CreateFromPointArray(M.Vertices.ToPoint3dArray());
        //RTree MPoints = new RTree();

        //for (int i = 0; i < M.Vertices.Count; i++)
        //    MPoints.Insert(M.Vertices[i], i);

        //return MPoints;
    }
# ---------- end c_script ----------
ftsv2 = FileToScriptV2(File=path)
swatch = ColourSwatch(SwatchColor=RGB(145, 121, 121))
panel_3 = Panel(c_script.out)
crv = Curve(c_script.Tr)
vdisex_2 = VectorDisplayEx(Point=c_script.Ap, Vector=c_script.Av, Colour=swatch, Width=2)
explode = Explode(Curve=flatten(crv), Recursive=True)  # -> simplify(Segments), simplify(Vertices)
preview = CustomPreview(Geometry=crv, Material=swatch)
cull_i = CullIndex(List=explode.Vertices, Indices="-1", Wrap=True)
crv_2 = Curve([<curve referenced from the Rhino model> x2])
group = Group(Objects=crv_2)
meshcp = MeshClosestPoint(Point=cull_i, Mesh=conmesh)  # -> Point, Index, Parameter
vec = Vector(explode.Segments)
meval = MeshEval(Mesh=conmesh, Parameter=meshcp.Parameter)  # -> Point, Normal, Colour
xprod_3 = CrossProduct(VectorA=vec, VectorB=meval.Normal, Unitize=False)  # -> simplify(Vector), Length
pl = ConstructPlane(Origin=cull_i, XAxis=vec, YAxis=xprod_3.Vector)
orient = Orient(Geometry=group, Source=PlaneXY(0, 0, 0), Target=pl)  # -> Geometry, Transform
ungroup = Ungroup(Group=orient.Geometry)
explode_2 = Explode(Curve=ungroup, Recursive=True)  # -> Segments, Vertices
meshcp_2 = MeshClosestPoint(Point=explode_2.Vertices, Mesh=conmesh)  # -> Point, Index, Parameter
intcrv = Interpolate(Vertices=meshcp_2.Point, Degree=3, Periodic=False, KnotStyle=1)  # -> Curve, Length, Domain
