# Grasshopper definition AgentSystem.gh (Grasshopper 1.0.7)
# Copyright: Co-de-iT
# plug-ins: FileToScript, Weaverbird, Noise 4D

number_slider = Slider(1, range=0..2)

# ---- group: QUAD-MESH
mesh = Mesh(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)

# ----
wbcatmullclark = WeaverbirdsCatmullClarkSubdivision(MeshCurves=mesh, Level=Slider(3, range=1..3), SmoothNakedEdges=number_slider)
wbcatmullclark_2 = WeaverbirdsCatmullClarkSubdivision(MeshCurves=wbcatmullclark, Level=Slider(2, range=1..3), SmoothNakedEdges=number_slider)
# <title>
# 
# <description>
# 
# code by Alessio Erioli
# 
# v 0.1
mesh_2 = Mesh(wbcatmullclark_2)
demesh = DeconstructMesh(Mesh=mesh_2)  # -> Vertices, Faces, Colours, Normals
perlin = PerlinNoise(Values=demesh.Vertices, Time=Slider(0, range=0..10), Scale=Slider(0.03, range=0..1))
pi = Pi(Factor=Slider(7, range=0..30))
Z = UnitZ(Factor=1)
lng = ListLength(List=demesh.Vertices)
xprod = CrossProduct(VectorA=demesh.Normals, VectorB=Z, Unitize=False)  # -> Vector, Length
random = Random(Range=lng, Number=Slider(200, range=2..5000), Seed=2, Integers=True)
multiplication = Multiplication(A=perlin, B=pi)
cset = CreateSet(List=random)  # -> Set, Map
vrot = Rotate(Vector=xprod.Vector, Axis=demesh.Normals, Angle=multiplication)
vrot_2 = Rotate(Vector=xprod.Vector, Axis=demesh.Normals, Angle="Pi*0.5")
lng_2 = ListLength(List=cset.Set)
item = ListItem(List=demesh.Normals, Index=cset.Set, Wrap=True)
gradient = Gradient(LowerLimit="-1", UpperLimit=1, Parameter=perlin, stops=[0: RGB(0, 0, 0), 1: RGB(255, 255, 255)])
Z_2 = UnitZ(Factor=1)
random_2 = Random(Range="-Pi to Pi", Number=lng_2, Seed="3")
vec = Vector(vrot_2)
xprod_2 = CrossProduct(VectorA=item, VectorB=Z_2, Unitize=False)  # -> Vector, Length
dir_type = ValueList({"desktop": 0, "documents": 1, "GH file path": 2, "C:": 3}, selected="GH file path")
amp = Amplitude(Vector=vec, Amplitude=Slider(0.543, range=0..1))
vrot_3 = Rotate(Vector=xprod_2.Vector, Axis=item, Angle=random_2)
item_2 = ListItem(List=demesh.Vertices, Index=cset.Set, Wrap=True)
file_name = Panel("AgentSystem.cs")
conmesh = ConstructMesh(Vertices=demesh.Vertices, Faces=demesh.Faces, Colours=gradient)
f_pathg = PathGenerator(type=dir_type, subDir="AgentSystem")  # -> dir; inputs type: Int32, subDir: String
# ---------- f_pathg: C# ----------
                           /*
    froGH - a sparse collection of (in)utilities for Grasshopper

    Path Generator
    code by Alessio Erioli - value list generation based on code by James Ramsden

    froGH by Co-de-iT is licensed under a Creative Commons Attribution 4.0 International License.
    http://creativecommons.org/licenses/by/4.0/

    */
    initComp();


    String S = "";
    String root = "";
    String end = "\\";
    String eol = Environment.NewLine;

    // __________________ autoList part __________________

    // variable for the list
    Grasshopper.Kernel.Special.GH_ValueList vList;
    // tries to cast input as list
    try{

      // if the list is not the first parameter then change Input[0] to the corresponding value
      vList = (Grasshopper.Kernel.Special.GH_ValueList) Component.Params.Input[0].Sources[0];
      // Print("value list connected");
      // check if the list must be created
      //if (vList.NickName != "dir type"){
      if (!vList.NickName.Equals("dir type")){
        vList.ClearData();
        vList.ListItems.Clear();
        vList.NickName = "dir type";
        var item1 = new Grasshopper.Kernel.Special.GH_ValueListItem("desktop", "0");
        var item2 = new Grasshopper.Kernel.Special.GH_ValueListItem("documents", "1");
        var item3 = new Grasshopper.Kernel.Special.GH_ValueListItem("GH file path", "2");
        var item4 = new Grasshopper.Kernel.Special.GH_ValueListItem("C:", "3");
        vList.ListItems.Add(item1);
        vList.ListItems.Add(item2);
        vList.ListItems.Add(item3);
        vList.ListItems.Add(item4);

        vList.ListItems[0].Value.CastTo(out type);
      }
    }
    catch{
      // handles anything that is not a value list
    }


    switch(type){
      case 0:
        root = Environment.GetFolderPath(Environment.SpecialFolder.Desktop) + end;
        S = "Desktop";
        break;
      case 1:
        root = Environment.GetFolderPath(Environment.SpecialFolder.MyDocuments) + end;
        S = "Documents";
        break;
      case 2:
        GH_Document ghDoc = owner.OnPingDocument();

        if (ghDoc.IsFilePathDefined)
        {
          int nameLen = ghDoc.DisplayName.TrimEnd('*').Length + 3; // +3 accounts for the '.gh' extension
          int fileLen = ghDoc.FilePath.TrimEnd('*').Length;

          //F = ghDoc.DisplayName.TrimEnd('*');
          root = ghDoc.FilePath.Substring(0, fileLen - nameLen);
          //root = gh_d.FilePath;
          S = "GH File path";
        }
        else
        {
          Print("No path defined. Saving to Desktop until then");
          root = Environment.GetFolderPath(Environment.SpecialFolder.Desktop);
          S = "Desktop";
        }
        break;
      case 3:
        root = "C:" + end;
        S = root + end;
        break;
    }
    dir = root + (subDir != null ? (subDir + end) : "");
    Component.Message = S;
# ---------- f_pathg: C# additional code ----------
  void initComp(){
    Component.Name = "Path Generator";
    Component.NickName = "f_PathG";
    Component.Description = "generates a path based on local direcories such as Desktop, Documents, GH file path";
    Component.Params.Input[0].Name = "dir type";
    Component.Params.Input[0].Description = "directory type: 0 desktop, 1 documents, 2 GH file path, 3 C:\nconnect a value list for automatic list generation";
    Component.Params.Input[1].Name = "custom subdir";
    Component.Params.Input[1].Description = "(optional) custom subdirectory";
  }
# ---------- end f_pathg ----------
vdisex = VectorDisplayEx(Point=demesh.Vertices, Vector=amp, Colour=RGB(0, 0, 0), Width=2)
unit = UnitVector(Vector=vrot_3)
nr = Slider(5, range=0..5)
concat = Concatenate(FragmentA=f_pathg, FragmentB=file_name)
panel = Panel(concat)
reset = Button()
go = BooleanToggle(False)
multiplication_2 = Multiplication(A=nr, B=Slider(0.824, range=0..1))
panel_2 = Panel(multiplication_2)
path = FilePath(concat)
c_script = CSharpScript(
    reset=reset,
    go=go,
    M=conmesh,
    MVf=vec,
    meI=Slider(5, range=0..50),
    P=item_2,
    V=unit,
    nR=nr,
    coS=Slider(0.327, range=0..50),
    alS=Slider(9.029, range=0..50),
    seS=Slider(1.949, range=0..50),
    seR=multiplication_2,
    tSpac=Slider(3, range=0..10))  # -> out, Ap, Av, neigh, Tr; inputs reset: Boolean, go: Boolean, M: Mesh, MVf: list of Vector3d, meI: Double, P: list of Point3d, V: list of Vector3d, nR: Double, coS: Double, alS: Double, seS: Double, seR: Double, tSpac: Double
# ---------- c_script: C# usings ----------
using System.Threading;
using System.Threading.Tasks;
# ---------- c_script: C# ----------
        GH_Point[] ptsOut;
        GH_Vector[] vecOut;
        Polyline[] trails;
        DataTree<GH_Point> neighOut;

        if (reset || AgSys == null /*|| MPoints == null*/)
        {
            AgSys = new AgentSystem(P, V);
            //MPoints = PointCloudFromMesh(M);
            Menv = M;
            MeshRTree = RTreeFromMesh(M);
            MeshField = BuildMeshField(M, MVf);
            //ptsOut = new GH_Point[Flock.Agents.Count];
            //vecOut = new GH_Vector[Flock.Agents.Count];
        }

        if (go)
        {
            // update parameters
            AgSys.NeighborhoodRadius = nR;
            AgSys.CohesionStrength = coS;
            AgSys.AlignmentStrength = alS;
            AgSys.SeparationStrength = seS;
            AgSys.SeparationRadius = seR;
            AgSys.MeshStrength = meI;
            AgSys.TrailSpacing = tSpac;
            AgSys.futPosMultiplier = 1.5;
            AgSys.MeshSeekRadius = 5.0;

            // update system
            //AgSys.Update();
            AgSys.UpdateRTree();
            Component.ExpireSolution(true);
        }

        AgSys.GetPtsVecs(out ptsOut, out vecOut);
        neighOut = GetNeighbours(AgSys);
        trails = AgSys.GetTrails();

        Ap = ptsOut;
        Av = vecOut;
        neigh = neighOut;
        Tr = trails;
# ---------- c_script: C# additional code ----------
 

    // global variables
    public AgentSystem AgSys;
    public static TensorPoint[] MeshField;
    public static Mesh Menv;
    public static RTree MeshRTree;

    // classes

    public class AgentSystem
    {
        public List<Agent> Agents;
        public List<Polyline> AgentsTrails;
        public double NeighborhoodRadius;
        public double CohesionStrength;
        public double AlignmentStrength;
        public double SeparationStrength;
        public double SeparationRadius;
        public double MaxSpeed;
        public double BoundingBoxSize;
        public double ContainmentStrength;
        public double MeshStrength;
        public double TrailSpacing;
        public double futPosMultiplier;
        public double MeshSeekRadius;
        public double SeekColorStrength;

        public AgentSystem(List<Point3d> P, List<Vector3d> V)
        {
            Agents = new List<Agent>();

            for (int i = 0; i < P.Count; i++)
            {
                Agent ag = new Agent(P[i], V[i]);
                ag.Agents = this;

                Agents.Add(ag);
            }

            MaxSpeed = 0.3;
            BoundingBoxSize = 30.0;
            ContainmentStrength = 1.0;
            SeekColorStrength = 5.0;
        }

        public void Update()
        {
            // . . . . . . . . . . . . . . . . . . . . . . step 1 - calculate desired
            /*
             function(param a, param b, ....) {...}

            (param a, param b, ....) => {...}
             
             */
            Parallel.ForEach(Agents, ag =>
            {
                // find neighbours & compute desired velocity for each agent

                ComputeAgentDesiredVelocity(ag);
            });

            //foreach (Agent ag in Agents)
            //{
            //    // find neighbours & compute desired velocity for each agent
            //    ComputeAgentDesiredVelocity(ag);
            //}

            // . . . . . . . . . . . . . . . . . . . . . . step 2 - update agents velocity and position
            foreach (Agent ag in Agents) ag.UpdateVelocityAndPosition();
        }



        public void UpdateRTree()
        {

            foreach (Agent ag in Agents)
            {
                // clear neighbours list
                ag.neighbours.Clear();
                ag.neighTens.Clear();

                // Eventhandler function for RTree search
                EventHandler<RTreeEventArgs> rTreeCallback = (object sender, RTreeEventArgs args) =>
                {
                    ag.neighbours.Add(Menv.Vertices[args.Id]);
                    ag.neighTens.Add(MeshField[args.Id]);
                };

                //                   Sphere                                                                                 , callback function
                MeshRTree.Search(new Sphere(Menv.ClosestPoint(ag.position + ag.velocity * futPosMultiplier), MeshSeekRadius), rTreeCallback);

                ag.ResetDesired();
                ag.SeekMeshNeighbours(MeshStrength);
                ag.SeekColor(SeekColorStrength);

            }

            //FlockTrails();


            if (Agents.Count > 500)
            {
                Parallel.ForEach(Agents, ag =>
                {
                    ag.UpdateVelocityAndPosition();
                });
            }
            else
                foreach (Agent ag in Agents)
                    ag.UpdateVelocityAndPosition();

        }

        public void FlockTrails()
        {
            List<Polyline> AllTrails = new List<Polyline>();
            foreach (Agent ag in Agents)
                AllTrails.Add(ag.trail);

            // find closest trail point and dir for agent

            foreach (Agent ag in Agents)
            {
                double trailPar;
                Point3d testPoint = new Point3d();
                Point3d nearest = new Point3d();
                Point3d futPos = ag.position + ag.velocity;
                Vector3d nearestDir = new Vector3d();
                double dd;
                double MinD = Double.MaxValue;
                foreach (Polyline tr in AllTrails)
                {
                    // if it's not the trail of the current agent....
                    if (AllTrails.IndexOf(tr) != Agents.IndexOf(ag))
                    {
                        // evaluate closest point and its distance
                        trailPar = tr.ClosestParameter(futPos);
                        testPoint = tr.PointAt(trailPar);
                        dd = testPoint.DistanceToSquared(futPos);
                        // if closer that the min distance
                        if (dd < MinD)
                        {
                            MinD = dd;
                            nearest = new Point3d(testPoint);
                            nearestDir = tr.TangentAt(trailPar);
                        }
                    }

                }

                ag.FlockSinglePoint(nearest, nearestDir);
            }
        }

        public List<Agent> FindNeighbours(Agent ag)
        {
            List<Agent> neighbours = new List<Agent>();

            foreach (Agent neighbour in Agents)
            {
                if (neighbour != ag && neighbour.position.DistanceTo(ag.position) < NeighborhoodRadius)
                    neighbours.Add(neighbour);
            }

            return neighbours;
        }

        public void ComputeAgentDesiredVelocity(Agent ag)
        {
            List<Agent> neighbours = FindNeighbours(ag);
            ag.ResetDesired();
            ag.ComputeDesiredVelocity(neighbours);
        }

        // extract points and vectors for output
        public void GetPtsVecs(out GH_Point[] pts, out GH_Vector[] vecs)
        {
            pts = new GH_Point[Agents.Count];
            vecs = new GH_Vector[Agents.Count];

            for (int i = 0; i < Agents.Count; i++)
            {
                pts[i] = new GH_Point(Agents[i].position);
                vecs[i] = new GH_Vector(Agents[i].velocity);
            }
        }

        public Polyline[] GetTrails()
        {
            Polyline[] trails = new Polyline[Agents.Count];

            Parallel.For(0, Agents.Count, i =>
              {
                  trails[i] = Agents[i].trail;
              });
            return trails;
        }

    }

    public class Agent
    {
        // field
        public Point3d position;
        public Vector3d velocity;
        public Vector3d desiredVelocity;
        public Polyline trail;
        public AgentSystem Agents;
        public List<Point3d> neighbours;
        public List<TensorPoint> neighTens;

        // constructor
        public Agent(Point3d position, Vector3d velocity)
        {
            this.position = position;
            this.velocity = velocity;
            desiredVelocity = this.velocity;
            trail = new Polyline { this.position };
            neighbours = new List<Point3d>();
            neighTens = new List<TensorPoint>();
        }

        // methods
        public void ResetDesired()
        {
            desiredVelocity = velocity;
        }

        public void ComputeDesiredVelocity(List<Agent> neighbours)
        {
            // ------------------------------- CONTAINMENT -------------------------------
            //Containment();
            // ------------------------------- FLOCKING -------------------------------
            if (neighbours.Count > 0)
            {
                Flock(neighbours);
            }

            // ------------------------------- POINT CLOUD or MESH BEHAVIOUR -------------------------------
            //SeekPointCloud(MPoints);
            //SeekMeshClosestPt(Menv);
            // ------------------------------- FIELD BEHAVIOUR -------------------------------

            // ------------------------------- CUSTOM MOVEMENT BEHAVIOUR ---------------------
        }

        public void Containment()
        {


            if (position.X < 0.0)
                desiredVelocity += new Vector3d(-position.X, 0.0, 0.0);
            else if (position.X > Agents.BoundingBoxSize)
                desiredVelocity += new Vector3d(Agents.BoundingBoxSize - position.X, 0, 0);

            if (position.Y < 0.0)
                desiredVelocity += new Vector3d(0.0, -position.Y, 0.0);
            else if (position.Y > Agents.BoundingBoxSize)
                desiredVelocity += new Vector3d(0.0, Agents.BoundingBoxSize - position.Y, 0.0);

            if (position.Z < 0.0)
                desiredVelocity += new Vector3d(0.0, 0.0, -position.Z);
            else if (position.Z > Agents.BoundingBoxSize)
                desiredVelocity += new Vector3d(0.0, 0.0, Agents.BoundingBoxSize - position.Z);

            desiredVelocity *= Agents.ContainmentStrength;
        }

        public void Flock(List<Agent> neighbours)
        {
            // ................................... COHESION BEHAVIOUR .....................
            //
            // find neighbours average
            Point3d average = new Point3d();

            foreach (Agent neighbour in neighbours)
                average += neighbour.position;

            average /= neighbours.Count;

            // go there
            Vector3d cohesion = average - position;

            desiredVelocity += Agents.CohesionStrength * cohesion;

            // ................................... ALIGNMENT BEHAVIOUR .....................
            //
            Vector3d alignment = Vector3d.Zero;

            foreach (Agent neighbour in neighbours)
                alignment += neighbour.velocity;

            alignment /= neighbours.Count;

            desiredVelocity += alignment * Agents.AlignmentStrength;

            // ................................... SEPARATION BEHAVIOUR .....................
            //
            Vector3d separation = Vector3d.Zero;

            foreach (Agent neighbour in neighbours)
            {
                double distanceToNeighbour = position.DistanceTo(neighbour.position);
                if (distanceToNeighbour < Agents.SeparationRadius)
                {
                    Vector3d getAway = position - neighbour.position;
                    separation += getAway /= (getAway.Length * distanceToNeighbour);
                }

            }

            desiredVelocity += separation * Agents.SeparationStrength;

        }

        public void FlockSinglePoint(Point3d target, Vector3d targetVel)
        {
            // ................................... COHESION BEHAVIOUR .....................
            //
            // go there
            Vector3d cohesion = target - position;

            desiredVelocity += Agents.CohesionStrength * cohesion;

            // ................................... ALIGNMENT BEHAVIOUR .....................
            //
            Vector3d alignment = Vector3d.Zero;

            desiredVelocity += targetVel * Agents.AlignmentStrength;

            // ................................... SEPARATION BEHAVIOUR .....................
            //
            Vector3d separation = Vector3d.Zero;

            double distanceToNeighbour = position.DistanceTo(target);
            if (distanceToNeighbour < Agents.SeparationRadius)
            {
                Vector3d getAway = position - target;
                separation += getAway /= (getAway.Length * distanceToNeighbour);
            }
            desiredVelocity += separation * Agents.SeparationStrength;
        }

        public void SeekPoint(Point3d target, double intensity)
        {
            Vector3d seek = target - position;
            seek.Unitize();
            seek *= Agents.MaxSpeed;

            desiredVelocity += seek * intensity;
        }

        public void SeekPointCloud(PointCloud pc)
        {
            Point3d futurePos = (Point3d)(position + velocity * 3.5);
            int pcIndex = pc.ClosestPoint(futurePos);
            Point3d p = pc[pcIndex].Location;

            SeekPoint(p, Agents.MeshStrength);

        }

        public void SeekMeshClosestPt(Mesh M)
        {
            Point3d mP = M.ClosestPoint(position + velocity * 1.5);
            SeekPoint(mP, Agents.MeshStrength);

        }

        public void SeekMeshNeighbours(double seekIntensity)
        {
            //desiredVelocity = velocity;
            if (neighbours.Count > 0)
            {

                Point3d average = new Point3d();

                foreach (Point3d n in neighbours)
                {
                    average += n;
                }

                average /= neighbours.Count;
                SeekPoint(average, seekIntensity);
            }
        }

        public void SeekColor(double seekIntensity)
        {

            if (neighTens.Count > 0)
            {
                double bri;
                double MaxBri = -1.0;
                int MaxInd = -1;

                // find point with max intensity
                for (int i = 0; i < neighTens.Count; i++)
                {
                    bri = neighTens[i].scalar; // brightness is 0-1 and RGB 0-255
                    if (bri > MaxBri)
                    {
                        MaxBri = bri;
                        MaxInd = i;
                    }
                }

                Vector3d seek = (neighTens[MaxInd].position - position) * 0.08 + neighTens[MaxInd].vector * 0.92;
                seek.Unitize();
                seek *= Agents.MaxSpeed;

                desiredVelocity += seek * seekIntensity;

            }
        }

        public void UpdateVelocityAndPosition()
        {
            // steering method
            velocity = 0.97 * velocity + 0.03 * desiredVelocity;

            // limit the velocity to maximum speed (0.5)
            if (velocity.Length > Agents.MaxSpeed)
            {
                velocity.Unitize();
                velocity *= Agents.MaxSpeed;
            }

            position +=velocity;

            if (position.DistanceTo(trail[trail.Count - 1]) > Agents.TrailSpacing)
                trail.Add(position);
            //trail.Add(position);

        }

        public List<GH_Point> GetNeighbours()
        {
            List<GH_Point> neighOut = new List<GH_Point>();

            foreach (Point3d n in neighbours)
                neighOut.Add(new GH_Point(n));

            return neighOut;
        }

    }

    public class TensorPoint
    {
        public Point3d position;
        public Vector3d vector;
        public double scalar;

        public TensorPoint(Point3d position, Vector3d vector, double scalar)
        {
            this.position = position;
            this.vector = vector;
            this.scalar = scalar;
        }
    }

    // utilities functions
    public PointCloud PointCloudFromMesh(Mesh M)
    {
        PointCloud pc = new PointCloud();

        for (int i = 0; i < M.Vertices.Count; i++)
        {
            pc.Add(M.Vertices[i], M.Normals[i]);
        }

        return pc;
    }

    public RTree RTreeFromMesh(Mesh M)
    {

        return RTree.CreateFromPointArray(M.Vertices.ToPoint3dArray());
        //RTree MPoints = new RTree();

        //for (int i = 0; i < M.Vertices.Count; i++)
        //    MPoints.Insert(M.Vertices[i], i);

        //return MPoints;
    }

    public TensorPoint[] BuildMeshField(Mesh M, List<Vector3d> VectorField)
    {
        TensorPoint[] MeshField = new TensorPoint[M.Vertices.Count];
        TensorPoint tp;
        for (int i = 0; i < M.Vertices.Count; i++)
        {
            tp = new TensorPoint(M.Vertices[i], VectorField[i], M.VertexColors[i].GetBrightness());
            MeshField[i] = tp;
        }

        return MeshField;
    }

    public DataTree<GH_Point> GetNeighbours(AgentSystem AgSys)
    {
        DataTree<GH_Point> neighOut = new DataTree<GH_Point>();

        for (int i = 0; i < AgSys.Agents.Count; i++)
        {
            neighOut.AddRange(AgSys.Agents[i].GetNeighbours(), new GH_Path(i));
        }

        return neighOut;
    }
# ---------- end c_script ----------
ftsv2 = FileToScriptV2(File=path)
swatch = ColourSwatch(SwatchColor=RGB(145, 121, 121))
panel_3 = Panel(c_script.out)
pt = Point(c_script.neigh)  # disabled
crv = Curve(c_script.Tr)
body_size = Slider(10, range=0..10)
vdisex_2 = VectorDisplayEx(Point=c_script.Ap, Vector=c_script.Av, Colour=swatch, Width=2)
dam = DataDam(DataA=crv, BufferDelay=10000000, BufferMode=0)
preview = CustomPreview(Geometry=crv, Material=swatch)
item_3 = ListItem(List=dam, Index=Slider(18, range=0..100), Wrap=True)
cir = Circle(Plane=PlaneXY(0, 0, 0), Radius=expr("x*0.5", body_size))
divlength = DivideLength(Curve=dam, Length=body_size)  # -> Points, Tangents, Parameters

# ---- group: body curves
crv_2 = Curve([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])

# ----
group = Group(Objects=crv_2)
cull_i = CullIndex(List=divlength.Points, Indices="-1", Wrap=True)
meshcp = MeshClosestPoint(Point=cull_i, Mesh=conmesh)  # -> Point, Index, Parameter
meval = MeshEval(Mesh=conmesh, Parameter=meshcp.Parameter)  # -> Point, Normal, Colour
vec_2 = Vector(divlength.Tangents)
xprod_3 = CrossProduct(VectorA=vec_2, VectorB=meval.Normal, Unitize=False)  # -> simplify(Vector), Length
pl = ConstructPlane(Origin=cull_i, XAxis=vec_2, YAxis=xprod_3.Vector)
orient = Orient(Geometry=group, Source=PlaneXY(0, 0, 0), Target=pl)  # -> Geometry, Transform
ungroup = Ungroup(Group=orient.Geometry)
explode = Explode(Curve=ungroup, Recursive=True)  # -> Segments, Vertices
meshcp_2 = MeshClosestPoint(Point=explode.Vertices, Mesh=conmesh)  # -> Point, Index, Parameter
intcrv = Interpolate(Vertices=meshcp_2.Point, Degree=3, Periodic=False, KnotStyle=1)  # -> Curve, Length, Domain
pline = PolyLine(Vertices=meshcp_2.Point, Closed=False)
