# Grasshopper definition 00_iterative strategies - intuition.gh (Grasshopper 1.0.7)
# Copyright: Co-de-iT
# plug-ins: Anemone

pt = Point(Point(0, 0, 0))
vec = Vector(Vector(-1, 0.5, 0))
pt_2 = Point(Point(-2, -1, 0))
vec_2 = Vector(Vector(1, 0.5, 0))
entwine = Entwine(Branch00=pt, Branch01=pt_2, FlattenInputs=True)  # -> simplify(Result)
entwine_2 = Entwine(Branch00=vec_2, Branch01=vec, FlattenInputs=True)  # -> simplify(Result)
entwine_3 = Entwine(Branch00=Slider(50, range=0..100), Branch01=Slider(46, range=0..100), FlattenInputs=True)
n_points = Slider(50, range=2..50)
seed = Slider(24, range=1..100)
# constant velocity
number_slider = Slider(41, range=0..100)
start = Button()
pt_3 = Point(Point(0, 0, 0))
vec_3 = Vector(Vector(2, 1, 0))
# changing velocity
number_slider_2 = Slider(100, range=0..100)
start_2 = Button()
pt_4 = Point(Point(0, 0, 0))
vec_4 = Vector(Vector(1, 0.5, 0))
start_3 = Button()
pt_5 = Point(Point(0, 0, 0))
vec_5 = Vector(Vector(1, 0.5, 0))
start_4 = Button()
# changing acceleration
number_slider_3 = Slider(100, range=0..100)
# a more general way to record data
number_slider_4 = Slider(100, range=0..100)
pt_6 = Point(Point(0, 0, 0))
vec_6 = Vector(Vector(1, 0.5, 0))
start_5 = Button()
rectangle = Rectangle(Plane=PlaneXY(0, 0, 0), XSize="-5 to 5", YSize="-5 to 5", Radius=0)  # -> Rectangle, Length
# working with multiple points
number_slider_5 = Slider(100, range=0..100)
vlen = VectorLength(Vector=vec_5)
pt_7 = Point(Point(0, 0, 0))
vec_7 = Vector(Vector(2, 1, 0))
vlen_2 = VectorLength(Vector=vec_6)
pop2d = Populate2D(Region=rectangle.Rectangle, Count=n_points, Seed=1)  # -> simplify(graft(Population))
random_vectors_2d = CSharpScript(n=n_points, S=seed)  # -> out, simplify(graft(V)); inputs n: Int32, S: Int32
# ---------- random_vectors_2d: C# ----------
    if (n <= 0 || S < 0) return;

    List <Vector3d> vecs = new List<Vector3d>();
    Vector3d v;
    rnd = new Random(S);

    for (int i = 0; i < n; i++)
    {
      v = new Vector3d(1, 0, 0);
      v.Rotate(rnd.NextDouble() * Math.PI * 2, Vector3d.ZAxis);
      vecs.Add(v);
    }

    V = vecs;
# ---------- random_vectors_2d: C# additional code ----------
  Random rnd;
# ---------- end random_vectors_2d ----------
random = Random(Range="0 to 1000", Number=n_points, Seed=2, Integers=True)  # -> simplify(graft(Random))
move = Move(Geometry=pt_7, Motion=vec_7)  # -> Geometry, Transform
loop_start = LoopStart(Repeat=number_slider, Trigger=start, Data=pt_3)  # -> port, Counter, Data; disabled
loop_start_2 = LoopStart(N=number_slider_2, T=start_2, D0=pt_4, D1=vec_4)  # -> port, Counter, Data, Data_2; disabled
loop_start_3 = LoopStart(N=number_slider_3, T=start_3, D0=pt_5, D1=vec_5)  # -> port, Counter, Data, Data_2; disabled
loop_start_4 = LoopStart(N=number_slider_4, T=start_4, D0=pt_6, D1=vec_6)  # -> port, Counter, Data, Data_2; disabled
random_2 = Random(Range=Domain(0, 1), Number=number_slider_2, Seed=Slider(46, range=0..100))
random_3 = Random(Range=Domain(0, 1), Number=number_slider_4, Seed=Slider(46, range=0..100))
random_4 = Random(Range=Domain(0, 1), Number=number_slider_3, Seed=Slider(46, range=0..100))
max_angle = Slider(0.25, range=0..0.5)
max_angle_2 = Slider(0.295, range=0..0.5)
move_2 = Move(Geometry=move.Geometry, Motion=vec_7)  # -> Geometry, Transform
# 00_iterative strategies - intuition
# 
# iterative strategies intuition approach
# 
# code by Alessio Erioli
# 
# v 0.1
move_3 = Move(Geometry=move_2.Geometry, Motion=vec_7)  # -> Geometry, Transform
move_4 = Move(Geometry=loop_start.Data, Motion=vec_3)  # -> Geometry, Transform
item = ListItem(List=random_2, Index=loop_start_2.Counter, Wrap=True)
item_2 = ListItem(List=random_4, Index=loop_start_3.Counter, Wrap=True)
loop_start_5 = LoopStart(N=number_slider_5, T=start_5, D0=pop2d, D1=random_vectors_2d.V)  # -> port, Counter, Data, Data_2; disabled
vdisex = VectorDisplayEx(Point=pop2d, Vector=random_vectors_2d.V, Colour=RGB(0, 0, 0), Width=2)
random_5 = Random(Range=Domain(0, 1), Number=number_slider_5, Seed=random)
item_3 = ListItem(List=loop_start_4.Data, Index="-1", Wrap=True)
item_4 = ListItem(List=loop_start_4.Data_2, Index="-1", Wrap=True)
expression = Expression(x=item, y=max_angle, Expression="((x*2)-1)*y*π")
expression_2 = Expression(x=item_2, y=max_angle_2, Expression="((x*2)-1)*y*π")
max_angle_3 = Slider(0.295, range=0..0.5)
loop_end = LoopEnd(port=loop_start.port, Exit=False, Data=move_4.Geometry, TimeOutVal=0, pausedState=False, state="Constant output")
vdisex_2 = VectorDisplayEx(Point=move_4.Geometry, Vector=vec_3, Colour=RGB(0, 0, 0), Width=2)
item_5 = ListItem(List=loop_start_5.Data, Index="-1", Wrap=True)
item_6 = ListItem(List=loop_start_5.Data_2, Index="-1", Wrap=True)
Z = UnitZ(Factor=1)
item_7 = ListItem(List=random_3, Index=loop_start_4.Counter, Wrap=True)
pt_8 = Point(loop_end)
max_angle_4 = Slider(0.5, range=0..0.5)
Z_2 = UnitZ(Factor=1)
vrot = Rotate(Vector=loop_start_3.Data_2, Axis=Z, Angle=expression_2)
expression_3 = Expression(x=item_7, y=max_angle_3, Expression="((x*2)-1)*y*π")
vrot_2 = Rotate(Vector=loop_start_2.Data_2, Axis=Z_2, Angle=expression)
item_8 = ListItem(List=random_5, Index=loop_start_5.Counter, Wrap=True)
Z_3 = UnitZ(Factor=1)
addition = Addition(A=loop_start_3.Data_2, B=vrot)
move_5 = Move(Geometry=loop_start_2.Data, Motion=vrot_2)  # -> Geometry, Transform
expression_4 = Expression(x=item_8, y=max_angle_4, Expression="((x*2)-1)*y*π")
vrot_3 = Rotate(Vector=item_4, Axis=Z_3, Angle=expression_3)
amp = Amplitude(Vector=addition, Amplitude=vlen)
Z_4 = UnitZ(Factor=1)
loop_end_2 = LoopEnd(
    port=loop_start_2.port,
    Exit=False,
    Data=move_5.Geometry,
    Data_2=vrot_2,
    TimeOutVal=0,
    pausedState=False,
    state="Constant & Record")  # -> D0, D1
vdisex_3 = VectorDisplayEx(Point=move_5.Geometry, Vector=vrot_2, Colour=ColourSwatch(SwatchColor=RGB(255, 255, 255)), Width=2)
vrot_4 = Rotate(Vector=item_6, Axis=Z_4, Angle=expression_4)
move_6 = Move(Geometry=loop_start_3.Data, Motion=amp)  # -> Geometry, Transform
addition_2 = Addition(A=item_4, B=vrot_3)
vec_8 = Vector(loop_end_2.D1)
pt_9 = Point(loop_end_2.D0)
max_speed = Slider(1, range=0..2)
amp_2 = Amplitude(Vector=addition_2, Amplitude=vlen_2)
vdisex_4 = VectorDisplayEx(Point=pt_9, Vector=vec_8, Colour=RGB(0, 0, 0), Width=1)
loop_end_3 = LoopEnd(
    port=loop_start_3.port,
    Exit=False,
    Data=move_6.Geometry,
    Data_2=amp,
    TimeOutVal=0,
    pausedState=False,
    state="Constant & Record")  # -> D0, D1
vdisex_5 = VectorDisplayEx(Point=move_6.Geometry, Vector=amp, Colour=ColourSwatch(SwatchColor=RGB(255, 255, 255)), Width=2)
addition_3 = Addition(A=item_6, B=vrot_4)
move_7 = Move(Geometry=item_3, Motion=amp_2)  # -> Geometry, Transform
amp_3 = Amplitude(Vector=addition_3, Amplitude=max_speed)
vec_9 = Vector(loop_end_3.D1)
pt_10 = Point(loop_end_3.D0)
vdisex_6 = VectorDisplayEx(Point=pt_10, Vector=vec_9, Colour=RGB(0, 0, 0), Width=1)
move_8 = Move(Geometry=item_5, Motion=amp_3)  # -> Geometry, Transform
merge = Merge(Data1=loop_start_4.Data_2, Data2=flatten(amp_2))
merge_2 = Merge(Data1=loop_start_4.Data, Data2=flatten(move_7.Geometry))
vdisex_7 = VectorDisplayEx(Point=move_7.Geometry, Vector=amp_2, Colour=ColourSwatch(SwatchColor=RGB(255, 255, 255)), Width=2)
loop_end_4 = LoopEnd(
    port=loop_start_4.port,
    Exit=False,
    Data=simplify(merge_2),
    Data_2=simplify(merge),
    TimeOutVal=0,
    pausedState=False,
    state="Constant output")  # -> D0, D1
vdisex_8 = VectorDisplayEx(Point=move_8.Geometry, Vector=amp_3, Colour=ColourSwatch(SwatchColor=RGB(255, 255, 255)), Width=2)
merge_3 = Merge(Data1=loop_start_5.Data_2, Data2=simplify(amp_3))
merge_4 = Merge(Data1=loop_start_5.Data, Data2=simplify(move_8.Geometry))
pt_11 = Point(loop_end_4.D0)
vec_10 = Vector(loop_end_4.D1)
vdisex_9 = VectorDisplayEx(Point=pt_11, Vector=vec_10, Colour=RGB(0, 0, 0), Width=1)
loop_end_5 = LoopEnd(
    port=loop_start_5.port,
    Exit=False,
    Data=simplify(merge_4),
    Data_2=simplify(merge_3),
    TimeOutVal=0,
    pausedState=False,
    state="Constant output")  # -> D0, D1
pt_12 = Point(loop_end_5.D0)
vec_11 = Vector(loop_end_5.D1)
vdisex_10 = VectorDisplayEx(Point=pt_12, Vector=vec_11, Colour=RGB(0, 0, 0), Width=1)
