# Grasshopper definition ICD CS 2017 review.gh (Grasshopper 1.0.7)
# Copyright: Co-de-iT
# plug-ins: Volvox

pt = Point(Point(23.33233518, 24.78155449, 0))
number_slider = Slider(5, range=0..10)

# ---- group: Chaikin subdivision scheme
pt_2 = Point([Point(-3.35970186, -6.854583452, 0), Point(-7.112248812, 30.76989789, 0), Point(15.42326619, 7.208448985, 0), Point(33.38196689, 13.79126817, 0), Point(31.25530172, 48.0701915, 0), Point(48.80216155, 61.22971664, 0), Point(72.32364106, 32.84922398, 0), Point(48.0619561, -1.61260102, 0)])
c_script = CSharpScript(cP=pt_2, iC=Slider(1, range=0..10))  # -> out, C; inputs cP: list of Point3d, iC: Int32
# ---------- c_script: C# ----------
    for (int j = 0; j < iC; j++)
    {
      List<Point3d> newCP = new List<Point3d>();
      
      for(int i = 0; i < cP.Count - 1; i++)
      {
        Point3d oneQPt = 0.75 * cP[i] + 0.25 * cP[i + 1];
        newCP.Add(oneQPt);
        
        Point3d threeQPt = 0.25 * cP[i] + 0.75 * cP[i + 1];
        newCP.Add(threeQPt);
      }
      
      cP = newCP;
    }
    
    C = new PolylineCurve(cP);
# ---------- end c_script ----------
explode = Explode(Curve=c_script.C, Recursive=True)  # -> Segments, Vertices

# ---- group: adaptive curve subdivision - De Casteljau algorithm
crv = Curve(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)
c_script_2 = CSharpScript(curve=crv, tolerance=Slider(0.729, range=0.001..2))  # -> out, outputSegments; inputs curve: Curve, tolerance: Double
# ---------- c_script_2: C# ----------
    /*
  adaptive curve subdivision - De Casteljau algorithm
  code by Long Nguyen - revisited by Alessio Erioli
  
  */
    
    curve.Domain = new Interval(0, 1);
    List<LineCurve> segments = new List<LineCurve>();
    DivideCurve(curve, 0.0, 1.0, tolerance, segments);
    outputSegments = segments;
# ---------- c_script_2: C# additional code ----------
  void DivideCurve(Curve curve, double tStart, double tEnd, double tolerance, List<LineCurve> segments)
  {
    Point3d startPoint = curve.PointAt(tStart);
    Point3d endPoint = curve.PointAt(tEnd);
    Point3d middlePoint = 0.5 * (startPoint + endPoint);

    double tClosest;
    curve.ClosestPoint(middlePoint, out tClosest);

    double distance = curve.PointAt(tClosest).DistanceTo(middlePoint);

    if (distance < tolerance)
      segments.Add(new LineCurve(startPoint, endPoint));
    else
    {
      double tMiddle = 0.5 * (tStart + tEnd);
      DivideCurve(curve, tStart, tMiddle, tolerance, segments);
      DivideCurve(curve, tMiddle, tEnd, tolerance, segments);
    }
  }
# ---------- end c_script_2 ----------
end = EndPoints(Curve=c_script_2.outputSegments)  # -> Start, End
join = JoinCurves(Curves=c_script_2.outputSegments, Preserve=False)

# ---- group: a class
vec = Vector(Vector(0.1, 0.3, 0))
pt_3 = Point(Point(0, 0, 0))
c_script_3 = CSharpScript(reset=Button(), P=pt_3, V=vec)  # -> out, A, B; inputs reset: Boolean, P: Point3d, V: Vector3d
# ---------- c_script_3: C# ----------
    if (reset || b == null)
      b = new Ball(P, V);

    b.Move();
    Print(Convert.ToString(b));
    A = b.Geom();
    B = b;
# ---------- c_script_3: C# additional code ----------
  Ball b;

  class Ball
  {
    public Point3d pos;   // public field or parameter
    private Vector3d vel; // private field
    public Vector3d Vel   // public parameter (allows value checks when setting)
    {
      get{return vel;}

      set{
        if (value.Length > 2.0) // value is a universal keyword that refers to the property value no matter the name
        {
          value.Unitize();
          value *= 2.0;
        }
        vel = value;

      }

    }

    // constructor(s)
    public Ball(Point3d pos, Vector3d vel)
    {
      this.pos = pos;
      this.vel = vel;

    }

    // using constructor chaining in C#
    public Ball() : this(new Point3d(0, 0, 0), new Vector3d(0, 0, 1))
    {}

    // methods

    public void Move(){
      pos += vel;
    }

    public Mesh Geom()
    {
      return Mesh.CreateFromSphere(new Sphere(pos, 1.0), 4, 4);
    }

  }
# ---------- end c_script_3 ----------
panel = Panel(c_script_3.out)
panel_2 = Panel(c_script_3.A)

# ----
timer = Timer(TimerInterval=1, Target=c_script_5)  # disabled
neg = Negative(Value=number_slider)

# ---- group: Value and Reference type
c_script_4 = CSharpScript()  # -> out, A
# ---------- c_script_4: C# ----------
    double myNumber = 2.0;
    Foo(myNumber);
    Print(myNumber.ToString());
    
    List<string> myTexts = new List<string>();
    Print(myTexts.Count.ToString());
    Foo(myTexts);
     Print(myTexts.Count.ToString());
# ---------- c_script_4: C# additional code ----------
  void Foo(double someNumber)
  {
    someNumber += 1.0;
  }
  
  void Foo(List<string> texts)
  {
    texts.Add("Oh Yeah!!!");
  }
# ---------- end c_script_4 ----------
panel_3 = Panel(c_script_4.out)

# ----
c_script_5 = CSharpScript(
    reset=Button(),
    gridSize=Slider(50, range=1..200),
    center=pt,
    amplitude=number_slider,
    waveLength=Slider(20, range=0..200),
    speed=Slider(5, range=0..100),
    falloff=Slider(0.3, range=0..10))  # -> out, outputPoints; inputs reset: Boolean, gridSize: Int32, center: Point3d, amplitude: Double, waveLength: Double, speed: Double, falloff: Double
# ---------- c_script_5: C# ----------
    if (reset)
    {
      t = 0.0;
      return;
    }

    //List<Point3d> wavePoints = new List<Point3d>();
    List<GH_Point> wavePoints = new List<GH_Point>();

    System.Diagnostics.Stopwatch myStopwatch = new System.Diagnostics.Stopwatch();
    myStopwatch.Start();

    for(int i = 0; i < gridSize; i++)
      for(int j = 0; j < gridSize; j++)
      {
        double x = i;
        double y = j;
        double z = 0.0;

        double r = center.DistanceTo(new Point3d(x, y, 0.0));
        //z = amplitude * Math.Min(t, 10) * 0.1 * Math.Cos((r - t * speed) / waveLength * 2.0 * Math.PI);
        z = amplitude * Math.Cos((r - t * speed) / waveLength * 2.0 * Math.PI);
        z /= (1.0 + r * falloff);

        //wavePoints.Add(new Point3d(x, y, z));
        wavePoints.Add(new GH_Point(new Point3d(x, y, z)));
      }

    // Display how much time has passed since we started the stopwatch
    Print(myStopwatch.Elapsed.TotalMilliseconds.ToString());

    t += 0.1;
    outputPoints = wavePoints;
# ---------- c_script_5: C# additional code ----------
  double t = 0.0;
# ---------- end c_script_5 ----------
dom = ConstructDomain(DomainStart=0, DomainEnd=number_slider)
pdecon = Deconstruct(Point=c_script_5.outputPoints)  # -> XComponent, YComponent, ZComponent; disabled
panel_4 = Panel(c_script_5.out)
abs = Absolute(Value=pdecon.ZComponent)  # disabled
num = Number(abs)  # disabled
bnd = Bounds(Numbers=flatten(num))  # disabled
dom_2 = ConstructDomain(DomainStart=0, DomainEnd=1)  # disabled
pt_4 = Point(Point(-6.052258915, 2.761087442, 0))
pt_5 = Point(Point(-2.438936298, 5.363458633, 3.4))
panel_5 = Panel("""<title>

<description>

code by <author>

v <version>""")
remap = RemapNumbers(Value=num, Source=dom, Target=dom_2)  # -> Mapped, Clipped; disabled
gradient = Gradient(
    LowerLimit=0,
    UpperLimit=1,
    Parameter=remap.Mapped,
    stops=[0: RGB(0, 98, 0), 0.25: RGB(81, 175, 17), 0.5: RGB(159, 198, 146), 0.75: RGB(170, 235, 41), 1: RGB(221, 255, 53)])  # disabled

# ---- group: tangent spheres from Rajaa Issa Essential Mathematics
c_script_6 = CSharpScript(A=pt_4, B=pt_5, t=Slider(0.255, range=0..1))  # -> out, S1, S2; inputs A: Point3d, B: Point3d, t: Double; disabled
# ---------- c_script_6: C# ----------
    Point3d D, C1, C2;
    double r1, r2;

    D = A + t * (B - A);

    C1 = A + 0.5 * (D - A);
    C2 = D + 0.5 * (B - D);

    r1 = C1.DistanceTo(D);
    r2 = C2.DistanceTo(D);
    S1 = new Sphere(C1, r1);
    S2 = new Sphere(C2, r2);
# ---------- end c_script_6 ----------

# ----
cloud = ConstructCloud(Points=c_script_5.outputPoints, Colors=gradient)  # disabled
