# Grasshopper definition ICD CS 2018 review.gh (Grasshopper 1.0.7)
# Copyright: Co-de-iT

cycles = Slider(7, range=1..7)
factor = Slider(0.15, range=0..1)
pt = Point([Point(-10.3917713, -11.23987661, 0), Point(-23.81430102, -12.02743073, 0), Point(-17.03670365, -21.65023412, 0), Point(-13.24599673, -28.90522197, 0), Point(-18.02255717, -29.47583627, 0), Point(-21.44113398, -30.65696497, 0)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])
pline = PolyLine(Vertices=pt, Closed=False)
crv = Curve(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)

# ---- group: 2D random points generator
c_script = CSharpScript(iCount=Slider(50, range=0..500))  # -> out, oPoints; inputs iCount: Int32
# ---------- c_script: C# ----------
    Random myRandomGenerator = new Random();
    
    List <Point3d> points = new List<Point3d>();

    for(int i = 0; i < iCount; i++)
    {
      double x = myRandomGenerator.NextDouble() * 6.0 - 3;
      double y = myRandomGenerator.NextDouble() * 6.0 - 3;
      double z = 0;
      Point3d myRandomPoint = new Point3d(x, y, z);
      points.Add(myRandomPoint);

    }
    
    oPoints = points;
# ---------- end c_script ----------

# ---- group: laplacian smoothing polyline
c_script_2 = CSharpScript(pl=pline, factor=factor, cycles=cycles)  # -> out, A; inputs pl: Polyline, factor: Double, cycles: Int32
# ---------- c_script_2: C# ----------
    // code by Giulio Piacentino - just reformatted as a function by Alessio Erioli
    
    // smoothens a polyline
    if (pl != null)                             //if pl is different than null
    {
      List<Point3d> pts = new List<Point3d>(pl); // get the polyline vertices

      if (pts.Count > 0)
        A = LaplacianSmooth(pts, factor, cycles);

    }
# ---------- c_script_2: C# additional code ----------
  List<Point3d> LaplacianSmooth(List<Point3d> inputPts, double factor, int cycles)
  {
    List<Point3d> pts = inputPts;

    int lastPtIndex = pts.Count - 1;
    double oneLessFactor = 1 - factor;

    List<Point3d> newPts = pts;
    while (cycles-- > 0)            // decreases at each cycle
    {
      newPts = new List<Point3d>(); // newPts becomes a new list

      for (int i = 0; i < pts.Count; i++)
      {
        Point3d pt = pts[i];
        if (i == 0 || i == lastPtIndex)
        {
          newPts.Add(pt);
          continue;
        }

        Point3d newPt = (pts[i - 1] + pts[i + 1]) * 0.5;
        newPt = newPt * factor + pt * oneLessFactor;
        newPts.Add(newPt);
      }

      pts = newPts;                 // exchange pts with newPts
    }

    return pts;
  }
# ---------- end c_script_2 ----------

# ----
divide = DivideCurve(Curve=crv, Count="50", Kinks=False)  # -> Points, Tangents, Parameters
pline_2 = PolyLine(Vertices=c_script_2.A, Closed=False)
button = Button()
timer = Timer(TimerInterval=1, Target=c_script_6)  # disabled
reset = Button()
timer_2 = Timer(TimerInterval=1, Target=c_script_3)  # disabled
panel = Panel("""<title>

<description>

code by <author>

v <version>""")

# ---- group: circles relaxation
c_script_3 = CSharpScript(iReset=reset, iStartingPositions=c_script.oPoints)  # -> out, oCenters, oVectors; inputs iReset: Boolean, iStartingPositions: list of Point3d
# ---------- c_script_3: C# ----------
    if (iReset)
      centers = new List<Point3d>(iStartingPositions);

    if (centers == null) return;

    List <Vector3d> totalMoves = new List<Vector3d>();
    List <Vector3d> averageMoves = new List<Vector3d>();
    List<double> collisionCounts = new List<double>();
    double collisionDistance = 2.0;

    for(int i = 0; i < centers.Count; i++)
    {
      totalMoves.Add(new Vector3d(0, 0, 0));
      averageMoves.Add(new Vector3d(0, 0, 0));
      collisionCounts.Add(0.0);
    }

    for(int i = 0; i < centers.Count; i++)
      for (int j = i + 1;j < centers.Count;j++)
      {
        double d = centers[i].DistanceTo(centers[j]); // calculate distance between centers
        if (d > collisionDistance) continue; // if there's no collision, do nothing
        Vector3d move = centers[i] - centers[j]; // calculate move away vector
        move.Unitize();
        move *= 0.5 * (collisionDistance - d); // each circle only takes half the push away
        totalMoves[i] += move; // assign move vector to moves
        totalMoves[j] -= move;
        collisionCounts[i] += 1.0;
        collisionCounts[j] += 1.0;
      }

    
    
    
    for(int i = 0;i < centers.Count; i++)
      if(collisionCounts[i] != 0.0)
      {
        Vector3d averageMove = totalMoves[i] / collisionCounts[i];
        centers[i] += averageMove;
        averageMoves[i] = averageMove;
      }

    oCenters = centers;
    oVectors = averageMoves;
# ---------- c_script_3: C# additional code ----------
  List <Point3d> centers;
# ---------- end c_script_3 ----------

# ---- group: curve subdivison and growth
c_script_4 = CSharpScript(iReset=button, iStartingPositions=divide.Points, iMaxCenterCount="1500")  # -> out, oCenters; inputs iReset: Boolean, iStartingPositions: list of Point3d, iMaxCenterCount: Int32; disabled
# ---------- c_script_4: C# usings ----------
using System.IO;
using System.Linq;
using System.Data;
using System.Drawing;
using System.Reflection;
using System.Windows.Forms;
using System.Xml;
using System.Xml.Linq;
using System.Runtime.InteropServices;

using Rhino.DocObjects;
using Rhino.Collections;
using GH_IO;
using GH_IO.Serialization;
# ---------- c_script_4: C# ----------
    if (iReset || centers == null)
      centers = new List<Point3d>(iStartingPositions);

    List<Vector3d> totalMoves = new List<Vector3d>();
    List<double> collisionCounts = new List<double>();

    for (int i = 0; i < centers.Count; i++)
    {
      totalMoves.Add(new Vector3d(0.0, 0.0, 0.0));
      collisionCounts.Add(0.0);
    }

    double collisionDistance = 2.0;

    for (int i = 0; i < centers.Count; i++)
      for (int j = i + 1; j < centers.Count; j++)
      {
        double d = centers[i].DistanceTo(centers[j]);
        if (d > collisionDistance) continue;
        Vector3d move = centers[i] - centers[j];
        if (move.Length < 0.001) continue;
        move.Unitize();
        move *= 0.5 * (collisionDistance - d);
        totalMoves[i] += move;
        totalMoves[j] -= move;
        collisionCounts[i] += 1.0;
        collisionCounts[j] += 1.0;
      }

    for (int i = 0; i < centers.Count; i++)
      if (collisionCounts[i] != 0.0)
        centers[i] += totalMoves[i] / collisionCounts[i];

    if (centers.Count < iMaxCenterCount)
    {
      // first I need to check all segments and then eventually insert new centers in
      // split segments
      List<int> splitIndices = new List<int>();

      for(int i = 0; i < centers.Count-1; i++)
        if(centers[i].DistanceTo(centers[i + 1]) > 1.9)
          splitIndices.Add(i + 1 + splitIndices.Count); // see slide 89

      foreach(int splitIndex in splitIndices)
      {
        Point3d newCenter = 0.5 * (centers[splitIndex - 1] + centers[splitIndex]);
        centers.Insert(splitIndex, newCenter);
      }

    }

    oCenters = centers;
# ---------- c_script_4: C# additional code ----------
  List<Point3d> centers;
# ---------- end c_script_4 ----------

# ---- group: curve subdivison and growth - simpler code
c_script_5 = CSharpScript(iReset=button, iStartingPositions=divide.Points, iMaxCenterCount="1500")  # -> out, oCenters; inputs iReset: Boolean, iStartingPositions: list of Point3d, iMaxCenterCount: Int32; disabled
# ---------- c_script_5: C# ----------
    if (iReset || centers == null)
      centers = new List<Point3d>(iStartingPositions);

    List<Vector3d> totalMoves = new List<Vector3d>();
    List<double> collisionCounts = new List<double>();

    // prepare move vectors and collision count lists
    for (int i = 0; i < centers.Count; i++)
    {
      totalMoves.Add(new Vector3d(0.0, 0.0, 0.0));
      collisionCounts.Add(0.0);
    }

    // set collision distance (can be set as parameter too)
    double collisionDistance = 2.0;

    // find collisions counts and sums moving vectors
    for (int i = 0; i < centers.Count; i++)
      for (int j = i + 1; j < centers.Count; j++)
      {
        double d = centers[i].DistanceTo(centers[j]);
        if (d > collisionDistance) continue;
        Vector3d move = centers[i] - centers[j];
        if (move.Length < 0.001) continue;
        move.Unitize();
        move *= 0.5 * (collisionDistance - d);
        totalMoves[i] += move;
        totalMoves[j] -= move;
        collisionCounts[i] += 1.0;
        collisionCounts[j] += 1.0;
      }

    for (int i = 0; i < centers.Count; i++)
      if (collisionCounts[i] != 0.0)
        centers[i] += totalMoves[i] / collisionCounts[i];



    if (centers.Count < iMaxCenterCount)
    {

      for(int i = 0; i < centers.Count - 1; i++)
        if(centers[i].DistanceTo(centers[i + 1]) > 1.9)
        {
          Point3d newCenter = 0.5 * (centers[i + 1] + centers[i]);
          centers.Insert(i + 1, newCenter); // see slide 89
        }

    }

    oCenters = centers;
# ---------- c_script_5: C# additional code ----------
  List<Point3d> centers;
# ---------- end c_script_5 ----------

# ---- group: curve subdivison and growth - simpler code w Laplacian Smoothing
c_script_6 = CSharpScript(iReset=button, iStartingPositions=divide.Points, iMaxCenterCount="1500")  # -> out, oCenters; inputs iReset: Boolean, iStartingPositions: list of Point3d, iMaxCenterCount: Int32
# ---------- c_script_6: C# ----------
    if (iReset || centers == null)
      centers = new List<Point3d>(iStartingPositions);

    List<Vector3d> totalMoves = new List<Vector3d>();
    List<double> collisionCounts = new List<double>();

    // prepare move vectors and collision count lists
    for (int i = 0; i < centers.Count; i++)
    {
      totalMoves.Add(new Vector3d(0.0, 0.0, 0.0));
      collisionCounts.Add(0.0);
    }

    // set collision distance (can be set as parameter too)
    double collisionDistance = 2.0;

    // find collisions counts and sums moving vectors
    for (int i = 0; i < centers.Count; i++)
      for (int j = i + 1; j < centers.Count; j++)
      {
        double d = centers[i].DistanceTo(centers[j]);
        if (d > collisionDistance) continue;
        Vector3d move = centers[i] - centers[j];
        if (move.Length < 0.001) continue;
        move.Unitize();
        move *= 0.5 * (collisionDistance - d);
        totalMoves[i] += move;
        totalMoves[j] -= move;
        collisionCounts[i] += 1.0;
        collisionCounts[j] += 1.0;
      }

    for (int i = 0; i < centers.Count; i++)
      if (collisionCounts[i] != 0.0)
        centers[i] += totalMoves[i] / collisionCounts[i];

centers = LaplacianSmooth(centers, 0.01, 1);

    if (centers.Count < iMaxCenterCount)
    {

      for(int i = 0; i < centers.Count - 1; i++)
        if(centers[i].DistanceTo(centers[i + 1]) > 1.9)
        {
          Point3d newCenter = 0.5 * (centers[i + 1] + centers[i]);
          centers.Insert(i + 1, newCenter); // see slide 89
        }

    }

    

    oCenters = centers;
# ---------- c_script_6: C# additional code ----------
  List<Point3d> centers;

  List<Point3d> LaplacianSmooth(List<Point3d> inputPts, double factor, int cycles)
  {
    List<Point3d> pts = inputPts;

    int lastPtIndex = pts.Count - 1;
    double oneLessFactor = 1 - factor;

    List<Point3d> newPts = pts;
    while (cycles-- > 0)            // decreases at each cycle
    {
      newPts = new List<Point3d>(); // newPts becomes a new list

      for (int i = 0; i < pts.Count; i++)
      {
        Point3d pt = pts[i];
        if (i == 0 || i == lastPtIndex)
        {
          newPts.Add(pt);
          continue;
        }

        Point3d newPt = (pts[i - 1] + pts[i + 1]) * 0.5;
        newPt = newPt * factor + pt * oneLessFactor;
        newPts.Add(newPt);
      }

      pts = newPts;                 // exchange pts with newPts
    }

    return pts;
  }
# ---------- end c_script_6 ----------

# ----
pline_3 = PolyLine(Vertices=c_script_6.oCenters, Closed=False)
nurbs = NurbsCurve(Vertices=c_script_6.oCenters, Degree=3, Periodic=False)  # -> Curve, Length, Domain; disabled
multiplication = Multiplication(A=c_script_3.oVectors, B=Slider(10, range=0..10))
explode = Explode(Curve=pline_3, Recursive=True)  # -> Segments, Vertices
cir = Circle(Plane=c_script_6.oCenters, Radius="1")
cir_2 = Circle(Plane=c_script_3.oCenters, Radius="1")
vdisex = VectorDisplayEx(Point=c_script_3.oCenters, Vector=multiplication, Colour=RGB(0, 0, 0), Width=2)
len = Length(Curve=explode.Segments)
bar_graph = BarGraph(len, BarColor=RGB(255, 0, 90))
preview = CustomPreview(Geometry=cir, Material=ColourSwatch(SwatchColor=RGB(51, 51, 51)))
num = Number(len)
bnd = Bounds(Numbers=flatten(num))
dom = ConstructDomain(DomainStart=0, DomainEnd=1)
remap = RemapNumbers(Value=num, Source=bnd, Target=dom)  # -> Mapped, Clipped
panel_2 = Panel("""150
112
120""")
gradient = Gradient(
    LowerLimit=0,
    UpperLimit=1,
    Parameter=remap.Mapped,
    stops=[0: RGB(0, 0, 0), 0.487: RGB(150, 120, 120), 1: RGB(255, 255, 255)])
preview_2 = CustomPreview(Geometry=explode.Segments, Material=gradient)
