# Grasshopper definition 03_20160405_basic stigmergy.gh (Grasshopper 1.0.7)
# Copyright: Co-de-iT
# plug-ins: Anemone, Human, Noise 4D

number_slider = Slider(100, range=50..200)
# reciproCITY
# Alessio Erioli
# Aldo Sollazzo
# Eugenio Bettucchi
# DEFINITIONS BY
number_slider_2 = Slider(4, range=1..5)
# 15-17 April 2016
seed = Slider(33, range=0..100)
multiplication = Multiplication(A=number_slider, B="2")
# basic stigmergy example
# (environment read/write)
pt = Point(flatten([Point(97.23026444, 47.18736088, 0), Point(102.9208052, 48.59891617, 0), Point(109.1723951, 44.36547091, 0), Point(101.5460938, 37.88936513, 0), Point(111.4122517, 36.20139809, 0), Point(112.988691, 52.15460782, 0), Point(89.47101574, 41.51944567, 0), Point(97.70682141, 55.38789412, 0)]))
noise_scale = Slider(0.016, range=0..0.05)
# loc
dup = DuplicateData(Data=pt, Number=number_slider_2, Order=True)
lng = ListLength(List=dup)
wheel = ColourWheel(
    lng,
    ColourGrips_Style=10,
    ColourGrips_Grip=[3.410431301, 3.141592654, 1.570796327, 4.71238898],
    ColourGrips_Lum=[0.0534287417, 0.560828417],
    ColourGrips_Range=[0.2307165557, 0.2307165557, 0.2307165557, 0.2307165557],
    ColourGrips_Sat=[1, 0.8651205502])
addition = Addition(A=seed, B=1)
random = Random(Range="1.0 to 3.0", Number=lng, Seed=seed)
random_2 = Random(Range="0 to Pi*2", Number=lng, Seed=addition)
Z = UnitZ(Factor=1)
X = UnitX(Factor=random)
vrot = Rotate(Vector=X, Axis=Z, Angle=random_2)

# ----
# noise map
mplane = MeshPlane(
    Boundary={Plane=PlaneXY(0, 0, 0), Size=Domain2(u=0..200, v=0..100)},
    WidthCount=multiplication,
    HeightCount=number_slider)  # -> Mesh, Area
demesh = DeconstructMesh(Mesh=mplane.Mesh)  # -> Vertices, Faces, Colours, Normals
perlin = PerlinNoise(Values=demesh.Vertices, Time=0, Scale=noise_scale)
gradient = Gradient(LowerLimit="-1", UpperLimit=1, Parameter=perlin, stops=[0: RGB(255, 255, 255), 1: RGB(0, 0, 0)])
Z_2 = UnitZ(Factor=-1)
move = Move(Geometry=demesh.Vertices, Motion=Z_2)  # -> Geometry, Transform
conmesh = ConstructMesh(Vertices=demesh.Vertices, Faces=demesh.Faces, Colours=gradient)

# ----
# vel
# col
# trail
vec = Vector(flatten(vrot))
col = Colour(flatten(wheel))
# < NB: always the trail as LAST
pt_2 = Point(dup)

# ----
# to UI
# fields
merge = Merge(Data1=simplify(graft(dup)), Data2=simplify(graft(vec)), Data3=simplify(graft(col)), Data4=simplify(graft(pt_2)))
group = Group(Objects=merge)

demesh_2 = DeconstructMesh(Mesh=conmesh)  # -> Vertices, Faces, Colours, Normals
f_mvneighv = VertexNeighbours(M=conmesh)  # -> nI, nV; inputs M: tree of Mesh; disabled
# ---------- f_mvneighv: C# ----------
                       /*
    froGH - a sparse collection of (in)utilities for Grasshopper

    Mesh Vertex Neighbor search - Tree Safe

    code by Alessio Erioli

    This component outputs the Point position and indexes of the Vertices neighbors
    for a given set of Meshes. It keeps the tree order intact (other similar components
    output a global list that is insensitive to the individual meshes)
    Works with a single mesh, a list or a tree of meshes

    froGH by Co-de-iT is licensed under a Creative Commons Attribution 4.0 International License.
    http://creativecommons.org/licenses/by/4.0/

    */
    initComp();



    DataTree <int> neighbors = new DataTree<int>();
    DataTree <Point3f> neighV = new DataTree<Point3f>();
    Mesh m1;
    GH_Path p;
    int [] neighInd;
    int[] indArr;
    for (int j = 0; j < M.BranchCount; j++){
      for (int k = 0; k < M.Branch(j).Count; k++){
        m1 = M[M.Paths[j], k];
        for (int i = 0; i < m1.Vertices.Count; i++){
          indArr = M.Paths[j].Indices;
          Array.Resize(ref indArr, indArr.Length + 2);
          indArr[indArr.Length - 2] = k;
          indArr[indArr.Length - 1] = i;
          p = new GH_Path(indArr);
          neighInd = m1.Vertices.GetConnectedVertices(i);
          neighbors.AddRange(neighInd, p);
          for (int v = 0; v < neighInd.Length; v++){
            neighV.Add(m1.Vertices[neighInd[v]], p);
          }
        }
      }
    }

    neighbors.SimplifyPaths();
    neighV.SimplifyPaths();

    nI = neighbors;
    nV = neighV;
# ---------- f_mvneighv: C# additional code ----------
  void initComp(){

    Component.Name = "Vertex Neighbours";
    Component.NickName = "f_MVNeighV";
    Component.Description = "Maps Vertex neighbours for a sets of Meshes\n(Tree safe)";
    Component.Params.Input[0].Name = "Mesh";
    Component.Params.Input[0].Description = "Input Mesh(es)";
    Component.Params.Output[0].Name = "neighbour vertices Indexes";
    Component.Params.Output[0].Description = "indexes of neighbour faces for each vertex";
    Component.Params.Output[1].Name = "neighbour Vertices";
    Component.Params.Output[1].Description = "neighbour vertices as points";
  }
# ---------- end f_mvneighv ----------
number_slider_3 = Slider(131, range=0..1000)
loop_start = LoopStart(N=number_slider_3, T=Button(), D0=group, D1=demesh_2.Colours)  # -> port, Counter, Data, Data_2

# ----
# basic parameters
evaporation_rate = Slider(0.97952, range=0..1)
maxforce = Slider(0.772, range=0..1)
futloc = Slider(2.915, range=0..3)
maxspeed = Slider(1.5, range=0..3)
ph_strength = Slider(0.238, range=0..1)

expression = Expression(x=number_slider_3, y=loop_start.Counter, Expression="round(y/x*100)")

ungroup = Ungroup(Group=loop_start.Data)  # -> simplify(Objects)
split = SplitList(List=ungroup, Index="3")  # -> ListA, ListB
# loc
# vel
# col
item = ListItem(List=split.ListA, Index=0, Wrap=True)  # -> Item, Item1, Item2

panel = Panel(expression)

# ----
# read environment
# future location
# brightest
# darkest
amp = Amplitude(Vector=item.Item1, Amplitude=futloc)
move_2 = Move(Geometry=item.Item, Motion=amp)  # -> Geometry, Transform
samples = Slider(5, range=3..10)
cps = ClosestPoints(Point=move_2.Geometry, Cloud=demesh_2.Vertices, Count=samples)  # -> ClosestPoint, CPIndex, Distance
item_2 = ListItem(List=loop_start.Data_2, Index=cps.CPIndex, Wrap=True)
ahsv = SplitAHSV(Colour=item_2)  # -> Alpha, Hue, Saturation, Value
sort = SortList(Keys=ahsv.Value, ValuesA=cps.ClosestPoint, ValuesB=cps.CPIndex)  # -> Keys, ValuesA, ValuesB
item_3 = ListItem(List=simplify(sort.ValuesA), Index=0, Wrap=True)  # -> Item1, Item
item_4 = ListItem(List=simplify(sort.ValuesB), Index=0, Wrap=True)  # -> Item1, Item
vec2pt = Vector2Pt(PointA=item.Item, PointB=item_3.Item1, Unitize=False)  # -> Vector, Length

panel_2 = Panel(split.ListB)

max_angle = Slider(90, range=0..90)
perlin_2 = PerlinNoise(Values=item.Item, Time=0, Scale=noise_scale)
multiplication_2 = Multiplication(A=perlin_2, B=max_angle)
Z_3 = UnitZ(Factor=1)
vrot_2 = Rotate(Vector=item.Item1, Axis=Z_3, Angle=degrees(multiplication_2))  # -> simplify(Vector)

# ----
# steer
maxforce_2 = Slider(0.384, range=0..1)
noise_intensity = Slider(0.296, range=0..1)
color_intensity = Slider(0.9, range=0..1)
steer = Steer(vel=item.Item1, des=vrot_2, maxv=maxspeed, maxf=maxforce_2)
steer_2 = Steer(vel=item.Item1, des=vec2pt.Vector, maxv=maxspeed, maxf=maxforce)
multiplication_3 = Multiplication(A=steer_2, B=color_intensity)
multiplication_4 = Multiplication(A=steer, B=noise_intensity)

cp = ClosestPoint(Point=item.Item, Cloud=demesh_2.Vertices)  # -> ClosestPoint, CPIndex, Distance
# write to environment
item_5 = ListItem(List=loop_start.Data_2, Index=cp.CPIndex, Wrap=True)  # -> simplify(Item1), Item
ahsv_2 = SplitAHSV(Colour=item_5.Item1)  # -> Alpha, Hue, Saturation, Value
addition_2 = Addition(A=ahsv_2.Value, B=ph_strength)
min = Minimum(A=addition_2, B="1")
frgb = ColourRGBF(Alpha=1, Red=min, Green=min, Blue=min)
replace = ReplaceItems(List=flatten(loop_start.Data_2), Item=flatten(frgb), Indices=flatten(cp.CPIndex), Wrap=False)
multiplication_5 = Multiplication(A=replace, B=evaporation_rate)

addition_3 = Addition(A=item.Item1, B=multiplication_4, C=multiplication_3)
vlen = VectorLength(Vector=addition_3)
min_2 = Minimum(A=vlen, B=maxspeed)
amp_2 = Amplitude(Vector=addition_3, Amplitude=min_2)
move_3 = Move(Geometry=item.Item, Motion=amp_2)  # -> Geometry, Transform
item_6 = ListItem(List=replace, Index=f_mvneighv.nI, Wrap=True)  # disabled
number_slider_4 = Slider(0.25, range=0..1)  # disabled
meshcp = MeshClosestPoint(Point=move_3.Geometry, Mesh=conmesh)  # -> Point, Index, Parameter
panel_3 = Panel(addition_3)
avr = Average(Input=item_6)  # disabled
# add to trail
merge_2 = Merge(Data1=simplify(split.ListB), Data2=simplify(meshcp.Point))  # disabled
merge_3 = Merge(Data1=simplify(graft(replace)), Data2=simplify(avr))  # disabled

merge_4 = Merge(Data1=simplify(meshcp.Point), Data2=simplify(amp_2), Data3=simplify(item.Item2), Data4=simplify(meshcp.Point))
group_2 = Group(Objects=merge_4)

panel_4 = Panel(merge_2)
interp = InterpolateData(Data=merge_3, Parameter=number_slider_4, Interpolation=2)  # -> flatten(Value); disabled
panel_5 = Panel(avr)  # disabled
loop_end = LoopEnd(
    port=loop_start.port,
    Exit=False,
    Data=simplify(group_2),
    Data_2=simplify(multiplication_5),
    TimeOutVal=0,
    pausedState=False,
    state="Constant output")  # -> D0, D1
ungroup_2 = Ungroup(Group=loop_end.D0)
split_2 = SplitList(List=ungroup_2, Index="3")  # -> ListA, ListB

interval = Slider(2, range=1..10)
repeat = RepeatData(Data="0", Length=expr("x-1", interval))
merge_5 = Merge(Data1="1", Data2=repeat)  # -> flatten(Result)
cull = CullPattern(List=split_2.ListB, CullPattern=merge_5)
pline = PolyLine(Vertices=cull, Closed=False)
smoothpline = SmoothPolyline(Polyline=pline, Strength=1, Times=Slider(8, range=1..30))
previewlw = CustomPreviewLineweights(
    Geometry=smoothpline,
    Shader=ColourSwatch(SwatchColor=RGB(113, 162, 189)),
    Thickness=Slider(1, range=1..3),
    Absolute=False)

item_7 = ListItem(List=split_2.ListA, Index=0, Wrap=True)  # -> Item, Item1, Item2
addition_4 = Addition(A=Slider(2.379, range=0..3), B=1)
cloud = CloudDisplay(Points=item_7.Item, Colours=item_7.Item2, Size=addition_4, SpriteType=0)  # disabled

pt_3 = Point(item_7.Item)
conmesh_2 = ConstructMesh(Vertices=demesh_2.Vertices, Faces=demesh_2.Faces, Colours=loop_end.D1)

# ==== cluster Steer
vel = ClusterInput()
des = ClusterInput()
maxv = ClusterInput()
maxf = ClusterInput()
amp = Amplitude(Vector=des, Amplitude=maxv)
subtraction = Subtraction(A=amp, B=vel)
multiplication = Multiplication(A=subtraction, B=maxf)
vlen = VectorLength(Vector=multiplication)
min = Minimum(A=vlen, B=maxv)
amp_2 = Amplitude(Vector=multiplication, Amplitude=min)
acc = ClusterOutput(amp_2)
