# Grasshopper definition 1016-11 CQ_DLA.gh (Grasshopper 0.8.52)

# DIFFUSION
# LIMITED
# AGGREGATION
number_of_iterations = Slider(650, range=1..1000)

# ---- group: Diffusion Limited Aggregation / INPUT GEOMETRY
boundary_crv = Curve(<curve referenced from the Rhino model>)
origin_pts = Point(<point referenced from the Rhino model>)

# ---- group: Diffusion Limited Aggregation
# DESIGN.EPFL.CH/ORGANICITES
movement_step_size = Slider(7.3, range=0..20)
connection_threshold = Slider(5, range=0..50)
# CODE QUOTIDIEN: Definition originally written for
#   Organicités: Growth Typologies
#   Media × Design Lab: EPFL
#   [Laboratoire de Design et Media]
# 
#              codeQuotidien.wordpress.org
#              Trevor Patt
#              trpatt@gmail.com
# 
#   Creative Commons:
#     Attribution
#     NonCommercial
#     ShareAlike
random_seed = Slider(2, range=1..20)
# 1016-2011
reset_after_x_steps = Slider(250, range=100..500)
save_trace = BooleanToggle(True)
dla = VBScript(
    origin=origin_pts,
    bnd=boundary_crv,
    n=number_of_iterations,
    stp=movement_step_size,
    thrs=connection_threshold,
    sd=random_seed,
    reset=reset_after_x_steps,
    trace=save_trace)  # -> out, Node, Seg, BndNdx, FromNdx, ToNdx, tr; inputs origin: list of Point3d, bnd: list of Curve
# ---------- dla: VB ----------
    Dim R As New Random(sd)

    'boundDomain CONTAINS THE CORNER POINTS OF A BOUNDING BOX
    Dim boundDomain As New List(Of Point3d)
    'ptOut CONTAINS THE NODE POINTS OF THE DLA RESULT
    Dim ptOut As New List (Of point3d)
    Dim ptTrace As New datatree(Of point3d)
    Dim lnOut As New list(Of Line)
    'ndxReg CONTAINS NODE INDICES IN BRANCHES BY REGION
    Dim ndxReg As New DataTree(Of int32)
    'ndxBnd CONTAINS BOUNDARY CURVE INDEX
    Dim ndxBnd As New List(Of int32)

    Dim fromTree As New datatree(Of Int32)
    Dim toTree As New datatree(Of int32)


    'LOOP EACH BOUNDARY CURVE IN bnd AND FIND THE EXTREME X,Y COORDINATES
    For j As int32=0 To bnd.count - 1
      If bnd(j).IsClosed Then
        If bnd(j).ispolyline Then
          Dim pL As New polyline
          bnd(j).TryGetPolyline(pL)
          'FIND EXTREME X,Y COORDINATES
          BoundingPts(boundDomain, pL)
        End If
      End If
    Next
    boundDomain.Add(New Point3d(boundDomain(1).X - boundDomain(0).X, boundDomain(1).Y - boundDomain(0).Y, 0))
    Dim gridX As Double = math.Floor(boundDomain(2).X / thrs)
    Dim gridY As Double = math.Floor(boundDomain(2).Y / thrs)
    boundDomain.Add(New point3d(gridX, gridY, thrs))
    Dim diag As Double = boundDomain(0).distanceto(boundDomain(1))

    'ADD ALL ORIGIN POINTS TO DATA
    For i As int32= 0 To origin.count - 1
      Dim ck As int32 = 0
      CheckInterior(bnd, origin(i), ck)
      If ck > 0 Then
        ptOut.Add(Origin(i))
        GetPointIndex(origin(i), boundDomain, gridX, gridY)
        ndxReg.Add(i, New Gh_Path(gridX, gridY))
        ndxBnd.Add(ck - 1)
      End If
    Next

    'ADD NEW POINTS
    For i As int32=origin.Count - 1 To n + origin.count
      Dim currNdx As int32 = ptOut.Count
      Dim theta As Double = R.NextDouble * math.PI * 2
      Dim ptTemp As New point3d((.5 * diag * math.Cos(theta)) + (boundDomain(0).X + boundDomain(2).X / 2), (.5 * diag * math.Sin(theta)) + (boundDomain(0).Y + boundDomain(2).Y / 2), 0)
      If trace  Then ptTrace.add(ptTemp, New GH_Path(currNdx))
      EnforceBoundBox(boundDomain, ptTemp, stp)

      Dim ck As int32 = 0
      Dim ndx As int32 = -1
      Dim ct As int32 = 0
      If trace  Then ptTrace.add(ptTemp, New GH_Path(currNdx))

      Do While ( ndx < 0 And ct < reset)
        'IF NOT WITHIN BOUNDARY CURVES TRANSLATE THE POINT stp DISTANCE IN theta DIRECTION
        theta = R.NextDouble * math.PI * 2
        ptTemp.X += stp * math.Cos(theta)
        ptTemp.Y += stp * math.Sin(theta)

        'CONSTRAIN MOVEMENT WITHIN BOUNDING BOX
        CheckBoundBox(boundDomain, ptTemp, stp)
        CheckInterior(bnd, ptTemp, ck)
        If trace Then ptTrace.add(ptTemp, New GH_Path(currNdx))

        If ck > 0 Then
          'CHECK POINTS IN GRIDS (-1,+1) FOR PROXIMITY
          GetPointIndex(ptTemp, boundDomain, gridX, gridY)
          Dim minDist As Double = thrs
          For j As int32=gridX - 1 To gridX + 1
            For k As int32=gridY - 1 To gridY + 1
              Dim pthJK As New GH_Path(j, k)
              If j >= 0 And k >= 0 AndAlso ndxReg.pathExists(pthJK) Then

                Dim regList As New List(Of int32)
                regList = ndxReg.Branch(pthJK)
                For m As int32=0 To regList.count - 1
                  Dim distck As Double = ptTemp.DistanceTo(ptOut(regList(m)))
                  If  distck < minDist Then
                    minDist = distck
                    ndx = regList(m)
                  End If
                Next

              End If
            Next
          Next
        End If
        ct += 1
      Loop

      'If Do Loop HAS Not TIMED OUT, ADD POINTS OTHERWISE BEGIN AGAIN On THE SAME i
      If ndx >= 0 Then
        ptOut.Add(ptTemp)
        GetPointIndex(ptTemp, boundDomain, gridX, gridY)
        ndxReg.Add(currNdx, New Gh_Path(gridX, gridY))
        lnOut.add(New Line(ptOut(ndx), ptTemp))
        ndxBnd.Add(ck - 1)
        fromTree.add(ndx, New GH_path(i))
        toTree.add(currNdx, New GH_Path(ndx))
        If trace Then ptTrace.add(ptTemp, New GH_Path(currNdx))
        Else
          i += -1
        If trace Then ptTrace.RemovePath(New GH_Path(currNdx))
      End If

    Next
    Node = ptOut
    Seg = lnOut
    BndNdx = ndxBnd
    FromNdx = fromTree
    ToNdx = toTree
    tr = ptTrace
# ---------- dla: VB additional code ----------
  Sub BoundingPts(ByRef bndPt As list(Of point3d), ByVal crv As Polyline)
    'CHECK BOUNDARY CURVE (POLYLINE) VERTICES AGAINST BOUNDING BOX
    For j As int32=0 To crv.count - 1
      If bndPt.count = 0 Then
        bndPt.add(crv(0))
        bndPt.add(crv(0))
      Else
        If crv(j).X < bndPt(0).X Then bndPt(0) = New Point3d(crv(j).X, bndPt(0).y, 0)
        If crv(j).X > bndPt(1).X Then bndPt(1) = New Point3d(crv(j).X, bndPt(1).y, 0)
        If crv(j).Y < bndPt(0).Y Then bndPt(0) = New Point3d(bndPt(0).X, crv(j).Y, 0)
        If crv(j).Y > bndPt(1).Y Then bndPt(1) = New Point3d(bndPt(1).X, crv(j).Y, 0)
      End If
    Next
  End Sub

  Sub CheckInterior(ByVal crv As List(Of Curve), ByRef pt As point3d, ByRef ck As int32)
    'IF POINT IS INSIDE A BOUNDARY CURVE ADD TO ck
    For j As int32=0 To crv.count - 1
      If crv(j).Contains(pt) = 1 Then
        ck = j + 1
      End If
    Next
  End Sub

  Sub EnforceBoundBox(ByVal bndPt As list(Of point3d), ByRef pt As point3d, ByVal bleed As Double)
    'IF POINT IS OUTSIDE OF BOUNDING BOX (+BLEED) MOVE BACK INSIDE
    If pt.X < bndPt(0).X - bleed Then pt.X = bndPt(0).X - bleed
    If pt.X > bndPt(1).X + bleed Then pt.X = bndPt(1).X + bleed
    If pt.Y < bndPt(0).Y - bleed Then pt.Y = bndPt(0).Y - bleed
    If pt.Y > bndPt(1).Y + bleed Then pt.Y = bndPt(1).Y + bleed
  End Sub

  Sub CheckBoundBox(ByVal bndPt As list(Of point3d), ByRef pt As point3d, ByVal bleed As Double)
    'IF POINT IS OUTSIDE OF BOUNDING BOX (+BLEED) MOVE BACK INSIDE
    If pt.X < bndPt(0).X - bleed Then pt.X += 2 * ((bndPt(0).X - bleed) - pt.X)
    If pt.X > bndPt(1).X + bleed Then pt.X += 2 * ((bndPt(1).X + bleed) - pt.X)
    If pt.Y < bndPt(0).Y - bleed Then pt.Y += 2 * ((bndPt(0).Y - bleed) - pt.Y)
    If pt.Y > bndPt(1).Y + bleed Then pt.Y += 2 * ((bndPt(1).Y + bleed) - pt.Y)
  End Sub

  Sub GetPointIndex(ByVal pt As point3d, ByVal bnd As List(Of point3d), ByRef gridX As int32, ByRef gridY As int32)
    gridX = (pt.X - bnd(0).X) / bnd(3).Z
    gridY = (pt.Y - bnd(0).Y) / bnd(3).Z
  End Sub
# ---------- end dla ----------

# ----
cir = Circle(Plane=dla.Node, Radius=1)
pline = PolyLine(Vertices=dla.tr, Closed=False)
crv = Curve(dla.Seg)

# ---- group: POINT INDEX CONNECTION LIST
pt_links_from = Panel(dla.FromNdx)
point_linked_to_by = Panel(dla.ToNdx)
