# Grasshopper definition 20160404_stigmergy_01_EU.gh (Grasshopper 1.0.7)
# Copyright: Co-de-iT
# plug-ins: Anemone, Human, Boid, Weaverbird, Mesh Pipe, Shortest Walk in Gh

# ---- group: stop loop
toggle = BooleanToggle(False)  # disabled

# ----
iter = Slider(100, range=0..100)
vision_rad = Slider(65, range=0..100)
vision_ang = Slider(75, range=0..90)
follow_tail = Slider(1, range=0..1)
agent = Slider(100, range=0..100)

repeat = RepeatData(Data=iter, Length=agent)  # disabled
series = Series(Start=0, Step=1, Count=agent)  # disabled
merge = Merge(Data1=graft(repeat), Data2=graft(series))  # -> simplify(Result); disabled
path = ConstructPath(Indices=merge)  # disabled
number_slider = Slider(10, range=0..10)  # disabled
toggle_2 = BooleanToggle(True)  # disabled
number_slider_2 = Slider(1, range=0..10)  # disabled
oct = OcTree(Square=toggle_2, Group=number_slider)  # -> Boxes, Points; disabled
pline = PolyLine(Closed=False)  # disabled
redpline = Reduce(Polyline=pline, Tolerance=number_slider_2)  # -> Polyline, Reduction; disabled
end = EndPoints(Curve=pline)  # -> Start, End; disabled
smesh = SimpleMesh(Brep=oct.Boxes)  # disabled
explode = Explode(Curve=redpline.Polyline, Recursive=True)  # -> simplify(flatten(Segments)), Vertices; disabled
ln = Line(StartPoint=end.Start, EndPoint=end.End)  # -> flatten(Line); disabled
wires = BrepWireframe(Brep=oct.Boxes, Density=-1)  # -> flatten(Wireframe); disabled
wbedges = WeaverbirdsMeshEdges()  # disabled
shortwalk = ShortestWalk(Curves=[wires, wbedges], WantedPath=explode.Segments)  # -> ShortestWalk, Succession, Direction, Length; disabled
explode_2 = Explode(Curve=shortwalk.ShortestWalk, Recursive=True)  # -> flatten(Segments), Vertices; disabled
curvepoint = PointOnCurve(explode_2.Segments, parameter=0.5)  # disabled
number_slider_3 = Slider(1.27, range=0..10)  # disabled
number_slider_4 = Slider(0.3, range=0..1)  # disabled
cullpt = CullDuplicates(Points=curvepoint, Tolerance=0.1, CullMode=1)  # -> Points, Indices, Valence; disabled
number_slider_5 = Slider(4, range=0..10)  # disabled
number_slider_6 = Slider(0.1, range=0..1)  # disabled
bnd = Bounds(Numbers=cullpt.Valence)  # disabled
item = ListItem(List=explode_2.Segments, Index=cullpt.Indices, Wrap=True)  # disabled
dom = ConstructDomain(DomainStart=number_slider_4, DomainEnd=number_slider_3)  # disabled
swatch = ColourSwatch(SwatchColor=RGB(255, 255, 255))  # disabled
remap = RemapNumbers(Value=cullpt.Valence, Source=bnd, Target=dom)  # -> Mapped, Clipped; disabled
mpipe = MeshPipe(Curve=item, Radius=remap.Mapped, Accuracy=number_slider_6, Rotation=0, Segments=number_slider_5, Caps=1)  # disabled
previewlw = CustomPreviewLineweights(Geometry=item, Shader=swatch, Thickness=cullpt.Valence)  # disabled
group = Group(Objects=mpipe)  # disabled

number_slider_7 = Slider(100, range=0..100)  # disabled
number_slider_8 = Slider(20, range=0..100)  # disabled
rndvec = RandomVector(Number=number_slider_7, Unit=True, RandomSeed=2, AbsoluteMultiplier=1)  # disabled
_4field = Curve(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)  # disabled
devec = DeconstructVector(Vector=rndvec)  # -> XComponent, YComponent, ZComponent; disabled
pop2d = Populate2D(Region=_4field, Count=number_slider_7, Seed=1)  # disabled
vec = VectorXYZ(XComponent=devec.XComponent, YComponent=devec.YComponent, ZComponent=0)  # -> unitize(Vector), Length; disabled
pt = Point(pop2d)  # disabled
loop_start = LoopStart(N=number_slider_8, D0=pt, D1=vec.Vector)  # -> port, Counter, Data, Data_2; disabled
panel = Panel(loop_start.Counter)  # disabled
pt_2 = Point(flatten(loop_start.Data))  # disabled
pt_3 = Point(graft(pt_2))  # disabled
rec = DataRecorder(pt_3, DataLimit=32, RecordData=True)  # disabled
panel_2 = Panel("""true
false
false
false
false""")  # disabled
vision_radius = Slider(30, range=0..100)  # disabled
vision_angle = Slider(75, range=0..90)  # disabled
vec_2 = Vector(loop_start.Data_2)  # disabled
vec_3 = Vector(Vector(0, 0, 0))  # disabled
number_slider_9 = Slider(0.8, range=0..1)  # disabled
rad = Radians(Degrees=vision_angle)  # disabled
number_slider_10 = Slider(0.4, range=0..12)  # disabled
cluster = Cluster_2(L=rec)  # disabled
cloud = CloudDisplay(Points=rec, Colours=cluster, Size=number_slider_10, SpriteType=1)  # disabled

# ---- group: record input
cull = CullPattern(List=rec, CullPattern=panel_2)  # disabled

# ----
pt_4 = Point(flatten(cull))  # disabled
lng = ListLength(List=pt_4)  # disabled
repeat_2 = RepeatData(Data=vec_3, Length=lng)  # disabled
visible = FindVisibleAgents(
    AgentLocationPoint=pt_2,
    AgentMotionVector=vec_2,
    LocationPointsOfTheFlock=pt_4,
    FlockMotionVectors=repeat_2,
    SearchDistance=vision_radius,
    SearchAngle=rad)  # -> ListOfPoints, ListOfVectors, ListOfIndices; disabled
cluster_2 = Cluster(agent_location=pt_2, agent_vector_global=vec_2, visible_tail=visible.ListOfPoints, phollow_tail=number_slider_9)  # disabled
vec_4 = Vector(cluster_2)  # disabled
move = Move(Geometry=pt_2, Motion=vec_4)  # -> Geometry, Transform; disabled
loop_end = LoopEnd(
    port=loop_start.port,
    Exit=toggle,
    Data=flatten(move.Geometry),
    Data_2=flatten(vec_4),
    TimeOutVal=0,
    pausedState=False,
    state="Constant & Record")  # -> D0, D1; disabled

_4field_2 = Curve(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)
rndvec_2 = RandomVector(Number=agent, Unit=True, RandomSeed=2, AbsoluteMultiplier=1)
devec_2 = DeconstructVector(Vector=rndvec_2)  # -> XComponent, YComponent, ZComponent
vec_5 = VectorXYZ(XComponent=devec_2.XComponent, YComponent=devec_2.YComponent, ZComponent=devec_2.ZComponent)  # -> unitize(Vector), Length
pop2d_2 = Populate2D(Region=_4field_2, Count=agent, Seed=1)
vec_6 = Vector(Vector(0, 0, 0))
rad_2 = Radians(Degrees=vision_ang)

loop_start_2 = LoopStart(N=iter, D0=graft(pop2d_2), D1=vec_5.Vector)  # -> port, Counter, Data, Data_2
stop = BooleanToggle(False)
panel_3 = Panel(loop_start_2.Counter)

item_2 = ListItem(List=loop_start_2.Data, Index=0, Wrap=True)  # -> flatten(Item1), Item
lng_2 = ListLength(List=item_2.Item1)
repeat_3 = RepeatData(Data=vec_6, Length=lng_2)
visible_2 = FindVisibleAgents(
    AgentLocationPoint=item_2.Item1,
    AgentMotionVector=loop_start_2.Data_2,
    LocationPointsOfTheFlock=item_2.Item1,
    FlockMotionVectors=repeat_3,
    SearchDistance=vision_rad,
    SearchAngle=rad_2)  # -> ListOfPoints, ListOfVectors, ListOfIndices
cluster_3 = Cluster_2(L=loop_start_2.Data)
cloud_2 = CloudDisplay(Points=loop_start_2.Data, Colours=cluster_3, Size=Slider(0.4, range=0..12), SpriteType=1)

avr = Average(Input=item_2.Item1)
fspin = SpinForce(Plane=avr, Strength="-1", Radius=Slider(5, range=0..100), Decay=Slider(1, range=0..100))
mergef = MergeFields(Fields=fspin)
evf = EvaluateField(Field=mergef, Point=item_2.Item1)  # -> Tensor, Strength
amp = Amplitude(Vector=evf.Tensor, Amplitude=Slider(0, range=0..1))
addition = Addition(A=graft(loop_start_2.Data_2), B=graft(amp))  # -> flatten(Result)

cluster_4 = Cluster_3(
    agent_location=item_2.Item1,
    agent_vector_global=unitize(addition),
    visible_tail=visible_2.ListOfPoints,
    phollow_tail=follow_tail)

move_2 = Move(Geometry=item_2.Item1, Motion=cluster_4)  # -> Geometry, Transform
tlist = TailList(L=simplify(loop_start_2.Data), it=simplify(graft(move_2.Geometry)), len=Slider(25, range=0..100))  # -> out, simplify(A); inputs L: list, len: Int32
# ---------- tlist: C# usings ----------
using System.IO;
using System.Linq;
using System.Data;
using System.Drawing;
using System.Reflection;
using System.Windows.Forms;
using System.Xml;
using System.Xml.Linq;
using System.Runtime.InteropServices;

using Rhino.DocObjects;
using Rhino.Collections;
using GH_IO;
using GH_IO.Serialization;
# ---------- tlist: C# ----------
    Component.Name = "Tail List";
    Component.NickName = "TList";
    Component.Description = "Tail list - L list, it item to add, len tail length";

    if (L.Count > len) {
      L.RemoveAt(0);
    }
    L.Add(it);
    A = L;
# ---------- end tlist ----------
loop_end_2 = LoopEnd(
    port=loop_start_2.port,
    Exit=stop,
    Data=tlist.A,
    Data_2=flatten(cluster_4),
    TimeOutVal=0,
    pausedState=False,
    state="Constant output")  # -> D0, D1

# ---- group: OLD
cluster_5 = Cluster(
    agent_location=item_2.Item1,
    agent_vector_global=unitize(addition),
    visible_tail=visible_2.ListOfPoints,
    phollow_tail=follow_tail)  # disabled

# ----
group_2 = Group(Objects=loop_end_2.D0)  # disabled
trim = TrimTree(Tree=group_2, Depth=1)  # disabled
flip = FlipMatrix(Data=trim)  # disabled
ungroup = Ungroup(Group=flip)  # disabled
branch = TreeBranch(Tree=loop_end_2.D0, Path=path, MaintainPaths=True)  # -> simplify(Branch); disabled
trim_2 = TrimTree(Tree=ungroup, Depth=1)  # disabled

# ==== cluster Cluster
agent_location = ClusterInput()

# ---- group: agent velocity
agent_vector_global = ClusterInput()

# ---- group: visible tail points
visible_tail = ClusterInput()

# ---- group: follow tail intensity
phollow_tail = ClusterInput()

# ----
motion_vector = Vector(agent_vector_global)
pt = Point(simplify(visible_tail))
pt_2 = Point(agent_location)
num = Number(phollow_tail)
viewer = ParamViewer(pt)
dpath = DeconstructPath(Branch=viewer)  # -> flatten(Indices)
lng = ListLength(List=pt_2)  # disabled
series = Series(Start=0, Step=1, Count=lng)  # -> simplify(graft(Series)); disabled

# ---- group: tree for rebuilding structure
item = ListItem(List=pt, Index=0, Wrap=True)

# ----
panel = Panel(dpath)
lng_2 = ListLength(List=pt)  # disabled

# ---- group: rebuilt position structure
item_2 = ListItem(List=pt_2, Index=dpath, Wrap=True)
unflatten = UnflattenTree(Tree=item_2, Guide=item)

# ---- group: rebuilt velocities structure
item_3 = ListItem(List=motion_vector, Index=dpath, Wrap=True)
unflatten_2 = UnflattenTree(Tree=item_3, Guide=item)

# ----
repeat = RepeatData(Data=series, Length=lng_2)  # disabled
panel_2 = Panel("1")  # disabled
panel_3 = Panel("1")  # disabled
prune = PruneTree(Tree=pt, Minimum=panel_3, Maximum=0)  # disabled
prune_2 = PruneTree(Tree=repeat, Minimum=panel_2, Maximum=0)  # disabled
cp = ClosestPoint(Point=unflatten, Cloud=pt)  # -> ClosestPoint, CPIndex, Distance
item_4 = ListItem(List=prune_2, Index=0, Wrap=True)  # -> flatten(Item); disabled

# ---- group: agent to visible tail points
vec2pt = Vector2Pt(PointA=unflatten, PointB=pt, Unitize=False)  # -> Vector, Length; disabled

# ---- group: agent to closest visible tail point
vec2pt_2 = Vector2Pt(PointA=unflatten, PointB=cp.ClosestPoint, Unitize=False)  # -> Vector, Length

# ----
int = Integer(item_4)  # disabled
sort = SortList(Keys=vec2pt.Length, ValuesA=vec2pt.Vector)  # -> Keys, ValuesA; disabled
item_5 = ListItem(List=pt_2, Index=int, Wrap=True)  # -> graft(Item); disabled
item_6 = ListItem(List=sort.ValuesA, Index=0, Wrap=True)  # disabled
vdisex = VectorDisplayEx(Point=unflatten, Vector=vec2pt.Vector, Colour=RGB(0, 0, 0), Width=2)  # disabled
xprod = CrossProduct(VectorA=unflatten_2, VectorB=vec2pt_2.Vector, Unitize=True)  # -> Vector, Length

# ---- group: angle between velocity and desired
angle = Angle(VectorA=unflatten_2, VectorB=vec2pt_2.Vector)  # -> Angle, Reflex

# ----
vec2pt_3 = Vector2Pt(PointA=simplify(item_5), PointB=prune, Unitize=False)  # -> Vector, Length; disabled
deg = Degrees(Radians=angle.Angle)
sort_2 = SortList(Keys=vec2pt_3.Length, ValuesA=vec2pt_3.Vector, ValuesB=prune)  # -> Keys, ValuesA, ValuesB; disabled
item_7 = ListItem(List=motion_vector, Index=int, Wrap=True)  # disabled
bar_graph = BarGraph(deg, BarColor=RGB(255, 0, 90))

# ---- group: vec
item_8 = ListItem(List=sort_2.ValuesA, Index=0, Wrap=True)  # disabled

# ----
multiplication = Multiplication(A=angle.Angle, B=num)
angle_2 = Angle(VectorA=simplify(graft(item_7)), VectorB=item_8)  # -> Angle, Reflex; disabled
panel_4 = Panel(int)  # disabled
vrot = Rotate(Vector=unflatten_2, Axis=xprod.Vector, Angle=multiplication)  # -> flatten(Vector)
panel_5 = Panel("1")  # disabled
pl = PlaneNormal(Origin=simplify(item_5), ZAxis=simplify(graft(item_7)))  # disabled
vdisex_2 = VectorDisplayEx(Point=unflatten, Vector=xprod.Vector, Colour=RGB(0, 0, 0), Width=2)
pl_2 = PlaneNormal(Origin=item_5, ZAxis=item_8)  # disabled
division = Division(A=panel_5, B=num)  # disabled
deg_2 = Degrees(Radians=angle_2.Angle)  # disabled
clean = CleanTree(RemoveNulls=True, RemoveInvalid=True, RemoveEmpty=False, Tree=vrot)
ppx = PlanePlane(PlaneA=simplify(pl_2), PlaneB=simplify(graft(pl)))  # disabled
division_2 = Division(A=deg_2, B=division)  # disabled
vrot_2 = Rotate(Vector=graft(item_7), Axis=ppx, Angle=degrees(division_2))  # -> flatten(Vector); disabled
replace = ReplaceItems(List=motion_vector, Item=clean, Indices=dpath, Wrap=False)
panel_6 = Panel(replace)
replace_2 = ReplaceItems(List=motion_vector, Item=vrot_2, Indices=int, Wrap=False)  # disabled
vector = ClusterOutput(replace)

# ==== cluster Cluster_2
L = ClusterInput()

lng = ListLength(List=L)  # -> flatten(Length)
item = ListItem(List=lng, Index=0, Wrap=True)

range = Range(Domain=Domain(0, 1), Steps=expr("x-1", item))

graph = GraphMapper(
    range,
    x0=0,
    x1=1,
    y0=0,
    y1=1,
    container_name="Bezier",
    cpx=[0, 0.6374178529, 0.8142894506, 1],
    cpy=[0, 0.1260549426, 0.5961636305, 1])
hsl = ColourHSL(Alpha=1, Hue=0, Saturation="0", Luminance=graph)

C = ClusterOutput(hsl)

# ==== cluster Cluster_3
agent_location = ClusterInput()

# ---- group: agent velocity
agent_vector_global = ClusterInput()

# ---- group: visible tail points
visible_tail = ClusterInput()

# ---- group: follow tail intensity
phollow_tail = ClusterInput()

# ----
pt = Point(simplify(visible_tail))
pt_2 = Point(agent_location)
motion_vector = Vector(agent_vector_global)
num = Number(phollow_tail)
clean = CleanTree(RemoveNulls=True, RemoveInvalid=True, RemoveEmpty="true", Tree=pt)
viewer = ParamViewer(clean)
dpath = DeconstructPath(Branch=viewer)  # -> flatten(Indices)

# ---- group: tree for rebuilding structure
item = ListItem(List=clean, Index=0, Wrap=True)

# ---- group: rebuilt position structure
item_2 = ListItem(List=pt_2, Index=dpath, Wrap=True)
unflatten = UnflattenTree(Tree=item_2, Guide=item)

# ---- group: rebuilt velocities structure
item_3 = ListItem(List=motion_vector, Index=dpath, Wrap=True)
unflatten_2 = UnflattenTree(Tree=item_3, Guide=item)

# ----
cp = ClosestPoint(Point=unflatten, Cloud=clean)  # -> ClosestPoint, CPIndex, Distance

# ---- group: agent to closest visible tail point
vec2pt = Vector2Pt(PointA=unflatten, PointB=cp.ClosestPoint, Unitize=False)  # -> Vector, Length

# ----
xprod = CrossProduct(VectorA=unflatten_2, VectorB=vec2pt.Vector, Unitize=True)  # -> Vector, Length

# ---- group: angle between velocity and desired
angle = Angle(VectorA=unflatten_2, VectorB=vec2pt.Vector)  # -> Angle, Reflex

# ----
multiplication = Multiplication(A=angle.Angle, B=num)
vrot = Rotate(Vector=unflatten_2, Axis=xprod.Vector, Angle=multiplication)  # -> flatten(Vector)
replace = ReplaceItems(List=motion_vector, Item=vrot, Indices=dpath, Wrap=False)
vdisex = VectorDisplayEx(Point=pt_2, Vector=replace, Colour=RGB(0, 0, 0), Width=2)
vector = ClusterOutput(replace)
