# Grasshopper definition 20160411_respawn + stratification.gh (Grasshopper 1.0.7)
# Copyright: Co-de-iT
# plug-ins: MarchingCubes, MeshEdit Components, Anemone, Human, Weaverbird

mesh = Mesh(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)
mesh_2 = Mesh(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)
# <title>
# 
# <description>
# 
# code by <author>
# 
# v <version>
# 
# © Co-de-iT 2016 _ Creative Commons Attribution-NonCommercial-ShareAlike 4.0 International License
# reciproCITY
# respawn: Agents differ from paticles in one very important characteristic: they can store internal states.
# 
# Under certain conditions, agents can "die" (become inactive) and, at will, be "respawned". The logic is as follows:
# 
# . use a flag to store the alive/dead agent state
# . if dead ignore
# . if alive, check for respawn condition
# . if so, change state from alive to dead and generate a new one
# . else, update agent
# tutors
# Aldo Sollazzo
# Alessio Erioli
# IaaC . 15-17.04.2016
# agents
facen = FaceNormals(Mesh=mesh)  # -> Centers, Normals
reduction_factor = Slider(0.944, range=0..1)
# field
reduction_factor_2 = Slider(0.944, range=0..1)
demesh = DeconstructMesh(Mesh=mesh)  # -> Vertices, Faces, Colours, Normals
lng = ListLength(List=facen.Centers)
lng_2 = ListLength(List=demesh.Vertices)
multiplication = Multiplication(A=lng, B=reduction_factor)
multiplication_2 = Multiplication(A=lng_2, B=reduction_factor_2)
reduce = RandomReduce(List=facen.Centers, Reduction=multiplication, Seed=1)
reduce_2 = RandomReduce(List=demesh.Vertices, Reduction=multiplication_2, Seed=1)

number_slider = Slider(13, range=1..20)
expression = Expression(x=number_slider, Expression="Format(\"{{<{0}}}\", x)")
pt = Point(simplify(graft(reduce)))
pt_2 = Point(Point(0, 0, 0))
split = SplitTree(Data=pt, Masks=flatten(expression))  # -> Positive, Negative
viewer = ParamViewer(split.Negative)
dpath = DeconstructPath(Branch=viewer)  # -> flatten(Indices)
expression_2 = Expression(x=dpath, Expression="Format(\"{{{0}}}\", x)")
addition = Addition(A=dpath, B=1)  # -> flatten(Result)
replace = ReplacePaths(Data=pt_2, Search="{*}", Replace=number_slider)
# insert branch in data tree
replace_2 = ReplacePaths(Data=split.Negative, Search=expression_2, Replace=addition)
merge = Merge(Data1=split.Positive, Data2=replace, Data3=replace_2)

medges = MeshEdges(Mesh=mesh)  # -> NakedEdges, InteriorEdges, NonManifoldEdges
repeat = RepeatData(Data="0", Length=lng_2)
lng_3 = ListLength(List=reduce)
# flag point
# use points as boolean flags: groups take only geometry so we use geometry as information
# 
# 0,0,1 > agent is alive
# 0,0,0 > agent is dead
pt_3 = Point(Point(0, 0, 1))
fspin = SpinForce(Plane=reduce_2, Strength=Slider(20, range=0..20), Radius=Slider(13.2, range=0..30), Decay=2)
repeat_2 = RepeatData(Data=pt_3, Length=lng_3)
mergef = MergeFields(Fields=fspin)
# show boundaries
join = JoinCurves(Curves=medges.NakedEdges, Preserve=False)

data = Data()
data_2 = Data()
# append branch  to data tree
tstat = TreeStatistics(Tree=data)  # -> Paths, Length, Count
replace_3 = ReplacePaths(Data=data_2, Search="{*}", Replace=tstat.Count)
merge_2 = Merge(Data1=data, Data2=replace_3)

# ----
# in order to pass the trajectory as a polyline we must generate a line by using a dummy first point (that will be culled after the loop).
ln = Line(StartPoint=pt_3, EndPoint=reduce)
evf = EvaluateField(Field=mergef, Point=demesh.Vertices)  # -> Tensor, Strength
bnd = Bounds(Numbers=evf.Strength)
dom = ConstructDomain(DomainStart=Slider(1.089, range=0..5), DomainEnd=Slider(4.462, range=0..5))
# . agent location
# . alive/dead status
# . trajectory as polyline
merge_3 = Merge(Data1=simplify(graft(reduce)), Data2=simplify(graft(repeat_2)), Data3=simplify(graft(ln)))
remap = RemapNumbers(Value=evf.Strength, Source=bnd, Target=dom)  # -> Mapped, Clipped
amp = Amplitude(Vector=evf.Tensor, Amplitude=remap.Mapped)
group = Group(Objects=merge_3)  # -> simplify(Group)
velocity = Slider(2.33, range=0..10)
level_height = Slider(0.3, range=0..1)
number_slider_2 = Slider(50, range=0..1000)
button = Button()
exit = Button()
vdisex = VectorDisplayEx(Point=demesh.Vertices, Vector=amp, Colour=RGB(0, 0, 0), Width=1)
loop_start = LoopStart(N=number_slider_2, T=button, particles=group, strata=repeat)  # -> port, Counter, Particles, Strata
ungroup = Ungroup(Group=loop_start.Particles)
expression_3 = Expression(x=loop_start.Counter, y=number_slider_2, Expression="Format(\"{0} %\",round(x/y*100,1))")
# loc
# alive?
# trail as polyline
item = ListItem(List=ungroup, Index=0, Wrap=True)  # -> Item, Item1, Item2
panel = Panel(expression_3)

# ---- group: is agent alive?
pdecon = Deconstruct(Point=item.Item1)  # -> XComponent, YComponent, ZComponent
dispatch = Dispatch(List=item.Item2, DispatchPattern=pdecon.ZComponent)  # -> ListA, ListB
dispatch_2 = Dispatch(List=item.Item, DispatchPattern=pdecon.ZComponent)  # -> ListA, ListB
dispatch_3 = Dispatch(List=item.Item1, DispatchPattern=pdecon.ZComponent)  # -> ListA, ListB

# ---- group: respawn check
meshcp = MeshClosestPoint(Point=dispatch_2.ListA, Mesh=mesh)  # -> Point, Index, Parameter
crv_cp = CurveClosestPoint(Point=graft(meshcp.Point), Curve=join)  # -> Point, Parameter, Distance
edge_thres = Slider(1.5, range=0..10)
sort = SortList(Keys=crv_cp.Distance)  # -> Keys, ValuesA
item_2 = ListItem(List=sort.Keys, Index=0, Wrap=True)
smaller = SmallerThan(FirstNumber=item_2, SecondNumber=edge_thres)  # -> SmallerThan, simplify(OrEqualTo)
dispatch_4 = Dispatch(List=dispatch_2.ListA, DispatchPattern=smaller.OrEqualTo)  # -> ListA, ListB
dispatch_5 = Dispatch(List=dispatch_3.ListA, DispatchPattern=smaller.OrEqualTo)  # -> ListA, ListB
dispatch_6 = Dispatch(List=dispatch.ListA, DispatchPattern=smaller.OrEqualTo)  # -> ListA, ListB

# ---- group: update
clean = CleanTree(RemoveNulls=True, RemoveInvalid=True, RemoveEmpty=True, Tree=dispatch_4.ListB)
clean_2 = CleanTree(RemoveNulls=True, RemoveInvalid=True, RemoveEmpty=True, Tree=dispatch_5.ListB)
clean_3 = CleanTree(RemoveNulls=True, RemoveInvalid=True, RemoveEmpty=True, Tree=dispatch_6.ListB)
explode = Explode(Curve=clean_3, Recursive=True)  # -> Segments, Vertices
panel_2 = Panel("1")

# ---- group: update / move (field)
evf_2 = EvaluateField(Field=mergef, Point=clean)  # -> Tensor, Strength
amp_2 = Amplitude(Vector=evf_2.Tensor, Amplitude=velocity)
move = Move(Geometry=clean, Motion=amp_2)  # -> Geometry, Transform

# ---- group: update / Closest Vertex
cp = ClosestPoint(Point=move.Geometry, Cloud=demesh.Vertices)  # -> ClosestPoint, CPIndex, Distance

# ---- group: update / Update Strata
item_3 = ListItem(List=flatten(loop_start.Strata), Index=cp.CPIndex, Wrap=True)
addition_2 = Addition(A=item_3, B=panel_2)

# ---- group: update / normal vector
item_4 = ListItem(List=demesh.Normals, Index=cp.CPIndex, Wrap=True)

# ---- group: update / Height
amp_3 = Amplitude(Vector=item_4, Amplitude=level_height)

# ---- group: update / constrain to mesh and add to trajectory
multiplication_3 = Multiplication(A=amp_3, B=addition_2)
meshcp_2 = MeshClosestPoint(Point=move.Geometry, Mesh=mesh)  # -> Point, Index, Parameter
move_2 = Move(Geometry=meshcp_2.Point, Motion=multiplication_3)  # -> simplify(Geometry), Transform
merge_4 = Merge(Data1=simplify(explode.Vertices), Data2=simplify(move_2.Geometry))
pline = PolyLine(Vertices=merge_4, Closed=False)

# ----
lng_4 = ListLength(List=flatten(dispatch_5.ListA))
pt_4 = Point(Point(0, 0, 0))
repeat_3 = RepeatData(Data=pt_4, Length=lng_4)  # -> flatten(Data)
pt_5 = Point(flatten(dispatch_4.ListA))
crv = Curve(flatten(dispatch_6.ListA))
merge_5 = Merge(Data1=graft(pt_5), Data2=graft(repeat_3), Data3=graft(crv))
# killed agents
group_2 = Group(Objects=merge_5)  # -> flatten(Group)

merge_6 = Merge(Data1=dispatch_2.ListB, Data2=dispatch_3.ListB, Data3=dispatch.ListB)
clean_4 = CleanTree(RemoveNulls=True, RemoveInvalid=True, RemoveEmpty=Toggle(True), Tree=merge_6)
# inactive agents
group_3 = Group(Objects=clean_4)  # -> flatten(Group)

merge_7 = Merge(Data1=simplify(move.Geometry), Data2=simplify(clean_2), Data3=simplify(pline))
# updated agents
group_4 = Group(Objects=merge_7)  # -> flatten(Group)

replace_4 = ReplaceItems(List=loop_start.Strata, Item=flatten(addition_2), Indices=flatten(cp.CPIndex), Wrap=False)

execute = BooleanToggle(False)

radius = Slider(2, range=0..100)
number_slider_3 = Slider(1, range=0.3..10)
number_slider_4 = Slider(0.5, range=0.01..1)
list = ValueList({"None": 0, "Front to Back": 1, "Both Ends": 2}, selected="Both Ends")
multiplication_4 = Multiplication(A=replace_4, B=level_height)
dist = Slider(3, range=0..5)
amp_4 = Amplitude(Vector=demesh.Normals, Amplitude=multiplication_4)
bnd_2 = Bounds(Numbers=replace_4)
gradient = Gradient(
    LowerLimit=0,
    UpperLimit=bnd_2,
    Parameter=replace_4,
    stops=[0: RGB(234, 38, 0), 0.25: RGB(234, 126, 0), 0.5: RGB(254, 244, 84), 0.75: RGB(173, 203, 249)])
move_3 = Move(Geometry=demesh.Vertices, Motion=amp_4)  # -> Geometry, Transform
execute_2 = BooleanToggle(False)
toggle = BooleanToggle(False)
# display strata
orient2cam = OrientToCamera(Pt=move_3.Geometry, refresh=Button())  # -> out, A; inputs Pt: Point3d, refresh: Boolean
# ---------- orient2cam: C# ----------
    Plane p;
    String eol = Environment.NewLine;
    Component.Name = "Orient to Camera";
    Component.NickName = "Orient2Cam";
    Component.Message = "v0.1 _ by Alessio Erioli" + eol + "Co-de-iT";
    Component.Description = "Creates a plane on the input point aligned with current camera";


    if (RhinoDoc.ActiveDoc.Views.ActiveView.ActiveViewport.GetCameraFrame(out p)){
      A = new Plane(new Point3d(Pt.X, Pt.Y, Pt.Z), p.XAxis, p.YAxis);
    }
# ---------- end orient2cam ----------
execute_3 = BooleanToggle(False)
tag = TextTag3D(Location=orient2cam.A, Text=replace_4, Size=1, Colour=gradient, Justification=7)
vdisex_2 = VectorDisplayEx(Point=demesh.Vertices, Vector=amp_4, Colour=gradient, Width=Slider(1, range=1..3))

# ---- group: respawn
subtraction = Subtraction(A=lng_2, B="1")
lng_5 = ListLength(List=flatten(dispatch_4.ListA))
random = Random(Range=subtraction, Number=lng_5, Seed=loop_start.Counter, Integers=True)
item_5 = ListItem(List=demesh.Vertices, Index=random, Wrap=True)  # -> flatten(Item)
lng_6 = ListLength(List=item_5)
pt_6 = Point(Point(0, 0, 1))
repeat_4 = RepeatData(Data=pt_6, Length=lng_6)  # -> flatten(Data)

# ----
ln_2 = Line(StartPoint=pt_6, EndPoint=item_5)  # -> flatten(Line)

# ---- group: respawn (continued)
merge_8 = Merge(Data1=simplify(graft(item_5)), Data2=simplify(graft(repeat_4)), Data3=simplify(graft(ln_2)))
# respawned agents
group_5 = Group(Objects=merge_8)  # -> flatten(Group)

# ----
merge_9 = Merge(Data1=group_3, Data2=group_5, Data3=group_2, Data4=group_4)  # -> simplify(graft(Result))
loop_end = LoopEnd(
    port=loop_start.port,
    Exit=exit,
    Particles=simplify(merge_9),
    Strata=simplify(replace_4),
    TimeOutVal=0,
    pausedState=False,
    state="Constant output")  # -> particles, strata
ungroup_2 = Ungroup(Group=loop_end.particles)
item_6 = ListItem(List=ungroup_2, Index=0, Wrap=True)  # -> Item, Item1, Item2
explode_2 = Explode(Curve=item_6.Item2, Recursive=True)  # -> Segments, Vertices
cull_i = CullIndex(List=explode_2.Vertices, Indices=0, Wrap=True)
pline_2 = PolyLine(Vertices=cull_i, Closed=False)
clean_5 = CleanTree(RemoveNulls=True, RemoveInvalid=True, RemoveEmpty=True, Tree=pline_2)
smoothpline = SmoothPolyline(Polyline=clean_5, Strength=1, Times=Slider(5, range=1..30))  # -> flatten(Polyline)

dam = DataDam(DataA=smoothpline, BufferDelay=10000000, BufferMode=0)

crv_2 = Curve(dam)
# remember to
# clean tree before
# using the connect
# component!!
explode_3 = Explode(Curve=dam, Recursive=True)  # -> Segments, Vertices
lng_7 = ListLength(List=explode_3.Vertices)
range = Range(Domain=Domain(0, 1), Steps=lng_7)
graph = GraphMapper(range, x0=0, x1=1, y0=0, y1=1, container_name="Sine", Equation_px=[0, 0.4983883202], Equation_py=[0.702873826, 1])
graph_2 = GraphMapper(
    range,
    x0=0,
    x1=1,
    y0=0,
    y1=1,
    container_name="Bezier",
    cpx=[0, 0.3913043439, 0.6086956263, 1],
    cpy=[0.3695651889, 1, 1, 0.3913043737])
dam_2 = DataDam(DataA=explode_3.Vertices, BufferDelay=10000000, BufferMode=0)
cluster = Cluster(C=flatten(crv_2), B=number_slider_3)  # -> cell_n, bounding_box_edges
geometry_wrapper = VBScript(
    G=flatten(crv_2),
    R=flatten(radius),
    res=number_slider_3,
    iso=number_slider_4,
    smooth=Slider(1, range=0..10),
    taper=list,
    ratio=Slider(0.33, range=0..1),
    run=execute)  # -> out, mc; inputs G: list, R: list; disabled
# ---------- geometry_wrapper: VB ----------
    If run = True Then

      'set edge and triangle tables from the inestimable PaulBourke.net
      intEdgeTable = {&H0, &H109, &H203, &H30a, &H406, &H50f, &H605, &H70c,&H80c, &H905, &Ha0f, &Hb06, &Hc0a, &Hd03, &He09, &Hf00,&H190, &H99 , &H393, &H29a, &H596, &H49f, &H795, &H69c,&H99c, &H895, &Hb9f, &Ha96, &Hd9a, &Hc93, &Hf99, &He90,&H230, &H339, &H33 , &H13a, &H636, &H73f, &H435, &H53c,&Ha3c, &Hb35, &H83f, &H936, &He3a, &Hf33, &Hc39, &Hd30,&H3a0, &H2a9, &H1a3, &Haa , &H7a6, &H6af, &H5a5, &H4ac,&Hbac, &Haa5, &H9af, &H8a6, &Hfaa, &Hea3, &Hda9, &Hca0,&H460, &H569, &H663, &H76a, &H66 , &H16f, &H265, &H36c,&Hc6c, &Hd65, &He6f, &Hf66, &H86a, &H963, &Ha69, &Hb60,&H5f0, &H4f9, &H7f3, &H6fa, &H1f6, &Hff , &H3f5, &H2fc,&Hdfc, &Hcf5, &Hfff, &Hef6, &H9fa, &H8f3, &Hbf9, &Haf0,&H650, &H759, &H453, &H55a, &H256, &H35f, &H55 , &H15c,&He5c, &Hf55, &Hc5f, &Hd56, &Ha5a, &Hb53, &H859, &H950,&H7c0, &H6c9, &H5c3, &H4ca, &H3c6, &H2cf, &H1c5, &Hcc ,&Hfcc, &Hec5, &Hdcf, &Hcc6, &Hbca, &Hac3, &H9c9, &H8c0,&H8c0, &H9c9, &Hac3, &Hbca, &Hcc6, &Hdcf, &Hec5, &Hfcc,&Hcc , &H1c5, &H2cf, &H3c6, &H4ca, &H5c3, &H6c9, &H7c0,&H950, &H859, &Hb53, &Ha5a, &Hd56, &Hc5f, &Hf55, &He5c,&H15c, &H55 , &H35f, &H256, &H55a, &H453, &H759, &H650,&Haf0, &Hbf9, &H8f3, &H9fa, &Hef6, &Hfff, &Hcf5, &Hdfc,&H2fc, &H3f5, &Hff , &H1f6, &H6fa, &H7f3, &H4f9, &H5f0,&Hb60, &Ha69, &H963, &H86a, &Hf66, &He6f, &Hd65, &Hc6c,&H36c, &H265, &H16f, &H66 , &H76a, &H663, &H569, &H460,&Hca0, &Hda9, &Hea3, &Hfaa, &H8a6, &H9af, &Haa5, &Hbac,&H4ac, &H5a5, &H6af, &H7a6, &Haa , &H1a3, &H2a9, &H3a0,&Hd30, &Hc39, &Hf33, &He3a, &H936, &H83f, &Hb35, &Ha3c,&H53c, &H435, &H73f, &H636, &H13a, &H33 , &H339, &H230,&He90, &Hf99, &Hc93, &Hd9a, &Ha96, &Hb9f, &H895, &H99c,&H69c, &H795, &H49f, &H596, &H29a, &H393, &H99 , &H190,&Hf00, &He09, &Hd03, &Hc0a, &Hb06, &Ha0f, &H905, &H80c,&H70c, &H605, &H50f, &H406, &H30a, &H203, &H109, &H0}
      intTriTable= {{-1, -1, -1, -1, -1, -1, -1, -1, -1, -1, -1, -1, -1, -1, -1, -1},{0, 8, 3, -1, -1, -1, -1, -1, -1, -1, -1, -1, -1, -1, -1, -1},{0, 1, 9, -1, -1, -1, -1, -1, -1, -1, -1, -1, -1, -1, -1, -1},{1, 8, 3, 9, 8, 1, -1, -1, -1, -1, -1, -1, -1, -1, -1, -1},{1, 2, 10, -1, -1, -1, -1, -1,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

      use_iso = iso
      TaperCurves = taper
      TaperRatio = ratio
      If ratio < 0 Then
        TaperRatio = 0
      ElseIf ratio > 1 Then
        TaperRatio = 1
      End If

      'setup point and curve geometry sources
      Dim crvSource As New List(Of Curve)
      Dim crvRad As New List(Of Double)

      Dim ptSource As New List(Of Point3d)
      Dim ptRad As New List(Of Double)

      Dim brpSource As New List(Of Brep)
      Dim brpMesh As New List(Of Mesh)
      Dim brpRad As New List(Of Double)

      Dim radCounter As Int32 = -1

      For Gi As Int32 = 0 To G.Count - 1

        If GI <= R.Count - 1 Then
          radCounter += 1
        End If

        Dim crv As Curve = TryCast(G(Gi), Curve)
        If crv IsNot Nothing Then
          crv.Domain = New Interval(0, 1)
          crvSource.Add(Crv)
          crvRad.Add(R(radCounter))
        Else
          If TypeOf(G(Gi)) Is Line Then
            Dim lin As Line = DirectCast(G(Gi), Line)
            Dim lc As New LineCurve(lin)
            lc.Domain = New Interval(0, 1)
            crvSource.Add(lc)
            crvRad.Add(R(radCounter))
          Else
            Dim brp As Brep = TryCast(G(Gi), Brep)
            If brp IsNot Nothing Then
              brpSource.Add(brp)
              brpRad.Add(R(radCounter))
              Dim msh() As Mesh = Mesh.CreateFromBrep(brp)
              Dim mshSet As New Mesh
              For Each mshAdd As Mesh In msh
                mshSet.Append(mshAdd)
              Next
              refine_mesh(mshSet)
              brpMesh.Add(mshSet)
            Else
              ptSource.Add(G(Gi))
              ptRad.Add(R(radCounter))
            End If
          End If
        End If

      Next

      'charge sphere lookup data for both the rTree and the bounding box for the sample point 3D grid
      Dim pt As New List(Of Point3d)
      Dim rad As New List(Of Double)
      Dim tgtType As New List(Of Int32)
      Dim tgtIdx As New List(Of int32)



      For crvi As Int32 = 0 To crvSource.Count - 1 'assign series of spheres along curve for identifying sample points for inclusion
        Dim crv As Curve = crvSource(crvi)
        Dim SphereRad As Double = Math.Sqrt(crvRad(crvi) ^ 2 + (crvRad(crvi) / 2) ^ 2) * 1.3

        If crv.GetLength <= crvRad(crvi) Then

          pt.Add((crv.PointAtStart + crv.PointAtEnd) * 0.5)
          rad.Add(SphereRad)
          tgtType.Add(0)
          tgtIdx.Add(crvi)

        Else

          Dim t() As Double = crv.DivideByCount(crv.GetLength / crvRad(crvi), True)

          For Each tSet As Double In t
            Dim ptAdd As Point3d = crv.PointAt(tSet)
            Dim blAdd As Boolean = True

            If blAdd = True Then

              pt.Add(ptAdd)
              rad.Add(SphereRad)
              tgtType.Add(0)
              tgtIdx.Add(crvi)

            End If
          Next

        End If

      Next

      For pti As Int32 = 0 To ptSource.Count - 1
        pt.Add(ptSource(pti))
        rad.Add(ptRad(pti) * 1.3)
        tgtType.Add(1)
        tgtIdx.Add(pti)
      Next

      For brpi As Int32 = 0 To brpSource.Count - 1

        Dim brpCrvs() As Curve = brpSource(brpi).DuplicateEdgeCurves

        For crvi As Int32 = 0 To brpCrvs.Length - 1 'assign series of spheres along curve for identifying sample points for inclusion
          Dim crv As Curve = brpCrvs(crvi)
          Dim t() As Double = crv.DivideByCount(crv.GetLength / brpRad(brpi), True)
          Dim SphereRad As Double = Math.Sqrt(brpRad(brpi) ^ 2 + (brpRad(brpi) / 2) ^ 2) * 1.3
          For Each tSet As Double In t
            pt.Add(crv.PointAt(tSet))
            rad.Add(SphereRad)
            tgtType.Add(2)
            tgtIdx.Add(brpi)
          Next
        Next

        For fi As int32 = 0 To brpSource(brpi).Faces.Count - 1

          Dim bface As BrepFace = brpSource(brpi).Faces(fi)
          Dim SphereRad As Double = Math.Sqrt(brpRad(brpi) ^ 2 + (brpRad(brpi) / 2) ^ 2) * 1.3

          Dim w,h As Double
          bface.GetSurfaceSize(w, h)
          Dim ui As Double = w / brpRad(brpi)
          Dim vi As Double = h / brpRad(brpi)

          For u As Int32 = 0 To ui
            For v As Int32 = 0 To vi
              If bface.IsPointOnFace(bface.Domain(0).ParameterAt(u / ui), bface.Domain(1).ParameterAt(v / vi)) Then
                pt.Add(bface.PointAt(bface.Domain(0).ParameterAt(u / ui), bface.Domain(1).ParameterAt(v / vi)))
                rad.Add(SphereRad)
                tgtType.Add(2)
                tgtIdx.Add(brpi)
              End If
            Next
          Next

        Next

      Next


      'generate box orienting plane
      Dim pl As Plane = Nothing
      Plane.FitPlaneToPoints(pt, pl)
      pl.Origin = pt(0)
      '
      'generate bounding box
      Dim dom As New interval(-rad(0), rad(0))
      Dim b As New Box(pl, dom, dom, dom)
      '
      For set_s As Int32 = 1 To pt.Count - 1
        pl.Origin = pt(set_s)
        b.Union(pl.PointAt(-rad(set_s), -rad(set_s), -rad(set_s)))
        b.Union(pl.PointAt(rad(set_s), rad(set_s), rad(set_s)))
      Next

      b.Inflate(res * 3)
      Dim rt As New RTree 'the RTree used for assigning sample points to appropriate point/curve charges

      'calculate sample point grid size relative to the xyz of the oriented bounding box
      Dim xSet As Int32 = b.X.Length / res
      Dim ySet As Int32 = b.Y.Length / res
      Dim zSet As Int32 = b.Z.Length / res
      Dim xLength As Double = b.X.Length / xSet
      Dim yLength As Double = b.Y.Length / ySet
      Dim zLength As Double = b.Z.Length / zSet
      Dim xOffset As Double = xLength / 2
      Dim yOffset As Double = yLength / 2
      Dim zOffset As Double = zLength / 2

      pl.Origin = b.GetCorners(0)

      Dim bCornerLookup(xSet*ySet*zSet-1, 7) As Int32 'array of corner indices for each cell
      Dim bCenterIdx As Int32 = 0

      Dim bCorners As New List(Of Point3d) 'list of all cell corners
      Dim bCornerField((xSet+1)*(ySet+1)*(zSet+1)-1) As Double
      Dim bCornerIdx As Int32 = 0

      'Setup rTree with center points of each cell, all cell corner points and indices of corners for each cell for looking up iso calc

      For xRun As Int32 = 0 To xSet
        For yRun As Int32 = 0 To ySet
          For zRun As Int32 = 0 To zSet
            If xRun < xSet And yRun < ySet And zRun < zSet Then

              'setting up cell centers and assigning index array for all associated sample points

              Dim bCenter As Point3d = pl.PointAt(xOffset + (xLength * xRun), yOffset + (yLength * yRun), zOffset + (zLength * zRun))
              rt.Insert(bCenter, bCenterIdx)

              Dim lc As Int32 = bCornerIdx
              Dim rc As Int32 = lc + ((ySet + 1) * (zSet + 1))

              bCornerLookup(bCenterIdx, 0) = lc + zSet + 1
              bCornerLookup(bCenterIdx, 1) = rc + zSet + 1
              bCornerLookup(bCenterIdx, 2) = rc
              bCornerLookup(bCenterIdx, 3) = lc
              bCornerLookup(bCenterIdx, 4) = lc + zSet + 2
              bCornerLookup(bCenterIdx, 5) = rc + zSet + 2
              bCornerLookup(bCenterIdx, 6) = rc + 1
              bCornerLookup(bCenterIdx, 7) = lc + 1

              bCenterIdx += 1

            End If

            'sample points
            Dim bCorner As Point3d = pl.PointAt(xLength * xRun, yLength * yRun, zLength * zRun)
            bCorners.Add(bCorner)

            bCornerIdx += 1
          Next
        Next
      Next

      Dim MchCube As New Mesh

      'create a list of corner field values to calculate
      Dim CalcIndices As New DataTree(Of Int32) 'a data tree of sample points to be calculated, assigned according to charge
      'type and index, and cleaned of all duplicate values
      Dim CalcIndicesStart As New List(Of Int32) 'an initial list of sample points to be calculated, with potential duplicates

      Dim CenterTargetRaw As New List(Of Int32)
      Dim CenterTargetRefined As New List(Of Int32)

      For rti As int32 = 0 To pt.Count - 1 'cycle through all charge points

        'for each curve, there are multiple charge point spheres that need to be assessed

        If rti > 0 Then 'after the first charge is assessed, it is determined at each cycle if the charge is part of the same
          'input curve geometry...if it is part of a new one, then append the cleaned sample point indices, otherwise, continue
          'evaluating sample points
          If tgtType(rti) <> tgtType(rti - 1) Or tgtIdx(rti) <> tgtIdx(rti - 1) Then
            CalcIndices.AddRange(CalcIndicesStart.Distinct.ToList, New GH_Path(tgtType(rti - 1), tgtIdx(rti - 1)))
            CalcIndicesStart.Clear
          End If
        End If

        'use the rTree to test proximity of cell centers to charge points...for all cell centers within the assigned radius of
        'each charge point
        Dim DataSet As New search_data(pt(rti))
        If rt.Search(New Sphere(pt(rti), rad(rti)), AddressOf search_call, DataSet) = True Then
          If DataSet.target_idc.Count > 0 Then
            For Each target_idx As Int32 In DataSet.target_idc
              For i As int32 = 0 To 7
                CalcIndicesStart.Add(bCornerLookup(target_idx, i))
                CenterTargetRaw.Add(target_idx)
              Next
            Next
          End If
        End If

        'at the last cycle, append the last list
        If rti = pt.Count - 1 Then
          CalcIndices.AddRange(CalcIndicesStart.Distinct.ToList, New GH_Path(tgtType(rti), tgtIdx(rti)))
        End If

      Next

      'list of all unique cells that will need to be assessed
      CenterTargetRefined.AddRange(CenterTargetRaw.Distinct.ToList)

      'field calculations for all relevant charge/sample point relationships
      For Each p As GH_Path In CalcIndices.Paths

        Dim CI As List(Of Int32) = CalcIndices.Branch(p)

        If p.Indices(0) = 0 Then 'it's a curve

          Dim crv As Curve = crvSource(p.Indices(1))
          Dim radius As Double = crvRad(p.Indices(1))

          For Each CalcIndex As Int32 In CI
            bCornerField(CalcIndex) += calculate_crv_field(bCorners(CalcIndex), crv, radius)
          Next

        ElseIf p.Indices(0) = 1 Then 'it's a point

          Dim center As Point3d = ptSource(p.Indices(1))
          Dim radius As Double = ptRad(p.Indices(1))

          For Each CalcIndex As Int32 In CI
            bCornerField(CalcIndex) += calculate_pt_field(bCorners(CalcIndex), center, radius)
          Next

        Else 'it's a brep

          Dim brp As Brep = brpSource(p.Indices(1))
          Dim msh As Mesh = brpMesh(p.Indices(1))
          Dim radius As Double = brpRad(p.Indices(1))

          For Each CalcIndex As Int32 In CI
            bCornerField(CalcIndex) += calculate_brp_field(bCorners(CalcIndex), msh, radius)
          Next

        End If

      Next

      For Each CenterTarget As Int32 In CenterTargetRefined

        Dim CList As New List(Of Point3d)
        Dim CField As New List(Of Double)

        For i As Int32 = 0 To 7

          CList.Add(bCorners(bCornerLookup(CenterTarget, i)))
          CField.Add(bCornerField(bCornerLookup(CenterTarget, i)))

        Next

        Dim TriMesh As Mesh = local_cube(CList, CField)
        MchCube.append(TriMesh)

      Next

      refine_mesh(MchCube)

      Dim DisjointMesh() As Mesh = mchCube.SplitDisjointPieces
      For Each M As Mesh In DisjointMesh
        refine_mesh(M)
        For s As int32 = 0 To smooth - 1
          SmoothMesh(M)
        Next
      Next

      mc = DisjointMesh

    End If
# ---------- geometry_wrapper: VB additional code ----------
  Public intEdgeTable(255) As Int32
  Public intTriTable(255, 15) As Int32
  Public use_iso As Double
  Public TaperCurves As Int32
  Public TaperRatio As Double

  Function local_cube(ByVal c As List(Of Point3d), ByVal c_v As List(Of Double)) As Mesh

    'marching cube algorithm
    'adapted from the c++ script by Paul Bourke:
    'http://paulbourke.net/geometry/polygonise/

    Dim cubeindex As Int32
    If c_v(0) < use_iso Then cubeindex = cubeindex Or 1
    If c_v(1) < use_iso Then cubeindex = cubeindex Or 2
    If c_v(2) < use_iso Then cubeindex = cubeindex Or 4
    If c_v(3) < use_iso Then cubeindex = cubeindex Or 8
    If c_v(4) < use_iso Then cubeindex = cubeindex Or 16
    If c_v(5) < use_iso Then cubeindex = cubeindex Or 32
    If c_v(6) < use_iso Then cubeindex = cubeindex Or 64
    If c_v(7) < use_iso Then cubeindex = cubeindex Or 128

    Dim vertlist(11) As Point3d

    If intEdgeTable(cubeindex) And 1 Then vertlist(0) = interp_vertex(c(0), c(1), c_v(0), c_v(1))
    If intEdgeTable(cubeindex) And 2 Then vertlist(1) = interp_vertex(c(1), c(2), c_v(1), c_v(2))
    If intEdgeTable(cubeindex) And 4 Then vertlist(2) = interp_vertex(c(2), c(3), c_v(2), c_v(3))
    If intEdgeTable(cubeindex) And 8 Then vertlist(3) = interp_vertex(c(3), c(0), c_v(3), c_v(0))
    If intEdgeTable(cubeindex) And 16 Then vertlist(4) = interp_vertex(c(4), c(5), c_v(4), c_v(5))
    If intEdgeTable(cubeindex) And 32 Then vertlist(5) = interp_vertex(c(5), c(6), c_v(5), c_v(6))
    If intEdgeTable(cubeindex) And 64 Then vertlist(6) = interp_vertex(c(6), c(7), c_v(6), c_v(7))
    If intEdgeTable(cubeindex) And 128 Then vertlist(7) = interp_vertex(c(7), c(4), c_v(7), c_v(4))
    If intEdgeTable(cubeindex) And 256 Then vertlist(8) = interp_vertex(c(0), c(4), c_v(0), c_v(4))
    If intEdgeTable(cubeindex) And 512 Then vertlist(9) = interp_vertex(c(1), c(5), c_v(1), c_v(5))
    If intEdgeTable(cubeindex) And 1024 Then vertlist(10) = interp_vertex(c(2), c(6), c_v(2), c_v(6))
    If intEdgeTable(cubeindex) And 2048 Then vertlist(11) = interp_vertex(c(3), c(7), c_v(3), c_v(7))

    Dim box_mesh As New Mesh()

    For i As int32 = 0 To 16 Step 3
      If intTriTable(cubeindex, i) = -1 Then Exit For
      box_mesh.Vertices.Add(vertlist(intTriTable(cubeindex, i)))
      box_mesh.Vertices.Add(vertlist(intTriTable(cubeindex, i + 1)))
      box_mesh.Vertices.Add(vertlist(intTriTable(cubeindex, i + 2)))
      box_mesh.Faces.AddFace(New MeshFace(i + 2, i + 1, i))
    Next

    Return box_mesh

  End Function

  Function interp_vertex(ByVal p1 As Point3d, ByVal p2 As Point3d, ByVal v1 As Double, ByVal v2 As Double) As Point3d
    Return New Point3d(P1 + (use_iso - v1) / (v2 - v1) * (p2 - p1))
  End Function

  Function calculate_brp_field(ByVal test_pt As Point3d, ByVal msh As Mesh, ByVal radius As Double) As Double
    'metaball field calculations
    'based on methods described by Paul Bourke:
    'http://paulbourke.net/geometry/implicitsurf/

    Dim field_value As Double = 0
    Dim test_dist As Double = msh.ClosestPoint(test_pt).DistanceTo(test_pt)

    If test_dist > 0 And test_dist < radius / 3 Then
      field_value += 1 * (1 - 3 * test_dist ^ 2 / radius ^ 2)
    ElseIf test_dist >= radius / 3 And test_dist < radius Then
      field_value += (3 / 2) * (1 - test_dist / radius) ^ 2
    End If
    Return field_value

  End Function

  Function calculate_crv_field(ByVal test_pt As Point3d, ByVal crv As Curve, ByVal radius As Double) As Double
    'metaball field calculations
    'based on methods described by Paul Bourke:
    'http://paulbourke.net/geometry/implicitsurf/

    Dim field_value As Double = 0

    Dim t As Double
    crv.ClosestPoint(test_pt, t)
    Dim test_dist As Double = crv.PointAt(t).DistanceTo(test_pt)

    'if the curves are to be tapered, adjust the radius calculation
    'relative To the closest point along the charge curve

    If TaperCurves = 1 Then
      radius = (radius * (TaperRatio + 0.01)) + (radius * (1 - t) * (1 - TaperRatio))
    ElseIf TaperCurves = 2 Then
      radius = (radius * ((1 - TaperRatio) + 0.01)) + (radius * (1 - Math.Abs(0.5 - t)) * (TaperRatio))
    End If

    If test_dist > 0 And test_dist < radius / 3 Then
      field_value += 1 * (1 - 3 * test_dist ^ 2 / radius ^ 2)
    ElseIf test_dist >= radius / 3 And test_dist < radius Then
      field_value += (3 / 2) * (1 - test_dist / radius) ^ 2
    End If
    Return field_value

  End Function

  Function calculate_pt_field(ByVal test_pt As Point3d, ByVal center As Point3d, ByVal radius As Double) As Double
    'metaball field calculations
    'based on methods described by Paul Bourke:
    'http://paulbourke.net/geometry/implicitsurf/

    Dim field_value As Double = 0

    Dim test_dist As Double = test_pt.DistanceTo(center)

    If test_dist > 0 And test_dist < radius / 3 Then
      field_value += 1 * (1 - 3 * test_dist ^ 2 / radius ^ 2)
    ElseIf test_dist >= radius / 3 And test_dist < radius Then
      field_value += (3 / 2) * (1 - test_dist / radius) ^ 2
    End If

    Return field_value
  End Function

  Public Sub search_call(ByVal sender As Object, ByVal e As RTreeEventArgs)
    Dim data As search_data = TryCast(e.Tag, search_data)
    data.target_idc.Add(e.Id)
  End Sub

  Public Class search_data

    Public Sub New(ByVal get_search_node As Point3d)
      search_node = get_search_node
    End Sub

    Public search_node As Point3d
    Public target_idc As New List(Of Int32)

  End Class

  Function refine_mesh(ByRef msh As Mesh) As Boolean
    msh.Vertices.CombineIdentical(True, True)
    msh.FaceNormals.ComputeFaceNormals()
    msh.Normals.ComputeNormals()
    msh.UnifyNormals()
    Return True
  End Function

  Function SmoothMesh(ByRef msh As Mesh) As Boolean

    Dim vertices() As Point3d = msh.Vertices.ToPoint3dArray
    Dim set_vertices() As Point3d = msh.Vertices.ToPoint3dArray

    For v As int32 = 0 To msh.TopologyVertices.Count - 1

      Dim neighbors() As Int32 = msh.TopologyVertices.ConnectedTopologyVertices(v)
      Dim center As Int32 = msh.TopologyVertices.MeshVertexIndices(v)(0)

      Dim reset_center As New Point3d(0, 0, 0)
      Dim counter As Int32 = 0
      For Each neighbor As int32 In neighbors
        Dim reset_vertex As Int32 = msh.TopologyVertices.MeshVertexIndices(neighbor)(0)
        If reset_vertex <> center Then
          reset_center += vertices(reset_vertex)
          counter += 1
        End If
      Next

      set_vertices(center) = reset_center / counter
      set_vertices(center) = msh.ClosestPoint(set_vertices(center))

    Next

    For v As int32 = 0 To msh.Vertices.count - 1
      msh.Vertices(v) = New Point3f(set_vertices(v).X, set_vertices(v).Y, set_vertices(v).Z)
    Next

    Return True

  End Function
# ---------- end geometry_wrapper ----------
curve_charge = CurveCharge(Curve=graft(crv_2), Radius=radius, ChargeStrengths=graph)
n_of_cells_along_largest_size = Panel(cluster.cell_n)
cullvertices = MeshCullUnusedVertices(Mesh=geometry_wrapper.mc)
# connect structure
# warning - SLOW
cptree = ConnectPointTree(d=dist, Ptree=dam_2)  # -> out, P; inputs d: Double, Ptree: tree of Point3d
# ---------- cptree: C# usings ----------
using System.IO;
using System.Linq;
using System.Data;
using System.Drawing;
using System.Reflection;
using System.Windows.Forms;
using System.Xml;
using System.Xml.Linq;
using System.Runtime.InteropServices;

using Rhino.DocObjects;
using Rhino.Collections;
using GH_IO;
using GH_IO.Serialization;
# ---------- cptree: C# ----------
    String eol = Environment.NewLine;
    Component.Name = "Connect Point tree";
    Component.NickName = "CPtree";
    Component.Message = "v0.1 _ by Alessio Erioli" + eol + "Co-de-iT";
    Component.Description = "Connects points in a tree" + eol + " excluding their own branch" + eol +
      "d - distance threshold";
    /*
    System.Threading.Tasks.Parallel.ForEach(Ptree.AllData(), p => {
    });
    */

    Point3d p, p1;

    // System.Collections.Concurrent.ConcurrentBag<Line> conn = new System.Collections.Concurrent.ConcurrentBag<Line>();
    DataTree<Point3d> conT = new DataTree<Point3d> ();

    //List <Line> conn = new List<Line>();
    GH_Path pa;
    //System.Threading.Tasks.Parallel.For(0, Ptree.BranchCount, i => {
    for (int i = 0; i < Ptree.BranchCount; i++){
      for(int r = 0; r < Ptree.Branch(i).Count; r++){
        p = Ptree.Branch(i)[r];
        pa = new GH_Path(new int[]{i,r});
        conT.EnsurePath(pa);
        for (int j = i + 1; j < Ptree.BranchCount; j++){
          for(int k = 0; k < Ptree.Branch(j).Count(); k++){
            p1 = Ptree.Branch(j)[k];
            if (p.DistanceTo(p1) < d){
              conT.Add(p1, pa);
              //conn.Add(new Line(p, p1));
            }
          }
        }
      }
    }
    //  });
    P = conT;
# ---------- end cptree ----------
# isomesh
previewlw = CustomPreviewLineweights(Geometry=cluster.bounding_box_edges, Shader=ColourSwatch(SwatchColor=RGB(176, 176, 176)), Absolute=False)
wbjoin = WeaverbirdsJoinMeshesAndWeld(Mesh=cullvertices, Weld=Toggle(True))
ln_3 = Line(StartPoint=simplify(graft(dam_2)), EndPoint=cptree.P)
cocoon = Cocoon(Charges=flatten(curve_charge), Iso=number_slider_4, CellSize=number_slider_3, Execute=execute_2, Simple=False)  # -> Mesh, RefinementData; disabled
wbloop = WeaverbirdsLoopSubdivision(MeshCurves=wbjoin, Level=Slider(1, range=1..3), SmoothNakedEdges=1)
refine = Refine(
    RefinementData=cocoon.RefinementData,
    Samples=Slider(1, range=1..10),
    SampleSize=Slider(0.5, range=0..1),
    SampleTolerance=Slider(0.25, range=0..1),
    LaplacianSmoothing=Slider(1, range=1..10),
    ValencePasses=Slider(2, range=1..10),
    SubD=Slider(1, range=0..10),
    Execute=execute_3)
preview = CustomPreview(
    Geometry=ln_3,
    Shader={diffuse=RGB(255, 105, 180), emission=RGB(76, 32, 54), shine=0.5, specular=RGB(255, 255, 255), transparency=0})
previewmat = CustomPreviewMaterials(Geometry=wbloop, DiffuseColor=RGB(255, 255, 255))

# ==== cluster Cluster
C = ClusterInput()
bbox = BoundingBox(Content=C, Plane=PlaneXY(0, 0, 0), UnionBox=True)  # -> Box, Box_2
boxprop = BoxProperties(Box=bbox.Box)  # -> Center, Diagonal, Area, Volume, Degeneracy
edges = BrepEdges(Brep=bbox.Box)  # -> Naked, Interior, NonManifold
devec = DeconstructVector(Vector=boxprop.Diagonal)  # -> XComponent, YComponent, ZComponent
expression = Expression(x=devec.XComponent, y=devec.YComponent, z=devec.ZComponent, Expression="if(x>y, if(x>z,x,z),if(y>z,y,z))")
B = ClusterInput()
division = Division(A=expression, B=B)
int = Integer(division)
cell_n = ClusterOutput(int)
bounding_box_edges = ClusterOutput(edges.Interior)
