# Grasshopper definition aggregate_DLA-Rutten.gh (Grasshopper 0.9.75)

radius = Slider(2, range=0.1..10)
seed = Slider(1, range=0..10)
pt = Point(Point(3.747507403, -1.477470257, 0))
circle = Circle({Plane=PlaneXY(0, 0, 0), Radius=24})
vb = VBScript(Attractor=pt, Boundary=circle, Radius=radius, Seed=seed)  # -> out, Points, Lines; inputs Attractor: Point3d, Boundary: Curve
# ---------- vb: VB ----------
    'Random seed to use during this solution.
    Dim rnd As New Random(Seed)

    'Declare local variables for aggregate.
    Dim pts As New List(Of Point3d)
    Dim lns As New List(Of Line)
    Dim agg As New Grasshopper.Kernel.Geometry.SpatialTrees.Node3d(Of Point3d) _
      (AddressOf Grasshopper.Kernel.Geometry.SpatialTrees.TreeDelegates.Point3dCoordinates, _
      Boundary.GetBoundingBox(True))
    agg.Add(Attractor)

    'Infinite' loop for inserting particles into the aggregate.
    For k As Int32 = 0 To 10000
      Dim particle As Point3d = CreateParticle(Boundary, rnd)
      'If the particle was already created well within reach of the aggregate,
      'then do not accept it.
      Dim pp As Point3d = FindNeighbour(particle, Radius, agg)
      If (pp.IsValid) Then
        If (pp.DistanceTo(particle) < Radius * 0.9) Then
          Continue For
        End If
      End If

      Dim moveCount As Int32 = 0
      Dim iterate As Boolean = False

      'Inner 'infinite' loop for moving the particle around.
      Do
        If (moveCount > 1000) Then
          'Safety catch, abort the logic.
          Exit Do
        End If

        Dim neighbour As Point3d = FindNeighbour(particle, Radius, agg)
        If (neighbour.IsValid) Then
          'We have found a neighbour, grow the aggregate.
          agg.Add(particle)
          pts.Add(particle)
          lns.Add(New Line(neighbour, particle))
          iterate = True
          Exit Do
        Else
          'We have no found a neighbour, move the particle.
          particle = MoveParticle(particle, Attractor, Radius * 0.25, rnd)
          moveCount += 1
        End If
      Loop

      If (Not iterate) Then Exit For
    Next

    'Assign outputs
    Points = pts
    Lines = lns
# ---------- vb: VB additional code ----------
  ''' <summary>
  ''' Create a new random particle on the boundary.
  ''' </summary>
  ''' <param name="crv">Boundary curve.</param>
  ''' <param name="rnd">Random object.</param>
  ''' <returns>Random point on boundary.</returns>
  Private Function CreateParticle(crv As Curve, rnd As Random) As Point3d
    Dim t As Double = crv.Domain.ParameterAt(rnd.NextDouble())
    Return crv.PointAt(t)
  End Function
  ''' <summary>
  ''' Find the point in an aggregate that is within the search radius.
  ''' </summary>
  ''' <param name="point">Point to search from.</param>
  ''' <param name="radius">Search radius.</param>
  ''' <param name="agg">Aggregate.</param>
  Private Function FindNeighbour(point As Point3d, radius As Double, agg As Grasshopper.Kernel.Geometry.SpatialTrees.Node3d(Of Point3d)) As Point3d
    Dim idx As Grasshopper.Kernel.Geometry.SpatialTrees.Index3d(Of Point3d) = agg.NearestItem(point, 0.0, radius)
    If (idx Is Nothing) Then Return Point3d.Unset
    Return idx.Item
  End Function
  ''' <summary>
  ''' Move the particle randomly towards an attractor.
  ''' </summary>
  ''' <param name="point">Particle to move.</param>
  ''' <param name="attractor">Attractor point.</param>
  ''' <returns>New particle position.</returns>
  Private Function MoveParticle(point As Point3d, attractor As Point3d, distance As Double, rnd As Random) As Point3d
    If (rnd.NextDouble() < 0.5) Then
      'Move in x
      If (point.X < attractor.X) Then
        point.X += distance
      Else
        point.X -= distance
      End If
    Else
      'Move in y
      If (point.Y < attractor.Y) Then
        point.Y += distance
      Else
        point.Y -= distance
      End If
    End If

    'Rhino.RhinoDoc.ActiveDoc.Objects.AddPoint(point)
    Return point
  End Function
# ---------- end vb ----------
