# Grasshopper definition DLA_update_Piker.ghx (Grasshopper 0.9.56)
# plug-ins: Mesh Pipe

# Diffusion Limited Aggregation: Diffusion-limited Aggregation
# Daniel Piker 07/03/10
# 
# 
# 
# DLA is a simple algorithmic model of a type of fractal growth that produces dendritic forms which occur frequently in both living and non-living nature, invented in 1981 by Witten and Sander.
# 
# I've made it so you can grow aggregates on any starting geometry, and there are a few optional forces to let you shape the growth in different ways. It works in both 2D and 3D.
# 
# The topological space of this simulation is RP³ (particles wrap around to the opposite points on leaving the bounding sphere)
# 
# You're free to use this definition for anything you like - student project, commercial, whatever. You are also free to alter and adapt it. Just make sure you credit me by name anywhere you publish something made with this definition or any derivative of it.
# 
# I'd also appreciate it if you let me know of any interesting applications or developments you come up with, or just send me a screenshot if you produce a nice result.
# 
# danielpiker@gmail.com
slider = Slider(1.036, range=-5..5)
# To get started, set RESET to False and double-click the timer component above.
# 
# Minimizing the grasshopper window will make the simulation run significantly faster, as will holding down the right mouse button (!). You can stop and start the simulation using the global timer switch in the bottom right corner of your screen.
# 
# The seedPoints can be any list of points you want to start growing your aggregate on - such as divisions of a curve, or the vertices of a mesh. If you leave this input empty it will use a single point at the origin.
# 
# 'Proximity' controls how close the wandering particle can get to the existing aggregate before it sticks.
# 
# 'Wander' is the level of Brownian motion.
# 
# 'Pull' controls the strength of the pull towards the centre.
# It allows you to grow aggregates much quicker when used in addition to - or instead of - 'Wander'.
# 
# 'Spin' adds a rotational force, which can be clockwise or anti-clockwise, depending on sign.
# 
# 'Wind' can be any vector. (Take care if used in combination with 'Pull' as this can create stagnation points where the wandering particle gets trapped.)
toggle = BooleanToggle(True)
X = UnitX(Factor=0)
reset = BooleanToggle(False)
timer = Timer(TimerInterval=1, Target=vb)  # disabled
vb = VBScript(
    reset=reset,
    proximity=Slider(2.744, range=0..10),
    pull=Slider(0.236, range=0..5),
    wander=Slider(0, range=0..5),
    spin=slider,
    threeD=Toggle(False),
    wind=X,
    show=toggle)  # -> out, crystal, floating, Count, filaments, outer; inputs seedpoints: list, wind: Vector3d
# ---------- vb: VB ----------
    If reset Then

      aggregated.Clear

      Dim origin As New point3d(0, 0, 0)

      If seedpoints Is Nothing Or seedpoints.Contains(Nothing) Then
        aggregated.Add(origin)

      Else

        If seedpoints.Count = 0 Then
          aggregated.Add(origin)
        End If

        For Each p As point3d In seedpoints
          aggregated.Add(p)
        Next

      End If

      Dim startradius As Integer = 1

      For i As Integer = 0 To aggregated.Count - 1
        startradius = Math.Max(startradius, aggregated(i).distanceto(origin))
      Next

      startradius += wander + pull + 2 * proximity

      outerdist = startradius
      Lines = New List (Of line)

      Dim Random As New Random()
      Dim randoms(2) As Double

      Do
        For i As Integer = 0 To 2
          randoms(i) = (Random.NextDouble() - 0.5)
        Next
        If (randoms(0) ^ 2 + randoms(1) ^ 2 + randoms(2) ^ 2) < 1 Then Exit Do
      Loop

      Dim radial As New vector3d(randoms(0), randoms(1), 0)

      If threeD Then
        radial.X = randoms(0)
        radial.Y = randoms(1)
        radial.Z = randoms(2)
      End If

      radial.Unitize
      radial = radial * startradius
      Floater = origin + radial

      Counter = 0

    Else

      Counter += 1

      Dim Random As New Random()
      Dim randoms(2) As Double

      Do
        For i As Integer = 0 To 2
          randoms(i) = 2 * (Random.NextDouble() - 0.5)
        Next
        If (randoms(0) ^ 2 + randoms(1) ^ 2 + randoms(2) ^ 2) < 1 Then Exit Do
      Loop

      If wander <> 0 Then

        Dim wanderstep As New vector3d(randoms(0), randoms(1), 0)

        If threeD Then
          wanderstep.X = randoms(0)
          wanderstep.Y = randoms(1)
          wanderstep.Z = randoms(2)
        End If
        wanderstep.Unitize
        wanderstep *= wander
        Floater += wanderstep

      End If

      Dim distance As Double = Math.Sqrt(Floater.x ^ 2 + Floater.y ^ 2 + Floater.z ^ 2)
      Dim invdist As Double = 1 / distance
      Floater.x = Floater.x - Floater.x * pull * invdist
      Floater.y = Floater.y - Floater.y * pull * invdist
      If threeD Then
        Floater.z = Floater.z - Floater.z * pull * invdist
      Else
        Floater.z = 0
      End If

      If spin <> 0 Then
        spin = spin * invdist
        Floater.x = Floater.x * math.cos(spin) - Floater.y * math.sin(spin)
        Floater.y = Floater.y * math.cos(spin) + Floater.x * math.sin(spin)
      End If

      Floater += wind

      If distance > outerdist Then
        Dim beyond As vector3d
        beyond = New vector3d(Floater.x, Floater.y, Floater.z)

        beyond.unitize
        beyond *= outerdist

        Dim wrapround As vector3d
        wrapround = New vector3d(Floater.x, Floater.y, Floater.z)
        wrapround = wrapround - beyond

        Floater = New Point3d(0, 0, 0)
        Floater += (wrapround * 2) - beyond

      End If

      Dim p As Integer = 0

      Do While p < aggregated.Count

        If Floater.DistanceTo(aggregated(p)) < proximity Then
          aggregated.Add(New point3d(Floater))
          Lines.Add(New line(Floater, aggregated(p)))

          outerdist = math.Max(outerdist, (2 * proximity + pull + Math.Sqrt(aggregated(p).x ^ 2 + aggregated(p).y ^ 2 + aggregated(p).z ^ 2)))

          Do
            For i As Integer = 0 To 2
              randoms(i) = (Random.NextDouble() - 0.5)
            Next
            If (randoms(0) ^ 2 + randoms(1) ^ 2 + randoms(2) ^ 2) < 1 Then Exit Do
          Loop

          Dim radial As New vector3d(randoms(0), randoms(1), 0)
          If threeD Then
            radial.X = randoms(0)
            radial.Y = randoms(1)
            radial.Z = randoms(2)
          End If

          radial.Unitize
          radial = radial * (outerdist + 1)
          Floater.X = 0
          Floater.Y = 0
          Floater.Z = 0
          Floater = Floater + radial
          Exit Do
        Else

        End If

        p += 1

      Loop

      If show Then  Floating = Floater
      Count = Counter
      Crystal = aggregated
      Filaments = lines
      outer = outerdist

    End If
# ---------- vb: VB additional code ----------
  Dim Floater As Point3d
  Dim aggregated As New List(Of Point3d)
  Dim lines As  List(Of Line)
  Dim Counter As Integer
  Dim outerdist As Double
# ---------- end vb ----------
circle = CircleCNR(Center=Point(0, 0, 0), Normal=Vector(0, 0, 1), Radius=vb.outer)
pt = Point(vb.crystal)
pt_2 = Point(vb.floating)
crv = Curve(vb.filaments)
panel = Panel(vb.Count)
mpipe = MeshPipe(Curve=crv, Radius=0.2, Accuracy=0.2, Rotation=0, Segments=10, Caps=2)
