# Grasshopper definition agent bodies.gh (Grasshopper 1.0.7)
# Copyright: Co-de-iT
# plug-ins: MarchingCubes, CurlNoise, Anemone, Human, horsterCameraControl, Mesh Pipe

# align and move
number_slider = Slider(1000, range=10..5000)
plane_radius = Slider(0.25, range=0..1)
_3d = BooleanToggle(True)
box = Box({Plane=Plane(origin=(0, 0, 0), x=(0, 1, 0), y=(1, 0, 0)), X=Domain(0, 10), Y=Domain(0, 10), Z=Domain(-10, 0)})
_3d_2 = BooleanToggle(True)
random_vector = CSharpScript(n=number_slider, seed=Slider(0, range=0..100), DDD=_3d_2)  # -> out, V; inputs n: Int32, seed: Int32, DDD: Boolean
# ---------- random_vector: C# usings ----------
using System.IO;
using System.Linq;
using System.Data;
using System.Drawing;
using System.Reflection;
using System.Windows.Forms;
using System.Xml;
using System.Xml.Linq;
using System.Runtime.InteropServices;

using Rhino.DocObjects;
using Rhino.Collections;
using GH_IO;
using GH_IO.Serialization;
# ---------- random_vector: C# ----------
    if(seed == 0) rnd = new Random(); else rnd = new Random(seed);
    List <Vector3d> vectors = new List<Vector3d>();
    Vector3d vec = new Vector3d();
    for (int i = 0; i < n; i++){
      vec.X = rnd.NextDouble() - 0.5;
      vec.Y = rnd.NextDouble() - 0.5;
      vec.Z = DDD ? rnd.NextDouble() - 0.5 : 0;
      vec.Unitize();
      vectors.Add(vec);
    }
    V = vectors;
# ---------- random_vector: C# additional code ----------
  Random rnd;
# ---------- end random_vector ----------
pop3d = Populate3D(Region=box, Count=number_slider, Seed=1)
curl = CurlNoise(Points=pop3d, Scale=Slider(0.087, range=0..1), Offset=0.6, _3D=True)  # -> CurlVector, Colour

# ----
# align only (no move)
number_slider_2 = Slider(1000, range=10..5000)
box_2 = Box({Plane=Plane(origin=(0, 0, 0), x=(0, 1, 0), y=(1, 0, 0)), X=Domain(0, 10), Y=Domain(0, 10), Z=Domain(-10, 0)})
random_vector_2 = CSharpScript(n=number_slider_2, seed=Slider(0, range=0..100), DDD=_3d)  # -> out, V; inputs n: Int32, seed: Int32, DDD: Boolean; same code as random_vector
pop3d_2 = Populate3D(Region=box_2, Count=number_slider_2, Seed=1)
curl_2 = CurlNoise(Points=pop3d_2, Scale=Slider(0.087, range=0..1), Offset=0.6, _3D=True)  # -> CurlVector, Colour
unit = UnitVector(Vector=curl_2.CurlVector)
loop_start = LoopStart(Repeat=Slider(100, range=0..100), Data=random_vector_2.V)  # -> port, Counter, Data; disabled
vdisex = VectorDisplayEx(Point=pop3d_2, Vector=unit, Colour=unit, Width="1")
# <title>
# 
# <description>
# 
# code by <author>
# 
# v <version>
# 
# © Co-de-iT 2018 _ Creative Commons Attribution-NonCommercial-ShareAlike 4.0 International License
panel = Panel(loop_start.Counter)
prox = Proximity3D(Points=pop3d_2, Group="3", MinRadius=Slider(0.108, range=0..5), MaxRadius=Slider(1.853, range=0..5))  # -> Links, Topology
number_slider_3 = Slider(0.25, range=0..1)
proximity = Slider(0.4, range=0..1)
field = Slider(0.2, range=0..1)
item = ListItem(List=loop_start.Data, Index=prox.Topology, Wrap=True)
panel_2 = Panel(prox.Topology)
avr = Average(Input=item)
multiplication = Multiplication(A=graft(unit), B=field)
unit_2 = UnitVector(Vector=avr)
multiplication_2 = Multiplication(A=unit_2, B=proximity)
addition = Addition(A=multiplication_2, B=multiplication)
angle = Angle(VectorA=graft(loop_start.Data), VectorB=unit_2)  # -> Angle, Reflex; disabled
unit_3 = UnitVector(Vector=addition)
xprod = CrossProduct(VectorA=graft(loop_start.Data), VectorB=unit_2, Unitize=False)  # -> Vector, Length; disabled
subtraction = Subtraction(A=unit_3, B=graft(loop_start.Data))
multiplication_3 = Multiplication(A=angle.Angle, B=number_slider_3)  # disabled
vrot = Rotate(Vector=graft(loop_start.Data), Axis=xprod.Vector, Angle=multiplication_3)  # disabled
multiplication_4 = Multiplication(A=subtraction, B=number_slider_3)
addition_2 = Addition(A=graft(loop_start.Data), B=multiplication_4)
panel_3 = Panel("""{-1,-1,0}
{1,-1,0}
{1,1,0}
{-1,1,0}""")
unit_4 = UnitVector(Vector=addition_2)  # -> simplify(flatten(Vector))
loop_end = LoopEnd(port=loop_start.port, Exit=False, Data=unit_4, TimeOutVal=0, pausedState=False, state="Constant output")
conmesh = ConstructMesh(Vertices=panel_3, Faces={A=0, B=1, C=2, D=3})
scale = Scale(Geometry=conmesh, Center=Point(0, 0, 0), Factor=Slider(0.25, range=0..1))  # -> Geometry, Transform
pl = PlaneNormal(Origin=pop3d_2, ZAxis=loop_end)
deplane = DeconstructPlane(Plane=pl)  # -> Origin, XAxis, YAxis, ZAxis
orient = Orient(Geometry=scale.Geometry, Source=PlaneXY(0, 0, 0), Target=pl)  # -> Geometry, Transform
vdisex_2 = VectorDisplayEx(Point=pop3d_2, Vector=deplane.ZAxis, Colour=deplane.ZAxis, Width=2)
preview = CustomPreview(Geometry=orient.Geometry, Material=deplane.ZAxis)
preview_2 = CustomPreview(Geometry=orient.Geometry, Material=ColourSwatch(SwatchColor=RGB(255, 255, 255)))

unit_5 = UnitVector(Vector=curl.CurlVector)
vdisex_3 = VectorDisplayEx(Point=pop3d_2, Vector=random_vector_2.V, Colour=random_vector_2.V, Width="1")
loop_start_2 = LoopStart(N=Slider(50, range=0..100), D0=pop3d, D1=random_vector.V)  # -> port, Counter, Data, Data_2; disabled
vdisex_4 = VectorDisplayEx(Point=pop3d, Vector=unit_5, Colour=unit_5, Width=2)
panel_4 = Panel(loop_start_2.Counter)
pt = Point(loop_start_2.Data)
vec = Vector(loop_start_2.Data_2)
prox_2 = Proximity3D(Points=pt, Group="5", MinRadius=Slider(0.108, range=0..5), MaxRadius=Slider(5, range=0..5))  # -> Links, Topology
multiplication_5 = Multiplication(A=plane_radius, B="3")
item_2 = ListItem(List=pt, Index=prox_2.Topology, Wrap=True)
len = Length(Curve=prox_2.Links)
item_3 = ListItem(List=vec, Index=prox_2.Topology, Wrap=True)
smaller = SmallerThan(FirstNumber=len, SecondNumber=multiplication_5)  # -> SmallerThan, OrEqualTo
avr_2 = Average(Input=item_3)
avr_3 = Average(Input=item_2)  # -> flatten(ArithmeticMean)
max_force = Slider(0.25, range=0..1)
proximity_2 = Slider(0.724, range=0..1)
field_2 = Slider(0.189, range=0..1)
dispatch = Dispatch(List=prox_2.Topology, DispatchPattern=smaller.SmallerThan)  # -> ListA, ListB
unit_6 = UnitVector(Vector=avr_2)
vec2pt = Vector2Pt(PointA=pt, PointB=avr_3, Unitize=False)  # -> Vector, Length
item_4 = ListItem(List=pt, Index=dispatch.ListA, Wrap=True)
multiplication_6 = Multiplication(A=graft(unit_5), B=field_2)
multiplication_7 = Multiplication(A=unit_6, B=proximity_2)
avr_4 = Average(Input=item_4)  # -> flatten(ArithmeticMean)
addition_3 = Addition(A=multiplication_7, B=multiplication_6)
amp = Amplitude(Vector=vec2pt.Vector, Amplitude=Slider(0.026, range=0..1))
vec2pt_2 = Vector2Pt(PointA=avr_4, PointB=pt, Unitize=False)  # -> Vector, Length
unit_7 = UnitVector(Vector=addition_3)
amp_2 = Amplitude(Vector=vec2pt_2.Vector, Amplitude=Slider(0.12, range=0..1))
pt_2 = Point(Point(0, 0, 0))
vdisex_5 = VectorDisplayEx(Point=pt, Vector=amp_2, Colour=ColourSwatch(SwatchColor=RGB(255, 0, 0)), Width=2)

# ---- group: alignment / steering vector
subtraction_2 = Subtraction(A=unit_7, B=graft(vec))

# ----
nullrep = ReplaceNulls(Items=amp_2, Replacements=pt_2)  # -> Items, Count

# ---- group: alignment
multiplication_8 = Multiplication(A=subtraction_2, B=max_force)
addition_4 = Addition(A=graft(vec), B=multiplication_8)

# ----
addition_5 = Addition(A=amp, B=nullrep.Items)
move = Move(Geometry=pt, Motion=addition_5)  # -> flatten(Geometry), Transform
unit_8 = UnitVector(Vector=addition_4)  # -> simplify(flatten(Vector))
loop_end_2 = LoopEnd(
    port=loop_start_2.port,
    Exit=False,
    Data=move.Geometry,
    Data_2=unit_8,
    TimeOutVal=0,
    pausedState=False,
    state="Constant output")  # -> D0, D1

# ---- group: depth based color
toggle = BooleanToggle(True)  # disabled
getcamera = GetCamera(GetCamera=toggle)  # -> Location, Target, LensLength, UpDirection; disabled
dist = Distance(PointA=getcamera.Location, PointB=loop_end_2.D0)  # disabled
num = Number(dist)  # disabled
bnd = Bounds(Numbers=flatten(num))  # disabled
dom = ConstructDomain(DomainStart=0, DomainEnd=1)  # disabled
remap = RemapNumbers(Value=num, Source=bnd, Target=dom)  # -> Mapped, Clipped; disabled
gradient = Gradient(LowerLimit=0, UpperLimit=1, Parameter=remap.Mapped, stops=[0.0444: RGB(222, 222, 222), 0.891: RGB(191, 191, 191)])  # disabled

# ----
panel_5 = Panel("""{-1,-1,0}
{1,-1,0}
{1,1,0}
{-1,1,0}""")
conmesh_2 = ConstructMesh(Vertices=panel_5, Faces={A=0, B=1, C=2, D=3})
pl_2 = PlaneNormal(Origin=loop_end_2.D0, ZAxis=loop_end_2.D1)
scale_2 = Scale(Geometry=conmesh_2, Center=Point(0, 0, 0), Factor=plane_radius)  # -> Geometry, Transform

# ---- group: use this way of making the plane
xprod_2 = CrossProduct(VectorA=loop_end_2.D0, VectorB=loop_end_2.D1, Unitize=True)  # -> Vector, Length
# the position sets the origin, the orientation vector is the X axis and the cross product between orientation vector and origin point is the Y
pl_3 = ConstructPlane(Origin=loop_end_2.D0, XAxis=loop_end_2.D1, YAxis=xprod_2.Vector)
orient_2 = Orient(Geometry=scale_2.Geometry, Source=PlaneXY(0, 0, 0), Target=pl_3)  # -> Geometry, Transform

# ----
xprod_3 = CrossProduct(VectorA=loop_end_2.D1, VectorB=xprod_2.Vector, Unitize=True)  # -> Vector, Length
number_slider_4 = Slider(0.177, range=0..1)
deplane_2 = DeconstructPlane(Plane=pl_2)  # -> Origin, XAxis, YAxis, ZAxis
orient_3 = Orient(Geometry=scale_2.Geometry, Source=PlaneXY(0, 0, 0), Target=pl_2)  # -> Geometry, Transform
msphere = MeshSphere(Base=pl_2, Radius=expr("x*1.5", plane_radius), UCount=10, VCount=20)  # disabled

# ---- group: vec to col
c_script = CSharpScript(V=xprod_3.Vector)  # -> out, C; inputs V: Vector3d
# ---------- c_script: C# usings ----------
using System.Drawing;
# ---------- c_script: C# ----------
    if (V == null) return;
    
    C = MapVecToCol(V);
# ---------- c_script: C# additional code ----------
  public Color MapVecToCol(Vector3d V)
  {
    return Color.FromArgb((int) ((V.X + 1) * 0.5 * 255), (int) ((V.Y + 1) * 0.5 * 255),
      (int) ((V.Z + 1) * 0.5 * 255));
  }
# ---------- end c_script ----------

# ----
amp_3 = Amplitude(Vector=xprod_2.Vector, Amplitude=number_slider_4)
amp_4 = Amplitude(Vector=deplane_2.ZAxis, Amplitude=number_slider_4)
preview_3 = CustomPreview(Geometry=orient_2.Geometry, Material=xprod_3.Vector)
vdisex_6 = VectorDisplayEx(Point=loop_end_2.D0, Vector=amp_4, Colour=ColourSwatch(SwatchColor=RGB(255, 0, 0)), Width=2)
preview_4 = CustomPreview(Geometry=orient_3.Geometry, Material=amp_4)
preview_5 = CustomPreview(Geometry=orient_3.Geometry, Material=deplane_2.ZAxis)  # disabled
vdisex_7 = VectorDisplayEx(Point=loop_end_2.D0, Vector=amp_3, Colour=ColourSwatch(SwatchColor=RGB(53, 212, 0)), Width=2)
pt_3 = Point(Point(5.875783963, 5.526291957, 1.074511458))
timer = Timer(TimerInterval=1, Target=c_script_2)  # disabled
cir = Circle(Plane=pt_3, Radius=Slider(3.266, range=1..5))
crv = Curve(reparameterize(cir))
X = UnitX(Factor=1)

# ---- group: body shape
crv_2 = Curve([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])

# ----
c_script_2 = CSharpScript(C=crv, step=Slider(0.01, range=0..1))  # -> out, P; inputs C: Curve, step: Double
# ---------- c_script_2: C# ----------
    t += step;

    if (t > 1.0) t -= 1.0;

    P = C.PointAt(t);
# ---------- c_script_2: C# additional code ----------
  double t = 0;
# ---------- end c_script_2 ----------

# ---- group: oientation planes
pln = Plane(pl_2)

# ----
pop3d_3 = Populate3D(
    Region={Plane=PlaneXY(0, 0, 0), X=Domain(0, 10), Y=Domain(0, 10), Z=Domain(0, 2)},
    Count=Slider(1000, range=10..1000),
    Seed=1)
rot3d = Rotate3D(Geometry=crv_2, Angle=1.570796327, Center=Point(0, 0, 0), Axis=X)  # -> Geometry, Transform
number_slider_5 = Slider(0.053, range=0..1)  # disabled

# ---- group: op - internalized
pln_2 = Plane([Plane(origin=(1.178360993, 2.440863629, 5.023148825), x=(0.4556947269, -0.8901361221, 0), y=(0.3169722832, 0.1622702354, 0.9344500748)), Plane(origin=(7.874436222, 8.667528935, 9.173037922), x=(0.811919556, 0, -0.5837693334), y=(-0.0008752702548, 0.999998876, -0.001217345612)), Plane(origin=(9.026063966, 0.797122282, 5.067920446), x=(-0.6637772675, 0.7479303037, 0), y=(0.2616865896, 0.2322430426, 0.9367941599)), Plane(origin=(8.956457995, 8.871117965, 0.8442848609), x=(-0.5042320065, 0.8635682275, 0), y=(0.06684190108, 0.03902856176, 0.9969999657)), Plane(origin=(0.9355912431, 8.480187955, 0.9511144803), x=(0, -0.6761639767, -0.7367511633), y=(0.999770213, -0.01579332637, 0.01449455243)), Plane(origin=(5.094993752, 1.161898377, 9.47597495), x=(0.9148617915, 0, -0.403767139), y=(0.1111590272, 0.9613569956, 0.2518658329))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])

# ----
scale_3 = Scale(Geometry=rot3d.Geometry, Center=Point(0, 0, 0), Factor=Slider(1, range=0.001..2))  # -> Geometry, Transform

# ---- group: NURBS representation
explode = Explode(Curve=scale_3.Geometry, Recursive=True)  # -> Segments, Vertices
nurbs = NurbsCurve(Vertices=explode.Vertices, Degree=3, Periodic=False)  # -> flatten(Curve), Length, Domain
group = Group(Objects=nurbs.Curve)
orient_4 = Orient(Geometry=group, Source=PlaneXY(0, 0, 0), Target=pln_2)  # -> Geometry, Transform
preview_6 = CustomPreview(Geometry=orient_4.Geometry, Material=ColourSwatch(SwatchColor=RGB(0, 0, 0)))

# ----
merge = Merge(Data1=deplane_2.Origin, Data2=deplane_2.Origin)  # disabled
jitter = Jitter(List=merge, Jitter=1, Seed=2)  # -> Values, Indices; disabled
number_slider_6 = Slider(0.053, range=0..1)  # disabled

# ---- group: find neighbours (RTree)
c_script_3 = CSharpScript(P=flatten(pop3d_3), P0=c_script_2.P, radius=Slider(1.955, range=0..10))  # -> out, A, B; inputs P: list of Point3d, P0: Point3d, radius: Double
# ---------- c_script_3: C# ----------
    if (P == null || P.Count == 0) return;

    pts = P;
    cl.Clear();
    ci.Clear();

    // declare RTree
    RTree tree = new RTree();

    // poopulate it
    for(int i = 0; i < P.Count; i++)
      tree.Insert(P[i], i);

    // perform search
    
    // option 1.1: EventHandler declared on the fly
    EventHandler<RTreeEventArgs> rTreeCallback = (object sender, RTreeEventArgs e) =>
      {
      cl.Add(pts[e.Id]);
      ci.Add(e.Id);
      };
    // option 1.1 & 1.2: call to external function
    tree.Search(new Sphere(P0, radius), rTreeCallback);

    //    option 2: use embedded anonymous function with lambda syntax
    //    tree.Search(new Sphere(P0, radius), (object sender, RTreeEventArgs e) =>
    //      {
    //      cl.Add(pts[e.Id]);
    //      ci.Add(e.Id);
    //      });

    A = cl;
    B = ci;
# ---------- c_script_3: C# additional code ----------
  List<Point3d> cl = new List<Point3d>();
  List<int> ci = new List<int>();
  List<Point3d> pts = new List<Point3d>();


  // option 1.2: declare callback function as an external one
  //  private void rTreeCallback(object sender, RTreeEventArgs e){
  //    cl.Add(pts[e.Id]);
  //    ci.Add(e.Id);
  //  }
# ---------- end c_script_3 ----------

# ---- group: Dave Reeves remove duplicate points
removedup = CSharpScript(tolerance=number_slider_5)  # -> out, result, map; inputs points: list of Point3d, tolerance: Double; disabled
# ---------- removedup: C# ----------
    List<Point3d> _result = new List<Point3d>();
    int[] _map = new int[points.Count];

    RTree tree = new RTree();
    Sphere sphere = new Sphere();
    sphere.Radius = tolerance;
    Point3d pt;

    for(int i = 0; i < points.Count; i++){
      pt = points[i];

      // set search sphere
      sphere.Center = pt;

      // reset index and search
      dupIndex = -1;
      tree.Search(sphere, SearchCallback);

      if(dupIndex == -1)  // no duplicate found
      {
        tree.Insert(pt, i);
        _map[i] = _result.Count;
        _result.Add(pt);
      }
      else // duplicate found
      {
        _map[i] = dupIndex; // add index to map
      }
    }

    result = _result;
    map = _map;
# ---------- removedup: C# additional code ----------
  //
  private int dupIndex;

  // cancels search if hit is found
  void SearchCallback(Object sender, RTreeEventArgs e){
    dupIndex = e.Id;
    e.Cancel = true;
  }
# ---------- end removedup ----------

# ---- group: select by closest
c_script_4 = CSharpScript(P=flatten(pln_2), ind=Slider(5, range=0..20), radius=Slider(2, range=0..10))  # -> out, A, B; inputs P: list of Point3d, ind: Int32, radius: Double
# ---------- c_script_4: C# ----------
    if (P == null || P.Count == 0) return;

    pts = P;
    cl.Clear();
    ci.Clear();

    RTree tree = new RTree();

    for(int i = 0; i < P.Count; i++)
      tree.Insert(P[i], i);

    tree.Search(new Sphere(P[ind], radius), method);


    A = cl;
    B = ci;
# ---------- c_script_4: C# additional code ----------
  List<Point3d> cl = new List<Point3d>();
  List<int> ci = new List<int>();
  List<Point3d> pts = new List<Point3d>();


  private void method(object sender, RTreeEventArgs e){
    cl.Add(pts[e.Id]);
    ci.Add(e.Id);
  }
# ---------- end c_script_4 ----------

# ----
item_5 = ListItem(List=orient_4.Geometry, Index=c_script_4.B, Wrap=True)  # disabled
ungroup = Ungroup(Group=item_5)  # disabled
cp = ControlPoints(Curve=simplify(ungroup))  # -> Points, Weights, Knots; disabled
panel_6 = Panel("0")  # disabled
cull_i = CullIndex(List=cp.Points, Indices=panel_6, Wrap=True)  # -> simplify(List); disabled

group_2 = Group(Objects=scale_3.Geometry)
orient_5 = Orient(Geometry=group_2, Source=PlaneXY(0, 0, 0), Target=pln_2)  # -> Geometry, Transform
pt_4 = Point(c_script_4.A)
panel_7 = Panel(c_script_4.B)
item_6 = ListItem(List=orient_5.Geometry, Index=c_script_4.B, Wrap=True)

# ---- group: Dave Reeves remove duplicate points
# <--- check this out
removedup_2 = CSharpScript(points=jitter.Values, tolerance=number_slider_6)  # -> out, result, map; inputs points: list of Point3d, tolerance: Double; disabled; same code as removedup

# ----
ungroup_2 = Ungroup(Group=item_6)  # -> simplify(Objects)
preview_7 = CustomPreview(Geometry=item_6, Material=ColourSwatch(SwatchColor=RGB(0, 0, 0)))
max_velocity = Slider(0.01, range=0..1)
cohesion_search_radius = Slider(0.3, range=0..10)
angle_of_vision = Slider(90, range=0..179)
lng = ListLength(List=item_6)
loop_start_3 = LoopStart(Repeat=Slider(200, range=0..200), Data=ungroup_2)  # -> port, Counter, Data; disabled

# ---- group: to list and back to tree
c_script_5 = CSharpScript(P=loop_start_3.Data)  # -> out, A, B, C; inputs P: tree of Polyline
# ---------- c_script_5: C# ----------
    P.SimplifyPaths();

    List<Polyline> polys = P.AllData(); // data tree to List
    P.Graft(false);
    IList<GH_Path> paths = P.Paths;
    DataTree < Polyline> pTree = new DataTree<Polyline>();

    GH_Path p;


    for (int i = 0; i < paths.Count; i++){
      p = new GH_Path(paths[i][0]);
      pTree.Add(polys[i], p);
    }

    A = P.AllData();
    B = paths;
    C = pTree;
# ---------- end c_script_5 ----------

# ----
range = Range(Domain=Domain(0, 1), Steps=expr("x-1", lng))
explode_2 = Explode(Curve=loop_start_3.Data, Recursive=True)  # -> Segments, Vertices
explode_3 = Explode(Curve=ungroup_2, Recursive=True)  # -> Segments, Vertices
panel_8 = Panel(loop_start_3.Counter)
panel_9 = Panel(c_script_5.A)
rad = Radians(Degrees=angle_of_vision)
number_slider_7 = Slider(0.001, range=0..1)
gradient_2 = Gradient(LowerLimit=0, UpperLimit=1, Parameter=range, stops=[0: RGB(255, 255, 255), 1: RGB(69, 0, 94)])

vec_2 = Vector(explode_2.Segments)
# spring effect
len_2 = Length(Curve=explode_2.Segments)
len_3 = Length(Curve=explode_3.Segments)
panel_10 = Panel("""-1
0.5
0.5""")
subtraction_3 = Subtraction(A=len_2, B=len_3)
multiplication_9 = Multiplication(A=subtraction_3, B=panel_10)
amp_5 = Amplitude(Vector=vec_2, Amplitude=multiplication_9)
item_7 = ListItem(List=amp_5, Index=0, Wrap=True)  # -> Item, Item1, Item2
neg = Negative(Value=item_7.Item1)
neg_2 = Negative(Value=item_7.Item2)
addition_6 = Addition(A=neg, B=item_7.Item2)
addition_7 = Addition(A=item_7.Item, B=item_7.Item1)
merge_2 = Merge(Data1=addition_7, Data2=addition_6, Data3=neg_2)  # -> graft(Result)

# ---- group: neighbour search
c_script_6 = CSharpScript(P=loop_start_3.Data, rC=cohesion_search_radius, aV=rad)  # -> out, neighPts, neighInd, B, points, bV; inputs P: tree of Polyline, rC: Double, aV: Double
# ---------- c_script_6: C# ----------
    RTree rt = new RTree();

    List<Point3d> pts = new List<Point3d>();           // all points as list
    DataTree<Point3d> bodies = new DataTree<Point3d>(); // body points
    List<Point3d> bp = new List<Point3d>(); // temporary body points
    List<Point3d> fp = new List<Point3d>(); // found points
    List<int> fi = new List<int>();         // found indices

    List<Vector3d> tDirs = new List<Vector3d>(); // temporarily store directions here
    Vector3d tD = new Vector3d(); // temporarily store direction here
    DataTree<Vector3d> dirs = new DataTree<Vector3d>(); // forward directions for ach point in each "arm"
    DataTree<Point3d> np = new DataTree<Point3d>(); // neighbour points
    DataTree<int> ni = new DataTree<int>(); // neighbour indexes

    GH_Path path;

    // get direction from polyline
    // Polyline pol = P.Branch(0)[0]; // get the polyline
    // Vector3d dir = pol.GetSegments()[0].Direction; // get segments and convert them into directions

    // ...............................
    //        populate RTree
    // ...............................

    // . transfer all points to a Point3d List
    // . generate bodies Data Tree
    // . generate directions Data Tree

    for (int i = 0; i < P.BranchCount; i++){
      bp.Clear();
      bp.Add(P.Branch(i)[0][0]); // add body center (just once)
      for (int j = 0; j < P.Branch(i).Count; j++){
        tDirs.Clear();
        //bp.Add(P.Branch(i)[j][0]); // add body center
        for(int k = 1; k < P.Branch(i)[j].Count; k++){ // k starts from 1 to exclude the body center

          //      body----|  |-----polyline
          //              |  |  |--point
          //              |  |  |
          bp.Add(P.Branch(i)[j][k]);
          tD = P.Branch(i)[j].GetSegments()[k - 1].Direction;
          tD.Unitize();
          tDirs.Add(tD);
        }
        dirs.AddRange(tDirs, P.Path(i).AppendElement(j));
      }
      pts.AddRange(bp);
      bodies.AddRange(bp, P.Path(i));
    }

    // populate tree
    for (int i = 0; i < pts.Count; i++){
      rt.Insert(pts[i], i);
    }

    // ............................................................................................................................


    // ....................................
    // call search function for each point
    // ....................................
    int[] dPath;// = new int[2]; // array for directions Tree search
    Vector3d des; // vector that points to the target neighbour
    Vector3d currDir; // current direction
    Point3d currPt; // current point

    for (int i = 0; i < P.BranchCount; i++){
      for (int j = 0; j < P.Branch(i).Count; j++){
        for(int k = 1; k < P.Branch(i)[j].Count; k++){

          // clean fp and fi lists
          fp.Clear();
          fi.Clear();

          // call search on RTree for each polyline point
          //
          //        body----|  |-----polyline
          //                |  |  |--point
          //                |  |  |
          currPt = P.Branch(i)[j][k];
          rt.Search(new Sphere(currPt, rC), (Object sender, RTreeEventArgs e) => {
            fp.Add(pts[e.Id]);
            fi.Add(e.Id);
            });

          // if there are found points
          if (fp != null && fp.Count > 0) {

            // exclude own body points
            removeDups(bodies.Branch(i), ref fp, ref fi);

            // exclude by angle of vision aV
            dPath = new int[] {i,j};
            currDir = dirs.Branch(dPath)[k - 1];
            for(int p = fp.Count - 1; p >= 0; p--){
              des = Vector3d.Subtract((Vector3d) fp[p], (Vector3d) currPt);
              if (Vector3d.VectorAngle(des, currDir) <= aV) continue;
              fp.RemoveAt(p);
              fi.RemoveAt(p);
            }

          }
          // populate neighbour points tree
          path = P.Path(i).AppendElement(j).AppendElement(k - 1);
          np.AddRange(fp, path);
          ni.AddRange(fi, path);

        }
      }
    }

    neighPts = np;
    neighInd = ni;
    B = bodies;
    points = pts;
    bV = dirs;
# ---------- c_script_6: C# additional code ----------
  //
  //     list of points to chck against--|                      |----- list of points to "purge"
  //                                     |                      |                   |--------- point indices of list to "purge"
  private void removeDups(List<Point3d> pc, ref List <Point3d> pts, ref List <int> ind){
    for (int i = 0; i < pc.Count; i++){
      for (int j = pts.Count - 1; j >= 0; j--){ // backwads so we can eventually remove points
        if (pc[i].DistanceToSquared(pts[j]) < 0.0001) {
          pts.RemoveAt(j);
          ind.RemoveAt(j);
        }
      }
    }

  }
# ---------- end c_script_6 ----------

# ----
c_script_7 = CSharpScript(P=loop_start_3.Data, rC=cohesion_search_radius, aV=rad)  # -> out, neighPts, neighInd, B, points, bV; inputs P: tree of Polyline, rC: Double, aV: Double
# ---------- c_script_7: C# ----------
    RTree rt = new RTree();

    // determine nPoints for a body & arm
    int bPoints = P.Branch(0).Count * (P.Branch(0)[0].Count - 1) + 1; // body points
    int aPoints = P.Branch(0)[0].Count - 1; // arm points (all arms should have same n. of points)

    //List<Polyline> polys = new List <Polyline>();      // all polylines as list
    Point3d[] pts = new Point3d[P.BranchCount * bPoints];           // all points as list
    Point3d[][] bodies = new Point3d[P.BranchCount][]; // body points
    Point3d[] bp = new Point3d[bPoints]; // temporary body points
    List<Point3d> fp = new List<Point3d>(); // found points
    List<int> fi = new List<int>();         // found indices

    Vector3d[][][] dirs = new Vector3d[P.BranchCount][][]; // forward directions for each point in each "arm"
    Vector3d[] bDirs = new Vector3d[bPoints - 1]; // temporarily store body directions here (core has no directions)
    Vector3d[] tDirs = new Vector3d[aPoints]; // temporarily store arm directions here (core has no directions)
    Vector3d tD = new Vector3d(); // temporarily store direction here

    DataTree<Point3d> np = new DataTree<Point3d>(); // neighbour points
    DataTree<int> ni = new DataTree<int>(); // neighbour indexes

    GH_Path path;

    // get direction from polyline
    // Polyline pol = P.Branch(0)[0]; // get the polyline
    // Vector3d dir = pol.GetSegments()[0].Direction; // get segments and convert them into directions

    // ...............................
    //        populate RTree
    // ...............................

    // . transfer all points to a Point3d List
    // . generate bodies Data Tree
    // . generate directions Data Tree

    for (int i = 0; i < P.BranchCount; i++){
      bp = new Point3d[bPoints];
      bp[0] = P.Branch(i)[0][0]; // add body center
      for (int j = 0; j < P.Branch(i).Count; j++){
        tDirs = new Vector3d[bPoints - 1];
        for(int k = 1; k < P.Branch(i)[j].Count; k++){ // k starts from 1 to exclude the body center

          //     body----|  |-----polyline
          //             |  |  |--point
          //             |  |  |
          bp[k] = P.Branch(i)[j][k];
          tD = P.Branch(i)[j].GetSegments()[k - 1].Direction;
          tD.Unitize();
          tDirs[k - 1] = tD;
        }
        dirs.AddRange(tDirs, P.Path(i).AppendElement(j));
      }
      pts.AddRange(bp);
      bodies[i] = bp;
    }


    // populate tree
    for (int i = 0; i < pts.Count; i++){
      rt.Insert(pts[i], i);
    }


    // ............................................................................................................................


    // ....................................
    // call search function for each point
    // ....................................
    int[] dPath;// = new int[2]; // array for directions Tree search
    Vector3d des; // vector that points to the target neighbour
    Vector3d currDir; // current direction
    Point3d currPt; // current point

    for (int i = 0; i < P.BranchCount; i++){
      for (int j = 0; j < P.Branch(i).Count; j++){
        for(int k = 1; k < P.Branch(i)[j].Count; k++){

          // clean fp and fi lists
          fp.Clear();
          fi.Clear();

          // call search on RTree for each polyline point
          //
          //        body----|  |-----polyline
          //                |  |  |--point
          //                |  |  |
          currPt = P.Branch(i)[j][k];
          rt.Search(new Sphere(currPt, rC), (Object sender, RTreeEventArgs e) => {
            fp.Add(pts[e.Id]);
            fi.Add(e.Id);
            });

          // if there are found points
          if (fp != null && fp.Count > 0) {

            // exclude own body points
            removeDups(bodies[i], ref fp, ref fi);

            // exclude by angle of vision aV
            dPath = new int[] {i,j};
            currDir = dirs.Branch(dPath)[k - 1];
            for(int p = fp.Count - 1; p >= 0; p--){
              des = Vector3d.Subtract((Vector3d) fp[p], (Vector3d) currPt);
              if (Vector3d.VectorAngle(des, currDir) <= aV) continue;
              fp.RemoveAt(p);
              fi.RemoveAt(p);
            }

          }
          // populate neighbour points tree
          path = P.Path(i).AppendElement(j).AppendElement(k - 1);
          np.AddRange(fp, path);
          ni.AddRange(fi, path);

        }
      }
    }

    neighPts = np;
    neighInd = ni;
    B = bodies;
    points = pts;
    bV = dirs;
# ---------- c_script_7: C# additional code ----------
  //
  //     list of points to chck against--|                      |----- list of points to "purge"
  //                                     |                      |                   |--------- point indices of list to "purge"
  private void removeDups(List<Point3d> pc, ref List <Point3d> pts, ref List <int> ind){
    for (int i = 0; i < pc.Count; i++){
      for (int j = pts.Count - 1; j >= 0; j--){ // backwads so we can eventually remove points
        if (pc[i].DistanceToSquared(pts[j]) < 0.0001) {
          pts.RemoveAt(j);
          ind.RemoveAt(j);
        }
      }
    }
  }

  private void removeDups(Point3d[] pc, ref List <Point3d> pts, ref List <int> ind){
    for (int i = 0; i < pc.Length; i++){
      for (int j = pts.Count - 1; j >= 0; j--){ // backwads so we can eventually remove points
        if (pc[i].DistanceToSquared(pts[j]) < 0.0001) {
          pts.RemoveAt(j);
          ind.RemoveAt(j);
        }
      }
    }
  }

  // parallelization snippets

  /*
  var chunks = System.Collections.Concurrent.Partitioner.Create(0, _verts.Count);
  System.Threading.Tasks.Parallel.ForEach(chunks, range =>{
  for(int i = range.Item1; i < range.Item2; i++)
  {

  }
  });
  */

  /*
  System.Threading.Tasks.Parallel.For(0, P.BranchCount, i =>
  {});
  */
# ---------- end c_script_7 ----------
cull_i_2 = CullIndex(List=explode_2.Vertices, Indices="0", Wrap=True)  # -> simplify(graft(List))
cullpt = CullDuplicates(Points=flatten(explode_2.Vertices), Tolerance=0.1, CullMode=1)  # -> Points, Indices, Valence
item_8 = ListItem(List=explode_2.Vertices, Index=0, Wrap=True)
jitter_2 = Jitter(List=gradient_2, Jitter=1, Seed=2)  # -> simplify(graft(Values)), Indices; disabled
col = Colour(graft(gradient_2))
vec2pt_3 = Vector2Pt(PointA=cull_i_2, PointB=c_script_6.neighPts, Unitize=False)  # -> Vector, Length
msphere_2 = MeshSphere(Base=cullpt.Points, Radius=cohesion_search_radius, UCount="10", VCount="10")  # disabled
addition_8 = Addition(A=vec2pt_3.Length, B="0.01")
amp_6 = Amplitude(Vector=c_script_6.bV, Amplitude=max_velocity)  # -> graft(Vector)
one_over_x = OneOverX(Value=addition_8)
wav = WeightedAverage(Input=vec2pt_3.Vector, Weights=one_over_x)
avr_5 = Average(Input=vec2pt_3.Vector)
pshift = ShiftPaths(Data=wav, Offset="-2")
amp_7 = Amplitude(Vector=wav, Amplitude=max_velocity)
lng_2 = ListLength(List=pshift)
null = NullItem(Item=amp_7)  # -> NullFlags, InvalidFlags, Description
dup = DuplicateData(Data=col, Number=lng_2, Order=True)  # -> flatten(Data)
spring_intensity = Slider(0.8, range=0..1)
cohesion_intensity = Slider(0.025, range=0..1)
dispatch_2 = Dispatch(List=amp_7, DispatchPattern=null.NullFlags)  # -> ListA, ListB
dispatch_3 = Dispatch(List=amp_6, DispatchPattern=null.NullFlags)  # -> ListA, ListB
unflatten = UnflattenTree(Tree=dup, Guide=wav)
subtraction_4 = Subtraction(A=dispatch_2.ListB, B=dispatch_3.ListB)

# ----
# replace null vectors with 0 vectors
vec_3 = Vector(Vector(0, 0, 0))
nullrep_2 = ReplaceNulls(Items=dispatch_2.ListA, Replacements=vec_3)  # -> Items, Count

graft = GraftTree(Tree=explode_2.Vertices, IncludeEmptyLists=True, IncludeNullItems=True)
multiplication_10 = Multiplication(A=merge_2, B=spring_intensity)
addition_9 = Addition(A=subtraction_4, B=amp_6)
viewer = ParamViewer(graft)
amp_8 = Amplitude(Vector=addition_9, Amplitude=cohesion_intensity)
viewer_2 = ParamViewer(c_script_6.B)
panel_11 = Panel(viewer)
weave = Weave(Pattern=null.NullFlags, Stream0=amp_8, Stream1=nullrep_2.Items, NullGaps=False)
lng_3 = ListLength(List=c_script_6.B)
addition_10 = Addition(A=weave, B=multiplication_10)
vlen = VectorLength(Vector=addition_10)
dup_2 = DuplicateData(Data=col, Number=lng_3, Order=True)  # -> flatten(Data)
legend = Legend(Colour=flatten(col), Tags=viewer_2, LegendType=1)
min = Minimum(A=vlen, B=max_velocity)
# point tags
tag = TextTag3D(Location=flatten(graft), Text=viewer, Size=Slider(0.05, range=0..1), Colour=dup_2, Justification=7)
# cohesion vectors
vdisex_8 = VectorDisplayEx(Point=cull_i_2, Vector=amp_8, Colour=ColourSwatch(SwatchColor=RGB(43, 116, 128)), Width=2)
# neighbor vectors
vdisex_9 = VectorDisplayEx(Point=cull_i_2, Vector=vec2pt_3.Vector, Colour=ColourSwatch(SwatchColor=RGB(82, 82, 82)), Width=2)
# direction vectors
vdisex_10 = VectorDisplayEx(Point=cull_i_2, Vector=amp_6, Colour=ColourSwatch(SwatchColor=RGB(186, 186, 186)), Width=2)
# bodies as lines
previewlw = CustomPreviewLineweights(Geometry=[c_script_6.B, loop_start_3.Data], Shader=col, Thickness=Slider(2, range=1..5), Absolute=False)
amp_9 = Amplitude(Vector=addition_10, Amplitude=min)
# movement vectors
vdisex_11 = VectorDisplayEx(Point=cull_i_2, Vector=amp_9, Colour=unflatten, Width=2)
move_2 = Move(Geometry=cull_i_2, Motion=amp_9)  # -> Geometry, Transform

# ---- group: rebuilding bodies
pshift_2 = ShiftPaths(Data=move_2.Geometry, Offset=-1)
merge_3 = Merge(Data1=item_8, Data2=pshift_2)
pline = PolyLine(Vertices=merge_3, Closed=False)
pshift_3 = ShiftPaths(Data=pline, Offset=-1)

# ----
loop_end_3 = LoopEnd(port=loop_start_3.port, Exit=Button(), Data=pshift_3, TimeOutVal=0, pausedState=False, state="Constant output")
f_sbpath = SerialBranchPath(T=loop_end_3, i=Slider(0, range=0..42))  # -> P, D; inputs T: tree, i: Int32
# ---------- f_sbpath: C# ----------
                                            /*
    froGH - a sparse collection of (in)utilities for Grasshopper

    Serial Branch Path
    code by Alessio Erioli

    froGH by Co-de-iT is licensed under a Creative Commons Attribution 4.0 International License.
    http://creativecommons.org/licenses/by/4.0/

    */

    initComp();


    if (T.BranchCount > 0){
      int ind = i % T.BranchCount;
      P = T.Path(ind);
      D = T.Branches[ind];
    }
# ---------- f_sbpath: C# additional code ----------
  void initComp(){
    Component.Name = "Serial Branch Path";
    Component.NickName = "f_SBPath";
    Component.Description = "Retrieves the data tree path and data for a specific branch serial index";
    Component.Params.Input[0].Name = "Tree";
    Component.Params.Input[0].Description = "the data tree";
    Component.Params.Input[1].Name = "index";
    Component.Params.Input[1].Description = "serial index of branch to sample";
    Component.Params.Output[0].Name = "Path";
    Component.Params.Output[0].Description = "the tree branch path";
    Component.Params.Output[1].Name = "Data";
    Component.Params.Output[1].Description = "the tree branch content";
  }
# ---------- end f_sbpath ----------
fillet = Fillet(Curve=loop_end_3, Radius=Slider(0.08, range=0..1))
explode_4 = Explode(Curve=loop_end_3, Recursive=True)  # -> Segments, Vertices
previewlw_2 = CustomPreviewLineweights(Geometry=f_sbpath.D, Shader=ColourSwatch(SwatchColor=RGB(255, 0, 0)), Thickness=Slider(10, range=1..10), Absolute=False)
nurbs_2 = NurbsCurve(Vertices=explode_4.Vertices, Degree=3, Periodic=False)  # -> Curve, Length, Domain
number_slider_8 = Slider(0.055, range=0..1)
dam = DataDam(DataA=fillet, BufferDelay=10000000, BufferMode=0)
merge_4 = Merge(Data1=Slider(3, range=0..3), Data2=Slider(0.5, range=0..1))
curve_charge = CurveCharge(Curve=dam, Radius=number_slider_8, ChargeStrengths=merge_4)  # -> flatten(CurveCharge)
mpipe = MeshPipe(Curve=nurbs_2.Curve, Radius=number_slider_8, Accuracy=0.2, Rotation=0, Segments=4, Caps=1)  # -> flatten(Mesh); disabled
mjoin = MeshJoin(Meshes=mpipe)
cocoon = Cocoon(
    Charges=curve_charge,
    Iso=Slider(0.075, range=0..1),
    CellSize=Slider(0.055, range=0..0.2),
    Execute=Toggle(False),
    Simple=False)  # -> Mesh, RefinementData
item_9 = ListItem(List=cocoon.Mesh, Index=Slider(0, range=0..4), Wrap=True)
refine = Refine(
    RefinementData=cocoon.RefinementData,
    Samples=Slider(3, range=1..10),
    SampleSize=Slider(0.01, range=0..1),
    SampleTolerance=Slider(0.005, range=0..1),
    LaplacianSmoothing=Slider(2, range=1..10),
    ValencePasses=Slider(2, range=1..10),
    SubD=Slider(1, range=0..3),
    Execute=Toggle(False))
panel_12 = Panel(refine)
preview_8 = CustomPreview(Geometry=refine, Material=ColourSwatch(SwatchColor=RGB(255, 255, 255)))

# ---- group: Vestartas RTree
number_slider_9 = Slider(0.68, range=0..10)  # disabled
item_10 = ListItem(List=flatten(cull_i), Index=0, Wrap=True)  # disabled

# ---- group: Vestartas RTree / RTree search - from Petras Vestartas
c_script_8 = CSharpScript(P=flatten(cull_i), radius=number_slider_9)  # -> out, A, B; inputs P: list of Point3d, radius: Double; disabled
# ---------- c_script_8: C# ----------
    if (P == null || P.Count == 0) return;

    pts = P;
    cl.Clear();
    ci.Clear();

    RTree tree = new RTree();

    for(int i = 0; i < P.Count; i++)
      tree.Insert(P[i], i);

    tree.Search(new Sphere(P[0], radius), method);


    A = cl;
    B = ci;
# ---------- c_script_8: C# additional code ----------
  List<Point3d> cl = new List<Point3d>();
  List<int> ci = new List<int>();
  List<Point3d> pts = new List<Point3d>();


  private void method(object sender, RTreeEventArgs e){
    cl.Add(pts[e.Id]);
    ci.Add(e.Id);
  }
# ---------- end c_script_8 ----------

# ---- group: Vestartas RTree (continued)
ln = Line(StartPoint=item_10, EndPoint=c_script_8.A)  # disabled
