# Grasshopper definition aggregate_test.gh (Grasshopper 0.9.75)

circle = Circle({Plane=Plane(origin=(5, 10, 0), x=(0.9828721869, -0.1842885351, 0), y=(0.1842885351, 0.9828721869, 0)), Radius=32.55764119})
mesh = MeshBrep(
    Brep=circle,
    Settings={GridMaxCount=0, GridMinCount=106, JaggedSeams=False, MaxEdgeLength=2, MinEdgeLength=0.0001, MinTolerance=0, Refine=True, RefineAngle=0, RelativeTolerance=0.65, SimplePlanes=False, Tolerance=0})
pt = Point([Point(-9.798928261, 9.013404846, 0), Point(19.79892731, 28.74530792, 0)])
c_script = CSharpScript(A=pt, D=mesh, S=Slider(25000, range=100..100000))  # -> N, E; inputs A: list of Point3d, D: Mesh, S: Int32
# ---------- c_script: C# ----------
    Aggregate aggregate = new Aggregate(D, A);
    while (aggregate.TotalSteps <= S)
    {
      if (!aggregate.BeginWalk())
        break;

      while (aggregate.TotalSteps <= S)
      {
        if (aggregate.ContinueWalk() == RandomStepResult.FinalStep)
        {
          aggregate.CompleteWalk();
          break;
        }
      }
    }

    N = aggregate.GetOccupiedNodes();
    E = aggregate.GetConnectingLines();
# ---------- c_script: C# additional code ----------
  /// <summary>
  /// Enumerates the possible outcomes of a random walk step.
  /// </summary>
  public enum RandomStepResult
  {
    /// <summary>
    /// Next successful random step.
    /// </summary>
    NextStep,
    /// <summary>
    /// Random step approached an occupied node.
    /// </summary>
    FinalStep
  }
  /// <summary>
  /// Represents a single node in an aggregate network.
  /// </summary>
  public class AggregateNode
  {
    public AggregateNode(Point3f point, int index, int[] neighbours)
    {
      if (neighbours == null)
        throw new ArgumentNullException("neighbours");

      Point = point;
      Index = index;
      Occupied = false;
      Neighbours = neighbours.Clone() as int[];
    }

    public int Index { get; private set; }
    public int[] Neighbours { get; private set; }

    public bool Occupied { get; set; }
    public Point3d Point { get; private set; }

  }
  /// <summary>
  /// Represents an entire aggregate network.
  /// </summary>
  public class Aggregate
  {
    #region fields and constructor
    private readonly Point3dList _attractors = new Point3dList();
    private readonly SortedDictionary<int, AggregateNode> _nodes = new SortedDictionary<int, AggregateNode>();
    private readonly List<int> _boundary = new List<int>();
    private readonly Random _random = new Random(77);

    public Aggregate(Mesh mesh, IEnumerable<Point3d> attractors)
    {
      if (mesh == null)
        throw new ArgumentNullException("mesh");

      if (attractors == null)
        throw new ArgumentNullException("attractors");

      _attractors.AddRange(attractors);

      // Populate node database.
      for (int i = 0; i < mesh.Vertices.Count; i++)
      {
        int[] neighbours = mesh.Vertices.GetConnectedVertices(i);
        if (neighbours == null || neighbours.Length == 0)
          continue;
        _nodes.Add(i, new AggregateNode(mesh.Vertices[i], i, neighbours));
      }

      // Populate boundary index list.
      for (int e = 0; e < mesh.TopologyEdges.Count; e++)
      {
        int[] fi = mesh.TopologyEdges.GetConnectedFaces(e);
        if (fi == null)
          continue;
        if (fi.Length == 1)
        {
          //This is a boundary edge.
          Rhino.IndexPair topv = mesh.TopologyEdges.GetTopologyVertices(e);
          int[] vi = mesh.TopologyVertices.MeshVertexIndices(topv.I);
          foreach (int idx in vi)
            if (!_boundary.Contains(idx))
              _boundary.Add(idx);

          vi = mesh.TopologyVertices.MeshVertexIndices(topv.J);
          foreach (int idx in vi)
            if (!_boundary.Contains(idx))
              _boundary.Add(idx);
        }
      }

      // Set attractor points.
      bool validAttractors = false;
      foreach (Point3d point in attractors)
      {
        foreach (AggregateNode node in _nodes.Values)
        {
          if (node.Point.DistanceTo(point) < 1e-6)
          {
            node.Occupied = true;
            _boundary.Remove(node.Index);
            validAttractors = true;
          }
        }
      }
      if (!validAttractors)
        throw new ArgumentException("No valid attractors could be assigned");

      TotalSteps = 0;
    }
    #endregion

    #region Random walk logic
    private readonly List<int> _walk = new List<int>();

    /// <summary>
    /// Reset all random walk data.
    /// </summary>
    public void Reset()
    {
      _walk.Clear();
      TotalSteps = 0;
    }
    /// <summary>
    /// Gets the total number of steps taken since construction.
    /// </summary>
    public int TotalSteps
    {
      get;
      private set;
    }
    /// <summary>
    /// Gets the current node.
    /// </summary>
    public AggregateNode CurrentNode
    {
      get
      {
        if (_walk.Count == 0)
          return null;

        int idx = _walk[_walk.Count - 1];
        return _nodes[idx];
      }
    }

    /// <summary>
    /// Begin a new random walk by picking a random point on the boundary.
    /// </summary>
    /// <returns>True on success, false if no such point could be found.</returns>
    public bool BeginWalk()
    {
      _walk.Clear();
      if (_boundary.Count == 0)
        return false;

      TotalSteps++;
      int idx = _random.Next(_boundary.Count);
      _walk.Add(_boundary[idx]);

      return true;
    }
    /// <summary>
    /// Take the next random step in a walk.
    /// </summary>
    /// <returns>The result of the step.</returns>
    public RandomStepResult ContinueWalk()
    {
      if (_walk.Count == 0)
        throw new InvalidOperationException("You cannot continue a walk before starting one");

      // Check to see if the current position is bordering on an occupied node.
      AggregateNode node = CurrentNode;
      foreach (int idx in node.Neighbours)
      {
        if (_nodes[idx].Occupied)
          return RandomStepResult.FinalStep;
      }

      // Pick a random neighbour.
      int idxNext = _random.Next(node.Neighbours.Length);
      idxNext = node.Neighbours[idxNext];
      AggregateNode next = _nodes[idxNext];

      // in 50% of cases, if the step is further away from attractors, reject it.
      if (_random.NextDouble() < 0.1)
      {
        int cp = _attractors.ClosestIndex(next.Point);
        double d0 = _attractors[cp].DistanceTo(node.Point);
        double d1 = _attractors[cp].DistanceTo(next.Point);
        if (d0 < d1)
          return ContinueWalk();
      }

      _walk.Add(idxNext);

      TotalSteps++;
      return RandomStepResult.NextStep;
    }
    /// <summary>
    /// Mark the current node as occupied and erase the walk data.
    /// </summary>
    public void CompleteWalk()
    {
      if (_walk.Count == 0)
        throw new InvalidOperationException("You cannot complete a walk before beginning one");

      AggregateNode node = CurrentNode;
      node.Occupied = true;
      _boundary.Remove(node.Index);
      _walk.Clear();
    }
    #endregion

    #region diagram logic
    /// <summary>
    /// Gets an array of all the occupied nodes in the aggregate.
    /// </summary>
    public Point3d[] GetOccupiedNodes()
    {
      List<Point3d> points = new List<Point3d>();
      foreach (AggregateNode node in _nodes.Values)
        if (node.Occupied)
          points.Add(node.Point);

      return points.ToArray();
    }
    /// <summary>
    /// Gets an array of all the lines connecting occupied nodes in the aggregate.
    /// </summary>
    public Line[] GetConnectingLines()
    {
      List<Line> lines = new List<Line>();
      foreach (AggregateNode node in _nodes.Values)
        if (node.Occupied)
          foreach (int neighbour in node.Neighbours)
            if (neighbour > node.Index)
            {
              AggregateNode other = _nodes[neighbour];
              if (other.Occupied)
                lines.Add(new Line(node.Point, other.Point));
            }

      return lines.ToArray();
    }
    #endregion
  }
# ---------- end c_script ----------
