# Grasshopper definition XX_FlockingSim_00-start.gh (Grasshopper 1.0.7)
# Copyright: Co-de-iT
# plug-ins: File to Script

dir_type = ValueList({"desktop": 0, "documents": 1, "GH file path": 2, "C:": 3}, selected="GH file path")
subdir_from_vs_project = Panel("ws_files\ws_files")
file_to_sync = Panel("FlockingSim_00-start.cs")
radius = Slider(5.164, range=0..15)
radius_2 = Slider(2, range=0..15)
neighbourhood_radius = Slider(1.5, range=0..5)
separation_distance = Slider(0.25, range=0..3)
pt = Point(Point(34.04423611, 27.86083967, 0))
separation = Slider(30, range=0..50)
cohesion = Slider(5, range=0..50)
count = Slider(500, range=1..8000)
timestep = Slider(0.03, range=0.001..0.2)
alignment = Slider(10, range=0..10)
pt_2 = Point(Point(19.1397673, 17.97413366, 0))
f_pathg = PathGenerator(type=dir_type, subDir=subdir_from_vs_project)  # -> dir; inputs type: Int32, subDir: String
# ---------- f_pathg: C# ----------
                           /*
    froGH - a sparse collection of (in)utilities for Grasshopper

    Path Generator
    code by Alessio Erioli - value list generation based on code by James Ramsden

    froGH by Co-de-iT is licensed under a Creative Commons Attribution 4.0 International License.
    http://creativecommons.org/licenses/by/4.0/

    */
    initComp();


    String S = "";
    String root = "";
    String end = "\\";
    String eol = Environment.NewLine;

    // __________________ autoList part __________________

    // variable for the list
    Grasshopper.Kernel.Special.GH_ValueList vList;
    // tries to cast input as list
    try{

      // if the list is not the first parameter then change Input[0] to the corresponding value
      vList = (Grasshopper.Kernel.Special.GH_ValueList) Component.Params.Input[0].Sources[0];
      // Print("value list connected");
      // check if the list must be created
      //if (vList.NickName != "dir type"){
      if (!vList.NickName.Equals("dir type")){
        vList.ClearData();
        vList.ListItems.Clear();
        vList.NickName = "dir type";
        var item1 = new Grasshopper.Kernel.Special.GH_ValueListItem("desktop", "0");
        var item2 = new Grasshopper.Kernel.Special.GH_ValueListItem("documents", "1");
        var item3 = new Grasshopper.Kernel.Special.GH_ValueListItem("GH file path", "2");
        var item4 = new Grasshopper.Kernel.Special.GH_ValueListItem("C:", "3");
        vList.ListItems.Add(item1);
        vList.ListItems.Add(item2);
        vList.ListItems.Add(item3);
        vList.ListItems.Add(item4);

        vList.ListItems[0].Value.CastTo(out type);
      }
    }
    catch{
      // handles anything that is not a value list
    }


    switch(type){
      case 0:
        root = Environment.GetFolderPath(Environment.SpecialFolder.Desktop) + end;
        S = "Desktop";
        break;
      case 1:
        root = Environment.GetFolderPath(Environment.SpecialFolder.MyDocuments) + end;
        S = "Documents";
        break;
      case 2:
        GH_Document ghDoc = owner.OnPingDocument();

        if (ghDoc.IsFilePathDefined)
        {
          int nameLen = ghDoc.DisplayName.TrimEnd('*').Length + 3; // +3 accounts for the '.gh' extension
          int fileLen = ghDoc.FilePath.TrimEnd('*').Length;

          //F = ghDoc.DisplayName.TrimEnd('*');
          root = ghDoc.FilePath.Substring(0, fileLen - nameLen);
          //root = gh_d.FilePath;
          S = "GH File path";
        }
        else
        {
          Print("No path defined. Saving to Desktop until then");
          root = Environment.GetFolderPath(Environment.SpecialFolder.Desktop);
          S = "Desktop";
        }
        break;
      case 3:
        root = "C:" + end;
        S = root + end;
        break;
    }
    dir = root + (subDir != null ? (subDir + end) : "");
    Component.Message = S;
# ---------- f_pathg: C# additional code ----------
  void initComp(){
    Component.Name = "Path Generator";
    Component.NickName = "f_PathG";
    Component.Description = "generates a path based on local direcories such as Desktop, Documents, GH file path";
    Component.Params.Input[0].Name = "dir type";
    Component.Params.Input[0].Description = "directory type: 0 desktop, 1 documents, 2 GH file path, 3 C:\nconnect a value list for automatic list generation";
    Component.Params.Input[1].Name = "custom subdir";
    Component.Params.Input[1].Description = "(optional) custom subdirectory";
  }
# ---------- end f_pathg ----------
use_r_tree = BooleanToggle(True)
parallel = BooleanToggle(True)
reset = Button()
play = BooleanToggle(False)
_3d = BooleanToggle(False)
cir = Circle(Plane=pt_2, Radius=radius)
cir_2 = Circle(Plane=pt, Radius=radius_2)
concat = Concatenate(FragmentA=f_pathg, FragmentB=file_to_sync)
path = FilePath(concat)
# Flocking Simulation - starting code
# 
# Flocking Simulation based on ICD C# 2017 workshop
# 
# code by Long Nguyen, adapted by Alessio Erioli
# 
# v 0.1
c_script = CSharpScript(
    Reset=reset,
    Play=play,
    is3D=_3d,
    Count=count,
    TimeStep=timestep,
    NeighborRad=neighbourhood_radius,
    Alignment=alignment,
    Cohesion=cohesion,
    Separation=separation,
    SepDist=separation_distance,
    Repellers=[cir, cir_2],
    UseParallel=parallel,
    UseRTree=use_r_tree)  # -> info, Positions, Velocities; inputs Reset: Boolean, Play: Boolean, is3D: Boolean, Count: Int32, TimeStep: Double, NeighborRad: Double, Alignment: Double, Cohesion: Double, Separation: Double, SepDist: Double, Repellers: list, UseParallel: Boolean, UseRTree: Boolean
# ---------- c_script: C# ----------
        // adapted from Long Nguyen ICD C# ws 2017
        // adaptation by Alessio Erioli - (c) Co-de-iT 2019

        List<GH_Point> positions = new List<GH_Point>();
        List<GH_Vector> velocities = new List<GH_Vector>();

        if (Reset || flockSystem == null)
            flockSystem = new FlockSystem(Count, is3D);

        else
        {
            flockSystem.TimeStep = TimeStep;
            flockSystem.NeighborhoodRadius = NeighborRad;
            flockSystem.AlignmentStrength = Alignment;
            flockSystem.CohesionStrength = Cohesion;
            flockSystem.SeparationStrength = Separation;
            flockSystem.SeparationDistance = SepDist;
            flockSystem.Repellers = Repellers;
            flockSystem.UseParallel = UseParallel;
            flockSystem.UseRTree = UseRTree;

            flockSystem.Update();

            if (Play) Component.ExpireSolution(true);

            foreach (FlockAgent agent in flockSystem.Agents)
            {
                positions.Add(new GH_Point(agent.Position));
                velocities.Add(new GH_Vector(agent.Velocity));
            }


            Positions = positions;
            Velocities = velocities;

        }
# ---------- c_script: C# additional code ----------
 

    private FlockSystem flockSystem;

    public class FlockSystem
    {
        public List<FlockAgent> Agents;

        public double TimeStep;
        public double NeighborhoodRadius;
        public double FieldOfView;
        public double AlignmentStrength;
        public double CohesionStrength;
        public double SeparationStrength;
        public double SeparationDistance;
        public double MinSpeed;
        public double MaxSpeed;
        public List<Circle> Repellers;
        public bool UseParallel;
        public bool UseRTree;

        public FlockSystem(int agentCount, bool is3D)
        {
            Agents = new List<FlockAgent>();

            if (is3D) { }
            else
                for(int i=0; i< agentCount; i++)
                {
                    FlockAgent agent = new FlockAgent(
                        Util.GetRandomPoint(0.0, 30.0, 0.0, 30.0, 0.0, 0.0),
                        Util.GetRandomUnitVectorXY() * 4.0);
                    agent.FlockSystem = this;

                    Agents.Add(agent);
                }
        }

        public void Update()
        {
            foreach (FlockAgent agent in Agents)
                agent.UpdateVelocityAndPosition();
        }
    }


    public class FlockAgent
    {
        public Point3d Position;
        public Vector3d Velocity;

        public FlockSystem FlockSystem;

        public FlockAgent(Point3d position, Vector3d velocity)
        {
            Position = position;
            Velocity = velocity;
        }

        public void UpdateVelocityAndPosition()
        {
            Position += Velocity;

        }
    }

    // ---------- Utilities class ----------

    public static class Util
    {
        static Random random = new Random();

        public static Point3d GetRandomPoint(double minX, double maxX, double minY, double maxY, double minZ, double maxZ)
        {
            double x = minX + (maxX - minX) * random.NextDouble();
            double y = minY + (maxY - minY) * random.NextDouble();
            double z = minZ + (maxZ - minZ) * random.NextDouble();

            return new Point3d(x, y, z);
        }

        public static Vector3d GetRandomUnitVector()
        {
            double phi = 2.0 * Math.PI * random.NextDouble();
            double theta = Math.Acos(2.0 * random.NextDouble() - 1.0);

            double x = Math.Sin(theta) * Math.Cos(phi);
            double y = Math.Sin(theta) * Math.Sin(phi);
            double z = Math.Cos(theta);

            return new Vector3d(x, y, z);
        }

        public static Vector3d GetRandomUnitVectorXY()
        {
            double angle = 2.0 * Math.PI * random.NextDouble();

            double x = Math.Cos(angle);
            double y = Math.Sin(angle);

            return new Vector3d(x, y, 0.0);
        }
    }
# ---------- end c_script ----------
fts = FileToScript(File=path)
unit = UnitVector(Vector=c_script.Velocities)
multiplication = Multiplication(A=c_script.Velocities, B=Slider(0.706, range=0..3))
vdisex = VectorDisplayEx(Point=c_script.Positions, Vector=multiplication, Colour=RGB(0, 0, 0), Width=2)
