# Grasshopper definition XX_FlockingSim_01-noPar.gh (Grasshopper 1.0.7)
# Copyright: Co-de-iT
# plug-ins: File to Script

dir_type = ValueList({"desktop": 0, "documents": 1, "GH file path": 2, "C:": 3}, selected="GH file path")
radius = Slider(13.343, range=0..15)
radius_2 = Slider(15, range=0..15)
neighbourhood_radius = Slider(5, range=0..5)
separation_distance = Slider(0.25, range=0..3)
pt = Point(Point(34.04423611, 58.20530742, 0))
separation = Slider(30, range=0..50)
cohesion = Slider(5, range=0..50)
count = Slider(3000, range=1..8000)
timestep = Slider(0.03, range=0.001..0.2)
alignment = Slider(10, range=0..10)
pt_2 = Point(Point(19.1397673, 17.97413366, 0))
f_pathg = PathGenerator(type=dir_type, subDir="ws_files\ws_files")  # -> dir; inputs type: Int32, subDir: String
# ---------- f_pathg: C# ----------
                           /*
    froGH - a sparse collection of (in)utilities for Grasshopper

    Path Generator
    code by Alessio Erioli - value list generation based on code by James Ramsden

    froGH by Co-de-iT is licensed under a Creative Commons Attribution 4.0 International License.
    http://creativecommons.org/licenses/by/4.0/

    */
    initComp();


    String S = "";
    String root = "";
    String end = "\\";
    String eol = Environment.NewLine;

    // __________________ autoList part __________________

    // variable for the list
    Grasshopper.Kernel.Special.GH_ValueList vList;
    // tries to cast input as list
    try{

      // if the list is not the first parameter then change Input[0] to the corresponding value
      vList = (Grasshopper.Kernel.Special.GH_ValueList) Component.Params.Input[0].Sources[0];
      // Print("value list connected");
      // check if the list must be created
      //if (vList.NickName != "dir type"){
      if (!vList.NickName.Equals("dir type")){
        vList.ClearData();
        vList.ListItems.Clear();
        vList.NickName = "dir type";
        var item1 = new Grasshopper.Kernel.Special.GH_ValueListItem("desktop", "0");
        var item2 = new Grasshopper.Kernel.Special.GH_ValueListItem("documents", "1");
        var item3 = new Grasshopper.Kernel.Special.GH_ValueListItem("GH file path", "2");
        var item4 = new Grasshopper.Kernel.Special.GH_ValueListItem("C:", "3");
        vList.ListItems.Add(item1);
        vList.ListItems.Add(item2);
        vList.ListItems.Add(item3);
        vList.ListItems.Add(item4);

        vList.ListItems[0].Value.CastTo(out type);
      }
    }
    catch{
      // handles anything that is not a value list
    }


    switch(type){
      case 0:
        root = Environment.GetFolderPath(Environment.SpecialFolder.Desktop) + end;
        S = "Desktop";
        break;
      case 1:
        root = Environment.GetFolderPath(Environment.SpecialFolder.MyDocuments) + end;
        S = "Documents";
        break;
      case 2:
        GH_Document ghDoc = owner.OnPingDocument();

        if (ghDoc.IsFilePathDefined)
        {
          int nameLen = ghDoc.DisplayName.TrimEnd('*').Length + 3; // +3 accounts for the '.gh' extension
          int fileLen = ghDoc.FilePath.TrimEnd('*').Length;

          //F = ghDoc.DisplayName.TrimEnd('*');
          root = ghDoc.FilePath.Substring(0, fileLen - nameLen);
          //root = gh_d.FilePath;
          S = "GH File path";
        }
        else
        {
          Print("No path defined. Saving to Desktop until then");
          root = Environment.GetFolderPath(Environment.SpecialFolder.Desktop);
          S = "Desktop";
        }
        break;
      case 3:
        root = "C:" + end;
        S = root + end;
        break;
    }
    dir = root + (subDir != null ? (subDir + end) : "");
    Component.Message = S;
# ---------- f_pathg: C# additional code ----------
  void initComp(){
    Component.Name = "Path Generator";
    Component.NickName = "f_PathG";
    Component.Description = "generates a path based on local direcories such as Desktop, Documents, GH file path";
    Component.Params.Input[0].Name = "dir type";
    Component.Params.Input[0].Description = "directory type: 0 desktop, 1 documents, 2 GH file path, 3 C:\nconnect a value list for automatic list generation";
    Component.Params.Input[1].Name = "custom subdir";
    Component.Params.Input[1].Description = "(optional) custom subdirectory";
  }
# ---------- end f_pathg ----------
use_r_tree = BooleanToggle(True)
parallel = BooleanToggle(True)
reset = Button()
play = BooleanToggle(False)
_3d = BooleanToggle(False)
cir = Circle(Plane=pt_2, Radius=radius)
cir_2 = Circle(Plane=pt, Radius=radius_2)
concat = Concatenate(FragmentA=f_pathg, FragmentB="FlockingSim_01-nopar.cs")
path = FilePath(concat)
# Flocking Simulation
# 
# Flocking Simulation based on ICD C# 2017 workshop
# 
# code by Long Nguyen, adapted by Alessio Erioli
# 
# v 0.1
c_script = CSharpScript(
    Reset=reset,
    Play=play,
    is3D=_3d,
    Count=count,
    TimeStep=timestep,
    NeighborRad=neighbourhood_radius,
    Alignment=alignment,
    Cohesion=cohesion,
    Separation=separation,
    SepDist=separation_distance,
    Repellers=[cir, cir_2],
    UseParallel=parallel,
    UseRTree=use_r_tree)  # -> info, Positions, Velocities; inputs Reset: Boolean, Play: Boolean, is3D: Boolean, Count: Int32, TimeStep: Double, NeighborRad: Double, Alignment: Double, Cohesion: Double, Separation: Double, SepDist: Double, Repellers: list, UseParallel: Boolean, UseRTree: Boolean
# ---------- c_script: C# ----------
        // adapted from Long Nguyen ICD C# ws 2017
        // adaptation by Alessio Erioli - (c) Co-de-iT 2019
        // part 01 - flocking without parallelization

        List<GH_Point> positions = new List<GH_Point>();
        List<GH_Vector> velocities = new List<GH_Vector>();

        if (Reset || flockSystem == null)
            flockSystem = new FlockSystem(Count, is3D);

        else
        {
            flockSystem.TimeStep = TimeStep;
            flockSystem.NeighborhoodRadius = NeighborRad;
            flockSystem.AlignmentStrength = Alignment;
            flockSystem.CohesionStrength = Cohesion;
            flockSystem.SeparationStrength = Separation;
            flockSystem.SeparationDistance = SepDist;
            flockSystem.Repellers = Repellers;
            flockSystem.UseParallel = UseParallel;
            flockSystem.UseRTree = UseRTree;

            flockSystem.Update();

            if (Play) Component.ExpireSolution(true);

            foreach (FlockAgent agent in flockSystem.Agents)
            {
                positions.Add(new GH_Point(agent.Position));
                velocities.Add(new GH_Vector(agent.Velocity));
            }


            Positions = positions;
            Velocities = velocities;

        }
# ---------- c_script: C# additional code ----------
 

    private FlockSystem flockSystem;


    // ---------- Flock class ----------

    public class FlockSystem
    {
        public List<FlockAgent> Agents;

        public double TimeStep;
        public double NeighborhoodRadius;
        public double FieldOfView;
        public double AlignmentStrength;
        public double CohesionStrength;
        public double SeparationStrength;
        public double SeparationDistance;
        public double MinSpeed;
        public double MaxSpeed;
        public List<Circle> Repellers;
        public bool UseParallel;
        public bool UseRTree;

        public FlockSystem(int agentCount, bool is3D)
        {
            Agents = new List<FlockAgent>();

            if (is3D) { }
            else
                for(int i=0; i< agentCount; i++)
                {
                    FlockAgent agent = new FlockAgent(
                        Util.GetRandomPoint(0.0, 30.0, 0.0, 30.0, 0.0, 0.0),
                        Util.GetRandomUnitVectorXY() * 4.0);
                    agent.FlockSystem = this;

                    Agents.Add(agent);
                }
        }

        private List<FlockAgent> FindNeighBours(FlockAgent agent)
        {
            List<FlockAgent> neighbours = new List<FlockAgent>();

            foreach (FlockAgent neighbour in Agents)
            {
                if (neighbour != agent && neighbour.Position.DistanceTo(agent.Position) < NeighborhoodRadius)
                    neighbours.Add(neighbour);
            }

            return neighbours;
        }

        public void Update()
        {
            foreach(FlockAgent agent in Agents)
            {
                List<FlockAgent> neighbours = FindNeighBours(agent);
                agent.ComputeDesiredVelocity(neighbours);
            }

            foreach (FlockAgent agent in Agents)
                agent.UpdateVelocityAndPosition();
        }

        
    }

    // ---------- Agent class ----------

    public class FlockAgent
    {
        public Point3d Position;
        public Vector3d Velocity;
        private Vector3d desiredVelocity;

        public FlockSystem FlockSystem;

        public FlockAgent(Point3d position, Vector3d velocity)
        {
            Position = position;
            Velocity = velocity;
        }

        public void UpdateVelocityAndPosition()
        {
            Velocity = 0.97 * Velocity + 0.03 * desiredVelocity;

            if (Velocity.Length > 8.0) Velocity *= 8.0 / Velocity.Length;
            else if (Velocity.Length < 4.0) Velocity *= 4.0 / Velocity.Length;

            Position += Velocity;

        }

        public void ComputeDesiredVelocity(List<FlockAgent> neighbours)
        {
            desiredVelocity = new Vector3d(0.0, 0.0, 0.0);

            // Containment behavior --------------------

            double boundingBoxSize = 30.0;

            if (Position.X < 0.0)
                desiredVelocity += new Vector3d(-Position.X, 0.0, 0.0);
            else if (Position.X > boundingBoxSize)
                desiredVelocity += new Vector3d(boundingBoxSize - Position.X, 0.0, 0.0);
            if (Position.Y < 0.0)
                desiredVelocity += new Vector3d(0.0,-Position.Y, 0.0);
            else if (Position.Y > boundingBoxSize)
                desiredVelocity += new Vector3d(0.0, boundingBoxSize - Position.Y, 0.0);
            if (Position.Z < 0.0)
                desiredVelocity += new Vector3d( 0.0, 0.0, -Position.Z);
            else if (Position.Z > boundingBoxSize)
                desiredVelocity += new Vector3d(0.0, 0.0, boundingBoxSize - Position.Z);

            if (neighbours.Count == 0)
                desiredVelocity += Velocity; // maintain current velocity
            else
            {
                // Alignment behavior --------------------

                Vector3d alignment = Vector3d.Zero;

                foreach (FlockAgent neighbour in neighbours)
                    alignment += neighbour.Velocity;

                alignment /= neighbours.Count;
                desiredVelocity += FlockSystem.AlignmentStrength * alignment;

                // Cohesion behavior --------------------

                Point3d centre = Point3d.Origin; // a zero point to count average neighbours position

                foreach (FlockAgent neighbour in neighbours)
                    centre += neighbour.Position;

                centre /= neighbours.Count;

                Vector3d cohesion = centre - Position;
                desiredVelocity += FlockSystem.CohesionStrength * cohesion;

                // Separation behavior --------------------

                Vector3d separation = Vector3d.Zero;

                foreach (FlockAgent neighbour in neighbours)
                {
                    double distanceToNeighbour = Position.DistanceTo(neighbour.Position);
                    if(distanceToNeighbour < FlockSystem.SeparationDistance)
                    {
                        Vector3d getAway = Position - neighbour.Position;
                        separation += getAway /= (getAway.Length * distanceToNeighbour);
                    }

                }

                desiredVelocity += FlockSystem.SeparationStrength * separation;

            }

            // Avoiding obstacles (repellers) --------------------

            foreach (Circle repeller in FlockSystem.Repellers)
            {
                double distanceToRepeller = Position.DistanceTo(repeller.Center);
                Vector3d repulsion = Position - repeller.Center;

                repulsion /= (repulsion.Length * distanceToRepeller);
                repulsion *= 30.0 * repeller.Radius;
                desiredVelocity += repulsion;
            }
        }
    }

    // ---------- Utilities class ----------

    public static class Util
    {
        static Random random = new Random();

        public static Point3d GetRandomPoint(double minX, double maxX, double minY, double maxY, double minZ, double maxZ)
        {
            double x = minX + (maxX - minX) * random.NextDouble();
            double y = minY + (maxY - minY) * random.NextDouble();
            double z = minZ + (maxZ - minZ) * random.NextDouble();

            return new Point3d(x, y, z);
        }

        public static Vector3d GetRandomUnitVector()
        {
            double phi = 2.0 * Math.PI * random.NextDouble();
            double theta = Math.Acos(2.0 * random.NextDouble() - 1.0);

            double x = Math.Sin(theta) * Math.Cos(phi);
            double y = Math.Sin(theta) * Math.Sin(phi);
            double z = Math.Cos(theta);

            return new Vector3d(x, y, z);
        }

        public static Vector3d GetRandomUnitVectorXY()
        {
            double angle = 2.0 * Math.PI * random.NextDouble();

            double x = Math.Cos(angle);
            double y = Math.Sin(angle);

            return new Vector3d(x, y, 0.0);
        }
    }
# ---------- end c_script ----------
fts = FileToScript(File=path)
vlen = VectorLength(Vector=c_script.Velocities)
unit = UnitVector(Vector=c_script.Velocities)  # disabled
gradient = Gradient(LowerLimit="4", UpperLimit="8", Parameter=vlen, stops=[0: RGB(0, 0, 0), 1: RGB(255, 255, 255)])
multiplication = Multiplication(A=c_script.Velocities, B=Slider(0.249, range=0..3))
vdisex = VectorDisplayEx(Point=c_script.Positions, Vector=multiplication, Colour=gradient, Width=2)
