# Grasshopper definition XX_FlockingSim_02-par+RTree.gh (Grasshopper 1.0.7)
# Copyright: Co-de-iT
# plug-ins: FileToScript

dir_type = ValueList({"desktop": 0, "documents": 1, "GH file path": 2, "C:": 3}, selected="GH file path")
radius = Slider(4, range=0..15)
radius_2 = Slider(1.5, range=0..15)
neighbourhood_radius = Slider(1.5, range=0..5)
separation_distance = Slider(0.7, range=0..3)
pt = Point(Point(21.41530915, 24.58637691, 0))
separation = Slider(30, range=0..50)
cohesion = Slider(5, range=0..50)
count = Slider(3000, range=1..8000)
timestep = Slider(0.03, range=0.001..0.2)
alignment = Slider(10, range=0..10)
pt_2 = Point(Point(9.254029046, 7.480432574, 0))
f_pathg = PathGenerator(type=dir_type, subDir="ws_files\ws_files")  # -> dir; inputs type: Int32, subDir: String
# ---------- f_pathg: C# ----------
                           /*
    froGH - a sparse collection of (in)utilities for Grasshopper

    Path Generator
    code by Alessio Erioli - value list generation based on code by James Ramsden

    froGH by Co-de-iT is licensed under a Creative Commons Attribution 4.0 International License.
    http://creativecommons.org/licenses/by/4.0/

    */
    initComp();


    String S = "";
    String root = "";
    String end = "\\";
    String eol = Environment.NewLine;

    // __________________ autoList part __________________

    // variable for the list
    Grasshopper.Kernel.Special.GH_ValueList vList;
    // tries to cast input as list
    try{

      // if the list is not the first parameter then change Input[0] to the corresponding value
      vList = (Grasshopper.Kernel.Special.GH_ValueList) Component.Params.Input[0].Sources[0];
      // Print("value list connected");
      // check if the list must be created
      //if (vList.NickName != "dir type"){
      if (!vList.NickName.Equals("dir type")){
        vList.ClearData();
        vList.ListItems.Clear();
        vList.NickName = "dir type";
        var item1 = new Grasshopper.Kernel.Special.GH_ValueListItem("desktop", "0");
        var item2 = new Grasshopper.Kernel.Special.GH_ValueListItem("documents", "1");
        var item3 = new Grasshopper.Kernel.Special.GH_ValueListItem("GH file path", "2");
        var item4 = new Grasshopper.Kernel.Special.GH_ValueListItem("C:", "3");
        vList.ListItems.Add(item1);
        vList.ListItems.Add(item2);
        vList.ListItems.Add(item3);
        vList.ListItems.Add(item4);

        vList.ListItems[0].Value.CastTo(out type);
      }
    }
    catch{
      // handles anything that is not a value list
    }


    switch(type){
      case 0:
        root = Environment.GetFolderPath(Environment.SpecialFolder.Desktop) + end;
        S = "Desktop";
        break;
      case 1:
        root = Environment.GetFolderPath(Environment.SpecialFolder.MyDocuments) + end;
        S = "Documents";
        break;
      case 2:
        GH_Document ghDoc = owner.OnPingDocument();

        if (ghDoc.IsFilePathDefined)
        {
          int nameLen = ghDoc.DisplayName.TrimEnd('*').Length + 3; // +3 accounts for the '.gh' extension
          int fileLen = ghDoc.FilePath.TrimEnd('*').Length;

          //F = ghDoc.DisplayName.TrimEnd('*');
          root = ghDoc.FilePath.Substring(0, fileLen - nameLen);
          //root = gh_d.FilePath;
          S = "GH File path";
        }
        else
        {
          Print("No path defined. Saving to Desktop until then");
          root = Environment.GetFolderPath(Environment.SpecialFolder.Desktop);
          S = "Desktop";
        }
        break;
      case 3:
        root = "C:" + end;
        S = root + end;
        break;
    }
    dir = root + (subDir != null ? (subDir + end) : "");
    Component.Message = S;
# ---------- f_pathg: C# additional code ----------
  void initComp(){
    Component.Name = "Path Generator";
    Component.NickName = "f_PathG";
    Component.Description = "generates a path based on local direcories such as Desktop, Documents, GH file path";
    Component.Params.Input[0].Name = "dir type";
    Component.Params.Input[0].Description = "directory type: 0 desktop, 1 documents, 2 GH file path, 3 C:\nconnect a value list for automatic list generation";
    Component.Params.Input[1].Name = "custom subdir";
    Component.Params.Input[1].Description = "(optional) custom subdirectory";
  }
# ---------- end f_pathg ----------
use_r_tree = BooleanToggle(True)
parallel = BooleanToggle(True)
reset = Button()
play = BooleanToggle(False)
_3d = BooleanToggle(False)
cir = Circle(Plane=pt_2, Radius=radius)
cir_2 = Circle(Plane=pt, Radius=radius_2)
concat = Concatenate(FragmentA=f_pathg, FragmentB="FlockingSim_02-par+RTree.cs")
path = FilePath(concat)
c_script = CSharpScript(
    Reset=reset,
    Play=play,
    is3D=_3d,
    Count=count,
    TimeStep=timestep,
    NeighborRad=neighbourhood_radius,
    Alignment=alignment,
    Cohesion=cohesion,
    Separation=separation,
    SepDist=separation_distance,
    Repellers=[cir, cir_2],
    UseParallel=parallel,
    UseRTree=use_r_tree)  # -> info, Positions, Velocities; inputs Reset: Boolean, Play: Boolean, is3D: Boolean, Count: Int32, TimeStep: Double, NeighborRad: Double, Alignment: Double, Cohesion: Double, Separation: Double, SepDist: Double, Repellers: list, UseParallel: Boolean, UseRTree: Boolean
# ---------- c_script: C# usings ----------
using System.Threading;
using System.Threading.Tasks;
using System.Collections.Concurrent;
# ---------- c_script: C# ----------
        // adapted from Long Nguyen ICD C# ws 2017
        // adaptation by Alessio Erioli - (c) Co-de-iT 2019
        // part 02 - parallelization and RTree implementation

        //List<GH_Point> positions = new List<GH_Point>();
        //List<GH_Vector> velocities = new List<GH_Vector>();

        // in case of a variable number of agents initialize these
        // after the call to flockSystem.Update() with flockSystem.Agents.Count
        positions = new GH_Point[Count];
        velocities = new GH_Vector[Count];

        if (Reset || flockSystem == null)
            flockSystem = new FlockSystem(Count, is3D);

        else
        {
            flockSystem.TimeStep = TimeStep;
            flockSystem.NeighborhoodRadius = NeighborRad;
            flockSystem.AlignmentStrength = Alignment;
            flockSystem.CohesionStrength = Cohesion;
            flockSystem.SeparationStrength = Separation;
            flockSystem.SeparationDistance = SepDist;
            flockSystem.Repellers = Repellers;
            flockSystem.UseParallel = UseParallel;
            flockSystem.UseRTree = UseRTree;

            if (UseRTree)
                flockSystem.UpdateUsingRTree();
            else
                flockSystem.Update();

            if (Play) Component.ExpireSolution(true);

            //foreach (FlockAgent agent in flockSystem.Agents)
            //{
            //    positions.Add(new GH_Point(agent.Position));
            //    velocities.Add(new GH_Vector(agent.Velocity));
            //}

            Parallel.For(0, Count, i =>
            {
                positions[i] = new GH_Point(flockSystem.Agents[i].Position);
                velocities[i] = new GH_Vector(flockSystem.Agents[i].Velocity);
            });

            Positions = positions;
            Velocities = velocities;

        }
# ---------- c_script: C# additional code ----------
 

    // transformed the output geometry variables into arrays
    // for faster output via parallelization
    GH_Point[] positions;
    GH_Vector[] velocities;


    private FlockSystem flockSystem;

    // .................................
    // .......... Flock class ..........
    // .................................

    public class FlockSystem
    {
        public List<FlockAgent> Agents;

        public double TimeStep;
        public double NeighborhoodRadius;
        public double FieldOfView;
        public double AlignmentStrength;
        public double CohesionStrength;
        public double SeparationStrength;
        public double SeparationDistance;
        public double MinSpeed;
        public double MaxSpeed;
        public List<Circle> Repellers;
        public bool UseParallel;
        public bool UseRTree;

        public FlockSystem(int agentCount, bool is3D)
        {
            Agents = new List<FlockAgent>();

            if (is3D)
            {
                for (int i = 0; i < agentCount; i++)
                {
                    FlockAgent agent = new FlockAgent(
                        Util.GetRandomPoint(0.0, 30.0, 0.0, 30.0, 0.0, 30.0),
                        Util.GetRandomUnitVector() * 4.0);
                    agent.FlockSystem = this;

                    Agents.Add(agent);
                }
            }
            else
                for (int i = 0; i < agentCount; i++)
                {
                    FlockAgent agent = new FlockAgent(
                        Util.GetRandomPoint(0.0, 30.0, 0.0, 30.0, 0.0, 0.0),
                        Util.GetRandomUnitVectorXY() * 4.0);
                    agent.FlockSystem = this;

                    Agents.Add(agent);
                }
        }

        private List<FlockAgent> FindNeighBours(FlockAgent agent)
        {
            List<FlockAgent> neighbours = new List<FlockAgent>();

            foreach (FlockAgent neighbour in Agents)
            {
                if (neighbour != agent && neighbour.Position.DistanceTo(agent.Position) < NeighborhoodRadius)
                    neighbours.Add(neighbour);
            }

            return neighbours;
        }

        /* this function is defined to package the update actions in a void function
         * so to kmake use of the void delegate in the parallel computation case
         */
        private void ComputeAgentDesiredVelocity(FlockAgent agent)
        {
            List<FlockAgent> neighbours = FindNeighBours(agent);
            agent.ComputeDesiredVelocity(neighbours);
        }

        public void UpdateUsingRTree()
        {
            RTree rTree = new RTree(); // we build a new RTree every update

            // note: RTree cannot be parallelized
            for (int i = 0; i < Agents.Count; i++)
                rTree.Insert(Agents[i].Position, i);

            foreach (FlockAgent agent in Agents)
            {
                List<FlockAgent> neighbours = new List<FlockAgent>();

                EventHandler<RTreeEventArgs> rTreeCallback =
                (object sender, RTreeEventArgs args) =>
                {
                    if (Agents[args.Id] != agent)
                        neighbours.Add(Agents[args.Id]);
                };

                rTree.Search(new Sphere(agent.Position, NeighborhoodRadius), rTreeCallback);
                agent.ComputeDesiredVelocity(neighbours);
            }

            UpdateAgentsPositions();
            //var part = Partitioner.Create(0, Agents.Count);
            //Parallel.ForEach(part, (range, loopstate) =>
            //{
            //    for (int i = range.Item1; i < range.Item2; i++)
            //        Agents[i].UpdateVelocityAndPosition();
            //});
            //Parallel.ForEach(Agents, agent => { agent.UpdateVelocityAndPosition(); });
            //foreach (FlockAgent agent in Agents) agent.UpdateVelocityAndPosition();
        }



        public void Update()
        {
            if (!UseParallel)
                foreach (FlockAgent agent in Agents)
                {
                    List<FlockAgent> neighbours = FindNeighBours(agent);
                    agent.ComputeDesiredVelocity(neighbours);
                }

            else
                /* Parallelizing - phase 1
                 * implementing a void function to be used by the Parallel.ForEach delegate
                 * remember to update the "using" statements the first time
                 * the Parallel static class is used:
                 * using System.Threading.Tasks;
                 * (also in the C# component in GH)
                 */
                // Parallel.ForEach(Agents, ComputeAgentDesiredVelocity);

                /* Parallelizing - phase 2
                 * after parallelizing by using a delegate function (see line above)
                 * I can use anonymous functions to write the function in place
                 * like here below */
                Parallel.ForEach(Agents, agent =>
                {
                    List<FlockAgent> neighbours = FindNeighBours(agent);
                    agent.ComputeDesiredVelocity(neighbours);
                });

            UpdateAgentsPositions();
            // old implementation
            //foreach (FlockAgent agent in Agents)
            //    agent.UpdateVelocityAndPosition();
        }

        public void UpdateAgentsPositions()
        {
            // here's one of my mods - update positions and velocities in parallel
            var part = Partitioner.Create(0, Agents.Count);
            Parallel.ForEach(part, (range, loopstate) =>
            {
                for (int i = range.Item1; i < range.Item2; i++)
                    Agents[i].UpdateVelocityAndPosition();
            });
            //Parallel.ForEach(Agents, agent => { agent.UpdateVelocityAndPosition(); });
            //foreach (FlockAgent agent in Agents) agent.UpdateVelocityAndPosition();
        }

    }

    // .................................
    // .......... Agent class ..........
    // .................................

    public class FlockAgent
    {
        public Point3d Position;
        public Vector3d Velocity;
        private Vector3d desiredVelocity;

        public FlockSystem FlockSystem;

        public FlockAgent(Point3d position, Vector3d velocity)
        {
            Position = position;
            Velocity = velocity;
        }

        public void UpdateVelocityAndPosition()
        {
            /* this is a more elegant way of steering:
             classical method would have a steering vector newVel = desired-vel
             added to the velocity itself. In the way used here, gradual change
             of direction is implemented algebrically
             */
            Velocity = 0.97 * Velocity + 0.03 * desiredVelocity;

            // contain velocity vector between min and max (make external parameters?)
            if (Velocity.Length > 8.0) Velocity *= 8.0 / Velocity.Length;
            else if (Velocity.Length < 4.0) Velocity *= 4.0 / Velocity.Length;

            Position += Velocity * FlockSystem.TimeStep; // TimeStep can also be considered as the maxForce

        }

        public void ComputeDesiredVelocity(List<FlockAgent> neighbours)
        {
            desiredVelocity = new Vector3d(0.0, 0.0, 0.0);

            // Containment behavior --------------------

            // implementation: transform these into external parameters
            double boundingBoxSize = 30.0;
            double containmentStrength = 20.0; // added this variable to enhance containment

            if (Position.X < 0.0)
                desiredVelocity += new Vector3d(-Position.X, 0.0, 0.0);
            else if (Position.X > boundingBoxSize)
                desiredVelocity += new Vector3d(boundingBoxSize - Position.X, 0.0, 0.0);

            if (Position.Y < 0.0)
                desiredVelocity += new Vector3d(0.0, -Position.Y, 0.0);
            else if (Position.Y > boundingBoxSize)
                desiredVelocity += new Vector3d(0.0, boundingBoxSize - Position.Y, 0.0);

            if (Position.Z < 0.0)
                desiredVelocity += new Vector3d(0.0, 0.0, -Position.Z);
            else if (Position.Z > boundingBoxSize)
                desiredVelocity += new Vector3d(0.0, 0.0, boundingBoxSize - Position.Z);

            desiredVelocity *= containmentStrength;

            if (neighbours.Count == 0)
                desiredVelocity += Velocity; // maintain current velocity
            else
            {
                // Alignment behavior --------------------

                Vector3d alignment = Vector3d.Zero;

                foreach (FlockAgent neighbour in neighbours)
                    alignment += neighbour.Velocity;

                alignment /= neighbours.Count;
                desiredVelocity += FlockSystem.AlignmentStrength * alignment;

                // Cohesion behavior --------------------

                Point3d centre = Point3d.Origin; // a zero point to count average neighbours position

                foreach (FlockAgent neighbour in neighbours)
                    centre += neighbour.Position;

                centre /= neighbours.Count;

                Vector3d cohesion = centre - Position;
                desiredVelocity += FlockSystem.CohesionStrength * cohesion;

                // Separation behavior --------------------

                Vector3d separation = Vector3d.Zero;

                foreach (FlockAgent neighbour in neighbours)
                {
                    double distanceToNeighbour = Position.DistanceTo(neighbour.Position);
                    if (distanceToNeighbour < FlockSystem.SeparationDistance)
                    {
                        Vector3d getAway = Position - neighbour.Position;

                        /* We scale the getAway vector by inverse of distanceToNeighbour to make 
                           the getAway vector bigger as the agent gets closer to its neighbour */
                        separation += getAway /= (getAway.Length * distanceToNeighbour);
                    }

                }

                desiredVelocity += FlockSystem.SeparationStrength * separation;

            }

            // Avoiding obstacles (repellers) --------------------

            foreach (Circle repeller in FlockSystem.Repellers)
            {
                double distanceToRepeller = Position.DistanceTo(repeller.Center);
                Vector3d repulsion = Position - repeller.Center;

                repulsion /= (repulsion.Length * distanceToRepeller);
                repulsion *= 30.0 * repeller.Radius;
                desiredVelocity += repulsion;
            }
        }
    }

    // .....................................
    // .......... Utilities class ..........
    // .....................................

    public static class Util
    {
        static Random random = new Random();

        public static Point3d GetRandomPoint(double minX, double maxX, double minY, double maxY, double minZ, double maxZ)
        {
            double x = minX + (maxX - minX) * random.NextDouble();
            double y = minY + (maxY - minY) * random.NextDouble();
            double z = minZ + (maxZ - minZ) * random.NextDouble();

            return new Point3d(x, y, z);
        }

        public static Vector3d GetRandomUnitVector()
        {
            double phi = 2.0 * Math.PI * random.NextDouble();
            double theta = Math.Acos(2.0 * random.NextDouble() - 1.0);

            double x = Math.Sin(theta) * Math.Cos(phi);
            double y = Math.Sin(theta) * Math.Sin(phi);
            double z = Math.Cos(theta);

            return new Vector3d(x, y, z);
        }

        public static Vector3d GetRandomUnitVectorXY()
        {
            double angle = 2.0 * Math.PI * random.NextDouble();

            double x = Math.Cos(angle);
            double y = Math.Sin(angle);

            return new Vector3d(x, y, 0.0);
        }
    }
# ---------- end c_script ----------
ftsv2 = FileToScriptV2(File=path)
# Flocking Simulation
# 
# Flocking Simulation based on ICD C# 2017 workshop
# 
# code by Long Nguyen, adapted by Alessio Erioli
# 
# v 0.1
rectangle = Rectangle(Plane=PlaneXY(0, 0, 0), XSize="0 to 30.0", YSize="0 to 30.0", Radius=0)  # -> Rectangle, Length
box = DomainBox(Base=PlaneXY(0, 0, 0), X="0 to 30.0", Y="0 to 30.0", Z="0 to 30.0")
edges = BrepEdges(Brep=box)  # -> Naked, Interior, NonManifold
multiplication = Multiplication(A=c_script.Velocities, B=Slider(0.05, range=0..3))
filter = StreamFilter(Gate=_3d, Stream0=rectangle.Rectangle, Stream1=edges.Interior)
vdisex = VectorDisplayEx(Point=c_script.Positions, Vector=multiplication, Colour=RGB(0, 0, 0), Width="1")

# ---- group: boundary preview
preview = CustomPreview(Geometry=filter, Material=ColourSwatch(SwatchColor=RGB(150, 112, 120)))

# ---- group: points & lines display
cir_3 = Circle(Plane=c_script.Positions, Radius="0.05")
line = LineSDL(Start=c_script.Positions, Direction=c_script.Velocities, Length=1)
