# Grasshopper definition XX_Utilities.gh (Grasshopper 1.0.7)
# Copyright: Co-de-iT
# plug-ins: CurlNoise, FileToScript, Anemone

number_slider = Slider(10000, range=10..20000)
_3d = BooleanToggle(True)

crv = Curve(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)
curvepoint = PointOnCurve(crv, parameter=0.523)
pt = Point(Point(0.6942059364, -0.298831979, 8.557473151))
c_script = CSharpScript(location=curvepoint, target=pt, lens=Slider(15, range=0..100), run=Toggle(False))  # inputs location: Point3d, target: Point3d, lens: Double, run: Boolean
# ---------- c_script: C# ----------
    Component.Message = "Set Camera";
    
    if (run){
      //Get current viewport
      vp = Rhino.RhinoDoc.ActiveDoc.Views.ActiveView.ActiveViewport;
      //Set new camera
      vp.SetCameraLocations(target, location);
      vp.ChangeToPerspectiveProjection(true, lens);
    }
# ---------- c_script: C# additional code ----------
  //To get and set camera properties
  Rhino.Display.RhinoViewport vp;
# ---------- end c_script ----------

# ----
# get/set camera - Petras Vestartas
toggle = BooleanToggle(False)
c_script_2 = CSharpScript(run=toggle)  # -> location, target, lens, direction; inputs run: Boolean
# ---------- c_script_2: C# ----------
    Component.Message = "Get Camera";
    
    if(run){
      //Get camera
      //Get current viewport
      vp = doc.Views.ActiveView.ActiveViewport;
      //save camera  location and camera target
      location = vp.CameraLocation;
      target = vp.CameraTarget;
      lens = vp.Camera35mmLensLength;
      direction = vp.CameraUp;
    }
# ---------- c_script_2: C# additional code ----------
  Rhino.Display.RhinoViewport vp; //use to get and set rhino camera properties
# ---------- end c_script_2 ----------
panel = Panel(c_script_2.lens)
panel_2 = Panel(c_script_2.location)
panel_3 = Panel(c_script_2.target)
panel_4 = Panel(c_script_2.direction)

mesh = Mesh(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)
msphere = MeshSphere(Base=PlaneXY(0, 0, 0), Radius=10, UCount=10, VCount=20)

# ---- group: random field points
random_populate_mesh = CSharpScript(M=mesh, n=number_slider, s="2")  # -> Pts; inputs M: Mesh, V: Mesh, n: Int32, s: Int32
# ---------- random_populate_mesh: C# usings ----------
using System.IO;
using System.Linq;
using System.Data;
using System.Drawing;
using System.Reflection;
using System.Windows.Forms;
using System.Xml;
using System.Xml.Linq;
using System.Runtime.InteropServices;

using Rhino.DocObjects;
using Rhino.Collections;
using GH_IO;
using GH_IO.Serialization;
# ---------- random_populate_mesh: C# ----------
    Random r = new Random(s);
    BoundingBox b = new BoundingBox(M.Vertices.ToPoint3dArray());
    Point3d max = b.Max;
    Point3d min = b.Min;
    double x,y,z;
    int count = 0, i = 0;
    List<Point3d> pts = new List<Point3d>();
    List<Point3d> ptsOut = new List<Point3d>();

    while (count < n){

      x = b.Min.X + r.NextDouble() * (b.Max.X - b.Min.X);
      y = b.Min.Y + r.NextDouble() * (b.Max.Y - b.Min.Y);
      z = b.Min.Z + r.NextDouble() * (b.Max.Z - b.Min.Z);
      Point3d p = new Point3d(x, y, z);

      if (M.IsPointInside(p, 0.1, false) && (V == null ? true : !V.IsPointInside(p, 0.1, false))){
        pts.Add(p);
        count++;
      } else{
        ptsOut.Add(p);
      }

      i++;
    }

    Pts = pts;
# ---------- end random_populate_mesh ----------

# ----
charseq = CharSequence(Count=10, CharPool="ABCDEFGHIJKLMNOPQRSTUVWXYZ", Format="{0}")
random_vector = CSharpScript(seed=Slider(0, range=0..100), DDD=_3d)  # -> out, V; inputs n: Int32, seed: Int32, DDD: Boolean
# ---------- random_vector: C# ----------
    if(seed == 0) rnd = new Random(); else rnd = new Random(seed);
    List <Vector3d> vectors = new List<Vector3d>();
    Vector3d vec = new Vector3d();
    for (int i = 0; i < n; i++){
      vec.X = rnd.NextDouble() - 0.5;
      vec.Y = rnd.NextDouble() - 0.5;
      vec.Z = DDD ? rnd.NextDouble() - 0.5 : 0;
      vec.Unitize();
      vectors.Add(vec);
    }
    V = vectors;
# ---------- random_vector: C# additional code ----------
  Random rnd;
# ---------- end random_vector ----------
multiplication = Multiplication(A=Slider(5, range=1..20), B="2")

# ---- group: clean mesh Petras Vestartas
c_script_3 = CSharpScript(mesh=msphere)  # -> out, A; inputs mesh: Mesh
# ---------- c_script_3: C# ----------
    Component.Message = "Clean Mesh";

    mesh.Vertices.CombineIdentical(true, true);
    mesh.Vertices.CullUnused();
    mesh.Weld(3.14159265358979);
    mesh.UnifyNormals();
    mesh.FaceNormals.ComputeFaceNormals();
    mesh.Normals.ComputeNormals();

    A = mesh;
# ---------- end c_script_3 ----------

# ---- group: list interpolate
interplist = CSharpScript(V=charseq, i=Slider(0, range=0..1))  # -> E, ind; inputs V: list, i: Double
# ---------- interplist: C# ----------
    int index = (int) (i * (V.Count - 1));
    E = V[index];
    ind = index;
# ---------- end interplist ----------

# ----
random = Random(Range=number_slider, Number=multiplication, Seed=2, Integers=True)
item = ListItem(List=random_populate_mesh, Index=random, Wrap=True)
number_slider_2 = Slider(100, range=2..1000)
partition = PartitionList(List=item, Size="2")
_3d_2 = BooleanToggle(True)
item_2 = ListItem(List=partition, Index=0, Wrap=True)  # -> Item, Item1
panel_5 = Panel(interplist.E)
panel_6 = Panel(interplist.ind)
ln = Line(StartPoint=item_2.Item, EndPoint=item_2.Item1)  # -> flatten(Line)
Z = UnitZ(Factor=1)
number_slider_3 = Slider(38, range=2..100)

# ---- group: points
pt_2 = Point(graft(random_populate_mesh))

# ---- group: curves (lines)
crv_2 = Curve(ln)

# ----
random_vector_2 = CSharpScript(n=number_slider_2, seed=Slider(3, range=0..100), DDD=_3d_2)  # -> out, simplify(graft(V)); inputs n: Int32, seed: Int32, DDD: Boolean; same code as random_vector
repeat = RepeatData(Data=Z, Length=number_slider_2)  # -> simplify(graft(Data))
pop3d = Populate3D(Region={Plane=PlaneXY(0, 0, 0), X=Domain(0, 10), Y=Domain(0, 10), Z=Domain(0, 2)}, Count=number_slider_2, Seed=1)  # -> simplify(graft(Population))
# <title>
# 
# <description>
# 
# code by Alessio Erioli
# 
# v 0.1
pt_3 = Point(Point(5.875783963, 5.526291957, 1.074511458))
power = Slider(5, range=0..5)
timer = Timer(TimerInterval=1, Target=c_script_4)  # disabled
cir = Circle(Plane=pt_3, Radius=Slider(3.266, range=1..5))
crv_3 = Curve(reparameterize(cir))
panel_7 = Panel("F:\Users\alessio\Documents\Co-de-iT\Design By Data Master Paris\2019\workshop\CurlNoise\CurlNoise\CurlNoise.cs")
loop_start = LoopStart(N=number_slider_3, D0=pop3d, D1=random_vector_2.V)  # -> port, Counter, Data, Data_2; disabled

# ---- group: counter
c_script_4 = CSharpScript(C=crv_3, step=Slider(0.02, range=0..1))  # -> out, P; inputs C: Curve, step: Double
# ---------- c_script_4: C# ----------
    t += step;

    if (t > 1.0) t -= 1.0;

    P = C.PointAt(t);
# ---------- c_script_4: C# additional code ----------
  double t = 0;
# ---------- end c_script_4 ----------

# ----
range = Range(Domain=Slider(5.593, range=0..10), Steps=Slider(10, range=5..20))
number_slider_4 = Slider(0.053, range=0..1)  # disabled
item_3 = ListItem(List=loop_start.Data, Index="-1", Wrap=True)
item_4 = ListItem(List=loop_start.Data_2, Index="-1", Wrap=True)
Z_2 = UnitZ(Factor=range)
division = Division(A=loop_start.Counter, B=number_slider_3)
sqgrid = Square(
    Plane=PlaneXY(0, 0, 0),
    Size=Slider(0.25, range=0..1),
    ExtentX=Slider(58, range=1..100),
    ExtentY=Slider(66, range=1..100))  # -> Cells, Points
number_slider_5 = Slider(0.258, range=-1..1)
number_slider_6 = Slider(0.84, range=0..1)
toggle_2 = BooleanToggle(True)
X = UnitX(Factor=10)  # disabled

# ---- group: curl noise
c_script_5 = CSharpScript(
    P=flatten(item_3),
    S=number_slider_5,
    t=number_slider_6,
    D3=toggle_2,
    Reference="C:\Users\Alessio\AppData\Roaming\Grasshopper\Libraries\SimplexNoise.dll")  # -> out, simplify(graft(V)), simplify(graft(C)); inputs P: list of Point3d, S: Double, t: Double, D3: Boolean
# ---------- c_script_5: C# usings ----------
using System.Drawing;
using SimplexNoise;
using System.Threading;
using System.Threading.Tasks;
# ---------- c_script_5: C# ----------
        // test

        if (P == null || P.Count == 0) return;

        GH_Vector[] v = new GH_Vector[P.Count];
        GH_Colour[] c = new GH_Colour[P.Count];

        Parallel.For(0, P.Count, i => {
            CurlNoise(P[i], S, t, D3, out v[i], out c[i]);
        });

        
        V = v;
        C = c;
# ---------- c_script_5: C# additional code ----------
 

    public void CurlNoise(Point3d P, double S, double t, bool flag, out GH_Vector V, out GH_Colour C)
    {

        float fS = (float)S;
        float fT = (float)t;
        float nX = (float)P.X * fS + fT; // num5
        float nY = (float)P.Y * fS + fT; // num6
        float nZ = (float)P.Z * fS + fT; // num7

        double num8 = Noise.Generate(nX, nY, nZ);
        float dT = 1f;
        float nPlus = Noise.Generate(nX, nY + dT, nZ);
        float nMinus = Noise.Generate(nX, nY - dT, nZ);
        float nDiff = (nPlus - nMinus) / (2f * dT);
        nPlus = Noise.Generate(nX, nY, nZ + dT);
        nMinus = Noise.Generate(nX, nY, nZ - dT);
        float num13 = (nPlus - nMinus) / (2f * dT);
        float num14 = nDiff - num13;
        nX -= fT;
        nY -= fT;
        nPlus = Noise.Generate(nX, nY, nZ + dT);
        nMinus = Noise.Generate(nX, nY, nZ - dT);
        nDiff = (nPlus - nMinus) / (2f * dT);
        nPlus = Noise.Generate(nX + dT, nY, nZ);
        nMinus = Noise.Generate(nX - dT, nY, nZ);
        num13 = (nPlus - nMinus) / (2f * dT);
        float num15 = nDiff - num13;
        nPlus = Noise.Generate(nX + dT, nY, nZ);
        nMinus = Noise.Generate(nX - dT, nY, nZ);
        nDiff = (nPlus - nMinus) / (2f * dT);
        nPlus = Noise.Generate(nX, nY + dT, nZ);
        nMinus = Noise.Generate(nX, nY - dT, nZ);
        num13 = (nPlus - nMinus) / (2f * dT);
        float num16 = nDiff - num13;
        Vector3d val2 = new Vector3d((double)num14, (double)num15, (double)num16);
        if (!flag)
        {
            nPlus = Noise.Generate(nX, nY + dT);
            nMinus = Noise.Generate(nX, nY - dT);
            nDiff = (nPlus - nMinus) / (2f * dT);
            nPlus = Noise.Generate(nX + dT, nY);
            nMinus = Noise.Generate(nX - dT, nY);
            nDiff = (nPlus - nMinus) / (2f * dT);
            val2 = new Vector3d((double)nDiff, (double)(0f - num13), 0.0);
        }
        V = new GH_Vector(val2);
        val2.Unitize();
        int red = (int)Math.Floor(Remap((float)val2.X, -1f, 1f, 0f, 255f));
        int green = (int)Math.Floor(Remap((float)val2.Y, -1f, 1f, 0f, 255f));
        int blue = (int)Math.Floor(Remap((float)val2.Z, -1f, 1f, 0f, 255f));
        C = new GH_Colour(Color.FromArgb(red, green, blue));
   
    }

    public float Remap(float val, float from1, float to1, float from2, float to2)
    {
        return (val - from1) / (to1 - from1) * (to2 - from2) + from2;
    }
# ---------- end c_script_5 ----------

# ----
move = Move(Geometry=graft(sqgrid.Points), Motion=Z_2)  # -> simplify(Geometry), Transform

# ---- group: find neighbours (RTree)
c_script_6 = CSharpScript(P=random_populate_mesh, P0=c_script_4.P, radius=Slider(1.955, range=0..10))  # -> out, A, B; inputs P: list of Point3d, P0: Point3d, radius: Double
# ---------- c_script_6: C# ----------
    if (P == null || P.Count == 0) return;

    pts = P;
    cl.Clear();
    ci.Clear();

    // declare RTree
    RTree tree = new RTree();

    // poopulate it
    for(int i = 0; i < P.Count; i++)
      tree.Insert(P[i], i);

    // perform search
    
    // option 1.1: EventHandler declared on the fly
    EventHandler<RTreeEventArgs> rTreeCallback = (object sender, RTreeEventArgs e) =>
      {
      cl.Add(pts[e.Id]);
      ci.Add(e.Id);
      };
    // option 1.1 & 1.2: call to external function
    tree.Search(new Sphere(P0, radius), rTreeCallback);

    //    option 2: use embedded anonymous function with lambda syntax
    //    tree.Search(new Sphere(P0, radius), (object sender, RTreeEventArgs e) =>
    //      {
    //      cl.Add(pts[e.Id]);
    //      ci.Add(e.Id);
    //      });

    A = cl;
    B = ci;
# ---------- c_script_6: C# additional code ----------
  List<Point3d> cl = new List<Point3d>();
  List<int> ci = new List<int>();
  List<Point3d> pts = new List<Point3d>();


  // option 1.2: declare callback function as an external one
  //  private void rTreeCallback(object sender, RTreeEventArgs e){
  //    cl.Add(pts[e.Id]);
  //    ci.Add(e.Id);
  //  }
# ---------- end c_script_6 ----------

# ----
multiplication_2 = Multiplication(A=Slider(1, range=0..1), B=division)
move_2 = Move(Geometry=move.Geometry, Motion=X)  # -> Geometry, Transform; disabled

# ---- group: Dave Reeves remove duplicate points
removedup = CSharpScript(tolerance=number_slider_4)  # -> out, result, map; inputs points: list of Point3d, tolerance: Double; disabled
# ---------- removedup: C# ----------
    List<Point3d> _result = new List<Point3d>();
    int[] _map = new int[points.Count];

    RTree tree = new RTree();
    Sphere sphere = new Sphere();
    sphere.Radius = tolerance;
    Point3d pt;

    for(int i = 0; i < points.Count; i++){
      pt = points[i];

      // set search sphere
      sphere.Center = pt;

      // reset index and search
      dupIndex = -1;
      tree.Search(sphere, SearchCallback);

      if(dupIndex == -1)  // no duplicate found
      {
        tree.Insert(pt, i);
        _map[i] = _result.Count;
        _result.Add(pt);
      }
      else // duplicate found
      {
        _map[i] = dupIndex; // add index to map
      }
    }

    result = _result;
    map = _map;
# ---------- removedup: C# additional code ----------
  //
  private int dupIndex;

  // cancels search if hit is found
  void SearchCallback(Object sender, RTreeEventArgs e){
    dupIndex = e.Id;
    e.Cancel = true;
  }
# ---------- end removedup ----------

# ----
path = FilePath(panel_7)
c_script_7 = CSharpScript(x=Button())  # -> out, A; inputs x: Boolean
# ---------- c_script_7: C# ----------
   if(x) Rhino.RhinoApp.WriteLine("Hello Rhino");
# ---------- end c_script_7 ----------

# ---- group: SimplexNoise (x,y,z)
c_script_8 = CSharpScript(
    x=Slider(41.794, range=0..100),
    y=Slider(20.721, range=0..100),
    z=Slider(5.669, range=0..100),
    Reference="C:\Users\Alessio\AppData\Roaming\Grasshopper\Libraries\SimplexNoise.dll")  # -> out, A; inputs x: Double, y: Double, z: Double
# ---------- c_script_8: C# usings ----------
using SimplexNoise;
# ---------- c_script_8: C# ----------
    //    Noise noise = new Noise();

    A = SimplexNoise.Noise.Generate((float) x, (float)y,(float) z);
# ---------- end c_script_8 ----------

# ----
expression = Expression(V1=item_4, V2=c_script_5.V, i=multiplication_2, Expression="V1*(1-i)+V2*i")

# ---- group: Simplex Noise
c_script_9 = CSharpScript(
    P=sqgrid.Points,
    S=Slider(0.193, range=0..1),
    t=Slider(0, range=0..1),
    Reference="C:\Users\Alessio\AppData\Roaming\Grasshopper\Libraries\SimplexNoise.dll")  # -> out, A; inputs P: Point3d, S: Double, t: Double
# ---------- c_script_9: C# ----------
    //    Noise noise = new Noise();
    P *= S;
    P.Z += t;
    A = SimplexNoise.Noise.Generate((float) P.X, (float) P.Y, (float) P.Z);
# ---------- end c_script_9 ----------

# ----
panel_8 = Panel(c_script_8.A)

# ---- group: curl noise parallel
c_script_10 = CSharpScript(
    P=move.Geometry,
    S=number_slider_5,
    t=number_slider_6,
    D3=toggle_2,
    Reference="C:\Users\Alessio\AppData\Roaming\Grasshopper\Libraries\SimplexNoise.dll")  # -> out, V, C; inputs P: list of Point3d, S: Double, t: Double, D3: Boolean
# ---------- c_script_10: C# usings ----------
using System.Drawing;
using System.Threading;
using System.Threading.Tasks;
using SimplexNoise;
# ---------- c_script_10: C# ----------
        // test

        if (P == null || P.Count == 0) return;

        GH_Vector[] v = new GH_Vector[P.Count];
        GH_Colour[] c = new GH_Colour[P.Count];

        Parallel.For(0, P.Count, i => {
            CurlNoise(P[i], S, t, D3, out v[i], out c[i]);
        });

        
        V = v;
        C = c;
# ---------- c_script_10: C# additional code ----------
 

    public void CurlNoise(Point3d P, double S, double t, bool flag, out GH_Vector V, out GH_Colour C)
    {

        float fS = (float)S;
        float fT = (float)t;
        float nX = (float)P.X * fS + fT; // num5
        float nY = (float)P.Y * fS + fT; // num6
        float nZ = (float)P.Z * fS + fT; // num7

        double num8 = Noise.Generate(nX, nY, nZ);
        float dT = 1f;
        float nPlus = Noise.Generate(nX, nY + dT, nZ);
        float nMinus = Noise.Generate(nX, nY - dT, nZ);
        float nDiff = (nPlus - nMinus) / (2f * dT);
        nPlus = Noise.Generate(nX, nY, nZ + dT);
        nMinus = Noise.Generate(nX, nY, nZ - dT);
        float num13 = (nPlus - nMinus) / (2f * dT);
        float num14 = nDiff - num13;
        nX -= fT;
        nY -= fT;
        nPlus = Noise.Generate(nX, nY, nZ + dT);
        nMinus = Noise.Generate(nX, nY, nZ - dT);
        nDiff = (nPlus - nMinus) / (2f * dT);
        nPlus = Noise.Generate(nX + dT, nY, nZ);
        nMinus = Noise.Generate(nX - dT, nY, nZ);
        num13 = (nPlus - nMinus) / (2f * dT);
        float num15 = nDiff - num13;
        nPlus = Noise.Generate(nX + dT, nY, nZ);
        nMinus = Noise.Generate(nX - dT, nY, nZ);
        nDiff = (nPlus - nMinus) / (2f * dT);
        nPlus = Noise.Generate(nX, nY + dT, nZ);
        nMinus = Noise.Generate(nX, nY - dT, nZ);
        num13 = (nPlus - nMinus) / (2f * dT);
        float num16 = nDiff - num13;
        Vector3d val2 = new Vector3d((double)num14, (double)num15, (double)num16);
        if (!flag)
        {
            nPlus = Noise.Generate(nX, nY + dT);
            nMinus = Noise.Generate(nX, nY - dT);
            nDiff = (nPlus - nMinus) / (2f * dT);
            nPlus = Noise.Generate(nX + dT, nY);
            nMinus = Noise.Generate(nX - dT, nY);
            nDiff = (nPlus - nMinus) / (2f * dT);
            val2 = new Vector3d((double)nDiff, (double)(0f - num13), 0.0);
        }
        V = new GH_Vector(val2);
        val2.Unitize();
        int red = (int)Math.Floor(Remap((float)val2.X, -1f, 1f, 0f, 255f));
        int green = (int)Math.Floor(Remap((float)val2.Y, -1f, 1f, 0f, 255f));
        int blue = (int)Math.Floor(Remap((float)val2.Z, -1f, 1f, 0f, 255f));
        C = new GH_Colour(Color.FromArgb(red, green, blue));
   
    }

    public float Remap(float val, float from1, float to1, float from2, float to2)
    {
        return (val - from1) / (to1 - from1) * (to2 - from2) + from2;
    }
# ---------- end c_script_10 ----------

# ---- group: curl noise non parallel
c_script_11 = CSharpScript(
    P=move.Geometry,
    S=number_slider_5,
    t=number_slider_6,
    D3=toggle_2,
    Reference="C:\Users\Alessio\AppData\Roaming\Grasshopper\Libraries\SimplexNoise.dll")  # -> out, V, C; inputs P: Point3d, S: Double, t: Double, D3: Boolean; disabled
# ---------- c_script_11: C# usings ----------
using System.Drawing;
using SimplexNoise;
# ---------- c_script_11: C# ----------
        // test

        if (P == null) return;

        GH_Vector v;
        GH_Colour c;

        CurlNoise(P, S, t, D3, out v, out c);

        V = v;
        C = c;
# ---------- c_script_11: C# additional code ----------
 

    public void CurlNoise(Point3d P, double S, double t, bool flag, out GH_Vector V, out GH_Colour C)
    {

        float fS = (float)S;
        float fT = (float)t;
        float nX = (float)P.X * fS + fT; // num5
        float nY = (float)P.Y * fS + fT; // num6
        float nZ = (float)P.Z * fS + fT; // num7

        double num8 = Noise.Generate(nX, nY, nZ);
        float dT = 1f;
        float nPlus = Noise.Generate(nX, nY + dT, nZ);
        float nMinus = Noise.Generate(nX, nY - dT, nZ);
        float nDiff = (nPlus - nMinus) / (2f * dT);
        nPlus = Noise.Generate(nX, nY, nZ + dT);
        nMinus = Noise.Generate(nX, nY, nZ - dT);
        float num13 = (nPlus - nMinus) / (2f * dT);
        float num14 = nDiff - num13;
        nX -= fT;
        nY -= fT;
        nPlus = Noise.Generate(nX, nY, nZ + dT);
        nMinus = Noise.Generate(nX, nY, nZ - dT);
        nDiff = (nPlus - nMinus) / (2f * dT);
        nPlus = Noise.Generate(nX + dT, nY, nZ);
        nMinus = Noise.Generate(nX - dT, nY, nZ);
        num13 = (nPlus - nMinus) / (2f * dT);
        float num15 = nDiff - num13;
        nPlus = Noise.Generate(nX + dT, nY, nZ);
        nMinus = Noise.Generate(nX - dT, nY, nZ);
        nDiff = (nPlus - nMinus) / (2f * dT);
        nPlus = Noise.Generate(nX, nY + dT, nZ);
        nMinus = Noise.Generate(nX, nY - dT, nZ);
        num13 = (nPlus - nMinus) / (2f * dT);
        float num16 = nDiff - num13;
        Vector3d val2 = Vector3d.Zero;
        val2 = new Vector3d((double)num14, (double)num15, (double)num16);
        if (!flag)
        {
            nPlus = Noise.Generate(nX, nY + dT);
            nMinus = Noise.Generate(nX, nY - dT);
            nDiff = (nPlus - nMinus) / (2f * dT);
            nPlus = Noise.Generate(nX + dT, nY);
            nMinus = Noise.Generate(nX - dT, nY);
            nDiff = (nPlus - nMinus) / (2f * dT);
            val2 = new Vector3d((double)nDiff, (double)(0f - num13), 0.0);
        }
        V = new GH_Vector(val2);
        val2.Unitize();
        int red = (int)Math.Floor(Remap((float)val2.X, -1f, 1f, 0f, 255f));
        int green = (int)Math.Floor(Remap((float)val2.Y, -1f, 1f, 0f, 255f));
        int blue = (int)Math.Floor(Remap((float)val2.Z, -1f, 1f, 0f, 255f));
        C = new GH_Colour(Color.FromArgb(red, green, blue));
    }

    public float Remap(float val, float from1, float to1, float from2, float to2)
    {
        return (val - from1) / (to1 - from1) * (to2 - from2) + from2;
    }
# ---------- end c_script_11 ----------

# ----
curl = CurlNoise(Points=move.Geometry, Scale=number_slider_5, Offset=number_slider_6, _3D=toggle_2)  # -> CurlVector, Colour; disabled
ftsv2 = FileToScriptV2(File=path)
Z_3 = UnitZ(Factor=c_script_9.A)
number_slider_7 = Slider(0.414, range=0..1)
move_3 = Move(Geometry=sqgrid.Points, Motion=Z_3)  # -> Geometry, Transform
amp = Amplitude(Vector=expression, Amplitude=Slider(0.787, range=0..1))
move_4 = Move(Geometry=item_3, Motion=amp)  # -> Geometry, Transform
multiplication_3 = Multiplication(A=c_script_10.V, B=number_slider_7)
multiplication_4 = Multiplication(A=curl.CurlVector, B=number_slider_7)
merge = Merge(Data1=loop_start.Data_2, Data2=simplify(amp))
merge_2 = Merge(Data1=loop_start.Data, Data2=simplify(move_4.Geometry))
vdisex = VectorDisplayEx(Point=move.Geometry, Vector=multiplication_3, Colour=c_script_10.C, Width=2)
vdisex_2 = VectorDisplayEx(Point=move.Geometry, Vector=multiplication_4, Colour=curl.Colour, Width=2)
loop_end = LoopEnd(port=loop_start.port, Exit=False, Data=merge_2, Data_2=merge, TimeOutVal=0, pausedState=False, state="Constant output")  # -> D0, D1
lng = ListLength(List=loop_end.D0)  # -> flatten(Length); disabled
item_5 = ListItem(List=lng, Index=0, Wrap=True)  # disabled
range_2 = Range(Domain=Domain(0, 1), Steps=expr("x-1", item_5))  # disabled
gradient = Gradient(LowerLimit=0, UpperLimit=1, Parameter=range_2, stops=[0: RGB(0, 0, 0), 0.487: RGB(150, 120, 120), 1: RGB(255, 255, 255)])  # disabled
pline = PolyLine(Vertices=loop_end.D0, Closed=False)
number_slider_8 = Slider(0.25, range=0..1)  # disabled
cloud = CloudDisplay(Points=loop_end.D0, Colours=gradient, Size=number_slider_8, SpriteType=1)  # disabled

# ----
# field calculation
crv_cp = CurveClosestPoint(Point=pt_2, Curve=crv_2)  # -> Point, Parameter, Distance
vec2pt = Vector2Pt(PointA=pt_2, PointB=crv_cp.Point, Unitize=True)  # -> Vector, Length
eval = EvaluateCurve(Curve=crv_2, Parameter=crv_cp.Parameter)  # -> Point, Tangent, Angle
xprod = CrossProduct(VectorA=vec2pt.Vector, VectorB=eval.Tangent, Unitize=False)  # -> Vector, Length

# ---- group: avoid division by 0
addition = Addition(A=crv_cp.Distance, B=Slider(0.01, range=0..1))

# ----
one_over_x = OneOverX(Value=addition)
pow = Power(A=one_over_x, B=power)
wav = WeightedAverage(Input=xprod.Vector, Weights=pow)

vec = Vector(unitize(wav))
multiplication_5 = Multiplication(A=vec, B=Slider(0.1, range=0..1))
vdisex_3 = VectorDisplayEx(Point=pt_2, Vector=multiplication_5, Colour=vec, Width=2)
