# Grasshopper definition XX_align planes - intuition.gh (Grasshopper 1.0.7)
# Copyright: Co-de-iT
# plug-ins: CurlNoise, Anemone

n_of_planes = Slider(1000, range=10..5000)
# align and move
box = Box({Plane=Plane(origin=(0, 0, 0), x=(0, 1, 0), y=(1, 0, 0)), X=Domain(0, 10), Y=Domain(0, 10), Z=Domain(-10, 0)})
n_of_planes_2 = Slider(500, range=10..5000)

# ---- group: containing volume
# align only (no move)
box_2 = Box({Plane=Plane(origin=(0, 0, 0), x=(0, 1, 0), y=(1, 0, 0)), X=Domain(0, 10), Y=Domain(0, 10), Z=Domain(-10, 0)})

# ----
plane_radius = Slider(0.25, range=0..1)

# ---- group: volumetric grid
c_script = CSharpScript(B=box, n=Slider(30, range=0..100))  # -> out, A; inputs B: Brep, n: Int32
# ---------- c_script: C# ----------
    BoundingBox b1 = B.GetBoundingBox(false);

    DataTree<Point3d> pts = new DataTree<Point3d>();
    GH_Path path;

    double step = 1.0 / (double) n;

    for (int i = 0; i < n + 1; i++)
      for (int j = 0; j < n + 1; j++)
      {
        path = new GH_Path(i, j);
        for (int k = 0; k < n + 1; k++)
          pts.Add(b1.PointAt(i * step, j * step, k * step));
      }

    A = pts;
# ---------- end c_script ----------

# ----
_3d = BooleanToggle(True)
number_slider = Slider(0.6, range=0..1)
number_slider_2 = Slider(0.121, range=0..1)
random_vector = CSharpScript(n=n_of_planes, seed=Slider(0, range=0..100), DDD=_3d)  # -> out, V; inputs n: Int32, seed: Int32, DDD: Boolean
# ---------- random_vector: C# usings ----------
using System.IO;
using System.Linq;
using System.Data;
using System.Drawing;
using System.Reflection;
using System.Windows.Forms;
using System.Xml;
using System.Xml.Linq;
using System.Runtime.InteropServices;

using Rhino.DocObjects;
using Rhino.Collections;
using GH_IO;
using GH_IO.Serialization;
# ---------- random_vector: C# ----------
    if(seed == 0) rnd = new Random(); else rnd = new Random(seed);
    List <Vector3d> vectors = new List<Vector3d>();
    Vector3d vec = new Vector3d();
    for (int i = 0; i < n; i++){
      vec.X = rnd.NextDouble() - 0.5;
      vec.Y = rnd.NextDouble() - 0.5;
      vec.Z = DDD ? rnd.NextDouble() - 0.5 : 0;
      vec.Unitize();
      vectors.Add(vec);
    }
    V = vectors;
# ---------- random_vector: C# additional code ----------
  Random rnd;
# ---------- end random_vector ----------

# ---- group: random vectors 3D
random_vector_2 = CSharpScript(n=n_of_planes_2, S=Slider(30, range=0..100))  # -> out, V; inputs n: Int32, S: Int32
# ---------- random_vector_2: C# ----------
    Print(S.ToString());
    if (S == 0) rnd = new Random(); else rnd = new Random(S);
    List <Vector3d> vectors = new List<Vector3d>();
    Vector3d vec = new Vector3d();
    for (int i = 0; i < n; i++){
      vec.X = rnd.NextDouble() - 0.5;
      vec.Y = rnd.NextDouble() - 0.5;
      vec.Z = rnd.NextDouble() - 0.5;
      vec.Unitize();
      vectors.Add(vec);
    }
    V = vectors;
# ---------- random_vector_2: C# additional code ----------
  Random rnd;
# ---------- end random_vector_2 ----------

# ----
pop3d = Populate3D(Region=box, Count=n_of_planes, Seed=1)
pop3d_2 = Populate3D(Region=box_2, Count=n_of_planes_2, Seed=1)

# ---- group: field
curl = CurlNoise(Points=pop3d_2, Scale=Slider(0.121, range=0..1), Offset=Slider(0.6, range=0..1), _3D="true")  # -> CurlVector, Colour

# ----
curl_2 = CurlNoise(Points=c_script.A, Scale=number_slider_2, Offset=number_slider, _3D="true")  # -> CurlVector, Colour
unit = UnitVector(Vector=curl.CurlVector)
reset = Button()
reset_2 = Button()
amp = Amplitude(Vector=curl_2.CurlVector, Amplitude=Slider(0.25, range=0..1))
panel = Panel("""<title>

<description>

code by <author>

v <version>""")

# ---- group: initial points preview
vdisex = VectorDisplayEx(Point=pop3d, Vector=random_vector.V, Colour=random_vector.V, Width=2)

# ----
loop_start = LoopStart(N=Slider(100, range=0..100), T=reset, D0=pop3d, D1=random_vector.V)  # -> port, Counter, Data, Data_2

# ---- group: field preview
vdisex_2 = VectorDisplayEx(Point=c_script.A, Vector=amp, Colour=curl_2.Colour, Width="1")

# ---- group: initial points preview
vdisex_3 = VectorDisplayEx(Point=pop3d_2, Vector=random_vector_2.V, Colour=random_vector_2.V, Width=2)

# ---- group: field preview
vdisex_4 = VectorDisplayEx(Point=pop3d_2, Vector=unit, Colour=curl.Colour, Width=2)

# ----
loop_start_2 = LoopStart(Repeat=Slider(100, range=0..100), Trigger=reset_2, Data=random_vector_2.V)  # -> port, Counter, Data; disabled

# ---- group: find neighbours
max_neighbours = Panel("3")
prox = Proximity3D(Points=pop3d_2, Group=max_neighbours, MinRadius=Slider(0.108, range=0..5), MaxRadius=Slider(1.853, range=0..5))  # -> Links, Topology

# everything farther than a certain distance will not separate anymore
number_slider_3 = Slider(5, range=0..5)
max_neighbours_2 = Panel("5")
prox_2 = Proximity3D(Points=loop_start.Data, Group=max_neighbours_2, MinRadius=Slider(0.108, range=0..5), MaxRadius=number_slider_3)  # -> Links, Topology

# ----
panel_2 = Panel(loop_start.Counter)
panel_3 = Panel(loop_start_2.Counter)

curl_3 = CurlNoise(Points=loop_start.Data, Scale=number_slider_2, Offset=number_slider, _3D="true")  # -> CurlVector, Colour
unit_2 = UnitVector(Vector=curl_3.CurlVector)
item = ListItem(List=loop_start.Data_2, Index=prox_2.Topology, Wrap=True)
proximity_intensity = Slider(0.724, range=0..1)
field_intensity = Slider(0.189, range=0..1)
avr = Average(Input=item)
unit_3 = UnitVector(Vector=avr)
multiplication = Multiplication(A=graft(unit_2), B=field_intensity)
multiplication_2 = Multiplication(A=unit_3, B=proximity_intensity)
addition = Addition(A=multiplication_2, B=multiplication)
unit_4 = UnitVector(Vector=addition)
max_force = Slider(0.25, range=0..1)

neighbours_indexes = Panel(prox.Topology)

# ---- group: alignment behavior
item_2 = ListItem(List=loop_start_2.Data, Index=prox.Topology, Wrap=True)
avr_2 = Average(Input=item_2)
unit_5 = UnitVector(Vector=avr_2)

# ----
len = Length(Curve=prox_2.Links)
multiplication_3 = Multiplication(A=plane_radius, B="3")
smaller = SmallerThan(FirstNumber=len, SecondNumber=multiplication_3)  # -> SmallerThan, OrEqualTo
dispatch = Dispatch(List=prox_2.Topology, DispatchPattern=smaller.SmallerThan)  # -> ListA, ListB

c_script_2 = CSharpScript()  # -> out, A; inputs P: list of Point3d, V: list of Vector3d, vF: list of Vector3d, pR: Double, cI: Double, aI: Double, sI: Double, mF: Double
# ---------- c_script_2: C# ----------
// align planes with field - C#
# ---------- end c_script_2 ----------

# ---- group: defines desired vector
proximity_intensity_2 = Slider(0.343, range=0..1)
field_intensity_2 = Slider(0.429, range=0..1)
multiplication_4 = Multiplication(A=graft(unit), B=field_intensity_2)
multiplication_5 = Multiplication(A=unit_5, B=proximity_intensity_2)
addition_2 = Addition(A=multiplication_5, B=multiplication_4)
unit_6 = UnitVector(Vector=addition_2)

# ---- group: intial values
proximity_intensity_3 = Slider(0.724, range=0..1)
field_intensity_3 = Slider(0.189, range=0..1)

# ----
item_3 = ListItem(List=loop_start.Data, Index=prox_2.Topology, Wrap=True)
cohesion_intensity = Slider(0.026, range=0..1)
avr_3 = Average(Input=item_3)  # -> flatten(ArithmeticMean)
vec2pt = Vector2Pt(PointA=loop_start.Data, PointB=avr_3, Unitize=False)  # -> Vector, Length
multiplication_6 = Multiplication(A=vec2pt.Vector, B=cohesion_intensity)
amp_2 = Amplitude(Vector=vec2pt.Vector, Amplitude=cohesion_intensity)

# ---- group: alignment / steering vector
subtraction = Subtraction(A=unit_4, B=graft(loop_start.Data_2))

# ----
maxforce = Slider(0.25, range=0..1)
maxforce_2 = Slider(0.05, range=0..1)

# ---- group: alignment
multiplication_7 = Multiplication(A=subtraction, B=max_force)
addition_3 = Addition(A=graft(loop_start.Data_2), B=multiplication_7)

# ---- group: steer = desired - speed
subtraction_2 = Subtraction(A=unit_6, B=graft(loop_start_2.Data))

# ---- group: limit speed with maxForce
# try both methods and check results
amp_3 = Amplitude(Vector=subtraction_2, Amplitude=maxforce_2)
multiplication_8 = Multiplication(A=subtraction_2, B=maxforce)

# ----
addition_4 = Addition(A=graft(loop_start_2.Data), B=multiplication_8)
unit_7 = UnitVector(Vector=addition_4)  # -> simplify(flatten(Vector))
loop_end = LoopEnd(port=loop_start_2.port, Exit=False, Data=unit_7, TimeOutVal=0, pausedState=False, state="Constant output")
unit_8 = UnitVector(Vector=addition_3)  # -> simplify(flatten(Vector))

# ---- group: preview vectors
# direction
# steer
# desired
swatch = ColourSwatch(SwatchColor=RGB(255, 255, 255))
move = Move(Geometry=pop3d_2, Motion=loop_end)  # -> Geometry, Transform
vdisex_5 = VectorDisplayEx(Point=move.Geometry, Vector=flatten(multiplication_8), Colour=swatch, Width=2)
vdisex_6 = VectorDisplayEx(Point=pop3d_2, Vector=flatten(unit_6), Colour=ColourSwatch(SwatchColor=RGB(161, 95, 144)), Width=2)
vdisex_7 = VectorDisplayEx(Point=pop3d_2, Vector=loop_end, Colour=RGB(0, 0, 0), Width=2)

# ---- group: unary mesh plane
panel_4 = Panel("""{-1,-1,0}
{1,-1,0}
{1,1,0}
{-1,1,0}""")
conmesh = ConstructMesh(Vertices=panel_4, Faces={A=0, B=1, C=2, D=3})
scale = Scale(Geometry=conmesh, Center=Point(0, 0, 0), Factor=plane_radius)  # -> Geometry, Transform

# ---- group: create a mesh quad face
# alignment
plane_radius_2 = Slider(0.5, range=0..1)
panel_5 = Panel("""{-1,-1,0}
{1,-1,0}
{1,1,0}
{-1,1,0}""")
conmesh_2 = ConstructMesh(Vertices=panel_5, Faces={A=0, B=1, C=2, D=3})
scale_2 = Scale(Geometry=conmesh_2, Center=Point(0, 0, 0), Factor=plane_radius_2)  # -> Geometry, Transform

# ---- group: plane Y vector
# the position sets the origin, the orientation vector is the X axis and the cross product between orientation vector and origin point is the Y
xprod = CrossProduct(VectorA=pop3d_2, VectorB=loop_end, Unitize=True)  # -> Vector, Length

# ---- group: plane Z vector
xprod_2 = CrossProduct(VectorA=loop_end, VectorB=xprod.Vector, Unitize=True)  # -> Vector, Length

# ---- group: plane
pl = ConstructPlane(Origin=pop3d_2, XAxis=loop_end, YAxis=xprod.Vector)

# ----
number_slider_4 = Slider(0.177, range=0..1)
number_slider_5 = Slider(0.177, range=0..1)
orient = Orient(Geometry=scale_2.Geometry, Source=PlaneXY(0, 0, 0), Target=pl)  # -> Geometry, Transform
amp_4 = Amplitude(Vector=xprod.Vector, Amplitude=number_slider_5)
amp_5 = Amplitude(Vector=loop_end, Amplitude=number_slider_5)
preview = CustomPreview(Geometry=orient.Geometry, Material=xprod_2.Vector)
vdisex_8 = VectorDisplayEx(Point=pop3d_2, Vector=amp_4, Colour=ColourSwatch(SwatchColor=RGB(53, 212, 0)), Width=2)
vdisex_9 = VectorDisplayEx(Point=pop3d_2, Vector=amp_5, Colour=ColourSwatch(SwatchColor=RGB(255, 0, 0)), Width=2)
preview_2 = CustomPreview(Geometry=orient.Geometry, Material=ColourSwatch(SwatchColor=RGB(255, 255, 255)))

item_4 = ListItem(List=loop_start.Data, Index=dispatch.ListA, Wrap=True)
separation_intensity = Slider(0.12, range=0..1)
avr_4 = Average(Input=item_4)  # -> flatten(ArithmeticMean)
vec2pt_2 = Vector2Pt(PointA=avr_4, PointB=loop_start.Data, Unitize=False)  # -> Vector, Length
amp_6 = Amplitude(Vector=vec2pt_2.Vector, Amplitude=separation_intensity)

# ---- group: replace nulls with zero vectors
vec = Vector(Vector(0, 0, 0))
nullrep = ReplaceNulls(Items=vec2pt_2.Vector, Replacements=vec)  # -> Items, Count

# ----
multiplication_9 = Multiplication(A=nullrep.Items, B=separation_intensity)

# ---- group: movement vector
addition_5 = Addition(A=multiplication_6, B=multiplication_9)

# ----
move_2 = Move(Geometry=loop_start.Data, Motion=addition_5)  # -> flatten(Geometry), Transform
loop_end_2 = LoopEnd(
    port=loop_start.port,
    Exit=False,
    Data=move_2.Geometry,
    Data_2=unit_8,
    TimeOutVal=0,
    pausedState=False,
    state="Constant output")  # -> D0, D1

# ----
# direction
# steer
# desired
swatch_2 = ColourSwatch(SwatchColor=RGB(255, 255, 255))
move_3 = Move(Geometry=loop_end_2.D0, Motion=loop_end_2.D1)  # -> Geometry, Transform
# alignment
vdisex_10 = VectorDisplayEx(Point=move_3.Geometry, Vector=flatten(multiplication_7), Colour=swatch_2, Width=2)
vdisex_11 = VectorDisplayEx(Point=loop_end_2.D0, Vector=flatten(unit_4), Colour=ColourSwatch(SwatchColor=RGB(161, 95, 144)), Width=2)
vdisex_12 = VectorDisplayEx(Point=loop_end_2.D0, Vector=loop_end_2.D1, Colour=RGB(0, 0, 0), Width=2)

# ----
# movement
swatch_3 = ColourSwatch(SwatchColor=RGB(255, 0, 0))
vdisex_13 = VectorDisplayEx(Point=loop_end_2.D0, Vector=addition_5, Colour=swatch_3, Width=2)

# ---- group: plane Y vector
# the position sets the origin, the orientation vector is the X axis and the cross product between orientation vector and origin point is the Y
xprod_3 = CrossProduct(VectorA=loop_end_2.D0, VectorB=loop_end_2.D1, Unitize=True)  # -> Vector, Length

# ---- group: plane Z vector
xprod_4 = CrossProduct(VectorA=loop_end_2.D1, VectorB=xprod_3.Vector, Unitize=True)  # -> Vector, Length

# ---- group: plane
pl_2 = ConstructPlane(Origin=loop_end_2.D0, XAxis=loop_end_2.D1, YAxis=xprod_3.Vector)

# ---- group: vec to col
c_script_3 = CSharpScript(V=xprod_4.Vector)  # -> out, C; inputs V: Vector3d
# ---------- c_script_3: C# usings ----------
using System.Drawing;
# ---------- c_script_3: C# ----------
    if (V == null) return;
    
    C = MapVecToCol(V);
# ---------- c_script_3: C# additional code ----------
  public Color MapVecToCol(Vector3d V)
  {
    return Color.FromArgb((int) ((V.X + 1) * 0.5 * 255), (int) ((V.Y + 1) * 0.5 * 255),
      (int) ((V.Z + 1) * 0.5 * 255));
  }
# ---------- end c_script_3 ----------

# ----
orient_2 = Orient(Geometry=scale.Geometry, Source=PlaneXY(0, 0, 0), Target=pl_2)  # -> Geometry, Transform
amp_7 = Amplitude(Vector=xprod_3.Vector, Amplitude=number_slider_4)
amp_8 = Amplitude(Vector=loop_end_2.D1, Amplitude=number_slider_4)
preview_3 = CustomPreview(Geometry=orient_2.Geometry, Material=xprod_4.Vector)
vdisex_14 = VectorDisplayEx(Point=loop_end_2.D0, Vector=amp_7, Colour=ColourSwatch(SwatchColor=RGB(53, 212, 0)), Width=2)
vdisex_15 = VectorDisplayEx(Point=loop_end_2.D0, Vector=amp_8, Colour=ColourSwatch(SwatchColor=RGB(255, 0, 0)), Width=2)
