# Grasshopper definition XX_iterative_space filling curve.gh (Grasshopper 1.0.7)
# Copyright: Co-de-iT
# plug-ins: Anemone

X = UnitX(Factor=1)
pt = Point(Point(0, 0, 0))
line = LineSDL(Start=pt, Direction=X, Length=Slider(100, range=0..100))
loop_start = LoopStart(Repeat=Slider(0, range=0..8), Trigger=Button(), Data=line)  # -> port, Counter, Data

# ----
# iterative_space filling curve
# 
# the space filling curve as seen on the first part of this webinar: https://wiki.mcneel.com/visualizingmathematics#webinarvisualizing_mathematics_in_rhinoceros
# 
# code by Alessio Erioli
# 
# v 0.1
# basic process
line_2 = Line(graft(line))
cos = Cosine(Value="Pi/6")
one_over_x = OneOverX(Value=cos)
multiplication = Multiplication(A=one_over_x, B="0.25")
vec = Vector(line_2)
multiplication_2 = Multiplication(A=vec, B=multiplication)
Z = UnitZ(Factor=1)
curvepoint = PointOnCurve(line_2, parameter=0.5)
vrot = Rotate(Vector=multiplication_2, Axis=Z, Angle="Pi*0.5")
rev = Reverse(Vector=vrot)
end = EndPoints(Curve=line_2)  # -> Start, End
move = Move(Geometry=curvepoint, Motion=vrot)  # -> Geometry, Transform
move_2 = Move(Geometry=curvepoint, Motion=rev)  # -> Geometry, Transform
merge = Merge(Data1=end.Start, Data2=move.Geometry, Data3=move_2.Geometry, Data4=end.End)
pline = PolyLine(Vertices=merge, Closed=False)
explode = Explode(Curve=pline, Recursive=True)  # -> Segments, Vertices
line_3 = Line(graft(explode.Segments))

line_4 = Line(graft(loop_start.Data))

# ----
# parameter to get half of an equilateral triangle side from twice its height hh (the initial curve is divided in 2 triangular polylines):
# 
# hh = 2 * s * cos(Pi/6)
# 
# s = 0.5 * hh/ cos(Pi/6)
# 
# 0.5 * s = 0.5 * 0.5 * hh / cos (Pi/6))
# 
# s = 0.25 * hh / cos (Pi/6)
panel = Panel("Pi/6")
cos_2 = Cosine(Value=panel)
one_over_x_2 = OneOverX(Value=cos_2)
multiplication_3 = Multiplication(A=one_over_x_2, B="0.25")

vec_2 = Vector(line_4)
multiplication_4 = Multiplication(A=vec_2, B=multiplication_3)
curvepoint_2 = PointOnCurve(line_4, parameter=0.5)
Z_2 = UnitZ(Factor=1)
vrot_2 = Rotate(Vector=multiplication_4, Axis=Z_2, Angle="Pi*0.5")
rev_2 = Reverse(Vector=vrot_2)
move_3 = Move(Geometry=curvepoint_2, Motion=vrot_2)  # -> Geometry, Transform
move_4 = Move(Geometry=curvepoint_2, Motion=rev_2)  # -> Geometry, Transform
end_2 = EndPoints(Curve=line_4)  # -> Start, End
merge_2 = Merge(Data1=end_2.Start, Data2=move_3.Geometry, Data3=move_4.Geometry, Data4=end_2.End)
pline_2 = PolyLine(Vertices=merge_2, Closed=False)
explode_2 = Explode(Curve=pline_2, Recursive=True)  # -> flatten(Segments), Vertices
loop_end = LoopEnd(port=loop_start.port, Exit=False, Data=explode_2.Segments, TimeOutVal=0, pausedState=False, state="Constant output")
end_3 = EndPoints(Curve=loop_end)  # -> Start, End
len = Length(Curve=loop_end)
item = ListItem(List=end_3.End, Index="-1", Wrap=True)
ins = InsertItems(List=end_3.Start, Item=item, Indices="-1", Wrap=True)
fillet = Slider(0.5, range=0..1)
offset = Slider(0.21, range=0..1)
pline_3 = PolyLine(Vertices=ins, Closed=False)
item_2 = ListItem(List=len, Index=0, Wrap=True)
multiplication_5 = Multiplication(A=item_2, B=fillet)
multiplication_6 = Multiplication(A=item_2, B=offset)
fillet_2 = Fillet(Curve=pline_3, Radius=multiplication_5)
offset_2 = BooleanToggle(True)
gate = StreamGate(Stream=fillet_2, Gate=offset_2)  # -> Target0, Target1
gate_2 = StreamGate(Stream=multiplication_6, Gate=offset_2)  # -> Target0, Target1
preview = CustomPreview(
    Geometry=fillet_2,
    Material={diffuse=RGB(221, 160, 221), emission=RGB(66, 48, 66), shine=0.5, specular=RGB(255, 255, 255), transparency=0})
neg = Negative(Value=gate_2.Target1)
offset_l = OffsetCurveLoose(Curve=gate.Target1, Distance=gate_2.Target1)
offset_l_2 = OffsetCurveLoose(Curve=gate.Target1, Distance=neg)
merge_3 = Merge(Data1=offset_l, Data2=offset_l_2)
end_4 = EndPoints(Curve=merge_3)  # -> Start, End
pline_4 = PolyLine(Vertices=end_4.End, Closed=False)
pline_5 = PolyLine(Vertices=end_4.Start, Closed=False)
merge_4 = Merge(Data1=merge_3, Data2=pline_5, Data3=pline_4)  # -> flatten(Result)
join = JoinCurves(Curves=merge_4, Preserve=False)
preview_2 = CustomPreview(Geometry=join, Material=ColourSwatch(SwatchColor=RGB(255, 255, 255)))
