# Grasshopper definition XX_post-processing-Dendro.gh (Grasshopper 1.0.7)
# Copyright: Co-de-iT
# plug-ins: IntraLattice, DendroGH

# post processing (Dendro)
source = ValueList({"Imported": 0, "From file": 1}, selected="Imported")
input = DataInput(
    Destination="F:\Users\alessio\Documents\Co-de-iT\Design By Data Master Paris\2019\workshop\bodies-planes.ghdata",
    RelativePath="F:\Users\alessio\Documents\Co-de-iT\Design By Data Master Paris\2019\workshop\bodies-planes.ghdata|bodies-planes.ghdata",
    UpdateDelay=5)  # -> Bodies, Planes; disabled
crv = Curve(simplify(Tree({0}: [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], {1}: [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], {2}: [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], {3}: [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], {4}: [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], {5}: [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]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)))
filter = StreamFilter(Gate=source, Stream0=crv, Stream1=input.Bodies)
end = EndPoints(Curve=filter)  # -> Start, End
item = ListItem(List=end.Start, Index=0, Wrap=True)  # -> flatten(Item)

# ---- group: point for selection
pt = Point(Point(2.354573578, 5.564390926, 4.62768902))

# ---- group: find neighbours (RTree)
c_script = CSharpScript(P=item, P0=pt, radius=Slider(4, range=0..10))  # -> out, A, B; inputs P: list of Point3d, P0: Point3d, radius: Double
# ---------- c_script: C# usings ----------
using System.IO;
using System.Linq;
using System.Data;
using System.Drawing;
using System.Reflection;
using System.Windows.Forms;
using System.Xml;
using System.Xml.Linq;
using System.Runtime.InteropServices;

using Rhino.DocObjects;
using Rhino.Collections;
using GH_IO;
using GH_IO.Serialization;
# ---------- c_script: C# ----------
    if (P == null || P.Count == 0) return;

    pts = P;
    cl.Clear();
    ci.Clear();

    // declare RTree
    RTree tree = new RTree();

    // poopulate it
    for(int i = 0; i < P.Count; i++)
      tree.Insert(P[i], i);

    // perform search
    
    // option 1.1: EventHandler declared on the fly
    EventHandler<RTreeEventArgs> rTreeCallback = (object sender, RTreeEventArgs e) =>
      {
      cl.Add(pts[e.Id]);
      ci.Add(e.Id);
      };
    // option 1.1 & 1.2: call to external function
    tree.Search(new Sphere(P0, radius), rTreeCallback);

    //    option 2: use embedded anonymous function with lambda syntax
    //    tree.Search(new Sphere(P0, radius), (object sender, RTreeEventArgs e) =>
    //      {
    //      cl.Add(pts[e.Id]);
    //      ci.Add(e.Id);
    //      });

    A = cl;
    B = ci;
# ---------- c_script: C# additional code ----------
  List<Point3d> cl = new List<Point3d>();
  List<int> ci = new List<int>();
  List<Point3d> pts = new List<Point3d>();


  // option 1.2: declare callback function as an external one
  //  private void rTreeCallback(object sender, RTreeEventArgs e){
  //    cl.Add(pts[e.Id]);
  //    ci.Add(e.Id);
  //  }
# ---------- end c_script ----------

# ----
# post-processing - Dendro
# 
# Transform lines into isomesh model for additive fabrication
# 
# code by Alessio Erioli
# 
# v 0.1
list = ValueList({"All data": 0, "Partial list": 1}, selected="Partial list")
branch = TreeBranch(Tree=filter, Path=c_script.B, MaintainPaths=True)
filter_2 = StreamFilter(Gate=list, Stream0=filter, Stream1=branch)  # -> flatten(Stream); disabled

# ----
# in case of invalid mesh output: 1. try to increase the Isovalue to 0.001 or 0.002
# 
# 2. if that doesn't do the trick, increase the radius multiplier
radius_multiplier = Slider(1.85, range=1.5..3)
number_slider = Slider(0.03, range=0.01..1)
multiplication = Multiplication(A=radius_multiplier, B=number_slider)
vsettings = CreateSettings(
    VoxelSize=number_slider,
    Bandwidth=Slider(0.5, range=0..3),
    Isovalue=Slider(0, range=0..1),
    Adaptivity=Slider(0.6, range=0..1))
vcurve = CurveToVolume(Curves=filter_2, CurveRadius=multiplication, Settings=vsettings)
list_2 = ValueList({"Gaussian": 0, "Laplacian": 1, "Mean": 2, "Median": 3}, selected="Mean")
vsmooth = SmoothVolume(Volume=vcurve, Width=1, Type=list_2, Iterations=Slider(1, range=1..10))
# isomeshing
mvolume = VolumeToMesh(Volume=vsmooth, VolumeSettings=vsettings)
meshpreview = MeshPreview(Mesh=mvolume)
preview = CustomPreview(Geometry=mvolume, Material=ColourSwatch(SwatchColor=RGB(255, 255, 255)))

dir_type = ValueList({"desktop": 0, "documents": 1, "GH file path": 2, "C:": 3}, selected="GH file path")
f_pathg = PathGenerator(type=dir_type)  # -> dir; inputs type: Int32, subDir: String
# ---------- f_pathg: C# ----------
                           /*
    froGH - a sparse collection of (in)utilities for Grasshopper

    Path Generator
    code by Alessio Erioli - value list generation based on code by James Ramsden

    froGH by Co-de-iT is licensed under a Creative Commons Attribution 4.0 International License.
    http://creativecommons.org/licenses/by/4.0/

    */
    initComp();


    String S = "";
    String root = "";
    String end = "\\";
    String eol = Environment.NewLine;

    // __________________ autoList part __________________

    // variable for the list
    Grasshopper.Kernel.Special.GH_ValueList vList;
    // tries to cast input as list
    try{

      // if the list is not the first parameter then change Input[0] to the corresponding value
      vList = (Grasshopper.Kernel.Special.GH_ValueList) Component.Params.Input[0].Sources[0];
      // Print("value list connected");
      // check if the list must be created
      //if (vList.NickName != "dir type"){
      if (!vList.NickName.Equals("dir type")){
        vList.ClearData();
        vList.ListItems.Clear();
        vList.NickName = "dir type";
        var item1 = new Grasshopper.Kernel.Special.GH_ValueListItem("desktop", "0");
        var item2 = new Grasshopper.Kernel.Special.GH_ValueListItem("documents", "1");
        var item3 = new Grasshopper.Kernel.Special.GH_ValueListItem("GH file path", "2");
        var item4 = new Grasshopper.Kernel.Special.GH_ValueListItem("C:", "3");
        vList.ListItems.Add(item1);
        vList.ListItems.Add(item2);
        vList.ListItems.Add(item3);
        vList.ListItems.Add(item4);

        vList.ListItems[0].Value.CastTo(out type);
      }
    }
    catch{
      // handles anything that is not a value list
    }


    switch(type){
      case 0:
        root = Environment.GetFolderPath(Environment.SpecialFolder.Desktop) + end;
        S = "Desktop";
        break;
      case 1:
        root = Environment.GetFolderPath(Environment.SpecialFolder.MyDocuments) + end;
        S = "Documents";
        break;
      case 2:
        GH_Document ghDoc = owner.OnPingDocument();

        if (ghDoc.IsFilePathDefined)
        {
          int nameLen = ghDoc.DisplayName.TrimEnd('*').Length + 3; // +3 accounts for the '.gh' extension
          int fileLen = ghDoc.FilePath.TrimEnd('*').Length;

          //F = ghDoc.DisplayName.TrimEnd('*');
          root = ghDoc.FilePath.Substring(0, fileLen - nameLen);
          //root = gh_d.FilePath;
          S = "GH File path";
        }
        else
        {
          Print("No path defined. Saving to Desktop until then");
          root = Environment.GetFolderPath(Environment.SpecialFolder.Desktop);
          S = "Desktop";
        }
        break;
      case 3:
        root = "C:" + end;
        S = root + end;
        break;
    }
    dir = root + (subDir != null ? (subDir + end) : "");
    Component.Message = S;
# ---------- f_pathg: C# additional code ----------
  void initComp(){
    Component.Name = "Path Generator";
    Component.NickName = "f_PathG";
    Component.Description = "generates a path based on local direcories such as Desktop, Documents, GH file path";
    Component.Params.Input[0].Name = "dir type";
    Component.Params.Input[0].Description = "directory type: 0 desktop, 1 documents, 2 GH file path, 3 C:\nconnect a value list for automatic list generation";
    Component.Params.Input[1].Name = "custom subdir";
    Component.Params.Input[1].Description = "(optional) custom subdirectory";
  }
# ---------- end f_pathg ----------
cs_file_to_save = Panel("Volume_complete.vdb")
cs_file_to_read = Panel("Volume01.vdb")
# read/write .vdb files
concat = Concatenate(FragmentA=f_pathg, FragmentB=cs_file_to_save)
concat_2 = Concatenate(FragmentA=f_pathg, FragmentB=cs_file_to_read)
write = Button()
read = Button()
vread = ReadVolume(FilePath=concat_2, Read=read)  # disabled
vwrite = WriteVolume(Volume=vcurve, FilePath=concat, Write=write)

bbox = BoundingBox(Content=filter_2, Plane=PlaneXY(0, 0, 0), UnionBox=True)  # -> Box, Box_2
boxprop = BoxProperties(Box=bbox.Box)  # -> Center, Diagonal, Area, Volume, Degeneracy
one_over_x = OneOverX(Value=number_slider)
c_script_2 = CSharpScript(D=boxprop.Diagonal, s=one_over_x)  # -> out, A; inputs D: Vector3d, s: Double
# ---------- c_script_2: C# ----------
    int x,y,z,t;

    x = (int) Math.Floor(D.X * s);
    y = (int) Math.Floor(D.Y * s);
    z = (int) Math.Floor(D.Z * s);
    t = x * y * z;

    A = String.Format("{0:0,0} Cells\n\n X: {1}\n Y: {2}\n Z: {3}", t, x, y, z);
# ---------- end c_script_2 ----------
# statistics
stats = Panel(c_script_2.A)
