# Grasshopper definition XX_stigmergy advanced - code.gh (Grasshopper 1.0.7)
# Copyright: Co-de-iT
# plug-ins: FileToScript, Weaverbird, Noise 4D

# ---- group: TRI-MESH
mesh = Mesh(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)

# ---- group: QUAD-MESH
mesh_2 = Mesh(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)

# ----
mirror = Mirror(Geometry=mesh, Plane=PlaneYZ(0, 0, 0))  # -> Geometry, Transform
number_slider = Slider(1, range=0..2)
wbjoin = WeaverbirdsJoinMeshesAndWeld(Mesh=[mirror.Geometry, mesh], Weld=False)
wbcatmullclark = WeaverbirdsCatmullClarkSubdivision(MeshCurves=wbjoin, Level=Slider(3, range=1..3), SmoothNakedEdges=Slider(2, range=0..2))
wbcatmullclark_2 = WeaverbirdsCatmullClarkSubdivision(MeshCurves=mesh_2, Level=Slider(3, range=1..3), SmoothNakedEdges=number_slider)
wbloop = WeaverbirdsLoopSubdivision(MeshCurves=wbcatmullclark, Level=Slider(3, range=1..3), SmoothNakedEdges=Slider(2, range=0..2))
wbcatmullclark_3 = WeaverbirdsCatmullClarkSubdivision(MeshCurves=wbcatmullclark_2, Level=Slider(2, range=1..3), SmoothNakedEdges=number_slider)
list = ValueList({"TriMesh": 0, "QuadMesh": 1}, selected="QuadMesh")
# <title>
# 
# <description>
# 
# code by Alessio Erioli
# 
# v 0.1
demesh = DeconstructMesh(Mesh=wbcatmullclark)  # -> Vertices, Faces, Colours, Normals
filter = StreamFilter(Gate=list, Stream0=wbloop, Stream1=wbcatmullclark_3)

X = UnitX(Factor=1)
Z = UnitZ(Factor=1)
Y = UnitY(Factor=1)

number_slider_2 = Slider(0, range=0..10)
number_slider_3 = Slider(0.03, range=0..1)
demesh_2 = DeconstructMesh(Mesh=filter)  # -> Vertices, Faces, Colours, Normals
expression = Expression(V=demesh_2.Vertices, Expression="{-V.X, V.Y, V.Z}")
perlin = PerlinNoise(Values=demesh.Vertices, Time=number_slider_2, Scale=number_slider_3)
pdecon = Deconstruct(Point=demesh_2.Vertices)  # -> XComponent, YComponent, ZComponent
gradient = Gradient(LowerLimit="-1", UpperLimit=1, Parameter=perlin, stops=[0: RGB(0, 0, 0), 1: RGB(255, 255, 255)])
filter_2 = StreamFilter(Gate=list, Stream0=X, Stream1=Z)
perlin_2 = PerlinNoise(Values=demesh_2.Vertices, Time=number_slider_2, Scale=number_slider_3)
perlin_3 = PerlinNoise(Values=expression, Time=number_slider_2, Scale=number_slider_3)
abs = Absolute(Value=pdecon.XComponent)

# ---- group: division by zero??? WHY????!?
expression_2 = Expression(V=pdecon.XComponent, a=abs, Expression="if(a<0.1,0.0,(V/a))")  # disabled

# ----
merge = Merge(Data1=graft(perlin_2), Data2=graft(perlin_3))
c_script = CSharpScript(x=pdecon.XComponent, y=abs)  # -> out, A; inputs x: Double, y: Double
# ---------- c_script: C# ----------
    A = y < 0.01 ? 0 : (x / y);
# ---------- end c_script ----------
pi = Pi(Factor=Slider(7, range=0..30))
avr = Average(Input=merge)  # -> flatten(ArithmeticMean)
conmesh = ConstructMesh(Vertices=demesh.Vertices, Faces=demesh.Faces, Colours=gradient)
multiplication = Multiplication(A=pi, B=c_script.A)
filter_3 = StreamFilter(Gate=list, Stream0=avr, Stream1=perlin_2)
filter_4 = StreamFilter(Gate=list, Stream0=multiplication, Stream1=pi)

# ---- group: sampling points
lng = ListLength(List=demesh_2.Vertices)
random = Random(Range=lng, Number=Slider(1000, range=0..3000), Seed=2, Integers=True)
item = ListItem(List=demesh_2.Vertices, Index=random, Wrap=True)
cullpt = CullDuplicates(Points=item, Tolerance=0.1, CullMode=1)  # -> Points, Indices, Valence
mirror_2 = Mirror(Geometry=cullpt.Points, Plane=PlaneYZ(0, 0, 0))  # -> Geometry, Transform
merge_2 = Merge(Data1=cullpt.Points, Data2=mirror_2.Geometry)  # -> flatten(Result)
filter_5 = StreamFilter(Gate=list, Stream0=merge_2, Stream1=cullpt.Points)

# ----
gradient_2 = Gradient(LowerLimit="-1", UpperLimit=1, Parameter=filter_3, stops=[0: RGB(0, 0, 0), 1: RGB(255, 255, 255)])
xprod = CrossProduct(VectorA=demesh_2.Normals, VectorB=filter_2, Unitize=False)  # -> Vector, Length
multiplication_2 = Multiplication(A=filter_3, B=filter_4)
vrot = Rotate(Vector=xprod.Vector, Axis=demesh_2.Normals, Angle=multiplication_2)
conmesh_2 = ConstructMesh(Vertices=demesh_2.Vertices, Faces=demesh_2.Faces, Colours=gradient_2)
vdisex = VectorDisplayEx(Point=demesh_2.Vertices, Vector=vrot, Colour=RGB(0, 0, 0), Width=2)
medges = MeshEdges(Mesh=conmesh_2)  # -> NakedEdges, InteriorEdges, NonManifoldEdges; disabled
dir_type = ValueList({"desktop": 0, "documents": 1, "GH file path": 2, "C:": 3}, selected="GH file path")
swatch = ColourSwatch(SwatchColor=RGB(54, 54, 54))  # disabled
number_slider_4 = Slider(0.915, range=0..1)
number_slider_5 = Slider(12, range=0..20)
seek_intensity = Slider(0.8, range=0..1)
preview = CustomPreview(Geometry=[medges.NakedEdges, medges.InteriorEdges], Material=swatch)  # disabled
number_slider_6 = Slider(2.5, range=1..5)
f_pathg = PathGenerator(type=dir_type, subDir="Stigmergy\Stigmergy")  # -> dir; inputs type: Int32, subDir: String
# ---------- f_pathg: C# ----------
                           /*
    froGH - a sparse collection of (in)utilities for Grasshopper

    Path Generator
    code by Alessio Erioli - value list generation based on code by James Ramsden

    froGH by Co-de-iT is licensed under a Creative Commons Attribution 4.0 International License.
    http://creativecommons.org/licenses/by/4.0/

    */
    initComp();


    String S = "";
    String root = "";
    String end = "\\";
    String eol = Environment.NewLine;

    // __________________ autoList part __________________

    // variable for the list
    Grasshopper.Kernel.Special.GH_ValueList vList;
    // tries to cast input as list
    try{

      // if the list is not the first parameter then change Input[0] to the corresponding value
      vList = (Grasshopper.Kernel.Special.GH_ValueList) Component.Params.Input[0].Sources[0];
      // Print("value list connected");
      // check if the list must be created
      //if (vList.NickName != "dir type"){
      if (!vList.NickName.Equals("dir type")){
        vList.ClearData();
        vList.ListItems.Clear();
        vList.NickName = "dir type";
        var item1 = new Grasshopper.Kernel.Special.GH_ValueListItem("desktop", "0");
        var item2 = new Grasshopper.Kernel.Special.GH_ValueListItem("documents", "1");
        var item3 = new Grasshopper.Kernel.Special.GH_ValueListItem("GH file path", "2");
        var item4 = new Grasshopper.Kernel.Special.GH_ValueListItem("C:", "3");
        vList.ListItems.Add(item1);
        vList.ListItems.Add(item2);
        vList.ListItems.Add(item3);
        vList.ListItems.Add(item4);

        vList.ListItems[0].Value.CastTo(out type);
      }
    }
    catch{
      // handles anything that is not a value list
    }


    switch(type){
      case 0:
        root = Environment.GetFolderPath(Environment.SpecialFolder.Desktop) + end;
        S = "Desktop";
        break;
      case 1:
        root = Environment.GetFolderPath(Environment.SpecialFolder.MyDocuments) + end;
        S = "Documents";
        break;
      case 2:
        GH_Document ghDoc = owner.OnPingDocument();

        if (ghDoc.IsFilePathDefined)
        {
          int nameLen = ghDoc.DisplayName.TrimEnd('*').Length + 3; // +3 accounts for the '.gh' extension
          int fileLen = ghDoc.FilePath.TrimEnd('*').Length;

          //F = ghDoc.DisplayName.TrimEnd('*');
          root = ghDoc.FilePath.Substring(0, fileLen - nameLen);
          //root = gh_d.FilePath;
          S = "GH File path";
        }
        else
        {
          Print("No path defined. Saving to Desktop until then");
          root = Environment.GetFolderPath(Environment.SpecialFolder.Desktop);
          S = "Desktop";
        }
        break;
      case 3:
        root = "C:" + end;
        S = root + end;
        break;
    }
    dir = root + (subDir != null ? (subDir + end) : "");
    Component.Message = S;
# ---------- f_pathg: C# additional code ----------
  void initComp(){
    Component.Name = "Path Generator";
    Component.NickName = "f_PathG";
    Component.Description = "generates a path based on local direcories such as Desktop, Documents, GH file path";
    Component.Params.Input[0].Name = "dir type";
    Component.Params.Input[0].Description = "directory type: 0 desktop, 1 documents, 2 GH file path, 3 C:\nconnect a value list for automatic list generation";
    Component.Params.Input[1].Name = "custom subdir";
    Component.Params.Input[1].Description = "(optional) custom subdirectory";
  }
# ---------- end f_pathg ----------

# ---- group: TOO SLOW!!
pt = Point(Point(111.5103891, 48.10756142, 25.76258051))  # disabled
c_script_2 = CSharpScript(M=conmesh_2, P=pt)  # -> out, outPt; inputs M: Mesh, P: Point3d; disabled
# ---------- c_script_2: C# ----------
    IEnumerable<int[]> index;
    int[] VertexNumbers;

    index = RTree.Point3dClosestPoints(M.Vertices.ToPoint3dArray(), new List<Point3d>{P}, 500);
    IEnumerator en = index.GetEnumerator();
    en.MoveNext();
    VertexNumbers = (int[]) en.Current;

    outPt = M.Vertices[VertexNumbers[0]];
# ---------- end c_script_2 ----------

# ----
go = BooleanToggle(False)
reset = Button()
concat = Concatenate(FragmentA=f_pathg, FragmentB="stigmergy_basic.cs")
c_script_3 = CSharpScript(reset=reset, go=go, M=conmesh_2, P=filter_5, sR=number_slider_6, sI=seek_intensity)  # -> out, points, vectors, tr, cols, neigh, neighCol, outMCol; inputs reset: Boolean, go: Boolean, M: Mesh, P: list of Point3d, Vf: list of Vector3d, sR: Double, sI: Double
# ---------- c_script_3: C# usings ----------
using System.Drawing;
using System.Threading;
using System.Threading.Tasks;
using System.Collections.Concurrent;
# ---------- c_script_3: C# ----------
 
        // ............................................................................

        // return on null input
        if (M == null || P == null) return;

        // initialize on reset
        if (reset || PS == null)
        {
            PS = new ParticleSystem(P, M);
            scalarField = PopulateScalarField(M);
            vectorField = Vf.ToArray();
            MeshPoints = PopulatePointCloud(M);
            debug = "";
        }

        if (go)
        {
            PS.seekRadius = sR;
            PS.seekIntensity = sI;
            PS.futPosMult = 3.0f;
            PS.UpdateRTree(M);
            Component.ExpireSolution(true);
            //EvaporateMesh(M, 0.65);
            EvaporateField(scalarField, 0.98);
        }

        // extract geometries

        PS.GetPointsVectors(out pts, out vecs);

        // Print(debug);
        
        debug = "";
        points = pts;
        vectors = vecs;
        neigh = PS.GetNeighPts();
        neighCol = PS.GetNeighBrightness();
        //if (!go)
            outMCol = GetScalarField(scalarField);
        //tr = PS.GetTrails();
        /* see this line above and the one after this commentary?
         
         This made me bleed:
         
         trails are Polylines, but I initialize them with a single point (so that's not a Polyline... yet)
         This causes a 'reference not set to an instance' exception (when something is declared but not instanced)
         the problem is that everything below this line does not compile anymore BUT THE SCRIPT EXECUTES
         so I coudn't understand why neighPts contained data but nothig was outputting.... GROAN!!!

        */
        //neigh = neighPts;


        // ............................................................................
# ---------- c_script_3: C# additional code ----------
 
    // ............................................................................Global Variables
    public ParticleSystem PS;
    public GH_Point[] pts;
    public GH_Vector[] vecs;
    public Polyline[] trails;
    public static Vector3d[] vectorField;
    public static float[] scalarField;
    public static PointCloud MeshPoints;

    public static string debug;

    // ............................................................................Classes

    // .......................................................... Particle System ........

    public class ParticleSystem
    {
        // . . . . . . . . . . . . . . . . . . . . . . fields
        public List<Particle> Particles;
        public RTree MeshRTree;
        public double seekRadius;
        public double seekIntensity;
        public double futPosMult;

        // . . . . . . . . . . . . . . . . . . . . . . constructor
        public ParticleSystem(List<Point3d> positions, Mesh M)
        {
            Particles = new List<Particle>();

            for (int i = 0; i < positions.Count; i++)
                Particles.Add(new Particle(positions[i], RandomVector(i) * 1.5));

            MeshRTree = PopulateMeshRTree(M);
        }

        // . . . . . . . . . . . . . . . . . . . . . . methods

        public void Update(Mesh M)
        {

            foreach (Particle p in Particles)
                p.SeekMeshClosestPt(M, seekIntensity);
            foreach (Particle p in Particles)
                p.Update();

        }

        public void UpdateParallel(Mesh M)
        {

            var x = Partitioner.Create(0, Particles.Count);

            Parallel.ForEach(x, (range, loopstate) =>
            {
                for (int i = range.Item1; i < range.Item2; i++)
                {
                    Particles[i].SeekMeshClosestPt(M, seekIntensity);
                    Particles[i].Update();
                }
            });

        }

        public void UpdateParallelSimple(Mesh M)
        {
            Parallel.ForEach(Particles, p =>
            {
                //foreach (Particle p in Particles)
                p.SeekMeshClosestPt(M, seekIntensity);
                p.Update();
            });
            //foreach (Particle p in Particles)
            //    p.Update();

        }

        public void UpdateRTree(Mesh M)
        {
            //IEnumerable<int[]> index;
            //int[] VertexNumbers;
            //int vN;
            foreach (Particle p in Particles)
            {
                // clear particle neighbours list
                p.neighbours.Clear();
                p.neighFieldPts.Clear();

                // Eventhandler function for RTree search
                EventHandler<RTreeEventArgs> rTreeCallback = (object sender, RTreeEventArgs args) =>
                {
                    p.neighbours.Add(M.Vertices[args.Id]);
                    p.neighFieldPts.Add(new FieldPt(args.Id, scalarField[args.Id]));
                };

                MeshRTree.Search(new Sphere(M.ClosestPoint(p.pos + p.vel * futPosMult), seekRadius), rTreeCallback);

                // p.SeekNeighbours(seekIntensity);
                p.SeekColor(seekIntensity);

                //// query RTree of Mesh vertices for closest point to p.pos (returns an IEnumerable)
                //index = RTree.Point3dClosestPoints(M.Vertices.ToPoint3dArray(), new List<Point3d>{ p.pos}, 200);
                //// get enumerator
                //IEnumerator en = index.GetEnumerator();
                //// get first array of indices
                //en.MoveNext();
                //VertexNumbers = (int[]) en.Current;
                //vN = VertexNumbers[0];


                //// update scalar field
                scalarField[MeshPoints.ClosestPoint(p.pos)] += p.PheroStrength;

                
            }

            foreach (Particle p in Particles)
            {
                

            }

            if (Particles.Count > 500)
            {
                Parallel.ForEach(Particles, p =>
               {
                   
                   p.Update();
               });
            }
            else
                foreach (Particle p in Particles)
                    p.Update();

        }

        public void GetPointsVectors(out GH_Point[] pts, out GH_Vector[] vecs)
        {
            pts = new GH_Point[Particles.Count];
            vecs = new GH_Vector[Particles.Count];

            for (int i = 0; i < Particles.Count; i++)
            {
                pts[i] = new GH_Point(Particles[i].pos);
                vecs[i] = new GH_Vector(Particles[i].vel);
            }
        }

        public Polyline[] GetTrails()
        {
            Polyline[] trails = new Polyline[Particles.Count];
            for (int i = 0; i < Particles.Count; i++)
            {
                trails[i] = Particles[i].trail;
            }
            return trails;
        }

        public DataTree<GH_Point> GetNeighPts()
        {
            DataTree<GH_Point> ptsOut = new DataTree<GH_Point>();

            for (int i = 0; i < Particles.Count; i++)
                ptsOut.EnsurePath(new GH_Path(i));

            // parallelize for more than 500 particles
            if (Particles.Count > 500)
            {

                var x = Partitioner.Create(0, Particles.Count);

                Parallel.ForEach(x, (range, loopstate) =>
                {
                    for (int i = range.Item1; i < range.Item2; i++)
                    {
                        for (int j = 0; j < Particles[i].neighbours.Count; j++)
                            ptsOut.Add(new GH_Point(Particles[i].neighbours[j]), new GH_Path(i));
                    }
                });
            }
            else
            {
                for (int i = 0; i < Particles.Count; i++)
                {
                    for (int j = 0; j < Particles[i].neighbours.Count; j++)
                        ptsOut.Add(new GH_Point(Particles[i].neighbours[j]), new GH_Path(i));
                }
            }

            return ptsOut;
        }

        public DataTree<GH_Vector> GetNeighVectors()
        {

            DataTree<GH_Vector> vecOut = new DataTree<GH_Vector>();

            for (int i = 0; i < Particles.Count; i++)
                vecOut.EnsurePath(new GH_Path(i));

            for (int i = 0; i < Particles.Count; i++)
            {
                for (int j = 0; j < Particles[i].neighFieldPts.Count; j++)
                    vecOut.Add(new GH_Vector(Particles[i].neighFieldPts[j].v), new GH_Path(i));
            }

            return vecOut;
        }

        public DataTree<GH_Number> GetNeighBrightness()
        {

            DataTree<GH_Number> briOut = new DataTree<GH_Number>();

            for (int i = 0; i < Particles.Count; i++)
                briOut.EnsurePath(new GH_Path(i));

            for (int i = 0; i < Particles.Count; i++)
            {
                for (int j = 0; j < Particles[i].neighFieldPts.Count; j++)
                    briOut.Add(new GH_Number(Particles[i].neighFieldPts[j].bri), new GH_Path(i));
            }

            return briOut;
        }
    }

    // .......................................................... Particle ...............
    public class Particle
    {
        public Point3d pos;
        public Vector3d vel;
        public Vector3d acc;
        public double MaxSpeed;
        public float PheroStrength;
        public Polyline trail;
        public List<Point3d> neighbours;
        public List<FieldPt> neighFieldPts;

        public Particle(Point3d pos, Vector3d vel)
        {
            this.pos = pos;
            this.vel = vel;
            acc = Vector3d.Zero;
            MaxSpeed = 1.5f;
            PheroStrength = 0.1f;
            trail = new Polyline { this.pos };
            neighbours = new List<Point3d>();
            neighFieldPts = new List<FieldPt>();
        }

        public void Update()
        {
            Move();
            //trail.Add(pos);
        }

        public void SeekNeighbours(double seekIntensity)
        {
            acc = vel;

            if (neighbours.Count > 0)
            {
                acc = Vector3d.Zero;
                Vector3d desired = Vector3d.Zero;

                foreach (Point3d n in neighbours)
                {
                    desired += n - pos;
                }

                desired /= neighFieldPts.Count;
                desired.Unitize();
                desired *= MaxSpeed;

                acc = (desired - vel) * seekIntensity;
            }
        }

        public void SeekColor(double seekIntensity)
        {
            acc = vel;

            if (neighFieldPts.Count > 0)
            {
                acc = Vector3d.Zero;
                Vector3d desired = Vector3d.Zero;
                double bri;
                double MaxBri = -1.0;
                int MaxInd = -1;

                for (int i = 0; i < neighFieldPts.Count; i++)
                {
                    bri = neighFieldPts[i].bri; // brightness is 0-1 and RGB 0-255
                    if (bri > MaxBri)
                    {
                        MaxBri = bri;
                        MaxInd = i;
                    }


                }
                desired += neighbours[MaxInd] - pos;

                desired /= neighFieldPts.Count;
                desired.Unitize();
                desired *= MaxSpeed;

                acc = (desired - vel) * seekIntensity;
            }
        }

        public void SeekMeshClosestPt(Mesh M, double seekIntensity)
        {
            acc = Vector3d.Zero;
            MeshPoint mP = M.ClosestMeshPoint(pos + vel * 1.5, 100);
            if (mP != null)
            {
                Point3d mCP = mP.Point;

                Vector3d desired = mCP - pos;
                desired.Unitize();
                desired *= MaxSpeed;

                acc = (desired - vel) * seekIntensity;
            }

        }

        public void Move()
        {
            //vel = vel * 0.9 + acc * 0.1;
            vel = vel + acc;
            if (vel.Length > MaxSpeed)
            {
                vel.Unitize();
                vel *= MaxSpeed;
            }
            if (vel.Length < 1)
            {
                vel.Unitize();
            }
            pos += vel;
        }


    }

    public class FieldPt
    {
        public int id;
        public float bri;
        public Vector3d v;

        public FieldPt(int id, float bri, Vector3d v)
        {
            this.id = id;
            this.bri = bri;
            this.v = v;
        }

        public FieldPt(int id, float bri) : this(id, bri, Vector3d.Zero) { }

    }

    // ............................................................................Utilities

    public GH_Number[] GetScalarField(float[] scalarField)
    {
        GH_Number[] outField = new GH_Number[scalarField.Length];

        Parallel.For(0, scalarField.Length, i => 
        {
            outField[i] = new GH_Number(scalarField[i]);
        });

        return outField;
    }

    public static void EvaporateMesh(Mesh M, double evapoRatio)
    {
        if (M.VertexColors.Count == 0) return;


        var x = Partitioner.Create(0, M.VertexColors.Count);

        Parallel.ForEach(x, (range, loopstate) =>
        {
            double b;
            int c;
            for (int i = range.Item1; i < range.Item2; i++)
            {
                b = M.VertexColors[i].R;
                b *= evapoRatio;
                c = (int)b;
                M.VertexColors[i] = Color.FromArgb(c, c, c);
            }
        });

    }

    public static void EvaporateField(float[] scalarField, double evapoRatio)
    {
        float evap = (float)evapoRatio;
        var x = Partitioner.Create(0, scalarField.Length);

        Parallel.For(0, scalarField.Length, i =>
        {
                scalarField[i] *=  evap;
        });
    }

    public float[] PopulateScalarField(Mesh M)
    {
        float[] scalarField = new float[M.Vertices.Count];

        if (M.VertexColors.Count != 0)
        {

            var x = Partitioner.Create(0, M.VertexColors.Count);

            Parallel.ForEach(x, (range, loopstate) =>
            {
                for (int i = range.Item1; i < range.Item2; i++)
                {
                    scalarField[i] = M.VertexColors[i].GetBrightness();

                }
            });
        }
        return scalarField;
    }

    public static RTree PopulateMeshRTree(Mesh M)
    {
        RTree rt = new RTree();

        for (int i = 0; i < M.Vertices.Count; i++)
        {
            rt.Insert((Point3d)M.Vertices[i], i);
        }

        return rt;
    }

    public PointCloud PopulatePointCloud(Mesh M)
    {
        PointCloud mP = new PointCloud();

        for(int i=0; i< M.Vertices.Count;  i++)
        {
            mP.Add(M.Vertices[i], M.Normals[i]);
        }

        return mP;
    }

    public static Vector3d RandomVector(int seed)
    {
        Vector3d r = Vector3d.Zero;
        Random rnd = new Random(seed);
        r = new Vector3d((rnd.NextDouble() * 2) - 1, (rnd.NextDouble() * 2) - 1, (rnd.NextDouble() * 2) - 1);
        return r;
    }
# ---------- end c_script_3 ----------
path = FilePath(concat)
ftsv2 = FileToScriptV2(File=path)
cir = Circle(Plane=c_script_3.points, Radius=number_slider_6)  # disabled
c_script_4 = CSharpScript(C=ColourSwatch(SwatchColor=RGB(153, 81, 81)))  # -> out, R, Br; inputs C: Color; disabled
# ---------- c_script_4: C# usings ----------
using System.Drawing;
# ---------- c_script_4: C# ----------
    R = C.R;
    Br = C.GetBrightness();
# ---------- end c_script_4 ----------
amp = Amplitude(Vector=c_script_3.vectors, Amplitude=Slider(4, range=1..10))

# ---- group: PointCloud
pt_2 = Point(Point(111.5103891, 48.10756142, 25.76258051))  # disabled
c_script_5 = CSharpScript(M=conmesh_2, P=pt_2)  # -> out, outPt; inputs M: Mesh, P: Point3d; disabled
# ---------- c_script_5: C# ----------
    mP = new PointCloud();
    for(int i = 0; i < M.Vertices.Count;  i++)
    {
      mP.Add(M.Vertices[i], M.Normals[i]);
    }

    outPt = mP.ClosestPoint(P);
# ---------- c_script_5: C# additional code ----------
  PointCloud mP;
# ---------- end c_script_5 ----------

# ----
panel = Panel(c_script_3.out)
panel_2 = Panel(c_script_4.R)
panel_3 = Panel(c_script_4.Br)
frgb = ColourRGBF(Alpha=1, Red=c_script_3.neighCol, Green=c_script_3.neighCol, Blue=c_script_3.neighCol)  # disabled
frgb_2 = ColourRGBF(Alpha=1, Red=c_script_3.outMCol, Green=c_script_3.outMCol, Blue=0)
vdisex_2 = VectorDisplayEx(Point=c_script_3.points, Vector=c_script_3.vectors, Colour=ColourSwatch(SwatchColor=RGB(0, 242, 255)), Width="1")
crv = Curve(c_script_3.tr)
preview_2 = CustomPreview(Geometry=c_script_3.neigh, Material=frgb)  # disabled
c_script_6 = CSharpScript(M=conmesh_2, evap=Slider(0.915, range=0..1))  # -> out, outCol; inputs M: Mesh, evap: Double
# ---------- c_script_6: C# ----------
    M1 = M;
    cols = populateCols(M1);
    EvaporateMesh(cols, evap);
    outCol = cols;
# ---------- c_script_6: C# additional code ----------
  public Mesh M1;
  public Color[] cols;

  public Color[] populateCols(Mesh M1)
  {
    Color[] cols = new Color[M1.VertexColors.Count];

    var x = Partitioner.Create(0, M1.VertexColors.Count);

    Parallel.ForEach(x, (range, loopstate) =>
      {
      for (int i = range.Item1; i < range.Item2; i++)
      {
        cols[i] = M1.VertexColors[i];
      }
      });
    return cols;
  }


  public void EvaporateMesh(Color[] cols, double evapoRatio)
  {


    var x = Partitioner.Create(0, cols.Length);

    Parallel.ForEach(x, (range, loopstate) =>
      {
      double b;
      int c;
      for (int i = range.Item1; i < range.Item2; i++)
      {
        b = cols[i].R;
        b *= evapoRatio;
        c = (int) b;
        cols[i] = Color.FromArgb(c, c, c);
      }
      });

  }
# ---------- end c_script_6 ----------
conmesh_3 = ConstructMesh(Vertices=demesh_2.Vertices, Faces=demesh_2.Faces, Colours=frgb_2)
conmesh_4 = ConstructMesh(Vertices=demesh_2.Vertices, Faces=demesh_2.Faces, Colours=c_script_6.outCol)
