# Grasshopper definition ZZ_list operation speed comparison.gh (Grasshopper 1.0.7)
# Copyright: Co-de-iT

series = Series(Start=0, Step=1, Count="100000")
int = Integer("5")
int_2 = Integer("2")
int_3 = Integer("3")
c_script = CSharpScript(x=series, y=int, z=int_2, u=int_3)  # -> out, A; inputs x: Double, y: Double, z: Double, u: Double; disabled
# ---------- c_script: C# ----------
    A = (x + y - z) / u;
# ---------- end c_script ----------
# list access - lambda expression
# List<double> newX = new List<double>();
#     x.ForEach(xx => {newX.Add((xx + y - z) / u);});
# A = newX;
c_script_2 = CSharpScript(x=series, y=int, z=int_2, u=int_3)  # -> out, A; inputs x: list of Double, y: Double, z: Double, u: Double
# ---------- c_script_2: C# ----------
    List<double> newX = new List<double>();
    x.ForEach(xx => {newX.Add( (xx + y - z) / u);});
    A = newX;
# ---------- end c_script_2 ----------
expression = Expression(x=series, y=int, z=int_2, u=int_3, Expression="(x+y-z)/u")  # disabled
# list access - functional
# using System.Linq;
# 
# 
#     A = x.Select(xx => (xx + y - z) / u);
c_script_3 = CSharpScript(x=series, y=int, z=int_2, u=int_3)  # -> out, A; inputs x: list of Double, y: Double, z: Double, u: Double
# ---------- c_script_3: C# usings ----------
using System.Linq;
# ---------- c_script_3: C# ----------
    A = x.Select(xx => (xx + y - z) / u);
# ---------- end c_script_3 ----------
c_script_4 = CSharpScript(x=series, y=int, z=int_2, u=int_3)  # -> out, A; inputs x: list of Double, y: Double, z: Double, u: Double
# ---------- c_script_4: C# ----------
    double[] newX = new double[x.Count];
    for(int i = 0; i < x.Count; i++)
      newX[i] = (x[i] + y - z) / u;
    A = newX;
# ---------- end c_script_4 ----------
# list access - parallel 1
# using System.Threading;
# using System.Threading.Tasks;
# 
#     double[] newX = new double[x.Count];
# 
#     Parallel.For(0, x.Count, i =>
#       {
#         newX[i] = (x[i] + y - z) / u;
#       });
#     A = newX;
c_script_5 = CSharpScript(x=series, y=int, z=int_2, u=int_3)  # -> out, A; inputs x: list of Double, y: Double, z: Double, u: Double
# ---------- c_script_5: C# usings ----------
using System.Threading;
using System.Threading.Tasks;
# ---------- c_script_5: C# ----------
    double[] newX = new double[x.Count];
    
    Parallel.For(0, x.Count, i =>
      {
        newX[i] = (x[i] + y - z) / u;
      });
    A = newX;
# ---------- end c_script_5 ----------
# list access - parallel 2
# using System.Threading;
# using System.Threading.Tasks;
# using System.Collections.Concurrent;
# 
#     double[] newX = new double[x.Count];
#     var p = Partitioner.Create(0, x.Count);
#     Parallel.ForEach(p, (range, loopState) =>
#       {
#       for(int i = range.Item1; i < range.Item2; i++)
#         newX[i] = (x[i] + y - z) / u;
#       });
#     A = newX;
c_script_6 = CSharpScript(x=series, y=int, z=int_2, u=int_3)  # -> out, A; inputs x: list of Double, y: Double, z: Double, u: Double
# ---------- c_script_6: C# usings ----------
using System.Threading;
using System.Threading.Tasks;
using System.Collections.Concurrent;
# ---------- c_script_6: C# ----------
    double[] newX = new double[x.Count];
    var p = Partitioner.Create(0, x.Count);
    Parallel.ForEach(p, (range, loopState) =>
      {
      for(int i = range.Item1; i < range.Item2; i++)
        newX[i] = (x[i] + y - z) / u;
      });
    A = newX;
# ---------- end c_script_6 ----------
# straight from panel
expression_2 = Expression(x=series, y="5", z="2", u="3", Expression="(x+y-z)/u")  # disabled
# list access functional
# a= map(lambda xx: (xx + y - z)/u,x)
python = GhPythonScript(x=series, y=int, z=int_2, u=int_3)  # -> out, a; inputs x: list
# ---------- python: Python ----------
__author__ = "Alessio"
__version__ = "2019.01.21"

import rhinoscriptsyntax as rs

a= map(lambda xx: (xx + y - z)/u,x)
# ---------- end python ----------
panel = Panel("""<title>

<description>

code by <author>

v <version>""")
# converted to int
# item access
# list access
# double[] newX = new double[x.Count];
#     for(int i = 0; i < x.Count; i++)
#       newX[i] = (x[i] + y - z) / u;
#     A = newX;
panel_2 = Panel("   A = (x + y - z) / u;")
